# Dynamo custom node [&] PolyCurve.ByCurves.dyf (Dynamo 2.10.1.3976)
# category: Ampersand.[&] Curve
# Create polycurves from an unordered list of curves.

# note: Colin McCrone
# Twitter:  @ColinMcCrone
# LinkedIn: https://www.linkedin.com/in/colinmccrone
# Updated:  2021-05-26
# An example Dynamo script for how to use this node can be found in the 'extra' folder where the package files are stored. To find it, go to the Packages Menu and select "Manage Packages." Where Ampersand is listed, open the drop-down menu link at the right and choose "Show Root Directory." Open the "extra" folder to find the example file called AmpersandExamples.dyn.
curves = Input(curves: Autodesk.DesignScript.Geometry.Curve[])
# note: Assigns curves to groups with unique (arbirary) numbers.
python_script = Python(IN[0]=curves)  # CPython3
# ---------- python_script.python (71 lines) ----------
# Assign curves to groups according to whether they are connected via
# shared start points and end points.  Group numbers are not important.
#
# Colin McCrone
# Twitter:  https://twitter.com/colinmccrone
# LinkedIn: https://www.linkedin.com/in/colinmccrone
# Updated:  2015-09-28
#
import clr
import math
clr.AddReference('ProtoGeometry')
from Autodesk.DesignScript.Geometry import *


# Determine whether two points are equal
def PointsEqual(pt1, pt2):
	tolerance = 0.00001
	
	if (math.fabs(pt1.X - pt2.X) < tolerance and
	    math.fabs(pt1.Y - pt2.Y) < tolerance and
	    math.fabs(pt1.Z - pt2.Z) < tolerance):
		return True
	else:
		return False


# Get input
crvs = IN[0]


# List the group to which each curve belongs
crvGroup = [-1 for x in range(len(crvs))]
crvGroup[0] = 0
maxGroupNum = 1


# Find start and end points for each curve
starts = []
ends = []
for crv in crvs:
	starts.append(Curve.PointAtParameter(crv,0))
	ends.append(crv.PointAtParameter(1))


# Find connected groups of curves
for i in range(len(crvs)):
	# Add i to its own group it not already part of a group
	if (crvGroup[i] == -1):
		crvGroup[i] = i
	
	# Find connections
	for j in range(len(crvs)):
		if (i != j and
			(PointsEqual(starts[i], starts[j]) or
			PointsEqual(starts[i], ends[j]) or
			PointsEqual(ends[i], starts[j]) or
			PointsEqual(ends[i], ends[j]))):
			
			# Add j to i group
			if (crvGroup[j] == -1):
				crvGroup[j] = crvGroup[i]
			# Add j group to i group
			elif (crvGroup[i] != crvGroup[j]):
				oldNum = crvGroup[j]
				for k in range(len(crvs)):
					if (crvGroup[k] == oldNum):
						crvGroup[k] = crvGroup[i]


# Output the (arbitrary) group numbers
OUT = crvGroup
# ----------------------------------------
groupByKey = List.GroupByKey(list=curves, keys=python_script)
byJoinedCurves = PolyCurve.ByJoinedCurves(curves=groupByKey.groups)
polyCurve = Output(byJoinedCurves)
