# Dynamo custom node [&] PolyList.VariablyOffsetTriangle.dyf "[&] PointList.VariablyOffsetTriangle" (Dynamo 2.10.1.3976)
# category: Ampersand.[&] Point
# For a triangle vertices ABC, specify the points {A, B, C}, and the offset distance in the order {AB, BC, CA}.  Use (+) for inside offset, (-) for outside offset.  Output is a new set of points {A', B', C'}.

# note: Colin McCrone
# Twitter:  @ColinMcCrone
# LinkedIn: https://www.linkedin.com/in/colinmccrone
# Updated:  2021-05-26
# An example Dynamo script for how to use this node can be found in the 'extra' folder where the package files are stored. To find it, go to the Packages Menu and select "Manage Packages." Where Ampersand is listed, open the drop-down menu link at the right and choose "Show Root Directory." Open the "extra" folder to find the example file called AmpersandExamples.dyn.
vertices = Input(vertices: Autodesk.DesignScript.Geometry.Point[])
# note: Variably-offset triangle
# For a triangle vertices ABC, specify the points {A, B, C}, and the offset distance in the order {AB, BC, CA}.  Use (+) for inside offset, (-) for outside offset.
# Output is a new set of points {A', B', C'}.
code_block = CodeBlock(vtx=vertices) { ptA = vtx[0]; }
offsets = Input(offsets: double[] = [1, 1, 1])
code_block_2 = CodeBlock(vtx=vertices) { ptB = vtx[1]; }
byTwoPoints = Vector.ByTwoPoints(start=code_block, end=code_block_2)
# note: Vector A --> B
normalized = Vector.Normalized(vector=byTwoPoints)
code_block_3 = CodeBlock(vtx=vertices) { ptC = vtx[2]; }
byTwoPoints_2 = Vector.ByTwoPoints(start=code_block, end=code_block_3)
# note: Vector A --> C
normalized_2 = Vector.Normalized(vector=byTwoPoints_2)
# note: A angle
angleWithVector = Vector.AngleWithVector(vector=normalized, otherVector=normalized_2)
byTwoPoints_3 = Vector.ByTwoPoints(start=code_block_2, end=code_block_3)
# note: Vector B --> C
normalized_3 = Vector.Normalized(vector=byTwoPoints_3)
# note: Vector B --> A
reverse = Vector.Reverse(vector=normalized)
# note: B angle
angleWithVector_2 = Vector.AngleWithVector(vector=reverse, otherVector=normalized_3)
# note: Vector C --> A
reverse_2 = Vector.Reverse(vector=normalized_2)
# note: C angle
code_block_4 = CodeBlock(A=angleWithVector, B=angleWithVector_2) { 180 - A - B; }
# note: Vector C --> B
reverse_3 = Vector.Reverse(vector=normalized_3)
code_block_5 = CodeBlock(offsets=offsets, AtoB=normalized, Aangle=angleWithVector, AtoC=normalized_2, BtoC=normalized_3, Bangle=angleWithVector_2, BtoA=reverse, CtoA=reverse_2, Cangle=code_block_4, CtoB=reverse_3)
# ---------- code_block_5.designscript (14 lines) ----------
ABoffset = offsets[0];
BCoffset = offsets[1];
CAoffset = offsets[2];

// Vector pairs from each vertex

AtoB.Scale(CAoffset / Math.Sin(Aangle));
AtoC.Scale(ABoffset / Math.Sin(Aangle));

BtoC.Scale(ABoffset / Math.Sin(Bangle));
BtoA.Scale(BCoffset / Math.Sin(Bangle));

CtoA.Scale(BCoffset / Math.Sin(Cangle));
CtoB.Scale(CAoffset / Math.Sin(Cangle));
# ----------------------------------------
add = Vector.Add(vector=code_block_5.out3, vectorToAdd=code_block_5.out4)
add_2 = Point.Add(point=code_block, vectorToAdd=add)
add_3 = Vector.Add(vector=code_block_5.out5, vectorToAdd=code_block_5.out6)
add_4 = Point.Add(point=code_block_2, vectorToAdd=add_3)
add_5 = Vector.Add(vector=code_block_5.out7, vectorToAdd=code_block_5.out8)
add_6 = Point.Add(point=code_block_3, vectorToAdd=add_5)
list_create = List.Create(item0=add_2, item1=add_4, item2=add_6)
vertices_2 = Output(list_create)  # "vertices"
