# Dynamo custom node [&] String.ByListAsDS.dyf (Dynamo 2.10.1.3976)
# category: Ampersand
# Convert a list of strings to a single string in DS format that would produce the same string

# note: Colin McCrone
# Twitter:  @ColinMcCrone
# LinkedIn: https://www.linkedin.com/in/colinmccrone
# Updated:  2021-05-26
# An example Dynamo script for how to use this node can be found in the 'extra' folder where the package files are stored. To find it, go to the Packages Menu and select "Manage Packages." Where Ampersand is listed, open the drop-down menu link at the right and choose "Show Root Directory." Open the "extra" folder to find the example file called AmpersandExamples.dyn.
list = Input(list: string[])
python_script = Python(IN[0]=list)  # CPython3
# ---------- python_script.python (25 lines) ----------
# Translate a list of strings in Dynamo to a single string formatted as if it were text in a code block to yield the same result.
#
# Colin McCrone
# Twitter:  https://twitter.com/colinmccrone
# LinkedIn: https://www.linkedin.com/in/colinmccrone
# Updated:  2019-05-20
#
import clr
clr.AddReference('ProtoGeometry')

strs = IN[0]

ds = "["

for i in range(len(strs)):
	ds = ds + "\"" + strs[i]

	if i == len(strs)-1:
		ds = ds + "\""
	else:
		ds = ds + "\",\n"

ds = ds + "];"

OUT = ds
# ----------------------------------------
string = Output(python_script)
