# Dynamo custom node Atmos.SlattedFacade.SlatGenerator.dyf (Dynamo 1.3.0.875)
# category: Atmos.Geometry.SlattedFacade
# This node will generate a randomised series of 'Slats' based on the following criteria: Slat Thickness, Offset Distance (Total depth), total Slat Amount and a Tool Amount.

srf = Input(srf : Surface)  # Input Surface.
slatThickness = Input(slatThickness : double = 50)  # Slat Thickness.
offsetDistance = Input(offsetDistance : double = 750)  # Offset Distance.
slatAmount = Input(slatAmount : int = 50)  # Amount of Slats.
toolAmount = Input(toolAmount : int = 18)  # Amount of 'Cutting Tools'.
base_operations = CodeBlock(surface01=srf, sltThickness=slatThickness, offsetDistance=offsetDistance, slatAmount=slatAmount, toolAmount=toolAmount)
# ---------- base_operations.designscript (21 lines) ----------
//Inputs
srf = surface01;
slatThickness = sltThickness;
dist = offsetDistance;
sltAmt = slatAmount;
toolAmt = toolAmount;
maxToolRadius = dist - slatThickness;
//Offset Surface
srfOff = surface01.Offset(dist);
//Base Surface and Switcher
per0 = Flatten(srf.PerimeterCurves());
side1 = {per0[0],per0[2].Reverse()};
side2 = {per0[1],per0[3].Reverse()};
//Offset Surface and Switcher
per1 = Flatten(srfOff.PerimeterCurves());
side3 = {per1[0],per1[2].Reverse()};
side4 = {per1[1],per1[3].Reverse()};
toolPicker = side4;
//Curves Coming in the length of a slat
crv0 = side1.ExtendEnd(-sltThickness/2).ExtendStart(-sltThickness/2);
crv1 = side3.ExtendEnd(-sltThickness/2).ExtendStart(-sltThickness/2);
# ----------------------------------------
vertical_slats = CodeBlock(sltAmt=base_operations.sltAmt, crv0=base_operations.crv0, crv1=base_operations.crv1, slatThickness=base_operations.slatThickness, toolAmt=base_operations.toolAmt, toolPicker=base_operations.toolPicker, maxToolRadius=base_operations.maxToolRadius)
# ---------- vertical_slats.designscript (23 lines) ----------
spread = (0..1..#sltAmt);
points0 = crv0<1>.PointAtParameter(spread<2>);
points1 = crv1<1>.PointAtParameter(spread<2>);
//Creating the Base Slats
slatSrf = Surface.ByLoft(DSCore.List.Transpose(Line.ByStartPointEndPoint
(points0,points1)));
srfThicken = {Surface.Thicken(slatSrf,slatThickness,true)};
//Creating the Tooling Paths
toolSpread = (0..1..#toolAmt);
toolPoints = toolPicker<1>.PointAtParameter(toolSpread<2>);
//Creating Tooling Shapes
count0 = Count(Flatten(toolPoints));
toolRads = DSCore.List.Chop(DSCore.List.Shuffle(Math.Round(
(slatThickness..maxToolRadius..#count0))),count0/2);
vec0 = Vector.ByTwoPoints(DSCore.List.Shuffle(toolPoints[0]),
DSCore.List.Shuffle(toolPoints[1]));
//Creating our Planes to host our Tool Profiles
pln0 = Plane.ByOriginNormal(toolPoints,vec0).ToCoordinateSystem()
.XYPlane;
circ0 = Circle.ByPlaneRadius(pln0,toolRads);
profiles = DSCore.List.Transpose({DSCore.List.Shuffle(circ0[0]),circ0[1]});
solids = Autodesk.Geometry.Solid.ByLoft(profiles);
difference = Flatten(srfThicken.DifferenceAll(solids));
# ----------------------------------------
solids = Output(vertical_slats.difference)
