# Dynamo custom node Atmos.XY.frameExtents.dyf (Dynamo 0.9.0.3067)
# category: Atmos.XYPlaneNodes
# Gathers the maximum and minimum points from a selection of model lines to create an extent frame. Output gives you the frame rectangle, corner points, centre points of frame and centroid of shape.

modelCurves = Input()
the_guts = CodeBlock(t3=modelCurves)
# ---------- the_guts.designscript (29 lines) ----------
t2 = t3.Curves;
t4 = t2.ToNurbsCurve();
t5 = t4.EndPoint;
t6 = Flatten(t5);
t7 = t4.StartPoint;
t8 = Flatten(t7);
t9 = t4.ControlPoints();
t10 = Flatten(t9);
t11 = {t6, t8, t10};
t12 = Flatten(t11);
t13 = Point.PruneDuplicates(t12, 0.001);
t14 = t13.X;
t15 = List.MaximumItem(t14);
t16 = t13.Y;
t17 = List.MinimumItem(t16);
t18 = Point.ByCoordinates(t15, t17, 0);
t19 = List.MinimumItem(t14);
t20 = Point.ByCoordinates(t19, t17, 0);
t21 = List.MaximumItem(t16);
t22 = Point.ByCoordinates(t19, t21, 0);
t23 = Point.ByCoordinates(t15, t21, 0);
t24 = {t18, t20, t22, t23};
t25 = Rectangle.ByCornerPoints(t24);
t26 = t25.Curves();
t27 = t26.PointAtParameter(0.5);
t28 = t26.EndPoint;
t29 = Line.ByStartPointEndPoint(t18, t22);
t30 = Line.ByStartPointEndPoint(t23, t20);
t31 = t29.Intersect(t30);
# ----------------------------------------
centrePoints = Output(the_guts.t27)
cornerPoints = Output(the_guts.t28)
centroid = Output(the_guts.t31)
rectangle = Output(the_guts.t25)
