# Dynamo custom node AxisByExcel.dyf (Dynamo 1.3.2.2480)
# category: DynaTools.Civil.Tunnel

ExcelPath = Input()
SheetName = Input(SheetName : string)

# group: Axis curve
fromPath = FileObject(ExcelPath)  # "File.FromPath"
readFromFile = Excel.ReadFromFile(file=fromPath, sheetName=SheetName)
transpose = List.Transpose(readFromFile)
code_block = CodeBlock(lst=transpose) { lst[0]; lst[1]; lst[3]; }
byCoordinates = Point.ByCoordinates(x=code_block.out0, y=code_block.out1, z=code_block.out2)
code_block_2 = CodeBlock { 1; }
byPoints = NurbsCurve.ByPoints(byCoordinates, code_block_2)

Subdivision = Input(Subdivision : double)

# group: Curve Subdivisions
code_block_3 = CodeBlock(crv=byPoints, step=Subdivision) { 0..crv.Length..step; }
pointAtSegmentLength = Curve.PointAtSegmentLength(curve=byPoints, segmentLength=code_block_3)

Points = Output(pointAtSegmentLength)
splitByPoints = Curve.SplitByPoints(curve=byPoints, points=pointAtSegmentLength)
code_block_4 = CodeBlock(lst=splitByPoints) { lst.StartPoint; lst.EndPoint; }
byTwoPoints = Vector.ByTwoPoints(start=code_block_4.out0, end=code_block_4.out1)
ZAxis = Vector.ZAxis()
YAxis = Vector.YAxis()
byOriginVectors = CoordinateSystem.ByOriginVectors(origin=pointAtSegmentLength, xAxis=byTwoPoints, yAxis=ZAxis, zAxis=YAxis)
YAxis_2 = CoordinateSystem.YAxis(byOriginVectors)
code_block_5 = CodeBlock { 90; }
rotate = CoordinateSystem.Rotate(coordinateSystem=byOriginVectors, origin=pointAtSegmentLength, axis=YAxis_2, degrees=code_block_5)
cs = Output(rotate)
ZAxis_2 = CoordinateSystem.ZAxis(byOriginVectors)
