# Dynamo custom node CheckListParameters.dyf (Dynamo 1.3.2.2480)
# category: DynaTools.ElementTools.Parameters
# Check parameters availability within the project.
# The list can be imported from an excel file or just as a list of string.

ParameterList = Input(ParameterList : string[])  # List of parameters
python_script = Python(IN[0]=ParameterList)
# ---------- python_script.python (70 lines) ----------
############################################
#Copyright 2017							 ###
#Twitter: @CesareCaoduro				 ###
#Email: cesare.caoduro@gmail.com		 ###
############################################

#Declaration section#

import sys
import clr

pyt_path = r'C:\Program Files (x86)\IronPython 2.7\Lib'
sys.path.append(pyt_path)
import os

clr.AddReference('ProtoGeometry')
from Autodesk.DesignScript.Geometry import *

clr.AddReference('RevitAPIUI')
from  Autodesk.Revit.UI import *

clr.AddReference('RevitAPI')
from Autodesk.Revit.DB import *
from Autodesk.Revit.Creation import *

clr.AddReference('RevitNodes')
import Revit

clr.ImportExtensions(Revit.Elements)
clr.ImportExtensions(Revit.GeometryConversion)

clr.AddReference('RevitServices')
from RevitServices.Persistence import DocumentManager
from RevitServices.Transactions import TransactionManager

#Access the active document#
doc = DocumentManager.Instance.CurrentDBDocument
uidoc = DocumentManager.Instance.CurrentUIApplication.ActiveUIDocument

#Start a transaction on the active document#
TransactionManager.Instance.EnsureInTransaction(doc)

#Insert here your code#
input = IN[0]
found, notFound, fff = [], [], []
ff, nf, tot = 0, 0, len(input)

col = FilteredElementCollector(doc).OfClass(ParameterElement)

for i in input:
	f = 0
	for c in col:
		if i == c.Name:
			f = 1
			fff.append(c)
	if f == 1 :
		found.append(i)
		ff += 1
	else:
		notFound.append(i)
		nf += 1

	


#Dispose the active transaction
TransactionManager.Instance.TransactionTaskDone()

#List outputs#
OUT = found, notFound, (tot, ff, nf), fff
# ----------------------------------------
code_block = CodeBlock(lst=python_script) { lst[0]; lst[1]; lst[2][0]; lst[2][1]; lst[2][2]; lst[3]; }
ParameterFound = Output(code_block.out0)  # "ParameterFound : string[]"; List of parameters found
ParameterNotFound = Output(code_block.out1)  # "ParameterNotFound : string[]"; List of parameters not found
TotalCheckedParameters = Output(code_block.out2)  # "TotalCheckedParameters : double"; Total number of parameters checked
TotalFoundParameters = Output(code_block.out3)  # "TotalFoundParameters : double"; Total number of parameters found
TotalNotFoundParameters = Output(code_block.out4)  # "TotalNotFoundParameters : double"; Total number of parameters not found
MaxScore = Input(MaxScore : double = 5)  # Define the highest score value for this KPI
code_block_2 = CodeBlock(f=code_block.out3, tot=code_block.out2, maxScore=MaxScore) { percentage = f * 100 / tot; score = Math.Round(percentage * maxScore / 100,2); }
Score = Output(code_block_2.score)  # "Score : double"; KPI Score (0-5)
ParameterElement = Output(code_block.out5)
