# Dynamo custom node DetailGroup.dyf (Dynamo 1.3.2.2480)
# category: DynaTools.QAQC.Document

Refresh = Input(Refresh: bool)  # Refresh
python_script = Python(IN[0]=Refresh)
# ---------- python_script.python (62 lines) ----------
############################################
#Copyright 2017							 ###
#Twitter: @CesareCaoduro				 ###
#Email: cesare.caoduro@gmail.com		 ###
############################################

#Declaration section#

import sys
import clr

pyt_path = r'C:\Program Files (x86)\IronPython 2.7\Lib'
sys.path.append(pyt_path)
import os

clr.AddReference('ProtoGeometry')
from Autodesk.DesignScript.Geometry import *

clr.AddReference('RevitAPIUI')
from  Autodesk.Revit.UI import *

clr.AddReference('RevitAPI')
from Autodesk.Revit.DB import *
from Autodesk.Revit.Creation import *

clr.AddReference('RevitNodes')
import Revit

clr.ImportExtensions(Revit.Elements)
clr.ImportExtensions(Revit.GeometryConversion)

clr.AddReference('RevitServices')
from RevitServices.Persistence import DocumentManager
from RevitServices.Transactions import TransactionManager

#Access the active document#
doc = DocumentManager.Instance.CurrentDBDocument
uidoc = DocumentManager.Instance.CurrentUIApplication.ActiveUIDocument

#Start a transaction on the active document#
TransactionManager.Instance.EnsureInTransaction(doc)

#Insert here your code#
input = IN[0]
output, names = [], []

if input:
	col = FilteredElementCollector(doc).OfCategory(BuiltInCategory.OST_IOSDetailGroups).WhereElementIsNotElementType()
	for c in col:
		output.append(c.ToDSType(True))
		names.append(c.Name)
	col = FilteredElementCollector(doc).OfCategory(BuiltInCategory.OST_IOSAttachedDetailGroups).WhereElementIsNotElementType()
	for c in col:
		output.append(c.ToDSType(True))
		names.append(c.Name)


#Dispose the active transaction
TransactionManager.Instance.TransactionTaskDone()

#List outputs#
OUT = output, len(output), names
# ----------------------------------------
code_block = CodeBlock(lst=python_script) { lst[0]; lst[1]; lst[2]; }
groupByKey = List.GroupByKey(list=code_block.out0, keys=code_block.out2)
DetailGroups = Output(groupByKey.groups)
DetailGroupUniqueNames = Output(groupByKey.unique_keys)
code_block_2 = CodeBlock(x=groupByKey.groups) { Count(x); }
code_block_3 = CodeBlock(x=code_block_2) { x == 0; }
code_block_4 = CodeBlock { "NA"; }
code_block_5 = CodeBlock()
# ---------- code_block_5.designscript (9 lines) ----------
//Check wheter a number is a NaN value
"
import math
score = IN[0]
if math.isnan(score):
 OUT = 0
else:
 OUT = score
";
# ----------------------------------------
MaxDetailGroups = Input(MaxDetailGroups : double = 10)  # Define the highest score value for this KPI
MaxScore = Input(MaxScore : double = 5)  # Define the highest score value for this KPI
code_block_6 = CodeBlock(f=code_block_2, tot=MaxDetailGroups, maxScore=MaxScore) { percentage = f * 100 / tot; score = maxScore - Math.Round(percentage * maxScore / 100,2); }
python_script_from_string = PythonStringNode(script=code_block_5, IN[0]=code_block_6.score)
if_ = If(test=code_block_3, true=code_block_4, false=python_script_from_string)
Score = Output(if_)
