# Dynamo custom node ListOfViewByType.dyf (Dynamo 1.3.2.2480)
# category: DynaTools.QAQC.Views

python_script = Python()  # unwired: IN[0]
# ---------- python_script.python (87 lines) ----------
############################################
#Copyright 2017							 ###
#Twitter: @CesareCaoduro				 ###
#Email: cesare.caoduro@gmail.com		 ###
############################################

#Declaration section#

import sys
import clr

pyt_path = r'C:\Program Files (x86)\IronPython 2.7\Lib'
sys.path.append(pyt_path)
import os

clr.AddReference('ProtoGeometry')
from Autodesk.DesignScript.Geometry import *

clr.AddReference('RevitAPIUI')
from  Autodesk.Revit.UI import *

clr.AddReference('RevitAPI')
from Autodesk.Revit.DB import *
from Autodesk.Revit.Creation import *

clr.AddReference('RevitNodes')
import Revit

clr.ImportExtensions(Revit.Elements)
clr.ImportExtensions(Revit.GeometryConversion)

clr.AddReference('RevitServices')
from RevitServices.Persistence import DocumentManager
from RevitServices.Transactions import TransactionManager

#Access the active document#
doc = DocumentManager.Instance.CurrentDBDocument
uidoc = DocumentManager.Instance.CurrentUIApplication.ActiveUIDocument

#Start a transaction on the active document#
TransactionManager.Instance.EnsureInTransaction(doc)

#Insert here your code#
output = []
sPlan, pView, cPlan, sections, elevations, tredView, schedule, dView, legend = [], [], [], [], [], [], [], [], []
tot = 0

col = FilteredElementCollector(doc).OfCategory(BuiltInCategory.OST_Views)

for c in col:
	if c.get_Parameter(BuiltInParameter.VIEW_TYPE_SCHEDULES).AsString() == 'Structural Plan':
		sPlan.append(c.ToDSType(True))
		tot += 1
	elif c.get_Parameter(BuiltInParameter.VIEW_TYPE_SCHEDULES).AsString() == 'Cross Section':
		sections.append(c.ToDSType(True))
		tot += 1
	elif c.get_Parameter(BuiltInParameter.VIEW_TYPE_SCHEDULES).AsString() == 'Floor Plan':
		pView.append(c.ToDSType(True))
		tot += 1
	elif c.get_Parameter(BuiltInParameter.VIEW_TYPE_SCHEDULES).AsString() == 'Ceiling Plan':
		cPlan.append(c.ToDSType(True))
		tot += 1
	elif c.get_Parameter(BuiltInParameter.VIEW_TYPE_SCHEDULES).AsString() == 'Building Elevation':
		elevations.append(c.ToDSType(True))
		tot += 1
	elif c.get_Parameter(BuiltInParameter.VIEW_TYPE_SCHEDULES).AsString() == '3D View':
		tredView.append(c.ToDSType(True))
		tot += 1
	elif c.get_Parameter(BuiltInParameter.VIEW_TYPE_SCHEDULES).AsString() == 'Detail':
		dView.append(c.ToDSType(True))
		tot += 1
	elif c.get_Parameter(BuiltInParameter.VIEW_TYPE_SCHEDULES).AsString() == 'Legend':
		legend.append(c.ToDSType(True))
		tot += 1
	
		
cView = col = FilteredElementCollector(doc).OfClass(ViewSchedule)
for c in cView:
	schedule.append(c.ToDSType(True))
	tot += 1
	
#Dispose the active transaction
TransactionManager.Instance.TransactionTaskDone()


#List outputs#
OUT = sPlan, pView, cPlan, sections, elevations, tredView, schedule, dView, tot, legend
# ----------------------------------------
code_block = CodeBlock(lst=python_script) { lst[0]; lst[1]; lst[2]; lst[3]; lst[4]; lst[5]; lst[6]; lst[7]; lst[8]; lst[9]; }
StructuralPlan = Output(code_block.out0)
FloorPlan = Output(code_block.out1)
CeilingPlan = Output(code_block.out2)
Sections = Output(code_block.out3)
Elevations = Output(code_block.out4)
n3DView = Output(code_block.out5)  # "3DView"
Schedules = Output(code_block.out6)
DraftingViews = Output(code_block.out7)
LegendViews = Output(code_block.out9)
TotalNumber = Output(code_block.out8)
