# Dynamo graph QAQC.dyn (Dynamo 1.3.2.2480)

boolean = BoolSelector(true)

# group: Score Parameters
file_path = Filename("..\ParameterMatrix.xlsx")
parametersMatrixFromExcel = Custom[ParametersMatrixFromExcel](PathToFile=file_path, Refresh=boolean)
checkListParameters = Custom[CheckListParameters](ParameterList=parametersMatrixFromExcel.ParameterList)  # Check parameters availability within the project. The list can be imported from an excel file or just as a list of string.
parameterBinding = Custom[ParameterBinding](ParameterElement=checkListParameters.ParameterElement, CategoriesList=parametersMatrixFromExcel.CategoriesList)  # Check whether a parameter is correctly associated to a list of categories

# group: Score Views on Sheets
viewOnSheet = Custom[ViewOnSheet]()
listOfViewByType = Custom[ListOfViewByType]()
score = Custom[Score](TotalNumber=viewOnSheet.TotalNumber, ActualNumber=listOfViewByType.TotalNumber)  # Score a number against another, using a KPI maximum value

# group: Score File Size
fileInfo = Custom[FileInfo]()

# group: Score DWG linked/imported files
linkedCADFile = Custom[LinkedCADFile](Refresh=boolean)  # Check the number of CAD drawings linked or imported
code_block = CodeBlock()
# ---------- code_block.designscript (2 lines) ----------
//Maximum acceptable CAD links per project
20;
# ----------------------------------------
code_block_2 = CodeBlock(lst=linkedCADFile.CADFiles) { Count(lst); }
inverseScore = Custom[InverseScore](TotalNumber=code_block, ActualNumber=code_block_2)

# group: Score RVT Links
linkedRevit = Custom[LinkedRevit](Refresh=boolean)
code_block_3 = CodeBlock()
# ---------- code_block_3.designscript (2 lines) ----------
//Maximum acceptable RVT links per project
20;
# ----------------------------------------
code_block_4 = CodeBlock(lst=linkedRevit.LinkedRVT) { Count(lst); }
inverseScore_2 = Custom[InverseScore](TotalNumber=code_block_3, ActualNumber=code_block_4)

create = List.Create(checkListParameters.Score, parameterBinding.Score, score.Score, fileInfo.Score, linkedCADFile.Score, inverseScore.Score, linkedRevit.Score, inverseScore_2.Score)
code_block_5 = CodeBlock(x=create) { Math.Round(Math.Average(x)); }

# group: Score Model Groups
code_block_6 = CodeBlock()
# ---------- code_block_6.designscript (2 lines) ----------
//Maximum acceptable Model groups per project
30;
# ----------------------------------------
modelGroup = Custom[ModelGroup](Refresh=boolean)
code_block_7 = CodeBlock(lst=modelGroup.ModelGroups) { Count(Flatten(lst)); }
inverseScore_3 = Custom[InverseScore](TotalNumber=code_block_6, ActualNumber=code_block_7)

# group: Score Detail Groups
code_block_8 = CodeBlock()
# ---------- code_block_8.designscript (2 lines) ----------
//Maximum acceptable detail groups per project
30;
# ----------------------------------------
detailGroup = Custom[DetailGroup](Refresh=boolean)
code_block_9 = CodeBlock(lst=detailGroup.DetailGroups) { Count(Flatten(lst)); }
inverseScore_4 = Custom[InverseScore](TotalNumber=code_block_8, ActualNumber=code_block_9)
