# Dynamo custom node Element SetRotation.dyf (Dynamo 2.6.2.15705)
# category: GeniusLoci.Element
# Set the angle of the element around its local Z-axis.
# (Same as the Rotate command in Revit)

element = Input(element: var)
degree = Input(degree: var)  # The angle around Z-axis
python_script = Python(IN[0]=element, IN[1]=degree)
# ---------- python_script.python (160 lines) ----------
#Alban de Chasteigner 2020
#twitter : @geniusloci_bim
#geniusloci.bim@gmail.com
#https://github.com/albandechasteigner/GeniusLociForDynamo

import clr
clr.AddReference("RevitNodes")
import Revit
clr.ImportExtensions(Revit.GeometryConversion)

clr.AddReference("RevitAPI")
import Autodesk
from Autodesk.Revit.DB import *
import math

clr.AddReference("RevitServices")
import RevitServices
from RevitServices.Persistence import DocumentManager
from RevitServices.Transactions import TransactionManager
doc = DocumentManager.Instance.CurrentDBDocument

elements = UnwrapElement(IN[0]) if isinstance(IN[0],list) else [UnwrapElement(IN[0])]
angles = [i* math.pi/180 for i in IN[1]] if isinstance(IN[1],list) else [IN[1]* math.pi/180]

def GetCropBox(view):
	provider= ParameterValueProvider(ElementId(BuiltInParameter.ID_PARAM))
	rule = FilterElementIdRule(provider, FilterNumericEquals(), view.Id )
	filter= ElementParameterFilter(rule)
	return doc.GetElement(FilteredElementCollector(view.Document).WherePasses(filter).ToElementIds().Find(lambda x: x.IntegerValue != view.Id.IntegerValue))

TransactionManager.Instance.EnsureInTransaction(doc)
for angle, element in zip(angles, elements):
	#if angle>math.pi:
		#angle=abs(angle-2*math.pi)
	#else:angle
	#Get initial Rotation Angle using transform
	#transform=element.GetTransform()
	#vectorTran = transform.OfVector(transform.BasisX)
	#rot = transform.BasisX.AngleOnPlaneTo(vectorTran, transform.BasisZ) 
	#rot = rot * (180 / math.pi)
	if element.Category != None and hasattr(element, "Location") and element.Category.CategoryType == CategoryType.Model :
		loc = element.Location
		if loc:	
			# ImportInstance and linkInstance
			if hasattr(element, "GetTotalTransform"):
				trans=element.GetTotalTransform()
				loca = trans.Origin
				rot = -trans.BasisX.AngleOnPlaneTo(XYZ.BasisX, XYZ.BasisZ)
			# point-based elements (e.g. most loadable families)
			elif isinstance(loc,LocationPoint):
				loca=loc.Point
				if hasattr(loc, "Rotation"):
					rot=loc.Rotation
				# Group, assembly
				else:rot = 0
			elif isinstance(element, MEPCurve):
				loca=loc.Curve.Evaluate(0.5,True)
				for c in element.ConnectorManager.Connectors :
					rot = math.asin(c.CoordinateSystem.Inverse.BasisY.X)
			# line-based elements (e.g. walls)
			elif isinstance(loc, LocationCurve):
				loca=loc.Curve.Evaluate(0.5,True)
				rot=loc.Curve.Direction.AngleTo(XYZ.BasisX)
			else:
				box = element.get_BoundingBox(None)
				loca = (box.Min+box.Max)/2
				rot = 0
				# sketch-based elements (ceiling, floor and roof)
				if hasattr(element, "FindInserts"):
					for ref in HostObjectUtils.GetTopFaces(element):
						geomFace=element.GetGeometryObjectFromReference(ref)
						#Get BoundingBox max UV point
						maxUV = geomFace.GetBoundingBox().Max
						#Get transform
						trans=geomFace.ComputeDerivatives(maxUV)
						if isinstance(element,Ceiling):
							rot = abs(trans.BasisZ.AngleOnPlaneTo(XYZ.BasisX, XYZ.BasisZ)-2*math.pi)
						else:
							rot = abs(trans.BasisY.AngleOnPlaneTo(XYZ.BasisX, XYZ.BasisZ)-math.pi)
				else : rot = 0
				
	elif element.Category != None and element.Category.CategoryType == CategoryType.Annotation :
		# view specific elements (e.g. filled regions)
		if hasattr(element, "OwnerViewId") and element.OwnerViewId != ElementId.InvalidElementId :
			view=doc.GetElement(element.OwnerViewId)
			box = element.BoundingBox[view]
			loca = (box.Min+box.Max)/2
			rot = 0
		# SectionBox
		elif ElementId(BuiltInCategory.OST_SectionBox) == element.Category.Id:
			box = doc.GetElement(ElementId(element.Id.IntegerValue + 1)).GetSectionBox()
			transform = box.Transform
			min = transform.OfPoint(box.Min)
			max = transform.OfPoint(box.Max)
			loca = (min+max)/2
			rot = 0
		elif isinstance(element,Grid):
			line=element.Curve
			start=line.GetEndPoint(0)
			end=line.GetEndPoint(1)   
			box=BoundingBoxXYZ()
			box.Min = start
			box.Max = end
			loca = (box.Min+box.Max)/2
			rot = 0			
		elif isinstance(element,ReferencePlane):
			doc=element.Document
			view = doc.ActiveView
			for crv in element.GetCurvesInView(DatumExtentType.ViewSpecific,view):
				line = crv
			start=line.GetEndPoint(0)
			end=line.GetEndPoint(1)   
			box=BoundingBoxXYZ()
			box.Min = start
			box.Max = end
			loca = (box.Min+box.Max)/2
			rot = 0	
		# VolumOfInterest
		elif hasattr(element, "Location"):
			box = element.get_BoundingBox(None)
			loca = (box.Min+box.Max)/2
			rot = 0
			
	elif element.Category != None and element.Category.CategoryType == CategoryType.Internal :
		# ViewSection Marker
		if ElementId(BuiltInCategory.OST_Viewers) == element.Category.Id :
			viewSection = doc.GetElement(ElementId(element.Id.IntegerValue + 1))
			shape=viewSection.GetCropRegionShapeManager().GetCropShape()
			#Last line of the rectangle
			l=[s for s in shape[0]][3]
			loca = l.Evaluate(0.5, True)
			#loca = viewSection.Origin
			rot = 0
		#PlanView, SectionView and 3D View
		elif hasattr(element, "CropBox") :
			box = element.CropBox
			element = GetCropBox(element)
			transform = box.Transform
			min = transform.OfPoint(box.Min)
			max = transform.OfPoint(box.Max)
			loca = (min+max)/2
			rot = 0	
	else:
		# CropBox
		if element.Category == None :
			view=doc.GetElement(element.get_Parameter(BuiltInParameter.ID_PARAM).AsElementId())
			box = view.CropBox
			transform = box.Transform
			min = transform.OfPoint(box.Min)
			max = transform.OfPoint(box.Max)
			loca = (min+max)/2
			rot = 0
			
	line = Line.CreateBound(loca, XYZ(loca.X,loca.Y,loca.Z+1))
	#Set Rotation
	Autodesk.Revit.DB.ElementTransformUtils.RotateElement(doc, element.Id, line, angle - rot)
TransactionManager.Instance.TransactionTaskDone()

if isinstance(IN[0], list): OUT = elements
else: OUT = elements[0]
# ----------------------------------------
Element = Output(python_script)
