# Dynamo custom node Cleanup.DeleteImportedLinePatterns.dyf
# category: Modelical.Actions
# This node deletes all the imported line patterns generated when importing CAD files.

bool = Input(_bool: bool = false)  # Set TRUE to delete imported Line Patterns
python = Python(IN[0]=bool)  # CPython3
# ---------- python.python (51 lines) ----------
# This node has been made by Modelical
# www.modelical.com

import clr
#Load Revit API
clr.AddReference('RevitAPI')
from Autodesk.Revit.DB import *
import Autodesk

#Load document reference
clr.AddReference("RevitServices")
import RevitServices
from RevitServices.Persistence import DocumentManager
from RevitServices.Transactions import TransactionManager

doc = DocumentManager.Instance.CurrentDBDocument
uiapp = DocumentManager.Instance.CurrentUIApplication
app = uiapp.Application

bool = IN[0]

collector = FilteredElementCollector(doc)
allLinePatterns = collector.OfClass(LinePatternElement).ToElements()

linePatternsNames = UnwrapElement(allLinePatterns)
output = "Set TRUE to delete imported Line Patterns"
delLinePatternsId = []

if bool == True:
    for l in linePatternsNames:
        if l.Name.startswith("IMPORT"):
            delLinePatternsId.append(l.Id)
    output = str(len(delLinePatternsId)) + " Line Pattern/s have been deleted"
    
    if len(delLinePatternsId)==0:
        output="There are no Imported Lines Patterns"
    else:
        t=Transaction(doc, "Modelical.RemoveImportedLinePatterns")
        t.Start()
        try:
            for l in delLinePatternsId:
                doc.Delete(l)
            
            t.Commit()
        except Exception as ex:
        	output=ex
        finally:
        	t.Dispose()        

        
OUT = output
# ----------------------------------------
info = Output(python)  # "_info"
