# Dynamo custom node Element.ResetOverrides.dyf
# category: Modelical.Elements.Actions
# This node modifies the visualization of the elements in the active view by selecting color and fill pattern. Solid fill pattern will be applied by default.

elements = Input(_elements: var[]..[])  # Elements to reset override in active View.
python = Python(IN[0]=elements)  # CPython3
# ---------- python.python (41 lines) ----------
# This node has been made by Modelical
# www.modelical.com

import clr

clr.AddReference("RevitServices")
import RevitServices
from RevitServices.Persistence import DocumentManager
from RevitServices.Transactions import TransactionManager

from System.Collections.Generic import *

clr.AddReference("RevitAPI")
import Autodesk
from Autodesk.Revit.DB import *

doc = DocumentManager.Instance.CurrentDBDocument

def toList(input):
    if isinstance(input, list):
        return input
    else:
        return [input]

elements = toList(UnwrapElement(IN[0]))

view = doc.ActiveView
override = OverrideGraphicSettings()

t=Transaction(doc, "Modelical.ResetOverride")
t.Start()
try:
    for e in elements:
        view.SetElementOverrides(e.Id, override)
    t.Commit()
    OUT = elements
    
except exception as ex:
    OUT = ex
finally:
    t.Dispose()
# ----------------------------------------
Selected_elements__elements = Output(python)  # "/*Selected elements*/ _elements"
