# Dynamo custom node List.Rider.dyf (Dynamo 2.6.1.8786)
# category: Modelical.Query
# This node gets the combination of two lists, by mixing all the elements of the list without the first element and without the last element.

list = Input(_list: var[]..[])  # List
code_block = CodeBlock(l=list)
# ---------- code_block.designscript (3 lines) ----------
// This node has been made by Modelical
// www.modelical.com
List.Transpose([List.DropItems(l, -1),List.DropItems(l, 1)]);
# ----------------------------------------
combined = Output(code_block)  # "_combined"
