# Dynamo custom node MEP.ChangeFittingLevel.dyf
# category: Modelical.Elements.Actions
# This node allows to change the level of a pipe or a duct fitting, without modifying the position.

ductOrPipeFittings = Input(_ductOrPipeFittings: var[]..[])  # Can include ducts or pipes. Their reference level will change
selectedLevel = Input(_selectedLevel: Revit.Elements.Level[]..[])  # Selected level or levels.
python = Python(IN[0]=ductOrPipeFittings, IN[1]=selectedLevel)  # CPython3
# ---------- python.python (142 lines) ----------
# This node has been made by Modelical
# www.modelical.com

import clr


clr.AddReference("RevitAPI")
from Autodesk.Revit.DB import *
from Autodesk.Revit.DB.Structure import *

clr.AddReference("RevitAPIUI")
from Autodesk.Revit.UI import *

clr.AddReference("RevitNodes")
import Revit
clr.ImportExtensions(Revit.GeometryConversion)
clr.ImportExtensions(Revit.Elements)

clr.AddReference("RevitServices")
import RevitServices
from RevitServices.Persistence import DocumentManager
from RevitServices.Transactions import TransactionManager

uidoc = DocumentManager.Instance.CurrentUIApplication
doc = DocumentManager.Instance.CurrentDBDocument
app = uidoc.Application


# Function Helpers
def toList(input):
    if isinstance(input, list):
        return input
    else:
        return [input]

# Logic starts here
elements = toList(UnwrapElement(IN[0]))
destinationLevels =toList(UnwrapElement(IN[1]))


# Transactions

t=Transaction(doc, "Modelical.ChangeMEPReferenceLevel")
t.Start()
try:
    
    if int(app.VersionNumber) < 2020:
        if len(destinationLevels) == 1:
            for f in elements:
                if f.Category.Name == str(Revit.Elements.Category.ById(ElementId(BuiltInCategory.OST_DuctCurves).IntegerValue)) or f.Category.Name == str(Revit.Elements.Category.ById(ElementId(BuiltInCategory.OST_PipeCurves).IntegerValue)):
                        startLevel =f.get_Parameter(BuiltInParameter.RBS_START_LEVEL_PARAM).Set(destinationLevels[0].Id)
                else:
                    try:
                        startLevelId = f.get_Parameter(BuiltInParameter.FAMILY_LEVEL_PARAM).AsElementId()
                        startLevelElevation = doc.GetElement(startLevelId).Elevation
                        startOffset = f.get_Parameter(BuiltInParameter.INSTANCE_FREE_HOST_OFFSET_PARAM).AsDouble()
                        endLevelElevation = destinationLevels[0].Elevation
                        endOffset = (startLevelElevation + startOffset) - endLevelElevation
                        endLevelId = destinationLevels[0].Id
    
                        f.get_Parameter(BuiltInParameter.INSTANCE_FREE_HOST_OFFSET_PARAM).Set(endOffset)
                        f.get_Parameter(BuiltInParameter.FAMILY_LEVEL_PARAM).Set(endLevelId)
                        f.ToDSType(True)
                    except:
                        None
        elif len(destinationLevels) > 1:
                i = 0
                for f in elements:
                    if f.Category.Name == str(Revit.Elements.Category.ById(ElementId(BuiltInCategory.OST_DuctCurves).IntegerValue)) or f.Category.Name == str(Revit.Elements.Category.ById(ElementId(BuiltInCategory.OST_PipeCurves).IntegerValue)):
    
                        startLevel =f.get_Parameter(BuiltInParameter.RBS_START_LEVEL_PARAM).Set(destinationLevels[i].Id)
                    else:
                        try:
                            startLevelId = f.get_Parameter(BuiltInParameter.FAMILY_LEVEL_PARAM).AsElementId()
                            startLevelElevation = doc.GetElement(startLevelId).Elevation
                            startOffset = f.get_Parameter(BuiltInParameter.INSTANCE_FREE_HOST_OFFSET_PARAM).AsDouble()
                            endLevelElevation = destinationLevels[i].Elevation
                            endOffset = (startLevelElevation + startOffset) - endLevelElevation
                            endLevelId = destinationLevels[i].Id
    
                            f.get_Parameter(BuiltInParameter.INSTANCE_FREE_HOST_OFFSET_PARAM).Set(endOffset)
                            f.get_Parameter(BuiltInParameter.FAMILY_LEVEL_PARAM).Set(endLevelId)
                            f.ToDSType(True)
                        except:
                            None
                    i+=1
    
    elif int(app.VersionNumber) >= 2020:
            if len(destinationLevels) == 1:
    
                for f in elements:
                    if f.Category.Name == str(Revit.Elements.Category.ById(ElementId(BuiltInCategory.OST_DuctCurves).IntegerValue)) or f.Category.Name == str(Revit.Elements.Category.ById(ElementId(BuiltInCategory.OST_PipeCurves).IntegerValue)):
    
                        startLevel =f.get_Parameter(BuiltInParameter.RBS_START_LEVEL_PARAM).Set(destinationLevels[0].Id)
                    else:
                        try:
                            startLevelId = f.get_Parameter(BuiltInParameter.FAMILY_LEVEL_PARAM).AsElementId()
                            startLevelElevation = doc.GetElement(startLevelId).Elevation
                            startOffset = f.get_Parameter(BuiltInParameter.INSTANCE_ELEVATION_PARAM).AsDouble()
                            endLevelElevation = destinationLevels[0].Elevation
                            endOffset = (startLevelElevation + startOffset) - endLevelElevation
                            endLevelId = destinationLevels[0].Id
    
                            f.get_Parameter(BuiltInParameter.FAMILY_LEVEL_PARAM).Set(endLevelId)
                            f.get_Parameter(BuiltInParameter.INSTANCE_ELEVATION_PARAM).Set(endOffset)
                            f.ToDSType(True)
                        except:
                            None
    
            elif len(destinationLevels) > 1:
                i = 0
                for f in elements:
    
                    if f.Category.Name == str(Revit.Elements.Category.ById(ElementId(BuiltInCategory.OST_DuctCurves).IntegerValue)) or f.Category.Name == str(Revit.Elements.Category.ById(ElementId(BuiltInCategory.OST_PipeCurves).IntegerValue)):
    
                        startLevel =f.get_Parameter(BuiltInParameter.RBS_START_LEVEL_PARAM).Set(destinationLevels[i].Id)
    
                    else:
                        try:
                            startLevelId = f.get_Parameter(BuiltInParameter.FAMILY_LEVEL_PARAM).AsElementId()
                            test.append(startLevelId)
    
                            startLevelElevation = doc.GetElement(startLevelId).Elevation
                            startOffset = f.get_Parameter(BuiltInParameter.INSTANCE_FREE_HOST_OFFSET_PARAM).AsDouble()
                            endLevelElevation = destinationLevels[i].Elevation
                            endOffset = (startLevelElevation + startOffset) - endLevelElevation
                            endLevelId = destinationLevels[i].Id
    
                            f.get_Parameter(BuiltInParameter.FAMILY_LEVEL_PARAM).Set(endLevelId)
                            f.get_Parameter(BuiltInParameter.INSTANCE_ELEVATION_PARAM).Set(endOffset)
                            f.ToDSType(True)
                        except:
                            None
                    i+=1
                    
    OUT = elements
    t.Commit()
except Exception as ex:
    OUT=ex
    #t.RollBack
finally:
    t.Dispose()
# ----------------------------------------
elements = Output(python)  # "_elements"
