# Dynamo custom node Vector.SimilarityBetweenVectors.dyf (Dynamo 2.6.1.8786)
# category: Modelical.Geometry.Query
# This node checks if two vectors are similar with an absolute tolerance.

referenceVector = Input(_referenceVector: Autodesk.DesignScript.Geometry.Vector)  # Reference Vector.
vectorsToCompare = Input(_vectorsToCompare: Autodesk.DesignScript.Geometry.Vector[]..[])  # Vectors to compare.
tolerance = Input(_tolerance: double = 0.0001)  # Absolute tolerance
python_script = Python(IN[0]=referenceVector, IN[1]=vectorsToCompare, IN[2]=tolerance)
# ---------- python_script.python (49 lines) ----------
# This node has been made by Modelical
# www.modelical.com

import clr
clr.AddReference('ProtoGeometry')
from Autodesk.DesignScript.Geometry import *

from math import *

#Load Dynamo wrappers
clr.AddReference("RevitNodes")
import Revit
from Revit.Elements import *
clr.ImportExtensions(Revit.GeometryConversion)
clr.ImportExtensions(Revit.Elements)

def toList(input):
	if isinstance(input,list) == False:
		return [input]
	else:
		return input

def flatten(x):
    result = []
    for el in x:
        if hasattr(el, "__iter__") and not isinstance(el, basestring):
            result.extend(flatten(el))
        else:
            result.append(el)
    return result

def vecSimilarity(v1,v2,tolerance):
	if abs(v1.X - v2.X) <= tolerance and abs(v1.Y - v2.Y) <= tolerance and abs(v1.Z - v2.Z) <= tolerance:
		return True
	else:
		return False


vec1 = toList(IN[0])
vec2 = toList(IN[1])
tolerance = IN[2]

result=[]
index=0
for v in vec2:
	result.append(vecSimilarity(vec1[0],vec2[index],tolerance))
	index+=1

OUT = result
# ----------------------------------------
similarVector = Output(python_script)  # "_similarVector"
