# Dynamo graph 11-VASA-Path-Density.dyn (Dynamo 2.19.3.6394)
# packages: VASA 0.4.0

# note: Input Variables
# Pink indicates variables that can be altered per project and must be set accordingly before running the script.
# note: Functional Logic
# Cyan indicates the logic of the script. No changes should be made in these groups unless advised.
# note: Output Values
# Orange indicates key resulting values of nodes that should be observed after running the graph.
# note: Display Objects
# Blue indicates objects that can be previewed in the 3D background after running the graph.

# group: VASA Workflow 11: Path Density
# note: DYNAMO PROJECT
# 11-VASA-Path-Density.dyn
# note: ASSOCIATED FILE(S)
# sample-data : 2 STL files
# note: REQUIRED DYNAMO PACKAGES
# VASA
# note: DYNAMO VERSION
# 2.19.3
# note: AUTHOR(S) / CREATION DATE
# Autodesk Research 2022
# note: DESCRIPTION
# A demonstration of how to generate sample points and create a density map using the Voxel-based Architectural Space Analysis (VASA) package.
# note: ADDITIONAL COMMENTS
# First, sample points are generated using a distance field and a set of parameters. The parameters include the approximate spacing between points. Sample points can be used for a variety of purposes. In this example, the distance field is repurposed to generate paths from each sample point to a common source point.
# Second, a density map is created and visualized. In this example, the density map captures the number of shortest paths between each sample point and the main entrance.

# group: STL File Paths
building_geometry_file_path = Filename(".\TechnicalSchool_building_mm_bin.stl")
glazing_geometry_file_path = Filename(".\TechnicalSchool_glazing_mm_bin.stl")

# group: Triangle Data
importFromSTL = VASA.Utils.TrianglesAsNineNumbers.ImportFromSTL(filePath=building_geometry_file_path)
code_block = CodeBlock(buildingTriangles=importFromSTL) { buildingTriangles; }
importFromSTL_2 = VASA.Utils.TrianglesAsNineNumbers.ImportFromSTL(filePath=glazing_geometry_file_path)
code_block_2 = CodeBlock(glazingTriangles=importFromSTL_2) { glazingTriangles; }

# group: Voxel/Path Model Parameters
coarse_voxel_width_code_block = CodeBlock { 1000; }
finestlod_integer_slider = IntegerSlider(4, range=0..5 step 1)
agent_diameter_offset_integer = IntegerSlider(7, range=1..7 step 1)  # "Agent Diameter Offset - Integer Slider"

# group: Voxel Model
byTriangles = VASA.Core.VoxelModel.ByTriangles(trianglesAsNineNumbers=code_block, coarseVoxelWidth=coarse_voxel_width_code_block, finestLOD=finestlod_integer_slider)
byTriangles_2 = VASA.Core.VoxelModel.ByTriangles(trianglesAsNineNumbers=code_block_2, coarseVoxelWidth=coarse_voxel_width_code_block, finestLOD=finestlod_integer_slider)
list_create = List.Create(item0=byTriangles, item1=byTriangles_2)
union = VASA.Operations.SolidOperations.Union(voxelModels=list_create)

# group: Crop Depth
integer_slider = IntegerSlider(10, range=0..60 step 1)

# group: Crop Voxel Model
crop = VASA.Core.VoxelModel.Crop(voxelModel=union, upperZDepth=integer_slider)
extents = VASA.Core.VoxelModel.Extents(voxelModel=crop)

# group: Building Voxel Color
color_palette = ColorPalette({R: 255, G: 255, B: 255, A: 31})

# group: Display Building Voxels
displayVoxels = VASA.Core.VoxelModel.DisplayVoxels(voxelModel=crop, color=color_palette)

# group: Path Model
byVoxelModel = VASA.Pathfinding.PathModel.ByVoxelModel(voxelModel=union, agentDiameterOffset=agent_diameter_offset_integer)

# group: Source Point
source_point_x_number_slider = DoubleSlider(15000, range=10000..15000 step 10)
source_point_y_number_slider = DoubleSlider(3000, range=2000..18000 step 10)
source_point_z_number_slider = DoubleSlider(2000, range=1500..2500 step 10)
byCoordinates = Point.ByCoordinates(x=source_point_x_number_slider, y=source_point_y_number_slider, z=source_point_z_number_slider)

# group: Distance Field
# A distance field is created to (1) generate sample points, and (2) find paths to a common source point.
byPathModelAndSourcePoint = VASA.Pathfinding.DistanceField.ByPathModelAndSourcePoint(pathModel=byVoxelModel, sourcePoint=byCoordinates)

# group: Sample Point Parameters
spacing_number_slider = DoubleSlider(5000, range=1000..5000 step 500)
min_diameter_offset_integer = IntegerSlider(15, range=1..45 step 1)  # "Min Diameter Offset - Integer Slider"
minimum_distance_number_slider = DoubleSlider(18000, range=0..20000 step 500)

# group: Sample Point Generation
# Sample points are generated automatically from the distance field and a set of parameters.
generateSamplePoints = VASA.Pathfinding.DistanceField.GenerateSamplePoints(distanceField=byPathModelAndSourcePoint, spacing=spacing_number_slider, minDiameterOffset=min_diameter_offset_integer, minDistance=minimum_distance_number_slider)

# group: Path Voxels
# Paths are computed between each sample point and the source point. They are then converted into voxels, expanded, and intersected with the set of reachable voxels.
list_create_2 = List.Create()  # unwired: item0, item1
reachableVoxels = VASA.Pathfinding.DistanceField.ReachableVoxels(distanceField=byPathModelAndSourcePoint)
byDistanceFieldAndSamplePoint = VASA.Pathfinding.Path.ByDistanceFieldAndSamplePoint(distanceField=byPathModelAndSourcePoint, samplePoint=generateSamplePoints)
pathVoxels = VASA.Pathfinding.Path.PathVoxels(path=byDistanceFieldAndSamplePoint)
code_block_3 = CodeBlock(agentDiameter=agent_diameter_offset_integer) { agentDiameter; 2*agentDiameter; }
enlarge = VASA.Core.VoxelModel.Enlarge(voxelModel=pathVoxels, lowerXPadding=code_block_3.agentDiameter, upperXPadding=code_block_3.agentDiameter, lowerYPadding=code_block_3.agentDiameter, upperYPadding=code_block_3.agentDiameter, lowerZPadding=code_block_3.agentDiameter, upperZPadding=code_block_3.agentDiameter)
expandHorizontally = VASA.Operations.SurfaceOperations.ExpandHorizontally(voxelModel=enlarge, diameterOffset=code_block_3.out1)
cartesianProduct = List.CartesianProduct(combineFunction=list_create_2, list0=reachableVoxels, list1=expandHorizontally)
code_block_4 = CodeBlock { 1; }
flatten = List.Flatten(list=cartesianProduct, amount=code_block_4)
intersect = VASA.Operations.SolidOperations.Intersect(voxelModels=flatten)

# group: Path Density Map
# A density map is created from the overlapping sets of path voxels. The density map takes the form of a separate voxel model for each density level.
code_block_5 = CodeBlock(pathVoxelModels=intersect)
# ---------- code_block_5.designscript (5 lines) ----------
pathVoxelModels;
count = List.Count(pathVoxelModels);
n = Math.Floor(Math.Sqrt(count));
seq = (1..n..1);
levels = seq*seq;
# ----------------------------------------
densityMap = VASA.Operations.SpecialOperations.DensityMap(voxelModels=code_block_5.pathVoxelModels, levels=code_block_5.levels)
code_block_6 = CodeBlock(levels=code_block_5.levels) { levels; }

# group: Resize Path Density Map
resize = VASA.Core.VoxelModel.Resize(voxelModel=densityMap, newExtents=extents)

# group: Path Density Colors
count = List.Count(list=code_block_6)
code_block_7 = CodeBlock(n=count) { 1..0..#n; }
color_range = ColorRange(value=code_block_7)  # unwired: colors, indices

# group: Display Path Density Map
displayVoxels_2 = VASA.Core.VoxelModel.DisplayVoxels(voxelModel=resize, color=color_range)
