# Dynamo graph 13-VASA-Revit-RAC-Basic-Sample.dyn (Dynamo 2.16.1.2727)
# packages: VASA 0.4.0

# note: Input Variables
# Pink indicates variables that can be altered per project and must be set accordingly before running the script.
# note: Functional Logic
# Cyan indicates the logic of the script. No changes should be made in these groups unless advised.
# note: Output Values
# Orange indicates key resulting values of nodes that should be observed after running the graph.
# note: Display Objects
# Blue indicates objects that can be previewed in the 3D background after running the graph.

# group: VASA Workflow 13: Revit RAC Basic Sample
# note: DYNAMO PROJECT
# 13-VASA-Revit-RAC-Basic-Sample.dyn
# note: ASSOCIATED FILE(S)
# None
# note: AUTHOR(S) / CREATION DATE
# Autodesk Research 2023
# note: DESCRIPTION
# Demonstrates the use of VASA in Dynamo for Revit using the RAC Basic Sample Project. The analysis computes direct daylight for a given sun diraction (Winter Solstice at 1:00 pm) in sheltered (undercover) regions of the model.
# note: REQUIRED DYNAMO PACKAGES
# VASA
# note: ADDITIONAL COMMENTS
# 1. Open the sample project below in Revit:
#         rac_basic_sample_project.rvt
#         To find sample projects, search
#         online for "Revit Sample Project Files"
#         or look in the path below:
#         C:\Program Files\Autodesk\Revit 20XX\Samples
# 2. Select the 3D View named "{3D}".
# 3. Click Manage -> Dynamo.
# 4. Adjust the daylight direction vector and explore.
# note: DYNAMO VERSION
# Dynamo Revit 2.16.1

# group: Revit Geometry
element_types = ElementTypes("Floor")
all_elements_of_type = ElementsOfType(element_type=element_types)
geometry = Element.Geometry(element=all_elements_of_type)
element_types_2 = ElementTypes("Wall")
all_elements_of_type_2 = ElementsOfType(element_type=element_types_2)
geometry_2 = Element.Geometry(element=all_elements_of_type_2)
element_types_3 = ElementTypes("Ceiling")
all_elements_of_type_3 = ElementsOfType(element_type=element_types_3)
geometry_3 = Element.Geometry(element=all_elements_of_type_3)
element_types_4 = ElementTypes("RoofBase")
all_elements_of_type_4 = ElementsOfType(element_type=element_types_4)
geometry_4 = Element.Geometry(element=all_elements_of_type_4)
element_types_5 = ElementTypes("Stairs")
all_elements_of_type_5 = ElementsOfType(element_type=element_types_5)
geometry_5 = Element.Geometry(element=all_elements_of_type_5)
element_types_6 = ElementTypes("BuildingPad")
all_elements_of_type_6 = ElementsOfType(element_type=element_types_6)
geometry_6 = Element.Geometry(element=all_elements_of_type_6)
string = StringInput("Structural Columns")
byName = Category.ByName(name=string)
all_elements_of_category = ElementsOfCategory(Category=byName)
geometry_7 = Element.Geometry(element=all_elements_of_category)
element_types_7 = ElementTypes("TopographySurface")
all_elements_of_type_7 = ElementsOfType(element_class=element_types_7)
geometry_8 = Element.Geometry(element=all_elements_of_type_7)

# group: Building and Topography Geometry
list_create = List.Create(item0=geometry, item1=geometry_2, item2=geometry_3, item3=geometry_4, item4=geometry_5, item5=geometry_6, item6=geometry_7)
flatten = List.Flatten(list=list_create)
code_block = CodeBlock(building=flatten) { building; }
flatten_2 = List.Flatten(list=geometry_8)
string_2 = StringInput("Autodesk.DesignScript.Geometry.Mesh")
removeIfNot = List.RemoveIfNot(list=flatten_2, type=string_2)
code_block_2 = CodeBlock(topography=removeIfNot) { topography; }

# group: Coarse Voxel Width
# Set to 1 meter or 4 feet in project Length units.
# (e.g. Use 1000 if project is in millimeters).
code_block_3 = CodeBlock { 1000; }

# group: Building Voxels
byGeometry = VASA.Core.VoxelModel.ByGeometry(geometry=code_block, coarseVoxelWidth=code_block_3)
union = VASA.Operations.SolidOperations.Union(voxelModels=byGeometry)

# group: Building Voxel Color
color_palette = ColorPalette({R: 255, G: 255, B: 255, A: 63})

# group: Display Building Voxels
displayVoxels = VASA.Core.VoxelModel.DisplayVoxels(voxelModel=union, color=color_palette)

# group: Building Geometry Color
color_palette_2 = ColorPalette({R: 255, G: 255, B: 255, A: 127})

# group: Display Building Geometry
byGeometryColor = Modifiers.GeometryColor.ByGeometryColor(geometry=code_block, color=color_palette_2)

# group: Topography Triangles
fromMesh = VASA.Utils.TrianglesAsNineNumbers.FromMesh(mesh=code_block_2)

# group: Topography Voxels
byTriangles = VASA.Core.VoxelModel.ByTriangles(trianglesAsNineNumbers=fromMesh, coarseVoxelWidth=code_block_3)
union_2 = VASA.Operations.SolidOperations.Union(voxelModels=byTriangles)

# group: Topography Voxel Color
color_palette_3 = ColorPalette({R: 143, G: 188, B: 143, A: 31})

# group: Display Topography Voxels
displayVoxels_2 = VASA.Core.VoxelModel.DisplayVoxels(voxelModel=union_2, color=color_palette_3)

# group: Daylight Blocking Voxels
list_create_2 = List.Create(item0=union, item1=union_2)
union_3 = VASA.Operations.SolidOperations.Union(voxelModels=list_create_2)

# group: Daylight Direction
code_block_4 = CodeBlock { 30.6; 87.6; -37.4; }
byCoordinates = Vector.ByCoordinates(x=code_block_4.out0, y=code_block_4.out1, z=code_block_4.out2)

# group: Daylight Voxels
visibilityFromDirection = VASA.Operations.VisibilityOperations.VisibilityFromDirection(voxelModel=union_3, direction=byCoordinates)

# group: Excluded Voxels
code_block_5 = CodeBlock(daylightBlockingVoxels=union_3) { daylightBlockingVoxels; }
ZAxis = Vector.ZAxis()
visibilityFromDirection_2 = VASA.Operations.VisibilityOperations.VisibilityFromDirection(voxelModel=code_block_5, direction=ZAxis)
ZAxis_2 = Vector.ZAxis()
reverse = Vector.Reverse(vector=ZAxis_2)
visibilityFromDirection_3 = VASA.Operations.VisibilityOperations.VisibilityFromDirection(voxelModel=code_block_5, direction=reverse)
list_create_3 = List.Create(item0=visibilityFromDirection_2, item1=visibilityFromDirection_3)
union_4 = VASA.Operations.SolidOperations.Union(voxelModels=list_create_3)

# group: Sheltered Daylight Voxels
subtract = VASA.Operations.SolidOperations.Subtract(voxelModel0=visibilityFromDirection, voxelModel1=union_4)

# group: Sheltered Daylight Voxel Color
color_palette_4 = ColorPalette({R: 255, G: 255, B: 10, A: 255})

# group: Display Sheltered Daylight Voxels
displayVoxels_3 = VASA.Core.VoxelModel.DisplayVoxels(voxelModel=subtract, color=color_palette_4)
