# Dynamo graph spaceanalysis-visibility-04-one-point-view-cone.dyn (Dynamo 2.17.0.3472)
# packages: SpaceAnalysis 0.5.0

# note: Variables / Inputs
# Variables that can be altered per project and must be set accordingly before running the script.
# note: Working / Functions
# Core working of the script.
# note: Display / Visualization
# Logic used simply for visualization purposes, and doesn't contain core logic.

# group: Visibility - One Point View Cone
# note: DYNAMO PROJECT
# spaceanalysis-visibility-04-one-point-view-cone.dyn
# note: ASSOCIATED FILE(S)
# N/A
# note: AUTHOR(S) / CREATION DATE
# Autodesk Research / 2021
# note: DESCRIPTION
# Simple visibility example displaying global visibility values within a view cone
# note: DYNAMO VERSION
# 2.17.0
# note: ADDITIONAL COMMENTS
# N/A
# note: REQUIRED DYNAMO PACKAGES
# SpaceAnalysis

# group: View Point & Direction Point
number_slider = DoubleSlider(8.157, range=-8.677..100 step 0.1)
number_slider_2 = DoubleSlider(16.339, range=-2.512..100 step 0.1)
byCoordinates = Point.ByCoordinates(x=number_slider, y=number_slider_2)
number_slider_3 = DoubleSlider(4.062, range=-8.091..100 step 0.1)
number_slider_4 = DoubleSlider(6.981, range=-15.703..100 step 0.1)
byCoordinates_2 = Point.ByCoordinates(x=number_slider_3, y=number_slider_4)

# group: Display View and Direction Point Markers
code_block = CodeBlock { 0.25; }
byCenterPointRadius = Circle.ByCenterPointRadius(centerPoint=byCoordinates, radius=code_block)
color_palette = ColorPalette({R: 255, G: 0, B: 255, A: 255})
byGeometryColor = Modifiers.GeometryColor.ByGeometryColor(geometry=byCenterPointRadius, color=color_palette)
code_block_2 = CodeBlock { 0.25; }
byCenterPointRadius_2 = Circle.ByCenterPointRadius(centerPoint=byCoordinates_2, radius=code_block_2)
color_palette_2 = ColorPalette({R: 0, G: 191, B: 255, A: 255})
byGeometryColor_2 = Modifiers.GeometryColor.ByGeometryColor(geometry=byCenterPointRadius_2, color=color_palette_2)
byStartPointEndPoint = Line.ByStartPointEndPoint(startPoint=byCoordinates_2, endPoint=byCoordinates)
byGeometryColor_3 = Modifiers.GeometryColor.ByGeometryColor(geometry=byStartPointEndPoint, color=color_palette_2)

# group: Outer Boundary
code_block_3 = CodeBlock { [0, 20, 20, 0]; }
code_block_4 = CodeBlock { [0, 0, 40, 40]; }
byCoordinates_3 = Point.ByCoordinates(x=code_block_3, y=code_block_4)
code_block_5 = CodeBlock { [20, 20, 0, 0]; }
code_block_6 = CodeBlock { [0, 40, 40, 0]; }
byCoordinates_4 = Point.ByCoordinates(x=code_block_5, y=code_block_6)
byStartPointEndPoint_2 = Line.ByStartPointEndPoint(startPoint=byCoordinates_3, endPoint=byCoordinates_4)

# group: Internal Boundary
number_slider_5 = DoubleSlider(14.077, range=-5.692..100 step 0.1)
number_slider_6 = DoubleSlider(34.046, range=-16.8..100 step 0.1)
byCoordinates_5 = Point.ByCoordinates(x=number_slider_5, y=number_slider_6)
number_slider_7 = DoubleSlider(3.802, range=-6.882..100 step 0.1)
number_slider_8 = DoubleSlider(31.917, range=-5.141..100 step 0.1)
byCoordinates_6 = Point.ByCoordinates(x=number_slider_7, y=number_slider_8)
byStartPointEndPoint_3 = Line.ByStartPointEndPoint(startPoint=byCoordinates_5, endPoint=byCoordinates_6)

# group: Internal Boundary
number_slider_9 = DoubleSlider(15.498, range=-5.692..100 step 0.1)
number_slider_10 = DoubleSlider(25.865, range=-16.8..100 step 0.1)
byCoordinates_7 = Point.ByCoordinates(x=number_slider_9, y=number_slider_10)
number_slider_11 = DoubleSlider(5.918, range=-6.882..100 step 0.1)
number_slider_12 = DoubleSlider(21.587, range=-5.141..100 step 0.1)
byCoordinates_8 = Point.ByCoordinates(x=number_slider_11, y=number_slider_12)
byStartPointEndPoint_4 = Line.ByStartPointEndPoint(startPoint=byCoordinates_7, endPoint=byCoordinates_8)

join = List.Join(list0=byStartPointEndPoint_3, list1=byStartPointEndPoint_4)
code_block_7 = CodeBlock(lines=join) { lines; }

# group: Create SpaceLattice
byGeometry = BoundingBox.ByGeometry(geom=byStartPointEndPoint_2)
code_block_8 = CodeBlock { 1; }
byBoundingBoxAndLines = SpaceAnalysis.Core.SpaceLattice.ByBoundingBoxAndLines(boundingBox=byGeometry, barriers=code_block_7, resolution=code_block_8)

byTwoPoints = Vector.ByTwoPoints(start=byCoordinates_2, end=byCoordinates)

# group: View Cone
number_slider_13 = DoubleSlider(90, range=0..360 step 1)
number_slider_14 = DoubleSlider(25, range=0..100 step 1)
number_slider_15 = DoubleSlider(0.25, range=0..1 step 0.01)
number_slider_16 = DoubleSlider(0.75, range=0..1 step 0.01)
byViewPointAndViewDirection = SpaceAnalysis.Visibility.ViewCone.ByViewPointAndViewDirection(viewPoint=byCoordinates_2, viewDirection=byTwoPoints, angularWidth=number_slider_13, radialDepth=number_slider_14, angularSmoothness=number_slider_15, radialSmoothness=number_slider_16)

points = SpaceAnalysis.Core.SpaceLattice.Points(spaceLattice=byBoundingBoxAndLines)

# group: Create VisibilityGrid
bySpaceLatticeAndViewCone = SpaceAnalysis.Visibility.ViewField.BySpaceLatticeAndViewCone(spaceLattice=byBoundingBoxAndLines, viewCone=byViewPointAndViewDirection)
byViewField = SpaceAnalysis.Visibility.VisibilityGrid.ByViewField(viewField=bySpaceLatticeAndViewCone)
valueAtPoint = SpaceAnalysis.Visibility.VisibilityGrid.ValueAtPoint(visibilityGrid=byViewField, point=points)

surface = SpaceAnalysis.Core.SpaceLattice.Surface(spaceLattice=byBoundingBoxAndLines)

# group: Display Values of the VisibilityGrid
code_block_9 = CodeBlock(inputValues=valueAtPoint, surface=surface) { inputValues; surface; }
code_block_10 = CodeBlock()
# ---------- code_block_10.designscript (10 lines) ----------
a = 100;
DSCore.Color.ByARGB(a,0, 0, 4);
DSCore.Color.ByARGB(a,28, 16, 68);
DSCore.Color.ByARGB(a,79, 18, 123);
DSCore.Color.ByARGB(a,129, 37, 129);
DSCore.Color.ByARGB(a,181, 54, 122);
DSCore.Color.ByARGB(a,229, 89, 100);
DSCore.Color.ByARGB(a,251, 135, 97);
DSCore.Color.ByARGB(a,254, 194, 135);
DSCore.Color.ByARGB(a,251, 253, 191);
# ----------------------------------------
list_create = List.Create(item0=code_block_10.out1, item1=code_block_10.out2, item2=code_block_10.out3, item3=code_block_10.out4, item4=code_block_10.out5, item5=code_block_10.out6, item6=code_block_10.out7, item7=code_block_10.out8, item8=code_block_10.out9)
code_block_11 = CodeBlock { 0..1..#9; }
code_block_12 = CodeBlock { 0.25; 0.75; }
map = Math.Map(rangeMin=code_block_12.out0, rangeMax=code_block_12.out1, inputValue=code_block_9.inputValues)
color_range = ColorRange(colors=list_create, indices=code_block_11, value=map)
bySurfaceColors = Modifiers.GeometryColor.BySurfaceColors(surface=code_block_9.surface, colors=color_range)

# group: Display Lattice as Edges
edges = SpaceAnalysis.Core.SpaceLattice.Edges(spaceLattice=byBoundingBoxAndLines)
color_palette_3 = ColorPalette({R: 50, G: 205, B: 50, A: 98})
byGeometryColor_4 = Modifiers.GeometryColor.ByGeometryColor(geometry=edges, color=color_palette_3)
