# Dynamo custom node Element.GetInstanceOrTypeParameterValueByName.dyf (Dynamo 1.0.0.1180)
# category: Zebra.Revit
# Retrieves both the instance or type parameter from an element

element = Input()
empty = List.Empty()
addItemToFront = List.AddItemToFront(item=element, list=empty)
flatten = Flatten(addItemToFront)
python_script = Python(IN[0]=flatten)
# ---------- python_script.python (17 lines) ----------
import clr
clr.AddReference('RevitAPI')
from Autodesk.Revit.DB import *

clr.AddReference("RevitServices")
import RevitServices
from RevitServices.Persistence import DocumentManager

doc = DocumentManager.Instance.CurrentDBDocument
items = UnwrapElement(IN[0])
typelist = list()
for item in items:
	try: 
		typelist.append(doc.GetElement(item.GetTypeId()))
	except:
		typelist.append(list())
OUT = typelist
# ----------------------------------------
parameters = Element.Parameters(python_script)
string_from_object = FromObject(parameters)
code_block = CodeBlock { " : "; true; }
removeAfterCharacters = Custom[String.RemoveAfterCharacters](String=string_from_object, Characters=code_block.out0, includeChar=code_block.out1)  # Removes the part of the string after the input character/s
parameter = Input()
eq = removeAfterCharacters == parameter
code_block_2 = CodeBlock(x=eq) { x[0]; }
code_block_3 = CodeBlock(lst=code_block_2) { !(AllFalse(lst)); }
getParameterValueByName = Element.GetParameterValueByName(element=python_script, parameterName=parameter)
getParameterValueByName_2 = Element.GetParameterValueByName(element=element, parameterName=parameter)
if_ = If(test=code_block_3, true=getParameterValueByName, false=getParameterValueByName_2)
count = List.Count(if_)
code_block_4 = CodeBlock(input=count) { input>1; }
firstItem = List.FirstItem(if_)
if_2 = Custom[Logic.If](test=code_block_4, ifTrue=if_, ifFalse=firstItem)  # Retains the old status of the previous built-in IF node.
var = Output(if_2)  # "var[]..[]"
