# Dynamo custom node String.ChangeAllCharactersTo.dyf (Dynamo 0.8.0.950)
# category: Zebra.Core.String.Action
# Changes all the given characters to the new value

String = Input()
ChangeFrom = Input()
ChangeTo = Input()
replace = String.Replace(str=String, searchFor=ChangeFrom, replaceWith=ChangeTo)
String_2 = Output(replace)  # "String"
