# Dynamo custom node String.ConvertNumberToCharacter.dyf (Dynamo 0.9.0.3067)
# category: Zebra.Core.String.Action
# Returns the letter in the alphabet at the desired index. 1 = A, 2 = B, 3 = C ... 26 = Z etc

upperCase = Input(upperCase : bool = false)
code_block = CodeBlock { "Please choose a number between 1 and 26"; }
alphabetAsList = Custom[String.AlphabetAsList]()  # Creates the alphabet as a list of strings
addItemToFront = List.AddItemToFront(item=code_block, list=alphabetAsList.LowerString)
Number = Input()
getItemAtIndex = List.GetItemAtIndex(list=addItemToFront, index=Number)
isNull = Object.IsNull()
replaceByCondition = Replace(getItemAtIndex, code_block, isNull)
toUpper = String.ToUpper(replaceByCondition)
if_ = Custom[Logic.If](test=upperCase, ifTrue=toUpper, ifFalse=replaceByCondition)  # Retains the old status of the previous built-in IF node.
Character = Output(if_)
