# Dynamo custom node String.FromAsciiSymbolTo.dyf (Dynamo 0.8.0.950)
# category: Zebra.Core.String.Action
# Converts the ASCII symbol to its equivalent description, decimal code, hexadecimal code, binary code, and octal code.

asciiSymbol = Custom[String.AsciiSymbol]()  # Creates the ASCII symbols as string
toNumber = String.ToNumber(asciiSymbol)
asciiBinaryCode = Custom[String.AsciiBinaryCode]()  # Creates the binary codes as string
asciiDecimalCode = Custom[String.AsciiDecimalCode]()  # Creates the decimal codes as string
asciiOctalCode = Custom[String.AsciiOctalCode]()  # Creates the octal codes as string
asciiHexadecimalCode = Custom[String.AsciiHexadecimalCode]()  # Creates the hexadecimal codes as string
asciiDescription = Custom[String.AsciiDescription]()  # Creates the ASCII description as string
create = List.Create(asciiBinaryCode, asciiDecimalCode, asciiOctalCode, asciiHexadecimalCode, asciiDescription)
transpose = List.Transpose(create)
Sym = Input()
eq = asciiSymbol == Sym
filterByBoolMask = List.FilterByBoolMask(list=transpose, mask=eq)
code_block = CodeBlock { 4; }
getItemAtIndex = List.GetItemAtIndex(index=code_block)
map = List.Map(list=filterByBoolMask.in, f_x=getItemAtIndex)
Des = Output(map)
code_block_2 = CodeBlock { 1; }
getItemAtIndex_2 = List.GetItemAtIndex(index=code_block_2)
map_2 = List.Map(list=filterByBoolMask.in, f_x=getItemAtIndex_2)
Dec = Output(map_2)
code_block_3 = CodeBlock { 2; }
getItemAtIndex_3 = List.GetItemAtIndex(index=code_block_3)
map_3 = List.Map(list=filterByBoolMask.in, f_x=getItemAtIndex_3)
Oct = Output(map_3)
code_block_4 = CodeBlock { 3; }
getItemAtIndex_4 = List.GetItemAtIndex(index=code_block_4)
map_4 = List.Map(list=filterByBoolMask.in, f_x=getItemAtIndex_4)
Hex = Output(map_4)
code_block_5 = CodeBlock { 0; }
getItemAtIndex_5 = List.GetItemAtIndex(index=code_block_5)
map_5 = List.Map(list=filterByBoolMask.in, f_x=getItemAtIndex_5)
Bin = Output(map_5)
