# Dynamo custom node String.RemoveAfterCharacters.dyf (Dynamo 0.9.0.3067)
# category: Zebra.Core.String.Action
# Removes the part of the string after the input character/s

includeChar = Input(includeChar : bool = false)
String = Input()
Characters = Input()
ignoreCase = Input(ignoreCase : bool = true)
indexOf = String.IndexOf(string=String, searchFor=Characters, ignoreCase=ignoreCase)
length = String.Length(Characters)
code_block = CodeBlock(x=indexOf, len=length) { x + len; }
length_2 = String.Length(String)
code_block_2 = CodeBlock(x=length_2, si=code_block) { x-si; }
remove = String.Remove(str=String, startIndex=code_block, count=code_block_2)
indexOf_2 = String.IndexOf(string=remove, searchFor=Characters, ignoreCase=ignoreCase)
code_block_3 = CodeBlock(x=Characters) { String.Length(x); }
remove_2 = String.Remove(str=remove, startIndex=indexOf_2, count=code_block_3)
if_ = Custom[Logic.If](test=includeChar, ifTrue=remove_2, ifFalse=remove)  # Retains the old status of the previous built-in IF node.
String_2 = Output(if_)  # "String"
