# Dynamo custom node [&] Misc.ChainOfCircles.dyf (Dynamo 2.10.1.3976)
# category: Ampersand
# Find a series of tangent circles with the given radii whose centers lie along a curve.

# note: Colin McCrone
# Twitter:  @ColinMcCrone
# LinkedIn: https://www.linkedin.com/in/colinmccrone
# Updated:  2021-05-26
# An example Dynamo script for how to use this node can be found in the 'extra' folder where the package files are stored. To find it, go to the Packages Menu and select "Manage Packages." Where Ampersand is listed, open the drop-down menu link at the right and choose "Show Root Directory." Open the "extra" folder to find the example file called AmpersandExamples.dyn.
baseCurve = Input(baseCurve: Autodesk.DesignScript.Geometry.Curve)
radii = Input(radii: double[])
startParam = Input(startParam: double = 0)
python_script = Python(IN[0]=baseCurve, IN[1]=radii, IN[2]=startParam)  # CPython3
# ---------- python_script.python (43 lines) ----------
#
# Colin McCrone
# Twitter:  https://twitter.com/colinmccrone
# LinkedIn: https://www.linkedin.com/in/colinmccrone
# Updated:  2019-05-20
#
import clr
clr.AddReference('ProtoGeometry')
from Autodesk.DesignScript.Geometry import *

# Inputs
crv = IN[0]
radii = IN[1]
startParam = IN[2]

# Chord lengths between center points
chordLengths = []
chordLengths.append(0)
for i in range(len(radii)-1):
	chordLengths.append(radii[i] + radii[i+1])

# Circle center point parameters
cntrParams = []
cntrParams.append(startParam)
lastParam = startParam
for i in range(1,len(chordLengths)):
	dist = chordLengths[i]
	param = (crv.ParameterAtChordLength(dist,lastParam,True))
	cntrParams.append(param)
	lastParam = param

# Center points
cntrPoints = []
for i in range(len(radii)):
	cntrPoints.append(crv.PointAtParameter(cntrParams[i]))

# Circles
rings = []
for i in range(len(radii)):
	rings.append(Circle.ByCenterPointRadius(cntrPoints[i],radii[i]))

# Output circles
OUT = rings
# ----------------------------------------
circles = Output(python_script)
