# Dynamo custom node [&] Misc.Pentagram.dyf (Dynamo 2.10.1.3976)
# category: Ampersand
# Closed polycurve in the shape of a 5-pointed star.

# note: Colin McCrone
# Twitter:  @ColinMcCrone
# LinkedIn: https://www.linkedin.com/in/colinmccrone
# Updated:  2021-05-26
# An example Dynamo script for how to use this node can be found in the 'extra' folder where the package files are stored. To find it, go to the Packages Menu and select "Manage Packages." Where Ampersand is listed, open the drop-down menu link at the right and choose "Show Root Directory." Open the "extra" folder to find the example file called AmpersandExamples.dyn.
centerPoint = Input(centerPoint: Autodesk.DesignScript.Geometry.Point = Autodesk.DesignScript.Geometry.Point.ByCoordinates(0, 0, 0))
radius = Input(radius: double = 10)
byCoordinates = Vector.ByCoordinates(y=radius)
ZAxis = Vector.ZAxis()
code_block = CodeBlock { 0..#5..(360/5); }
rotate = Vector.Rotate(vector=byCoordinates, axis=ZAxis, degrees=code_block)
add = Point.Add(point=centerPoint, vectorToAdd=rotate)
code_block_2 = CodeBlock(R=radius) { R * Math.Sin(18)/Math.Cos(36); }
byCoordinates_2 = Vector.ByCoordinates(y=code_block_2)
code_block_3 = CodeBlock { 36..#5..(360/5); }
rotate_2 = Vector.Rotate(vector=byCoordinates_2, axis=ZAxis, degrees=code_block_3)
add_2 = Point.Add(point=centerPoint, vectorToAdd=rotate_2)
list_create = List.Create(item0=add, item1=add_2)
transpose = List.Transpose(lists=list_create)
flatten = List.Flatten(list=transpose)
boolean = BoolSelector(true)
byPoints = PolyCurve.ByPoints(points=flatten, connectLastToFirst=boolean)
polyCurve = Output(byPoints)
