# Dynamo custom node Atmos.SlattedFacade.SurfaceDistrubtion.dyf (Dynamo 1.3.0.875)
# category: Atmos.Geometry.SlattedFacade
# This node will take an input surface and replicate said surface across a Surface Distribution Grid.

originSrf = Input(originSrf : Surface)  # Origin Surface.
perimeterCurves = Surface.PerimeterCurves(originSrf)
flatten = Flatten(perimeterCurves)
code_block = CodeBlock { 0.5; 0; 1; }
pointAtParameter = Curve.PointAtParameter(curve=flatten, param=code_block.out0)
Z = Point.Z(pointAtParameter)
minimumItem = List.MinimumItem(Z)
eq = Z == minimumItem
filterByBoolMask = List.FilterByBoolMask(list=flatten, mask=eq)
pointAtParameter_2 = Curve.PointAtParameter(curve=filterByBoolMask.in, param=code_block.out0)
length = Curve.Length(flatten)
maximumItem = List.MaximumItem(length)
optionAmount = Input(optionAmount : int = 4)  # Option Amount: Strongly advisable that cap is set at 8.
code_block_2 = CodeBlock(max=maximumItem, amt=optionAmount) { xDist = (max + (max * 0.1)) * amt; yDist = (max / 3) * amt; }
code_block_3 = CodeBlock(xDist=code_block_2.xDist, amt=optionAmount, yDist=code_block_2.yDist) { gridX = -xDist/2..xDist/2..#amt; gridY = -yDist/2..yDist/2..#amt; }
byOrigin = CoordinateSystem.ByOrigin(code_block_3.gridX, code_block_3.gridY, lacing=CrossProduct)
origin = CoordinateSystem.Origin(byOrigin)
byTwoPoints = Vector.ByTwoPoints(start=pointAtParameter_2, end=origin, lacing=Longest)
translate = Geometry.Translate(geometry=originSrf, direction=byTwoPoints, lacing=Longest)
flatten_2 = Flatten(translate)
srfs = Output(flatten_2)
flatten_3 = Flatten(byTwoPoints)
optionVectors = Output(flatten_3)
pointAtParameter_3 = Curve.PointAtParameter(curve=filterByBoolMask.in, param=code_block.out1)
pointAtParameter_4 = Curve.PointAtParameter(curve=filterByBoolMask.in, param=code_block.out2)
byTwoPoints_2 = Vector.ByTwoPoints(start=pointAtParameter_3, end=pointAtParameter_4)
flatten_4 = Flatten(byTwoPoints_2)
originVector = Output(flatten_4)
filterByBoolMask_2 = List.FilterByBoolMask(list=pointAtParameter, mask=eq)
flatten_5 = Flatten(filterByBoolMask_2.in)
originPoint = Output(flatten_5)
