# Dynamo custom node Atmos.XY.pointsDistribution.dyf (Dynamo 0.9.0.3067)
# category: Atmos.XYPlaneNodes
# Creates a points distribution based off divisions across the XY Plane from a selection of Revit Model lines

modelLines = Input()
curves = Element.Curves(modelLines)
byJoinedCurves = PolyCurve.ByJoinedCurves(curves)
code_block = CodeBlock(t3=modelLines)
# ---------- code_block.designscript (29 lines) ----------
t2 = t3.Curves;
t4 = t2.ToNurbsCurve();
t5 = t4.EndPoint;
t6 = Flatten(t5);
t7 = t4.StartPoint;
t8 = Flatten(t7);
t9 = t4.ControlPoints();
t10 = Flatten(t9);
t11 = {t6, t8, t10};
t12 = Flatten(t11);
t13 = Point.PruneDuplicates(t12, 0.001);
t14 = t13.X;
t15 = List.MaximumItem(t14);
t16 = t13.Y;
t17 = List.MinimumItem(t16);
t18 = Point.ByCoordinates(t15, t17, 0);
t19 = List.MinimumItem(t14);
t20 = Point.ByCoordinates(t19, t17, 0);
t21 = List.MaximumItem(t16);
t22 = Point.ByCoordinates(t19, t21, 0);
t23 = Point.ByCoordinates(t15, t21, 0);
t24 = {t18, t20, t22, t23};
t25 = Rectangle.ByCornerPoints(t24);
t26 = t25.Curves();
t27 = t26.PointAtParameter(0.5);
t28 = t26.EndPoint;
t29 = Line.ByStartPointEndPoint(t18, t22);
t30 = Line.ByStartPointEndPoint(t23, t20);
t31 = t29.Intersect(t30);
# ----------------------------------------
resolution = Input(resolution: int = 20)
code_block_2 = CodeBlock(divs=resolution) { 0..1..#divs; }
clashThickness = Input(clashThickness: int = 2500)
code_block_3 = CodeBlock(BaseElementCurves=byJoinedCurves, rectangle=code_block.t25, Divisons=code_block_2, ClashThickness=clashThickness)
# ---------- code_block_3.designscript (31 lines) ----------
//Input elements
bec=BaseElementCurves;
frame=rectangle.Curves();
divs=Divisons;
clT = ClashThickness;
//Conversions
bec0=PolyCurve.ByJoinedCurves(bec);
surface0=Surface.ByPatch(bec0);
surface1 = surface0.Thicken(clT,true);
//Picking off the Sub-Elements
side0=frame[0];
side1=frame[1];
side2=frame[2];
side3=frame[3];
//Points at Parameter
p0=side0.PointAtParameter(divs);
p1=side1.PointAtParameter(divs);
p2=side2.PointAtParameter(divs);
p3=side3.PointAtParameter(divs);
//Reversing the alternate lists
rp1=List.Reverse(p2);
rp3=List.Reverse(p3);
//Creating lines from said points lists
line0=Line.ByStartPointEndPoint(p0,rp1);
line1=Line.ByStartPointEndPoint(p1,rp3);
//Cleaning up the lists
cline0 = List.Clean(line0,false);
cline1 = List.Clean(line1,false);
//Doing an intersect
srfintersect0=Flatten(cline0.Intersect(surface1));
lineintersect0=Flatten(srfintersect0.Intersect(cline1<1><2>));
# ----------------------------------------
code_block_4 = CodeBlock(inp=code_block_3.lineintersect0)
# ---------- code_block_4.designscript (11 lines) ----------
precision = 0.01;

px = inp.X;
py = inp.Y;
pz = inp.Z;

ppx = Math.Round(px/precision)*precision;
ppy = Math.Round(py/precision)*precision;
ppz = Math.Round(pz/precision)*precision;

pp = Point.ByCoordinates(ppx,ppy,ppz);
# ----------------------------------------
X = Point.X()
sortByFunction = SortByFunction(code_block_4.pp, X)
X_2 = Point.X()
groupByFunction = GroupByFunction(sortByFunction, X_2)
groupedPointList = Output(groupByFunction)
singlePointList = Output(code_block_4.pp)
centroid = Output(code_block.t31)
