# Dynamo custom node CopyWorksheet.dyf (Dynamo 2.3.0.5885)
# category: archilab_Bumblebee.Write
# This node creates a copy of the existing Excel Worksheet.

filePath = Input(filePath: string = null)  # FilePath to Excel file on drive. Leave empty to access Excel in "live mode".
RunIt = Input(RunIt: bool = false)  # Set to "true" to execute this node.
from_ = Input(_from: string)  # Sheet "From" is a name of the Worksheet to be copied.
to = Input(_to: var[]..[])  # Sheets "To" is a single or a list of Sheets that will be created from the template sheet.
python_script = Python(IN[0]=filePath, IN[1]=RunIt, IN[2]=from_, IN[3]=to)
# ---------- python_script.python (157 lines) ----------
# Copyright(c) 2019, David Mans, Konrad Sobon
# @arch_laboratory, http://archi-lab.net, http://neoarchaic.net

import clr
import sys
import System
from System import Array
from System.Collections.Generic import *

clr.AddReferenceByName('Microsoft.Office.Interop.Excel, Version=11.0.0.0, Culture=neutral, PublicKeyToken=71e9bce111e9429c')
from Microsoft.Office.Interop import Excel
System.Threading.Thread.CurrentThread.CurrentCulture = System.Globalization.CultureInfo("en-US")
from System.Runtime.InteropServices import Marshal

pyt_path = r'C:\Program Files (x86)\IronPython 2.7\Lib'
sys.path.append(pyt_path)
from os import path

assemblies = System.AppDomain.CurrentDomain.GetAssemblies()
path1 = [a.Location for a in assemblies if 'bumblebee,' in a.FullName][0]
path2 = System.IO.Path.GetDirectoryName(path1).rsplit('\\',1)[0]
bb_path = '%s\\extra\\' %path2
sys.path.append(bb_path)
import bumblebee as bb

#The inputs to this node will be stored as a list in the IN variable.
dataEnteringNode = IN

filePath = IN[0]
runMe = IN[1]
wsFromName = IN[2]
wsToName = IN[3]

if filePath != None:
	if filePath.GetType() == System.IO.FileInfo:
		filePath = filePath.FullName
	
def SetUp(xlApp):
	# supress updates and warning pop ups
	xlApp.Visible = False
	xlApp.DisplayAlerts = False
	xlApp.ScreenUpdating = False
	return xlApp

def ExitExcel(filePath, xlApp, wb, ws):
	def CleanUp(_list):
		if isinstance(_list, list):
			for i in _list:
				Marshal.ReleaseComObject(i)
		else:
			Marshal.ReleaseComObject(_list)
		return None
	
	wb.SaveAs(unicode(filePath))
	xlApp.ActiveWorkbook.Close(False)
	xlApp.ScreenUpdating = True
	CleanUp([ws,wb,xlApp])
	return None

def LiveStream():
	try:
		xlApp = Marshal.GetActiveObject("Excel.Application")
		xlApp.Visible = True
		xlApp.DisplayAlerts = False
		return xlApp
	except:
		return None

if runMe:
	try:
		errorReport = None
		if filePath == None:
			# run excel in a live mode
			xlApp = LiveStream()
			# if excel is running and data is being written to single sheet
			if not isinstance(wsToName, list):
				wb = xlApp.ActiveWorkbook
				wsFrom = xlApp.Sheets(wsFromName)
				if wsFrom == None:
					raise Exception("Worksheet to copy from could not be found.")
				wsTo = None
				try:
					wsTo = xlApp.Sheets(wsToName)
				except:
					pass
				if wsTo == None:
					wsFrom.Copy(After = wsFrom)
					wb.ActiveSheet.Name = wsToName
			# if excel is running and data is being written to multiple sheets
			else:
				wb = xlApp.ActiveWorkbook
				wsFrom = xlApp.Sheets(wsFromName)
				if wsFrom == None:
					raise Exception("Worksheet to copy from could not be found.")
				currentWs = wsFrom
				for i in wsToName:
					wsTo = None
					try:
						wsTo = xlApp.Sheets(i)
					except:
						pass
					if wsTo == None:
						wsFrom.Copy(After = currentWs)
						wb.ActiveSheet.Name = i
						currentWs = xlApp.Sheets(i)
		else:
			try:
				xlApp = SetUp(Excel.ApplicationClass())
				# if excel is closed and data is being written to single sheet
				if not isinstance(wsToName, list):
					xlApp.Workbooks.open(unicode(filePath))
					wb = xlApp.ActiveWorkbook
					wsFrom = xlApp.Sheets(wsFromName)
					if wsFrom == None:
						raise Exception("Worksheet to copy from could not be found.")
					wsTo = None
					try:
						wsTo = xlApp.Sheets(wsToName)
					except:
						pass
					if wsTo == None:
						wsFrom.Copy(After = wsFrom)
						wb.ActiveSheet.Name = wsToName
					ExitExcel(filePath, xlApp, wb, wsFrom)
				# if excel is closed and data is being written to multiple sheets
				else:
					xlApp.Workbooks.open(unicode(filePath))
					wb = xlApp.ActiveWorkbook
					wsFrom = xlApp.Sheets(wsFromName)
					if wsFrom == None:
						raise Exception("Worksheet to copy from could not be found.")
					currentWs = wsFrom
					for i in wsToName:
						wsTo = None
						try:
							wsTo = xlApp.Sheets(i)
						except:
							pass
						if wsTo == None:
							wsFrom.Copy(After = currentWs)
							wb.ActiveSheet.Name = i
							currentWs = xlApp.Sheets(i)
					ExitExcel(filePath, xlApp, wb, wsFrom)
			except:
				xlApp.Quit()
				Marshal.ReleaseComObject(xlApp)
	except:
			# if error accurs anywhere in the process catch it
			import traceback
			errorReport = traceback.format_exc()
else:
	errorReport = "Run Me is set to False. Please set \nto True if you wish to write data \nto Excel."

if errorReport == None:
	OUT = "Success!"
else:
	OUT = errorReport
# ----------------------------------------
Output = Output(python_script)  # ""
