# Dynamo custom node Document.ActiveViewFromCurrentDocument.dyf (Dynamo 2.18.1.5096)
# category: Clockwork.Revit.Application.Query
# Gets the active view of the current document

current = Document.Current()
activeView = Document.ActiveView(document=current)
View = Output(activeView)
