# Dynamo custom node UIMessenger.dyf "© UI.Messenger" (Dynamo 2.18.1.5096)
# category: Crumple.Script.Create
# Displays a message box with a title/body and OK/cancel button. If OK is selected, the third input's data will be passed through.

title = Input(title: string)  # Title of the UI.
body = Input(body: string)  # Body text of the UI.
pass_ = Input(pass: var[]..[] = null)  # Data to pass through
python_script = Python(IN[0]=title, IN[1]=body, IN[2]=pass_)  # IronPython2
# ---------- python_script.python (23 lines) ----------
# Made by Gavin Crump
# Free for use
# BIM Guru, www.bimguru.com.au

# Boilerplate text
import clr
clr.AddReference("RevitAPIUI")
from Autodesk.Revit.UI import *

# Preparing input from dynamo to revit
title = IN[0]
body  = IN[1]
passt = IN[2]

# Build and show the task dialogue
msg = TaskDialog.Show(title, body,
TaskDialogCommonButtons.Ok|TaskDialogCommonButtons.Cancel,TaskDialogResult.Cancel)

# Check if passing the result
if msg == TaskDialogResult.Ok:
	OUT = passt
else:
	OUT = None
# ----------------------------------------
result = Output(python_script)  # Passed through data. If canceled, will be null.
