# Dynamo custom node JetGroutingBySection.dyf (Dynamo 1.3.2.2480)
# category: DynaTools.Civil.Tunnel

# group: Input
CreateSolid = Input(CreateSolid : bool = true)
SectionFamily = Input(SectionFamily : FamilyType)  # Select the section to be used as reference for jet grouting
CleranceOffset = Input(CleranceOffset : double = 2.5)  # Define the clearance offset from the tunnel section to be considered with jet grouting
LineExtension = Input(LineExtension : double = 8)  # Define the bottom extension line to draw the horizontal section
UpSectionLevel = Input(UpSectionLevel : double)  # Define the up level offset from the center axes
FocusPointX = Input(FocusPointX : double)  # Define the vertical offset of the focus point, from the center axes
FocusPointY = Input(FocusPointY : double)  # Define the horizontal offset of the focus point, from the center axes
MinimumDistanceBetweenAxes = Input(MinimumDistanceBetweenAxes: double = 1.5)  # Define the minimum distance between jet grouting axes at the bottom level
BottomSectionLevel = Input(BottomSectionLevel : double = 10)  # Define the bottom level offset from the center axes
Tolerance = Input(Tolerance : double)  # TBC
cs = Input(cs : CoordinateSystem)

# group: Main Section
origin = Point.Origin()
byPoint = FamilyInstance.ByPoint(familyType=SectionFamily, point=origin)
curves = Element.Curves(byPoint)
byJoinedCurves = PolyCurve.ByJoinedCurves(curves)

# group: Offset Curve
code_block = CodeBlock(crv=byJoinedCurves, offset=CleranceOffset) { crv.StartPoint; crv.StartPoint.X+offset; }
byCoordinates = Point.ByCoordinates(x=code_block.out1)
scale = Geometry.Scale(byJoinedCurves, origin, code_block.out0, byCoordinates)

code_block_2 = CodeBlock(extension=LineExtension) { -extension..extension..#2; }
byCoordinates_2 = Point.ByCoordinates(x=code_block_2, y=UpSectionLevel)
code_block_3 = CodeBlock(lst=byCoordinates_2) { lst[0]; lst[1]; }
byStartPointEndPoint = Line.ByStartPointEndPoint(startPoint=code_block_3.out0, endPoint=code_block_3.out1)
byCoordinates_3 = Point.ByCoordinates(x=FocusPointX, y=FocusPointY)
code_block_4 = CodeBlock(extension=LineExtension, step=MinimumDistanceBetweenAxes) { 0..extension..step; }
code_block_5 = CodeBlock(y=BottomSectionLevel) { -y; }
byCoordinates_4 = Point.ByCoordinates(x=code_block_4, y=code_block_5)
code_block_6 = CodeBlock(x=code_block_4) { -x; }
restOfItems = List.RestOfItems(code_block_6)
byCoordinates_5 = Point.ByCoordinates(x=restOfItems, y=code_block_5)
join = List.Join(byCoordinates_4, byCoordinates_5)
byStartPointEndPoint_2 = Line.ByStartPointEndPoint(startPoint=byCoordinates_3, endPoint=join)

# group: Upper Check
intersectAll = Geometry.IntersectAll(geometry=byStartPointEndPoint, others=byStartPointEndPoint_2, lacing=CrossProduct)
flatten = Flatten(intersectAll)
splitByPoints = Curve.SplitByPoints(curve=byStartPointEndPoint, points=flatten)
length = Curve.Length(splitByPoints)
segment_length = List.MinimumItem(length)
code_block_7 = CodeBlock(x=segment_length, tol=Tolerance) { x<tol; }
code_block_8 = CodeBlock { null; }
if_ = If(test=code_block_7, true=code_block_8, false=byStartPointEndPoint_2)

# group: Section intersection points
intersectAll_2 = Geometry.IntersectAll(geometry=scale, others=if_, lacing=CrossProduct)
transpose = List.Transpose(intersectAll_2)
code_block_9 = CodeBlock { false; }
clean = List.Clean(list=transpose, preserveIndices=code_block_9)
code_block_10 = CodeBlock(lst=clean) { lst[0]; lst[1]; }

# group: Jet Grouting Solids
byStartPointEndPoint_3 = Line.ByStartPointEndPoint(startPoint=code_block_10.out0, endPoint=code_block_10.out1)
code_block_11 = CodeBlock { 0.5; }
pointAtParameter = Curve.PointAtParameter(curve=byStartPointEndPoint_3, param=code_block_11)
byTwoPoints = Vector.ByTwoPoints(start=code_block_10.out0, end=code_block_10.out1)
byOriginNormal = Plane.ByOriginNormal(origin=pointAtParameter, normal=byTwoPoints)
code_block_12 = CodeBlock { 0.75; }
byPlaneRadius = Circle.ByPlaneRadius(plane=byOriginNormal, radius=code_block_12)
bySweep = Solid.BySweep(byPlaneRadius, byStartPointEndPoint_3)
code_block_13 = CodeBlock { null; }
if_2 = If(test=CreateSolid, true=bySweep, false=code_block_13)

byOrigin = CoordinateSystem.ByOrigin()
byBestFitThroughPoints = Line.ByBestFitThroughPoints(join)

# group: CS transform
transform = Geometry.Transform(geometry=if_2, fromCoordinateSystem=byOrigin, contextCoordinateSystem=cs)
transform_2 = Geometry.Transform(geometry=byCoordinates_3, fromCoordinateSystem=byOrigin, contextCoordinateSystem=cs)
transform_3 = Geometry.Transform(geometry=byStartPointEndPoint, fromCoordinateSystem=byOrigin, contextCoordinateSystem=cs)
transform_4 = Geometry.Transform(geometry=byStartPointEndPoint_2, fromCoordinateSystem=byOrigin, contextCoordinateSystem=cs)
transform_5 = Geometry.Transform(geometry=byJoinedCurves, fromCoordinateSystem=byOrigin, contextCoordinateSystem=cs)
transform_6 = Geometry.Transform(geometry=scale, fromCoordinateSystem=byOrigin, contextCoordinateSystem=cs)
transform_7 = Geometry.Transform(geometry=byBestFitThroughPoints, fromCoordinateSystem=byOrigin, contextCoordinateSystem=cs)
transform_8 = Geometry.Transform(geometry=byStartPointEndPoint_3, fromCoordinateSystem=byOrigin, contextCoordinateSystem=cs)

# group: Output
Solids = Output(transform)  # Solids
FocusPoint = Output(transform_2)  # Focus point
UpLevelLine = Output(transform_3)
AxisLines = Output(transform_4)  # Axis lines from focus point
Section = Output(transform_5)  # Initial section curve
ScaledSection = Output(transform_6)  # Scaled section curve
BottomLevelLine = Output(transform_7)
transpose_2 = List.Transpose(clean)
JetGroutingAxis = Output(transform_8)  # Jet Grouting axis

# group (continued): CS transform
transform_9 = Geometry.Transform(geometry=transpose_2, fromCoordinateSystem=byOrigin, contextCoordinateSystem=cs)

# group (continued): Output
Points = Output(transform_9)  # Points to be used with Adaptive components
