# Dynamo custom node Copy DWFMarkup RevisionCloud to View.dyf (Dynamo 2.16.2.5624)
# category: GeniusLoci.DWF
# Copies the revision cloud from the Markup objects for the given or active sheet.
# Also copies the markup notes to the comments of the created revision cloud.
# Please note that markups are found by name (label) and therefore depend on the Revit localization (language).

sheet = Input(sheet: var[]..[] = Revit.Application.Document.Current.ActiveView)
python_script = Python(IN[0]=sheet)  # IronPython2
# ---------- python_script.python (110 lines) ----------
#Alban de Chasteigner 2020
#twitter : @geniusloci_bim
#geniusloci.bim@gmail.com

import clr
# Import RevitAPI Classes
clr.AddReference('RevitAPI')
import Autodesk
from Autodesk.Revit.DB import *

# Import DocumentManager
clr.AddReference("RevitServices")
import RevitServices
from RevitServices.Persistence import DocumentManager
from RevitServices.Transactions import TransactionManager

clr.AddReference("RevitNodes")
import Revit
clr.ImportExtensions(Revit.GeometryConversion)
#Import Collections
from System.Collections.Generic import List
import System

doc = DocumentManager.Instance.CurrentDBDocument
activeView = UnwrapElement(IN[0])

filters = List[ElementFilter]()
pvp = ParameterValueProvider(ElementId(BuiltInParameter.IMPORT_SYMBOL_NAME))
filters.Add(ElementParameterFilter(FilterStringRule(pvp, FilterStringContains(),"nuage")))
filters.Add(ElementParameterFilter(FilterStringRule(pvp, FilterStringContains(),"cloud")))
orFilter = LogicalOrFilter(filters)

TransactionManager.Instance.EnsureInTransaction(doc)
viewports=[doc.GetElement(vip) for vip in activeView.GetAllViewports()]	
for vp in viewports:
	view=doc.GetElement(vp.ViewId)
	if view.ViewType == ViewType.FloorPlan or view.ViewType == ViewType.CeilingPlan or view.ViewType == ViewType.EngineeringPlan or view.ViewType == ViewType.Section or view.ViewType == ViewType.Elevation :
		scale=vp.get_Parameter(BuiltInParameter.VIEW_SCALE).AsInteger()
		trans1 = SubTransaction(doc)
		trans1.Start()
		try:
			view.get_Parameter(BuiltInParameter.VIEWER_CROP_REGION).Set(1)
			view.SetCategoryHidden(ElementId(BuiltInCategory.OST_Sections),True)
			view.SetCategoryHidden(ElementId(BuiltInCategory.OST_CLines),True)
			view.SetCategoryHidden(ElementId(BuiltInCategory.OST_Grids),True)
			view.SetCategoryHidden(ElementId(BuiltInCategory.OST_Levels),True)
			view.SetCategoryHidden(ElementId(BuiltInCategory.OST_Callouts),True)
		except:pass
		BC = vp.GetBoxCenter()
		if view.ViewType == ViewType.Section or view.ViewType == ViewType.Elevation :
			viewCenter= (view.CropBox.Min + view.CropBox.Max)/2
			origin = view.CropBox.Transform.Origin
			if view.ViewDirection.IsAlmostEqualTo(-XYZ.BasisY):
				VC = origin + XYZ(viewCenter.X,0,viewCenter.Y)
			elif view.ViewDirection.IsAlmostEqualTo(XYZ.BasisY):
				VC = origin + XYZ(-viewCenter.X,0,viewCenter.Y)
			elif view.ViewDirection.IsAlmostEqualTo(-XYZ.BasisX):
				VC = origin + XYZ(0,-viewCenter.X, viewCenter.Y)
			elif view.ViewDirection.IsAlmostEqualTo(XYZ.BasisX):
				VC = origin + XYZ(0,viewCenter.X,viewCenter.Y)
		else:
			VC = (view.CropBox.Min + view.CropBox.Max)/2
		trans1.RollBack()

dwfMarkups = FilteredElementCollector(doc, activeView.Id).OfClass(ImportInstance).WhereElementIsNotElementType().WherePasses(orFilter).ToElements()

revisionId = FilteredElementCollector(doc).OfClass(Revision).FirstElementId()

revisions=[]
for dwf in dwfMarkups:
	comment=dwf.get_Parameter(BuiltInParameter.MARKUPS_HISTORY).AsString()
	curves = List[Curve]()
	bbox=dwf.BoundingBox[activeView]
	if view.ViewType == ViewType.FloorPlan or view.ViewType == ViewType.CeilingPlan or view.ViewType == ViewType.EngineeringPlan:
		pt1 = VC + XYZ((bbox.Min-BC).X * scale, (bbox.Min-BC).Y * scale, 0)
		pt2 = VC + XYZ((bbox.Min-BC).X * scale, (bbox.Max-BC).Y * scale, 0)
		pt3 = VC + XYZ((bbox.Max-BC).X * scale, (bbox.Max-BC).Y * scale, 0)
		pt4 = VC + XYZ((bbox.Max-BC).X * scale, (bbox.Min-BC).Y * scale, 0)
	elif view.ViewType == ViewType.Section or view.ViewType == ViewType.Elevation :
		if view.ViewDirection.IsAlmostEqualTo(-XYZ.BasisY):
			pt1 = VC + XYZ((bbox.Min-BC).X * scale,0, (bbox.Min-BC).Y * scale)
			pt2 = VC + XYZ((bbox.Min-BC).X * scale,0, (bbox.Max-BC).Y * scale)
			pt3 = VC + XYZ((bbox.Max-BC).X * scale,0, (bbox.Max-BC).Y * scale)
			pt4 = VC + XYZ((bbox.Max-BC).X * scale,0, (bbox.Min-BC).Y * scale)
		elif view.ViewDirection.IsAlmostEqualTo(XYZ.BasisY):
			pt1 = VC + XYZ((-bbox.Min+BC).X * scale,0, (bbox.Min-BC).Y * scale)
			pt2 = VC + XYZ((-bbox.Min+BC).X * scale,0, (bbox.Max-BC).Y * scale)
			pt3 = VC + XYZ((-bbox.Max+BC).X * scale,0, (bbox.Max-BC).Y * scale)
			pt4 = VC + XYZ((-bbox.Max+BC).X * scale,0, (bbox.Min-BC).Y * scale)
		elif view.ViewDirection.IsAlmostEqualTo(-XYZ.BasisX):
			pt1 = VC + XYZ(0,(BC-bbox.Min).X * scale, (bbox.Min-BC).Y * scale)
			pt2 = VC + XYZ(0,(BC-bbox.Min).X * scale, (bbox.Max-BC).Y * scale)
			pt3 = VC + XYZ(0,(BC-bbox.Max).X * scale, (bbox.Max-BC).Y * scale)
			pt4 = VC + XYZ(0,(BC-bbox.Max).X * scale, (bbox.Min-BC).Y * scale)
		elif view.ViewDirection.IsAlmostEqualTo(XYZ.BasisX):
			pt1 = VC + XYZ(0,(bbox.Min-BC).X * scale, (bbox.Min-BC).Y * scale)
			pt2 = VC + XYZ(0,(bbox.Min-BC).X * scale, (bbox.Max-BC).Y * scale)
			pt3 = VC + XYZ(0,(bbox.Max-BC).X * scale, (bbox.Max-BC).Y * scale)
			pt4 = VC + XYZ(0,(bbox.Max-BC).X * scale, (bbox.Min-BC).Y * scale)
	curves.Add(Line.CreateBound(pt1, pt2))
	curves.Add(Line.CreateBound(pt2, pt3))
	curves.Add(Line.CreateBound(pt3, pt4))
	curves.Add(Line.CreateBound(pt4, pt1))
	cloud=RevisionCloud.Create(doc,view,revisionId,curves)
	cloudComments=cloud.get_Parameter(BuiltInParameter.ALL_MODEL_INSTANCE_COMMENTS).Set(comment)
	revisions.append(cloud)
	
TransactionManager.Instance.TransactionTaskDone()

OUT = dwfMarkups,revisions
# ----------------------------------------
code_block = CodeBlock(x=python_script) { x[0]; x[1]; }
DWFMarkup = Output(code_block.out0)
RevisionCloud = Output(code_block.out1)
