# Dynamo custom node Set SystemType Graphics.dyf (Dynamo 2.6.2.15705)
# category: GeniusLoci.MEP
# Assigns line pattern, line weight, line color and  material to the given System Type.
# (All graphic inputs are optional)

SystemType = Input(SystemType: var[]..[])
linePattern = Input(linePattern: var[]..[] = null)
LineColor = Input(LineColor: var[]..[] = null)  # Dynamo Color
LineWeight = Input(LineWeight: var[]..[] = null)  # Integer
material = Input(material: var[]..[] = null)
set_systemtype_properties = Python(IN[0]=SystemType, IN[1]=linePattern, IN[2]=LineColor, IN[3]=LineWeight, IN[4]=material)
# ---------- set_systemtype_properties.python (53 lines) ----------
#Alban de Chasteigner 2019
#twitter : @geniusloci_bim
#geniusloci.bim@gmail.com

import clr
clr.AddReference('RevitAPI')
import Autodesk
from Autodesk.Revit.DB import *

clr.AddReference("RevitNodes")
import Revit
clr.ImportExtensions(Revit.Elements)

clr.AddReference("RevitServices")
import RevitServices
from RevitServices.Persistence import DocumentManager
from RevitServices.Transactions import TransactionManager

def tolist(obj1):
    if hasattr(obj1,"__iter__"): return obj1
    else: return [obj1]

doc = DocumentManager.Instance.CurrentDBDocument
systypes = tolist(UnwrapElement(IN[0]))
linePatterns=tolist(UnwrapElement(IN[1]))
colors=tolist(IN[2])
weights=tolist(IN[3])
materials = tolist(UnwrapElement(IN[4]))

# "Start" the transaction
TransactionManager.Instance.EnsureInTransaction(doc)
for systype,linePattern,color,weight, material in zip(systypes,linePatterns,colors,weights,materials):
	if linePattern == None:
		pass
	else:	
		systype.LinePatternId = linePattern.Id
	if color == None:
		pass
	else:
		systype.LineColor = Color(color.Red, color.Green, color.Blue)
	if weight == None:
		pass
	else:
		systype.LineWeight = weight
	if material == None:
		pass
	else:
		systype.MaterialId = material.Id

# "End" the transaction
TransactionManager.Instance.TransactionTaskDone()

OUT = systypes
# ----------------------------------------
SystemType_2 = Output(set_systemtype_properties)  # "SystemType"
