# Dynamo graph Revit Life Safety Areas.dyn (Dynamo 0.9.1.4062)

# group: Set Square Footage per Occupant for Areas https://bimdata.click/revit-life-safety-areas/ Notes: 1. Always test DYN files prior to using them on actual Revit Projects. 2. Delete area when you no longer want to retain any information as this will create warnings.
categories = Categories("Areas")
all_elements_of_category = ElementsOfCategory(categories)
string = StringInput("LifeSafetySqFtPerOccupantKeys")
getParameterValueByName = Element.GetParameterValueByName(element=all_elements_of_category, parameterName=string)
watch = Watch(getParameterValueByName)
string_2 = StringInput("LifeSafetySqFtPerOccupant")
setParameterByName = Element.SetParameterByName(element=all_elements_of_category, parameterName=string_2, value=getParameterValueByName)

# group: Set Occupant Load for Areas https://bimdata.click/revit-life-safety-areas/ Notes: 1. Always test DYN files prior to using them on actual Revit Projects. 2. Delete area when you no longer want to retain any information as this will create warnings.
categories_2 = Categories("Areas")
all_elements_of_category_2 = ElementsOfCategory(categories_2)
watch_2 = Watch(all_elements_of_category_2)
code_block = CodeBlock { "LifeSafetyOccupantLoad"; }
code_block_2 = CodeBlock { "Area"; }
getParameterValueByName_2 = Element.GetParameterValueByName(element=all_elements_of_category_2, parameterName=code_block_2)
code_block_3 = CodeBlock { "LifeSafetySqFtPerOccupantKeys"; }
getParameterValueByName_3 = Element.GetParameterValueByName(element=all_elements_of_category_2, parameterName=code_block_3)
div = getParameterValueByName_2 / getParameterValueByName_3
ceiling = Math.Ceiling(div)
setParameterByName_2 = Element.SetParameterByName(element=all_elements_of_category_2, parameterName=code_block, value=ceiling)
