# Dynamo custom node View.DuplicateByTemplate.dyf (Dynamo 2.12.0.5650)
# category: Modelical.Views.Create
# This node duplicates the selected view as many times as view templates (selected by name). Also applies the corresponding view template.

views = Input(_views: var[]..[])  # View(s) to duplicate
templateNames = Input(_templateNames: var[]..[])  # Template names to apply to views
python_script = Python(IN[0]=views, IN[1]=templateNames)  # IronPython2
# ---------- python_script.python (89 lines) ----------
# This node has been made by Modelical
# www.modelical.com

import clr
clr.AddReference("ProtoGeometry")
from Autodesk.DesignScript.Geometry import *


clr.AddReference("DSCoreNodes")
from DSCore import *


clr.AddReference("RevitAPI")
from Autodesk.Revit.DB import *
from Autodesk.Revit.DB.Structure import *

clr.AddReference("RevitAPIUI")
from Autodesk.Revit.UI import *

clr.AddReference("RevitNodes")
import Revit
clr.ImportExtensions(Revit.GeometryConversion)
clr.ImportExtensions(Revit.Elements)


clr.AddReference("RevitServices")
import RevitServices
from RevitServices.Persistence import DocumentManager
from RevitServices.Transactions import TransactionManager

uidoc = DocumentManager.Instance.CurrentUIApplication
doc = DocumentManager.Instance.CurrentDBDocument
app = uidoc.Application

# To be able to import Python Standard Library modules, we need to locate them
import sys
sys.path.append(r"C:\Program Files (x86)\IronPython 2.7\Lib")
# Function Helpers
def Feet2m(value):
	return value * 0.3048

def toList(input):

    if hasattr(input, "__iter__") and not isinstance(input, basestring):
        return input
    else:
        return [input]

def flatten(x):
    result = []
    for el in x:
        if hasattr(el, "__iter__") and not isinstance(el, basestring):
            result.extend(flatten(el))
        else:
            result.append(el)
    return result

# Logic starts here
views = toList(UnwrapElement(IN[0]))
templateNames=toList(IN[1])

allViews=FilteredElementCollector(doc).OfCategory(BuiltInCategory.OST_Views)
vTemplates=[]
newViews=[]
eList=[]
TransactionManager.Instance.EnsureInTransaction(doc)
for v in views:
	newDupViews=[]
	for tN in templateNames:
		for vT in allViews:
			if vT.IsTemplate and tN== vT.Name:
				try:
					newView=v.Duplicate(ViewDuplicateOption.WithDetailing)
					try:
						a=doc.GetElement(newView).Name = v.Name+"_"+tN
					except:
						None
					try:
						b=doc.GetElement(newView).ViewTemplateId = vT.Id
					except:
						None
					newDupViews.append(doc.GetElement(newView))
				except:
					eList.append(v)
				
	newViews.append(newDupViews)
TransactionManager.Instance.TransactionTaskDone()
# Output
OUT = [newViews, eList]
# ----------------------------------------
code_block = CodeBlock(l=python_script) { l[0]; l[1]; }
newViews = Output(code_block.out0)  # "_newViews"
errorViews = Output(code_block.out1)  # "_errorViews"
