# Dynamo custom node ❄_PC_Get_Transform_and_Scale.dyf
# category: Sastrugi.Pointcloud Geometry
# (Sastrugi_Pointcloud_Geometry) This node returns the Transform Origin/Vectors and Scale of a Pointcloud Instance.

PointcloudInstance = Input(PointcloudInstance: var[]..[])
elementType = Element.ElementType(element=PointcloudInstance)
codeBlock = CodeBlock { "Scale"; }
getParameterValueByName = Element.GetParameterValueByName(element=elementType, parameterName=codeBlock)
flatten = List.Flatten(list=getParameterValueByName)
Scale = Output(flatten)
flatten_2 = List.Flatten(list=PointcloudInstance)
python = Python(IN[0]=flatten_2)  # CPython3
# ---------- python.python (53 lines) ----------
# Python coding credit to Dynamo Forum user - @Ewan_Opie 2019
# Sastrugi Package https://sites.google.com/view/sastrugi/home

import clr
clr.AddReference("RevitNodes")
import Revit
clr.ImportExtensions(Revit.Elements)

clr.AddReference("RevitServices")
import RevitServices
from RevitServices.Persistence import DocumentManager
from RevitServices.Transactions import TransactionManager

from System.Collections.Generic import *

clr.AddReference("RevitAPI")
import Autodesk
from Autodesk.Revit.DB import *

clr.ImportExtensions(Revit.GeometryConversion)

doc = DocumentManager.Instance.CurrentDBDocument
uiapp = DocumentManager.Instance.CurrentUIApplication
app = uiapp.Application

def tolist(obj1):
	if hasattr(obj1,"__iter__"): return obj1
	else: return [obj1]	
	
cloud = tolist(UnwrapElement(IN[0]))

TransactionManager.Instance.EnsureInTransaction(doc)

Ori = []
OvX = []
OvY = []
OvZ = []

for c in cloud:
	ct = []
	tF = c.GetTotalTransform()
	oR = tF.Origin.ToPoint()
	xV = tF.BasisX.ToVector()
	yV = tF.BasisY.ToVector()
	zV = tF.BasisZ.ToVector()
	Ori.append(oR)
	OvX.append(xV)
	OvY.append(yV)
	OvZ.append(zV)
		
TransactionManager.Instance.TransactionTaskDone()

OUT = Ori,OvX,OvY,OvZ
# ----------------------------------------
codeBlock_2 = CodeBlock(OUT=python) { OUT[0]; OUT[1]; OUT[2]; OUT[3]; }
Origin = Output(codeBlock_2.out0)
X_Axis = Output(codeBlock_2.out1)  # "X-Axis"
Y_Axis = Output(codeBlock_2.out2)  # "Y-Axis"
Z_Axis = Output(codeBlock_2.out3)  # "Z-Axis"
