# Dynamo graph spaceanalysis-acoustics-03-two-points-union-vs-intersection.dyn (Dynamo 2.17.0.3472)
# packages: SpaceAnalysis 0.5.0

# note: Variables / Inputs
# Variables that can be altered per project and must be set accordingly before running the script.
# note: Working / Functions
# Core working of the script.
# note: Display / Visualization
# Logic used simply for visualization purposes, and doesn't contain core logic.

# group: Acoustics - Two Sound Points & Union vs. Intersection
# note: DYNAMO PROJECT
# spaceanalysis-acoustics-03-two-points-union-vs-intersection.dyn
# note: ASSOCIATED FILE(S)
# N/A
# note: AUTHOR(S) / CREATION DATE
# Autodesk Research / 2021
# note: Acoustics example with two sound fields combined by union (audible from either point) or intersection (audible from both points)
# note: DYNAMO VERSION
# 2.17.0
# note: ADDITIONAL COMMENTS
# N/A
# note: REQUIRED DYNAMO PACKAGES
# SpaceAnalysis

# group: Create AudibilityGrid by Union(true) vs Intersection(false)
boolean = BoolSelector(true)

# group: Outer Boundary
code_block = CodeBlock { [0, 20, 20, 0]; }
code_block_2 = CodeBlock { [0, 0, 40, 40]; }
byCoordinates = Point.ByCoordinates(x=code_block, y=code_block_2)
code_block_3 = CodeBlock { [20, 20, 0, 0]; }
code_block_4 = CodeBlock { [0, 40, 40, 0]; }
byCoordinates_2 = Point.ByCoordinates(x=code_block_3, y=code_block_4)
byStartPointEndPoint = Line.ByStartPointEndPoint(startPoint=byCoordinates, endPoint=byCoordinates_2)

# group: Internal Boundary
number_slider = DoubleSlider(14.934, range=-5.692..100 step 0.1)
number_slider_2 = DoubleSlider(22.294, range=-16.8..100 step 0.1)
byCoordinates_3 = Point.ByCoordinates(x=number_slider, y=number_slider_2)
number_slider_3 = DoubleSlider(5.418, range=-6.882..100 step 0.1)
number_slider_4 = DoubleSlider(27.651, range=-5.141..100 step 0.1)
byCoordinates_4 = Point.ByCoordinates(x=number_slider_3, y=number_slider_4)
byStartPointEndPoint_2 = Line.ByStartPointEndPoint(startPoint=byCoordinates_3, endPoint=byCoordinates_4)

# group: Internal Boundary
number_slider_5 = DoubleSlider(11.96, range=-5.692..100 step 0.1)
number_slider_6 = DoubleSlider(16.113, range=-16.8..100 step 0.1)
byCoordinates_5 = Point.ByCoordinates(x=number_slider_5, y=number_slider_6)
number_slider_7 = DoubleSlider(4.033, range=-6.882..100 step 0.1)
number_slider_8 = DoubleSlider(11.005, range=-5.141..100 step 0.1)
byCoordinates_6 = Point.ByCoordinates(x=number_slider_7, y=number_slider_8)
byStartPointEndPoint_3 = Line.ByStartPointEndPoint(startPoint=byCoordinates_5, endPoint=byCoordinates_6)

join = List.Join(list0=byStartPointEndPoint_2, list1=byStartPointEndPoint_3)
code_block_5 = CodeBlock(lines=join) { lines; }

# group: Create SpaceLattice
byGeometry = BoundingBox.ByGeometry(geom=byStartPointEndPoint)
code_block_6 = CodeBlock { 0.5; }
byBoundingBoxAndLines = SpaceAnalysis.Core.SpaceLattice.ByBoundingBoxAndLines(boundingBox=byGeometry, barriers=code_block_5, resolution=code_block_6)

# group: Sound Points
number_slider_9 = DoubleSlider(4.149, range=-8.091..100 step 0.1)
number_slider_10 = DoubleSlider(14.454, range=-15.703..100 step 0.1)
byCoordinates_7 = Point.ByCoordinates(x=number_slider_9, y=number_slider_10)
number_slider_11 = DoubleSlider(12.033, range=-8.677..100 step 0.1)
number_slider_12 = DoubleSlider(18.676, range=-2.512..100 step 0.1)
byCoordinates_8 = Point.ByCoordinates(x=number_slider_11, y=number_slider_12)

list_create = List.Create(item0=byCoordinates_7, item1=byCoordinates_8)

# group: Sound Intensity
number_slider_13 = DoubleSlider(1, range=0..1 step 0.01)

# group: Sound Absorption
number_slider_14 = DoubleSlider(0.1, range=0..1 step 0.01)

# group: Create SoundField
bySpaceLatticeAndSoundPoint = SpaceAnalysis.Acoustics.SoundField.BySpaceLatticeAndSoundPoint(spaceLattice=byBoundingBoxAndLines, soundPoint=list_create, intensity=number_slider_13, absorption=number_slider_14)

# group: Create AudibilityGrid by Union
byUnion = SpaceAnalysis.Acoustics.AudibilityGrid.ByUnion(soundFields=bySpaceLatticeAndSoundPoint)
values = SpaceAnalysis.Acoustics.AudibilityGrid.Values(audibilityGrid=byUnion)

# group: Create AudibilityGrid by Intersection
byIntersection = SpaceAnalysis.Acoustics.AudibilityGrid.ByIntersection(soundFields=bySpaceLatticeAndSoundPoint)
values_2 = SpaceAnalysis.Acoustics.AudibilityGrid.Values(audibilityGrid=byIntersection)

if_ = RefactoredIf(test=boolean, true=values, false=values_2)
surface = SpaceAnalysis.Acoustics.AudibilityGrid.Surface(audibilityGrid=byIntersection)

# group: Display Values of the AudibilityGrid
code_block_7 = CodeBlock(inputValues=if_, surface=surface) { inputValues; surface; }
code_block_8 = CodeBlock()
# ---------- code_block_8.designscript (10 lines) ----------
a = 100;
DSCore.Color.ByARGB(a,225, 242, 247);
DSCore.Color.ByARGB(a,206, 232, 229);
DSCore.Color.ByARGB(a,177, 210, 211);
DSCore.Color.ByARGB(a,140, 192, 198);
DSCore.Color.ByARGB(a,131, 186, 211);
DSCore.Color.ByARGB(a,152, 146, 237);
DSCore.Color.ByARGB(a,186, 132, 245);
DSCore.Color.ByARGB(a,217, 100, 241);
DSCore.Color.ByARGB(a,255, 119, 226);
# ----------------------------------------
list_create_2 = List.Create(item0=code_block_8.out1, item1=code_block_8.out2, item2=code_block_8.out3, item3=code_block_8.out4, item4=code_block_8.out5, item5=code_block_8.out6, item6=code_block_8.out7, item7=code_block_8.out8, item8=code_block_8.out9)
code_block_9 = CodeBlock { 0..1..#9; }
code_block_10 = CodeBlock { 0; 1; }
map = Math.Map(rangeMin=code_block_10.out0, rangeMax=code_block_10.out1, inputValue=code_block_7.inputValues)
color_range = ColorRange(colors=list_create_2, indices=code_block_9, value=map)
bySurfaceColors = Modifiers.GeometryColor.BySurfaceColors(surface=code_block_7.surface, colors=color_range)

# group: Display Sound Point Markers
code_block_11 = CodeBlock { 0.25; }
byCenterPointRadius = Circle.ByCenterPointRadius(centerPoint=list_create, radius=code_block_11)
color_palette = ColorPalette({R: 255, G: 255, B: 0, A: 255})
byGeometryColor = Modifiers.GeometryColor.ByGeometryColor(geometry=byCenterPointRadius, color=color_palette)
