# Dynamo graph spaceanalysis-pathfinding-02-many-start-points.dyn (Dynamo 2.17.0.3472)
# packages: SpaceAnalysis 0.5.0

# note: Variables / Inputs
# Variables that can be altered per project and must be set accordingly before running the script.
# note: Working / Functions
# Core working of the script.
# note: Display / Visualization
# Logic used simply for visualization purposes, and doesn't contain core logic.

# group: Pathfinding - Many Start Points
# note: DYNAMO PROJECT
# spaceanalysis-pathfinding-02-many-start-points.dyn
# note: ASSOCIATED FILE(S)
# N/A
# note: AUTHOR(S) / CREATION DATE
# Autodesk Research / 2021
# note: DESCRIPTION
# Example of pathfinding with many start points and one end point.
# note: DYNAMO VERSION
# 2.17.0
# note: ADDITIONAL COMMENTS
# N/A
# note: REQUIRED DYNAMO PACKAGES
# SpaceAnalysis

# group: Internal Boundary
number_slider = DoubleSlider(7.373, range=-5.692..100 step 0.1)
number_slider_2 = DoubleSlider(-3.539, range=-16.8..100 step 0.1)
byCoordinates = Point.ByCoordinates(x=number_slider, y=number_slider_2)
number_slider_3 = DoubleSlider(-6.518, range=-6.547..100 step 0.1)
number_slider_4 = DoubleSlider(7.617, range=0..100 step 0.1)
byCoordinates_2 = Point.ByCoordinates(x=number_slider_3, y=number_slider_4)
byStartPointEndPoint = Line.ByStartPointEndPoint(startPoint=byCoordinates, endPoint=byCoordinates_2)

# group: Outer Boundary
code_block = CodeBlock { [-10, -10, 10, 10]; }
code_block_2 = CodeBlock { [-20, 20, 20, -20]; }
byCoordinates_3 = Point.ByCoordinates(x=code_block, y=code_block_2)
code_block_3 = CodeBlock { [-10, 10, 10, -10]; }
code_block_4 = CodeBlock { [20, 20, -20, -20]; }
byCoordinates_4 = Point.ByCoordinates(x=code_block_3, y=code_block_4)
byStartPointEndPoint_2 = Line.ByStartPointEndPoint(startPoint=byCoordinates_3, endPoint=byCoordinates_4)

list_create = List.Create(item0=byStartPointEndPoint, item1=byStartPointEndPoint_2)
flatten = List.Flatten(list=list_create)
code_block_5 = CodeBlock(lines=flatten) { lines; }

# group: Compute Lattice
byGeometry = BoundingBox.ByGeometry(geom=code_block_5)
code_block_6 = CodeBlock { 0.5; }
byBoundingBoxAndLines = SpaceAnalysis.Core.SpaceLattice.ByBoundingBoxAndLines(boundingBox=byGeometry, barriers=code_block_5, resolution=code_block_6)

# group: End Point
number_slider_5 = DoubleSlider(2.425, range=-8.919..100 step 0.1)
number_slider_6 = DoubleSlider(10.248, range=0..100 step 0.1)
byCoordinates_5 = Point.ByCoordinates(x=number_slider_5, y=number_slider_6)

# group: Starting Points
number_slider_7 = DoubleSlider(-7.947, range=-8.306..100 step 0.1)
number_slider_8 = DoubleSlider(-2.022, range=-3.04..100 step 0.1)
byCoordinates_6 = Point.ByCoordinates(x=number_slider_7, y=number_slider_8)
number_slider_9 = DoubleSlider(-3.047, range=-6.916..100 step 0.1)
number_slider_10 = DoubleSlider(-8.555, range=-11.213..100 step 0.1)
byCoordinates_7 = Point.ByCoordinates(x=number_slider_9, y=number_slider_10)
number_slider_11 = DoubleSlider(7.261, range=-8.759..100 step 0.1)
number_slider_12 = DoubleSlider(-15.55, range=-16.837..100 step 0.1)
byCoordinates_8 = Point.ByCoordinates(x=number_slider_11, y=number_slider_12)
number_slider_13 = DoubleSlider(-2.096, range=-5.213..100 step 0.1)
number_slider_14 = DoubleSlider(-1.825, range=-6.318..100 step 0.1)
byCoordinates_9 = Point.ByCoordinates(x=number_slider_13, y=number_slider_14)
number_slider_15 = DoubleSlider(-8.245, range=-8.994..100 step 0.1)
number_slider_16 = DoubleSlider(-18.965, range=-19.557..100 step 0.1)
byCoordinates_10 = Point.ByCoordinates(x=number_slider_15, y=number_slider_16)

list_create_2 = List.Create(item0=byCoordinates_6, item1=byCoordinates_7, item2=byCoordinates_8, item3=byCoordinates_9, item4=byCoordinates_10)

# group: Compute Pathfield and Find Shortest Routes
bySpaceLatticeAndEndPoint = SpaceAnalysis.Pathfinding.PathField.BySpaceLatticeAndEndPoint(spaceLattice=byBoundingBoxAndLines, endPoint=byCoordinates_5)
byPathField = SpaceAnalysis.Pathfinding.Route.ByPathField(pathField=bySpaceLatticeAndEndPoint, otherPoint=list_create_2)

# group: Route Smoothness
number_slider_17 = DoubleSlider(10, range=0..50 step 1)

# group: Display Path as PolyCurve
curve = SpaceAnalysis.Pathfinding.Route.Curve(route=byPathField, tidyIterations=number_slider_17)
ZAxis = Vector.ZAxis()
code_block_7 = CodeBlock { 0.01; }
translate = Geometry.Translate(geometry=curve, direction=ZAxis, distance=code_block_7)
color_palette = ColorPalette({R: 0, G: 0, B: 255, A: 255})
byGeometryColor = Modifiers.GeometryColor.ByGeometryColor(geometry=translate, color=color_palette)

# group: Display Start and End Point Markers
code_block_8 = CodeBlock { 0.25; }
byCenterPointRadius = Circle.ByCenterPointRadius(centerPoint=list_create_2, radius=code_block_8)
code_block_9 = CodeBlock { 4; }
regularPolygon = Polygon.RegularPolygon(circle=byCenterPointRadius, numberSides=code_block_9)
color_palette_2 = ColorPalette({R: 75, G: 0, B: 130, A: 255})
byGeometryColor_2 = Modifiers.GeometryColor.ByGeometryColor(geometry=regularPolygon, color=color_palette_2)
code_block_10 = CodeBlock { 0.25; }
byCenterPointRadius_2 = Circle.ByCenterPointRadius(centerPoint=byCoordinates_5, radius=code_block_10)
color_palette_3 = ColorPalette({R: 255, G: 0, B: 255, A: 255})
byGeometryColor_3 = Modifiers.GeometryColor.ByGeometryColor(geometry=byCenterPointRadius_2, color=color_palette_3)

# group: Display Lattice as Edges
edges = SpaceAnalysis.Core.SpaceLattice.Edges(spaceLattice=byBoundingBoxAndLines)
color_palette_4 = ColorPalette({R: 50, G: 205, B: 50, A: 98})
byGeometryColor_4 = Modifiers.GeometryColor.ByGeometryColor(geometry=edges, color=color_palette_4)
