# Dynamo graph 06-VASA-Reduced-Extents.dyn (Dynamo 2.19.3.6394)
# packages: VASA 0.4.0

# note: Input Variables
# Pink indicates variables that can be altered per project and must be set accordingly before running the script.
# note: Functional Logic
# Cyan indicates the logic of the script. No changes should be made in these groups unless advised.
# note: Output Values
# Orange indicates key resulting values of nodes that should be observed after running the graph.
# note: Display Objects
# Blue indicates objects that can be previewed in the 3D background after running the graph.

# group: VASA Workflow 06: Reduced Extents
# note: DYNAMO PROJECT
# 06-VASA-Reduced-Extents.dyn
# note: ASSOCIATED FILE(S)
# sample-data : 1 STL file
# note: REQUIRED DYNAMO PACKAGES
# VASA
# note: DYNAMO VERSION
# 2.19.3
# note: AUTHOR(S) / CREATION DATE
# Autodesk Research 2021
# note: DESCRIPTION
# A demonstration of how to create a set of extents in the Voxel-based Architectural Space Analysis (VASA) package. Extents in VASA are useful for voxelizing only a portion of a scene.
# note: ADDITIONAL COMMENTS
# Adjust the extents sliders to control the portion of the scene that gets voxelized. In this example, the extents are controlled by offsets measured in voxel spacings. Observe that changing the level of detail (LOD) in either the vertical or horizontal direction will change the extents.

# group: STL File Path
main_geometry_file_path = Filename(".\ResidentialSample_main_ft.stl")

# group: Triangle Data
importFromSTL = VASA.Utils.TrianglesAsNineNumbers.ImportFromSTL(filePath=main_geometry_file_path)

# group: Axes Parameters
coarse_voxel_width_code_block = CodeBlock { 4; }
code_block = CodeBlock { -30; -4; 1; }
byCoordinates = Point.ByCoordinates(x=code_block.out0, y=code_block.out1, z=code_block.out2)
voxel_rotation_number_slider = DoubleSlider(0, range=-90..90 step 5)
vertical_level_of_detail_integer = IntegerSlider(2, range=0..5 step 1)  # "Vertical Level of Detail - Integer Slider"

# group: Axes
byCoarseVoxelWidthAndOrigin = VASA.Core.Axes.ByCoarseVoxelWidthAndOrigin(coarseVoxelWidth=coarse_voxel_width_code_block, voxelOrigin=byCoordinates, voxelRotation=voxel_rotation_number_slider, verticalLOD=vertical_level_of_detail_integer)

# group: Extents Sliders
lower_x_offset_integer_slider = IntegerSlider(-109, range=-250..250 step 1)
upper_x_offset_integer_slider = IntegerSlider(107, range=-250..250 step 1)
lower_y_offset_integer_slider = IntegerSlider(-59, range=-250..250 step 1)
upper_y_offset_integer_slider = IntegerSlider(45, range=-250..250 step 1)
lower_z_offset_integer_slider = IntegerSlider(-11, range=-80..89 step 1)
upper_z_offset_integer_slider = IntegerSlider(17, range=-80..80 step 1)

# group: Level of Detail
integer_slider = IntegerSlider(4, range=0..5 step 1)

# group: Extents
byAxesAndSixOffsets = VASA.Core.Extents.ByAxesAndSixOffsets(axes=byCoarseVoxelWidthAndOrigin, lowerXOffset=lower_x_offset_integer_slider, upperXOffset=upper_x_offset_integer_slider, lowerYOffset=lower_y_offset_integer_slider, upperYOffset=upper_y_offset_integer_slider, lowerZOffset=lower_z_offset_integer_slider, upperZOffset=upper_z_offset_integer_slider, voxelLOD=integer_slider)

# group: Voxel Model
byTrianglesAndExtents = VASA.Core.VoxelModel.ByTrianglesAndExtents(trianglesAsNineNumbers=importFromSTL, extents=byAxesAndSixOffsets, finestLOD=integer_slider)

# group: Voxel Color
color_palette = ColorPalette({R: 127, G: 255, B: 212, A: 255})

# group: Display Voxels
displayVoxels = VASA.Core.VoxelModel.DisplayVoxels(voxelModel=byTrianglesAndExtents, color=color_palette)

# group: Display Extents
displayExtents = VASA.Core.Extents.DisplayExtents(extents=byAxesAndSixOffsets)
displayCornerVoxels = VASA.Core.Extents.DisplayCornerVoxels(extents=byAxesAndSixOffsets)

# group: Display Mesh
toMesh = VASA.Utils.TrianglesAsNineNumbers.ToMesh(trianglesAsNineNumbers=importFromSTL)
