# Dynamo custom node FillPattern.PresetCrosshatch.dyf (Dynamo 0.9.0.3067)
# category: Zebra.Revit
# Creates the string needed for a standard crosshatch pattern. Change the width to toggle the size of the pattern. Feed the output string into a FillPattern.ModelPatFile or FillPattern.DraftPatFile node.

n0 = DoubleSlider(0, range=0..360 step 1)  # "0"
Width = Input()
linePatternCreation = Custom[FillPattern.LinePatternCreation](Angle=n0, Origin_X=n0, Origin_Y=n0, X_Shift=n0, Y_Shift=Width, Pen_Down=n0, Pen_Up=n0)  # Creates and visualises the line pattern used in fill patterns. Part of the method of creating a Fill Pattern (.pat) file using the Zebra package.
n90 = DoubleSlider(90, range=0..360 step 1)  # "90"
linePatternCreation_2 = Custom[FillPattern.LinePatternCreation](Angle=n90, Origin_X=n0, Origin_Y=n0, X_Shift=n0, Y_Shift=Width, Pen_Down=n0, Pen_Up=n0)
create = List.Create(linePatternCreation.LinePattern, linePatternCreation_2.LinePattern)
LinePattern = Output(create)
string = StringInput("\n")
join = String.Join(string, linePatternCreation.String, linePatternCreation_2.String)
String = Output(join)
