# Dynamo custom node FillPattern.PresetFlemish.dyf (Dynamo 0.9.0.3067)
# category: Zebra.Revit
# Creates a string needed for the standard flemish bond pattern, with no mortar joints visible. Change the height and width of the brick to toggle the size of the pattern. Feed the output string into a FillPattern.ModelPatFile or FillPattern.DraftingPatFile node.

number = DoubleSlider(0, range=0..360 step 1)
Width = Input()
code_block = CodeBlock(w=Width) { (w/2)+((w/2)/2); }
Height = Input()
linePatternCreation = Custom[FillPattern.LinePatternCreation](Angle=number, Origin_X=number, Origin_Y=number, X_Shift=code_block, Y_Shift=Height, Pen_Down=number, Pen_Up=number)  # Creates and visualises the line pattern used in fill patterns. Part of the method of creating a Fill Pattern (.pat) file using the Zebra package.
number_2 = DoubleSlider(90, range=0..360 step 1)
linePatternCreation_2 = Custom[FillPattern.LinePatternCreation](Angle=number_2, Origin_X=number, Origin_Y=number, X_Shift=Height, Y_Shift=code_block, Pen_Down=Height, Pen_Up=Height)
linePatternCreation_3 = Custom[FillPattern.LinePatternCreation](Angle=number_2, Origin_X=Width, Origin_Y=number, X_Shift=Height, Y_Shift=code_block, Pen_Down=Height, Pen_Up=Height)
linePatternCreation_4 = Custom[FillPattern.LinePatternCreation](Angle=number_2, Origin_X=Width, Origin_Y=number, X_Shift=Height, Y_Shift=code_block, Pen_Down=Height, Pen_Up=Height)
linePatternCreation_5 = Custom[FillPattern.LinePatternCreation](Angle=number_2, Origin_X=Width, Origin_Y=number, X_Shift=Height, Y_Shift=code_block, Pen_Down=Height, Pen_Up=Height)
create = List.Create(linePatternCreation.LinePattern, linePatternCreation_2.LinePattern, linePatternCreation_3.LinePattern, linePatternCreation_4.LinePattern, linePatternCreation_5.LinePattern)
LinePattern = Output(create)
string = StringInput("\n")
join = String.Join(string, linePatternCreation.String, linePatternCreation_2.String, linePatternCreation_3.String, linePatternCreation_4.String, linePatternCreation_5.String)
String = Output(join)
