# Dynamo custom node FillPattern.PresetOctagon.dyf (Dynamo 0.9.0.3067)
# category: Zebra.Revit
# Creates the string needed for a standard octagon pattern. Change the side length to toggle the size of the pattern. Feed the output string into a FillPattern.ModelPatFile or FillPattern.DraftPatFile node.

number = DoubleSlider(0, range=0..360 step 1)
SideLength = Input()
code_block = CodeBlock(j=SideLength) { c2 = j*j; sqrt = Math.Sqrt(c2/2); -sqrt; sqrt*2; }
code_block_2 = CodeBlock(sqrt=code_block.sqrt, oct=SideLength, j=SideLength) { sqrt*2 + oct; a = sqrt+j; c2 = (a*a)+(a*a); sqr = Math.Sqrt(c2); sqr + j; sqrt + j; }
linePatternCreation = Custom[FillPattern.LinePatternCreation](Angle=number, Origin_X=code_block.sqrt, Origin_Y=number, X_Shift=number, Y_Shift=code_block_2.out0, Pen_Down=SideLength, Pen_Up=code_block.out3)  # Creates and visualises the line pattern used in fill patterns. Part of the method of creating a Fill Pattern (.pat) file using the Zebra package.
number_2 = DoubleSlider(90, range=0..360 step 1)
linePatternCreation_2 = Custom[FillPattern.LinePatternCreation](Angle=number_2, Origin_X=number, Origin_Y=code_block.sqrt, X_Shift=number, Y_Shift=code_block_2.out0, Pen_Down=SideLength, Pen_Up=code_block.out3)
number_3 = DoubleSlider(45, range=0..360 step 1)
linePatternCreation_3 = Custom[FillPattern.LinePatternCreation](Angle=number_3, Origin_X=number, Origin_Y=code_block.out2, X_Shift=code_block_2.out5, Y_Shift=code_block_2.out5, Pen_Down=SideLength, Pen_Up=code_block_2.sqr)
linePatternCreation_4 = Custom[FillPattern.LinePatternCreation](Angle=number_3, Origin_X=code_block.out2, Origin_Y=number, X_Shift=code_block_2.out5, Y_Shift=code_block_2.out5, Pen_Down=SideLength, Pen_Up=code_block_2.sqr)
number_4 = DoubleSlider(135, range=0..360 step 1)
linePatternCreation_5 = Custom[FillPattern.LinePatternCreation](Angle=number_4, Origin_X=number, Origin_Y=code_block.out2, X_Shift=code_block_2.out5, Y_Shift=code_block_2.out5, Pen_Down=SideLength, Pen_Up=code_block_2.sqr)
linePatternCreation_6 = Custom[FillPattern.LinePatternCreation](Angle=number_4, Origin_X=code_block.sqrt, Origin_Y=number, X_Shift=code_block_2.out5, Y_Shift=code_block_2.out5, Pen_Down=SideLength, Pen_Up=code_block_2.sqr)
create = List.Create(linePatternCreation.LinePattern, linePatternCreation_2.LinePattern, linePatternCreation_3.LinePattern, linePatternCreation_4.LinePattern, linePatternCreation_5.LinePattern, linePatternCreation_6.LinePattern)
LinePattern = Output(create)
string = StringInput("\n")
join = String.Join(string, linePatternCreation.String, linePatternCreation_2.String, linePatternCreation_3.String, linePatternCreation_4.String, linePatternCreation_5.String, linePatternCreation_6.String)
String = Output(join)
