# Dynamo custom node String.ContainsThisOrThat.dyf (Dynamo 0.9.0.3067)
# category: Zebra.Core.String.Query
# Returns true and false based on whether the string contains either input (multiple input as list)

code_block = CodeBlock { "null"; }
code_block_2 = CodeBlock { "null"; }
String = Input()
flatten = Flatten(String)
string_from_array = FromArray(flatten)
eq = code_block_2 == string_from_array
if_ = Custom[Logic.If](test=eq, ifTrue=String, ifFalse=flatten)  # Retains the old status of the previous built-in IF node.
SearchFor = Input()
ignoreCase = Input(ignoreCase : bool = true)
contains = String.Contains(str=if_, searchFor=SearchFor, ignoreCase=ignoreCase, lacing=CrossProduct)
flatten_2 = Flatten()
map = List.Map(list=contains, f_x=flatten_2)
formula = Formula("x=1")
trueForAny = TrueForAny(arg1=formula)
map_2 = List.Map(list=map, f_x=trueForAny)
code_block_3 = CodeBlock { "{null}"; }
count = List.Count()
map_3 = List.Map(list=String, f_x=count)
string_from_array_2 = FromArray(map_3)
eq_2 = code_block_3 == string_from_array_2
code_block_4 = CodeBlock { 1; }
if_2 = Custom[Logic.If](test=eq_2, ifTrue=code_block_4, ifFalse=map_3)
python_script = Python(IN[0]=map_2, IN[1]=if_2)
# ---------- python_script.python (15 lines) ----------
import clr

inputlist = IN[0]
listlengths = IN[1]
rowcounter = 0
elementlist = list()
for item in listlengths:
	itemcounter = 0
	itemlist = list()
	while itemcounter < item:
		itemlist.append(inputlist[rowcounter])
		rowcounter += 1
		itemcounter += 1
	elementlist.append(itemlist)
OUT = elementlist
# ----------------------------------------
string_from_array_3 = FromArray(python_script)
eq_3 = code_block == string_from_array_3
python_script_2 = Python(IN[0]=if_2, IN[1]=python_script)
# ---------- python_script_2.python (4 lines) ----------
check = IN[0]
items = IN[1]
if isinstance(check, (list)): OUT = items
else: OUT = items[0]
# ----------------------------------------
if_3 = Custom[Logic.If](test=eq_3, ifTrue=map_2, ifFalse=python_script_2)
flatten_3 = Flatten(if_3)
Bool = Output(flatten_3)
