# Dynamo custom node String.FindIndexOfPhrase.dyf (Dynamo 0.9.0.3067)
# category: Zebra.Core.String.Action
# Returns the indices of the entire phrase

String = Input()
SearchFor = Input()
ignoreCase = Input(ignoreCase : bool = true)
indexOf = String.IndexOf(string=String, searchFor=SearchFor, ignoreCase=ignoreCase)
length = String.Length(SearchFor)
code_block = CodeBlock(start=indexOf, len=length) { start..(start+len-1); }
Indices = Output(code_block)
