# Dynamo custom node String.FromBinaryCodeTo.dyf (Dynamo 0.8.1.1823)
# category: Zebra.Core.String.Action
# Converts the binary code to its equivalent symbol, description, decimal code, octal code and hexadecimal code. Works with an input of both string or number.

asciiDecimalCode = Custom[String.AsciiDecimalCode]()  # Creates the decimal codes as string
asciiOctalCode = Custom[String.AsciiOctalCode]()  # Creates the octal codes as string
asciiHexadecimalCode = Custom[String.AsciiHexadecimalCode]()  # Creates the hexadecimal codes as string
asciiSymbol = Custom[String.AsciiSymbol]()  # Creates the ASCII symbols as string
asciiDescription = Custom[String.AsciiDescription]()  # Creates the ASCII description as string
create = List.Create(asciiDecimalCode, asciiOctalCode, asciiHexadecimalCode, asciiSymbol, asciiDescription)
transpose = List.Transpose(create)
asciiBinaryCode = Custom[String.AsciiBinaryCode]()  # Creates the binary codes as string
toNumber = String.ToNumber(asciiBinaryCode)
Bin = Input()
toNumber_2 = String.ToNumber(Bin)
string_from_object = FromObject(toNumber_2)
code_block = CodeBlock { "null"; }
eq = string_from_object == code_block
if_ = Custom[Logic.If](test=eq, ifTrue=Bin, ifFalse=toNumber_2)  # Retains the old status of the previous built-in IF node.
eq_2 = toNumber == if_
filterByBoolMask = List.FilterByBoolMask(list=transpose, mask=eq_2)
code_block_2 = CodeBlock { 0; }
getItemAtIndex = List.GetItemAtIndex(index=code_block_2)
map = List.Map(list=filterByBoolMask.in, f_x=getItemAtIndex)
Dec = Output(map)
code_block_3 = CodeBlock { 1; }
getItemAtIndex_2 = List.GetItemAtIndex(index=code_block_3)
map_2 = List.Map(list=filterByBoolMask.in, f_x=getItemAtIndex_2)
Oct = Output(map_2)
code_block_4 = CodeBlock { 2; }
getItemAtIndex_3 = List.GetItemAtIndex(index=code_block_4)
map_3 = List.Map(list=filterByBoolMask.in, f_x=getItemAtIndex_3)
Hex = Output(map_3)
code_block_5 = CodeBlock { 3; }
getItemAtIndex_4 = List.GetItemAtIndex(index=code_block_5)
map_4 = List.Map(list=filterByBoolMask.in, f_x=getItemAtIndex_4)
Sym = Output(map_4)
code_block_6 = CodeBlock { 4; }
getItemAtIndex_5 = List.GetItemAtIndex(index=code_block_6)
map_5 = List.Map(list=filterByBoolMask.in, f_x=getItemAtIndex_5)
Des = Output(map_5)
