# Dynamo custom node String.NumbersAsList.dyf (Dynamo 0.8.0.950)
# category: Zebra.Core.String.Create
# Creates the numbers 0-9 as a list of strings

string = StringInput("0123456789")
length = String.Length(string)
code_block = CodeBlock(n=length) { 0..(n-1); 1; }
substring = String.Substring(str=string, startIndex=code_block.out0, length=code_block.out1)
n0_9 = Output(substring)  # "0-9"
