# Dynamo custom node String.RemoveBeforeCharacters.dyf (Dynamo 0.9.0.3067)
# category: Zebra.Core.String.Action
# Removes the part of the string before the input character/s

includeChar = Input(includeChar : bool = false)
String = Input()
Characters = Input()
ignoreCase = Input(ignoreCase : bool = true)
indexOf = String.IndexOf(string=String, searchFor=Characters, ignoreCase=ignoreCase)
code_block = CodeBlock(x=indexOf) { 0; x; }
remove = String.Remove(str=String, startIndex=code_block.out0, count=code_block.x)
code_block_2 = CodeBlock(x=Characters) { String.Length(x); }
remove_2 = String.Remove(str=remove, startIndex=code_block.out0, count=code_block_2)
if_ = Custom[Logic.If](test=includeChar, ifTrue=remove_2, ifFalse=remove)  # Retains the old status of the previous built-in IF node.
String_2 = Output(if_)  # "String"
