# Dynamo custom node String.RemoveWordsLessThanXLength.dyf "String.RemoveWordsOfMinimumLength" (Dynamo 0.8.0.950)
# category: Zebra.Core.String.Action
# Removes all the words in the string that are less than the minimum desired length

String = Input()
length = String.Length(String)
code_block = CodeBlock(x=length) { x; }
code_block_2 = CodeBlock { " "; }
boolean = BoolSelector(false)
allIndicesOf = Custom[String.AllIndicesOf](String=String, Character=code_block_2, ignoreCase=boolean)  # Returns the indices of the given characters. Works on both nested lists of strings and multiple character inputs
addItemToEnd = List.AddItemToEnd(code_block, allIndicesOf)
code_block_3 = CodeBlock(x=addItemToEnd) { x-1; }
code_block_4 = CodeBlock { -1; }
addItemToFront = List.AddItemToFront(item=code_block_4, list=allIndicesOf)
sub = code_block_3 - addItemToFront
MinLength = Input()
lt = sub < MinLength
filterByBoolMask = List.FilterByBoolMask(list=code_block_3, mask=lt)
filterByBoolMask_2 = List.FilterByBoolMask(list=sub, mask=lt)
sub_2 = filterByBoolMask.in - filterByBoolMask_2.in
code_block_5 = CodeBlock(x=sub_2, ind=filterByBoolMask_2.in) { x..(x+ind); }
flatten = Flatten(code_block_5)
uniqueItems = List.UniqueItems(flatten)
removeCharacterAtIndices = Custom[String.RemoveCharacterAtIndices](String=String, Indices=uniqueItems)  # Removes the characters from the string at the given indices
String_2 = Output(removeCharacterAtIndices)  # "String"
