# Dynamo custom node String.ToCamelCase.dyf (Dynamo 0.9.0.3067)
# category: Zebra.Core.String.Action
# Changes the current string to Camel Case. Boolean toogle for the removal of spaces.

withSpaces = Input(withSpaces : bool = true)
String = Input()
code_block = CodeBlock { 0; }
code_block_2 = CodeBlock()
# ---------- code_block_2.designscript (3 lines) ----------
" ";
"
";
# ----------------------------------------
boolean = BoolSelector(false)
allIndicesOf = Custom[String.AllIndicesOf](String=String, Character=code_block_2.out0, ignoreCase=boolean)  # Returns the indices of the given characters. Works on both nested lists of strings and multiple character inputs
allIndicesOf_2 = Custom[String.AllIndicesOf](String=String, Character=code_block_2.out1, ignoreCase=boolean)
join = List.Join(allIndicesOf, allIndicesOf_2)
code_block_3 = CodeBlock(x=join) { x+1; }
addItemToFront = List.AddItemToFront(item=code_block, list=code_block_3)
changeCharacterAtIndexToUpper = Custom[String.ChangeCharacterAtIndexToUpper](String=String, Index=addItemToFront)  # Changes the character/s at the given index/s to upper
code_block_4 = CodeBlock(x=String) { 0..(String.Length(x)-1); }
removeItemAtIndex = List.RemoveItemAtIndex(list=code_block_4, indices=addItemToFront)
changeCharacterAtIndexToLower = Custom[String.ChangeCharacterAtIndexToLower](String=changeCharacterAtIndexToUpper, Index=removeItemAtIndex)  # Changes the character/s at the given index/s to lower
removeCharacterAtIndices = Custom[String.RemoveCharacterAtIndices](String=changeCharacterAtIndexToLower, Indices=allIndicesOf)  # Removes the characters from the string at the given indices
if_ = Custom[Logic.If](test=withSpaces, ifTrue=changeCharacterAtIndexToLower, ifFalse=removeCharacterAtIndices)  # Retains the old status of the previous built-in IF node.
String_2 = Output(if_)  # "String"
