# Dynamo custom node [&] List.PickByKey.dyf (Dynamo 2.10.1.3976)
# category: Ampersand
# Take items from a list whose keys match a given set of choose values. Items and their corresponding keys are output in the order in which they are requested by the set of choose values.  As needed, items may appear multiple times in the output list or not at all.  Choose values that do not correspond to a key value produce a null selection, and all values not matched to a key are given as a third output.

# note: Colin McCrone
# Twitter:  @ColinMcCrone
# LinkedIn: https://www.linkedin.com/in/colinmccrone
# Updated:  2021-05-26
# An example Dynamo script for how to use this node can be found in the 'extra' folder where the package files are stored. To find it, go to the Packages Menu and select "Manage Packages." Where Ampersand is listed, open the drop-down menu link at the right and choose "Show Root Directory." Open the "extra" folder to find the example file called AmpersandExamples.dyn.
list = Input(list: var[]..[])
keys = Input(keys: var[]..[])
pickKeys = Input(pickKeys: var[]..[])
python_script = Python(IN[0]=list, IN[1]=keys, IN[2]=pickKeys)  # CPython3
# ---------- python_script.python (48 lines) ----------
# Take items from a list whose keys match a given set of choose values. Items and their corresponding keys are output in the order in which they are requested by the set of choose values.  As needed, items may appear multiple times in the output list or not at all.  Choose values that do not correspond to a key value produce a null selection, and all values not matched to a key are given as a third output.
#
# Example input:
#    list			= {A,B,C,D,E}
#    keys			= {1,2,3,4,5}
#    vals			= {2,2,8,5}
#
# Example output:
#    takenItems		= {B,B,null,E}
#    takenKeys		= {2,2,null,5}
#    valNotMatched	= {8}
#
# Colin McCrone
# Twitter:  https://twitter.com/colinmccrone
# LinkedIn: https://www.linkedin.com/in/colinmccrone
# Updated:  2019-05-20
#
import clr

# Input
data = IN[0]
keys = IN[1]
vals = IN[2]

# Output
itemsTaken = []
keysTaken = []
valNoMatch = []

# Find an item and a key for each value
for val in vals:
	found = False
	for i in range(len(data)):
		if val == keys[i]:
			itemsTaken.append(data[i])
			keysTaken.append(keys[i])
			found = True
			break
	if not found:
		itemsTaken.append(None)
		keysTaken.append(None)
		valNoMatch.append(val)

# Write output
OUT = []
OUT.append(itemsTaken)
OUT.append(keysTaken)
OUT.append(valNoMatch)
# ----------------------------------------
code_block = CodeBlock(OUT=python_script) { OUT[0]; OUT[1]; OUT[2]; }
itemsPicked = Output(code_block.out0)
keysPicked = Output(code_block.out1)
keysNotMatched = Output(code_block.out2)
