# Dynamo custom node [&] PolyCurve.ClosedLoopsFromCurves.dyf (Dynamo 2.10.1.3976)
# category: Ampersand.[&] Curve
# Find closed polycurves that enclose the "white spaces" from a network of planar, interesecting curves.
# packages: Ampersand 2019.12.31

# note: Colin McCrone
# Twitter:  @ColinMcCrone
# LinkedIn: https://www.linkedin.com/in/colinmccrone
# Updated:  2021-05-26
# An example Dynamo script for how to use this node can be found in the 'extra' folder where the package files are stored. To find it, go to the Packages Menu and select "Manage Packages." Where Ampersand is listed, open the drop-down menu link at the right and choose "Show Root Directory." Open the "extra" folder to find the example file called AmpersandExamples.dyn.
curves = Input(curves: Autodesk.DesignScript.Geometry.Curve[])

# group: Shatter curves by self-intersections
curves_shatter = Custom[[&] Curves.Shatter](curves=curves)  # package Ampersand; Split a collection of curves into smaller curves at each interesection

# group: Group curves into Clockwise loops
reverse = Curve.Reverse(curve=curves_shatter)
# note: Two copies of each curve, one going each way
join = List.Join(list0=curves_shatter, list1=reverse)
startPoint = Curve.StartPoint(curve=join)
endPoint = Curve.EndPoint(curve=join)
join_2 = List.Join(list0=startPoint, list1=endPoint)
code_block = CodeBlock()
# ---------- code_block.designscript (2 lines) ----------
// tolerance
0.0001;
# ----------------------------------------
# note: Unique end points
pruneDuplicates = Point.PruneDuplicates(points=join_2, tolerance=code_block)
count = List.Count(list=pruneDuplicates)
code_block_2 = CodeBlock(ct=count) { 0..(ct-1); }
code_block_3 = CodeBlock(endPts=endPoint, uniquePts=pruneDuplicates) { PointsAreEqual(endPts<1>,uniquePts<2>); }
filterByBoolMask = List.FilterByBoolMask(list=code_block_2, mask=code_block_3@L2)
# note: Index of the unique vertices that
# corresponds to the line's END point.
flatten = List.Flatten(list=filterByBoolMask.in)
code_block_4 = CodeBlock(startPts=startPoint, uniquePts=pruneDuplicates) { PointsAreEqual(startPts<1>,uniquePts<2>); }
filterByBoolMask_2 = List.FilterByBoolMask(list=code_block_2, mask=code_block_4@L2)
# note: Index of the unique vertices that
# corresponds to the line's START point.
flatten_2 = List.Flatten(list=filterByBoolMask_2.in)
groupByKey = List.GroupByKey(list=flatten, keys=flatten_2)
sortByKey = List.SortByKey(list=groupByKey.groups, keys=groupByKey.unique_keys)
code_block_5 = CodeBlock(endPtIndByStartPts=sortByKey.sortedList)
# ---------- code_block_5.designscript (2 lines) ----------
// adjacency list by start pt
endPtIndByStartPts;
# ----------------------------------------
groupByKey_2 = List.GroupByKey(list=join, keys=flatten_2)
sortByKey_2 = List.SortByKey(list=groupByKey_2.groups, keys=groupByKey_2.unique_keys)
code_block_6 = CodeBlock(crvsByStartPts=sortByKey_2.sortedList) { crvsByStartPts; }
count_2 = List.Count(list=code_block_5@L2)
code_block_7 = CodeBlock(num=count_2)
# ---------- code_block_7.designscript (2 lines) ----------
// used
List.OfRepeatedItem(false,num);
# ----------------------------------------
tangentAtParameter = Curve.TangentAtParameter(curve=code_block_6)
byBestFitThroughPoints = Plane.ByBestFitThroughPoints(points=pruneDuplicates)
normal = Plane.Normal(plane=byBestFitThroughPoints)
code_block_8 = CodeBlock(v=tangentAtParameter, vecs=tangentAtParameter, axis=normal)
# ---------- code_block_8.designscript (6 lines) ----------
CompareAngles(v,vecs,axis);

def CompareAngles(vec:var,vecs:var[],axis:var)
{
	return = Vector.AngleAboutAxis(vec,vecs,axis);
};
# ----------------------------------------
code_block_9 = CodeBlock(ind=code_block_5, angles=code_block_8)
# ---------- code_block_9.designscript (7 lines) ----------
ChooseNext(ind,angles);

def ChooseNext(ind:var[],angles:var[][])
{
	t3 = List.SortByKey(ind, angles@-2<1>);
	return = t3["sortedList"];
};
# ----------------------------------------
lastItem = List.LastItem(list=code_block_9@@L2)
sum = Math.Sum(values=count_2)
code_block_10 = CodeBlock(adj=code_block_5, crvsByStPts=code_block_6, used=code_block_7, nextVertex=lastItem, numTot=sum) { adj; crvsByStPts; used; nextVertex; numTot; }
python_script = Python(IN[0]=code_block_10.adj, IN[1]=code_block_10.crvsByStPts, IN[2]=code_block_10.used, IN[3]=code_block_10.nextVertex, IN[4]=code_block_10.numTot)  # CPython3
# ---------- python_script.python (75 lines) ----------
#
# Colin McCrone
# Twitter:  https://twitter.com/colinmccrone
# LinkedIn: https://www.linkedin.com/in/colinmccrone
# Updated:  2019-05-13
#
import clr

adj = IN[0]
crvsByStPts = IN[1]
used = IN[2]
nextVertex = IN[3]
numTot = IN[4]

numUsed = 0
crvSets = []
vertSets = []

counter = 0
while numUsed < numTot and counter < numTot:
	loop = []
	vLoop = []
	
	iNext = -1
	lastVertex = -1
	
	# Find first unused starting curve
	for i in range(len(used)):
		for j in range(len(used[i])):
			if not used[i][j]:
				# Record this in the new loop
				loop.append(crvsByStPts[i][j])
				used[i][j] = True
				lastVertex = i
				
				iNext = nextVertex[i][j]
				
				vLoop.append(i)
				break
		else:
			continue	# if loop exited normally
		break 			# if break condition was met above
	
	
	# Find rest of curves in same group
	subCounter = 0
	while subCounter < numTot:
		# Find jNext, the arbitrary location in the list-per-vertex
		jNext = -1
		for j in range(len(nextVertex[iNext])):
			if adj[iNext][j] == lastVertex:
				jNext = j
				break
		if jNext < 0:
			break
		
		# Record this curve if not already used
		if not used[iNext][jNext]:
			vLoop.append(iNext)
			loop.append(crvsByStPts[iNext][jNext])
			used[iNext][jNext] = True
			
			lastVertex = iNext
			iNext = nextVertex[iNext][jNext]
		else:
			crvSets.append(loop)
			vertSets.append(vLoop)
			break
		
		subCounter += 1

	counter += 1

# Output
OUT = crvSets
# ----------------------------------------

# group: Create polycuves
# note: Warnings are OK!
byJoinedCurves = PolyCurve.ByJoinedCurves(curves=python_script)
code_block_11 = CodeBlock { false; }
clean = List.Clean(list=byJoinedCurves, preserveIndices=code_block_11)
polycurve_isclockwise = Custom[[&] PolyCurve.IsClockwise](polycurve=clean, plane=byBestFitThroughPoints)  # package Ampersand; For closed polycurves with reasonably straight segments, return true if the curve is clockwise relative to the plane, false otherwise.
filterByBoolMask_3 = List.FilterByBoolMask(list=clean, mask=polycurve_isclockwise)

PolyCurves = Output(filterByBoolMask_3.in)

# group: DesignScript definitions
code_block_12 = CodeBlock()
# ---------- code_block_12.designscript (26 lines) ----------
//
// Colin McCrone
// Twitter:  https://twitter.com/colinmccrone
// LinkedIn: https://www.linkedin.com/in/colinmccrone
// Updated:  2019-05-13
//

// True or false: whether two points are equal
def PointsAreEqual(pt1 : var, pt2 : var)
{
	tol = 0.0001;
	difX = Math.Abs(pt1.X - pt2.X);
	difY = Math.Abs(pt1.Y - pt2.Y);
	difZ = Math.Abs(pt1.Z - pt2.Z);
	return = difX < tol && difY < tol && difZ < tol;
};

// Matrix of the given rank.
// 1 on the diagonal, 0 elsewhere
def Diagonal(rank:int)
{
	s1 = 1..rank;
	s2 = List.OfRepeatedItem(s1,rank);
	s3 = s1..#rank..0;
	return = s2 == s3 ? 1 : 0;
};
# ----------------------------------------
