# Dynamo custom node [&] PolySurface.SplitByTools.dyf (Dynamo 2.10.1.3976)
# category: Ampersand.[&] Surface
# Split a single polysurface with multiple tools.
# packages: Ampersand 2019.12.31

# note: Colin McCrone
# Twitter:  @ColinMcCrone
# LinkedIn: https://www.linkedin.com/in/colinmccrone
# Updated:  2021-05-26
# An example Dynamo script for how to use this node can be found in the 'extra' folder where the package files are stored. To find it, go to the Packages Menu and select "Manage Packages." Where Ampersand is listed, open the drop-down menu link at the right and choose "Show Root Directory." Open the "extra" folder to find the example file called AmpersandExamples.dyn.
polySurface = Input(polySurface: Autodesk.DesignScript.Geometry.PolySurface)
surfaces = PolySurface.Surfaces(polySurface=polySurface)
tools = Input(tools: var[])
geometry_splitbytools = Custom[[&] Geometry.SplitByTools](tools=tools)  # package Ampersand; Split one piece of geometry (other than a polysurface) by multiple tools; unwired: geometry
map = List.Map(list=surfaces, f_x=geometry_splitbytools)
flatten = List.Flatten(list=map)
code_block = CodeBlock(surfaces=flatten, tools=tools) { surfaces; tools; }
python_script = Python(IN[0]=code_block.surfaces, IN[1]=code_block.tools)  # IronPython2
# ---------- python_script.python (166 lines) ----------
#
# Colin McCrone
# Twitter:  https://twitter.com/colinmccrone
# LinkedIn: https://www.linkedin.com/in/colinmccrone
# Updated:  2016-05-15
#
import clr
clr.AddReference('ProtoGeometry')
from Autodesk.DesignScript.Geometry import *

# Flatten a 2-dimensional list to a 1-dimensional list
def Flatten2D(ls):
	flat = []	
	for x in ls:
		if type(x) is list:
			for y in x:
				flat.append(y)
		else:
			flat.append(x)	
	return flat

# Return the list of interections between a piece of geometry and multiple tools.  Note that this algorithm may return duplicates in the reults.
def IntersectMultiple(geom, tools):
	results = []
	
	for tool in tools:
		intersections = Geometry.Intersect(geom, tool)
		
		if intersections:
			if "Array" in str(type(intersections)):
				for intersection in intersections:
					results.append(intersection)
			else:
				results.append(intersections)
	
	return results

# Determine whether an object is a curve of any sort
def IsCurve(obj):
	if ("Line" in str(type(obj))):
		return True
	elif ("Curve" in str(type(obj))):
		return True
	elif ("Arc" in str(type(obj))):
		return True
	elif ("Ellipse" in str(type(obj))):
		return True
	elif ("Circle" in str(type(obj))):
		return True
	elif ("Polygon" in str(type(obj))):
		return True
	else:
		return False

# Determine whether an object is a point
def IsPoint(obj):
	if ("Point" in str(type(obj))):
		return True
	else:
		return False

# Determine whether the geometry touches any of the pieces of geometry in the set of tools
def DoesTouchTool(geom, tools):
	for tool in tools:
		if (Geometry.DoesIntersect(geom, tool)):
			return True
	return False

# Find whether two surfaces touch each other in places other than coincident any tool and therefore belong in the same group after they have been split by the tools
def BelongsWith(s1, s2, tools):
	iSrfSrf = Geometry.Intersect(s1, s2)
	
	# Assume surfaces do not belong together
	answer = False
	
	for i in range(len(iSrfSrf)):
		# If the surfaces share only a point, they belong together if that point does not also touch a tool
		if IsPoint(iSrfSrf[i]):
			if (DoesTouchTool(iSrfSrf[i], tools)):
				continue
			else:
				answer = True
				break
		
		# If the surfaces share a curve, they belong together if that curve does not touch a tool by more than a point
		if IsCurve(iSrfSrf[i]):
			iIntTool = IntersectMultiple(iSrfSrf[i], tools)
			
			# Change default answer to true
			if not iIntTool:
				answer = True
				break
			else:
				answer = True
			
			for j in range(len(iIntTool)):
				if IsCurve(iIntTool[j]):
					answer = False
					return answer
				else:
					continue
	
	return answer

# Sort a series of surfaces into groups divided by a list of splitting tools
srfs = IN[0]		# surfaces after split operation
tools = IN[1]		# the splitting tools
srfGroups = []

# Build an adjacency matrix
adj = [[False]*len(srfs) for srf in srfs]
for i in range(len(srfs)):
	for j in range(i+1, len(srfs)):
		if (BelongsWith(srfs[i], srfs[j], tools)):
			adj[i][j] = True
			adj[j][i] = True		

# Depth-first search: find all surfaces connected to the first available unconnected surface until no paths remain unexplored. Mark 
connected = [False]*len(srfs)
exhausted = [False]*len(srfs)
numFound = 0
counter = 0

# Loop finds one full connected set of surfaces per iteration
while(numFound < len(srfs)):
	numConnected = 0				# in this group
	numExhausted = 0				# in this group
	foundOrder = []					# trail of breadcrumbs (not incl loc)
	group = []						# group of connected surfaces
	loc = 0							# location of current search
	
	# Find first available root node
	for i in range(len(srfs)):
		if (not connected[i]):
			connected[i] = True
			loc = i
			numFound += 1			# found ever
			numConnected = 1		# part of this group
			group.append(srfs[i])
			break
	
	# Find all nodes connected to root node in the network
	while (numExhausted < numConnected and numFound < len(srfs)):
		for k in range(len(srfs)):
			# If found a new connection, make the jump to new loc
			if (adj[loc][k]) and (not connected[k]):
				foundOrder.append(loc)
				numFound += 1
				connected[k] = True
				numConnected += 1
				loc = k
				group.append(srfs[k])
				break
			
			# If no new connections, mark location as exhausted and jump backward
			if (k == (len(srfs)-1)):
				exhausted[loc] = True
				numExhausted += 1
				if (foundOrder):
					loc = foundOrder.pop()
				break

	srfGroups.append(group)

# Output
OUT = srfGroups
# ----------------------------------------
byJoinedSurfaces = PolySurface.ByJoinedSurfaces(surfaces=python_script)
polySurface_2 = Output(byJoinedSurfaces)  # "polySurface"
