# Dynamo custom node Get Objects by Type.dyf (Dynamo 1.2.0.2654)
# category: Archi-lab_MantisShrimp.Rhinoceros.ReadRhino
# This node will retrieve all of the objects of given type from a Rhino model.

RhinoFile = Input()
ObjectType = Input()
python_script = Python(IN[0]=RhinoFile, IN[1]=ObjectType)
# ---------- python_script.python (82 lines) ----------
# Copyright(c) 2016, Konrad Sobon
# @arch_laboratory, http://archi-lab.net

import clr
import sys
import System

pyt_path = r'C:\Program Files (x86)\IronPython 2.7\Lib'
sys.path.append(pyt_path)

from os import path
assemblies = System.AppDomain.CurrentDomain.GetAssemblies()
msUIpath = [a.Location for a in assemblies if 'MantisShrimp,' in a.FullName][0]
msPath = System.IO.Path.GetDirectoryName(msUIpath).rsplit('\\',1)[0]
msPathExtra = '%s\\extra\\' %msPath
msPathRh = '%s\\bin\\Rhino3dmIO.dll' %msPath
sys.path.append(msPathExtra)
clr.AddReferenceToFileAndPath(msPathRh)
import Rhino as rc

#The inputs to this node will be stored as a list in the IN variable.
dataEnteringNode = IN
rhModel = IN[0]

if isinstance(IN[1], list):
	rhType = IN[1]
else:
	rhType = [IN[1]]

def GetObjectType(obj):
	try:
		geo = obj.Geometry
		if geo.ToString() == "Rhino.Geometry.ArcCurve" and geo.IsArc():
			objType = "Arc"
		elif geo.ToString() == "Rhino.Geometry.NurbsCurve" and geo.IsClosed and geo.IsRational:
			objType = "Ellipse"
		elif geo.ToString() == "Rhino.Geometry.ArcCurve" and geo.IsCircle():
			objType = "Circle"
		else:
			objType = geo.ToString().split(".")[2]
	except:
		objType = "Unknown"
		pass
	return objType

def GetObjectsByType(rhObj = None, rht = rhType):
	if GetObjectType(rhObj) in rhType:
		return rhObj
	else:
		return None

def ClearList(_list):
    out = []
    for _list1 in _list:
        if _list1 is None:
            continue
        if not _list1:
        	continue
        if isinstance(_list1, list):
             _list1 = ClearList(_list1)
             if not _list1:
                 continue
        out.append(_list1)
    return out

def ProcessList(_func, _list):
    return map( lambda x: ProcessList(_func, x) if type(x)==list else _func(x), _list )

try:
	errorReport = None
	allObjects = rhModel.Objects
	objects = ProcessList(GetObjectsByType, allObjects)
except:
	# if error accurs anywhere in the process catch it
	import traceback
	errorReport = traceback.format_exc()

#Assign your output to the OUT variable
if errorReport == None:
	OUT = ClearList(objects)
else:
	OUT = errorReport
# ----------------------------------------
RhinoObject = Output(python_script)
