# Dynamo custom node RH Nurbs Surface to DS Nurbs Surface.dyf (Dynamo 1.2.0.2654)
# category: Archi-lab_MantisShrimp.Rhinoceros.Geometry
# converts rhino nurbs surfaces to design script nurbs surfaces

RhinoObject = Input()
python_script = Python(IN[0]=RhinoObject)
# ---------- python_script.python (63 lines) ----------
# Copyright(c) 2016, Konrad Sobon
# @arch_laboratory, http://archi-lab.net

import clr
import sys
import System

pyt_path = r'C:\Program Files (x86)\IronPython 2.7\Lib'
sys.path.append(pyt_path)

from os import path
assemblies = System.AppDomain.CurrentDomain.GetAssemblies()
msUIpath = [a.Location for a in assemblies if 'MantisShrimp,' in a.FullName][0]
msPath = System.IO.Path.GetDirectoryName(msUIpath).rsplit('\\',1)[0]
msPathExtra = '%s\\extra\\' %msPath
msPathRh = '%s\\bin\\Rhino3dmIO.dll' %msPath
sys.path.append(msPathExtra)
clr.AddReferenceToFileAndPath(msPathRh)

import Rhino as rc
from mantisshrimp import rhNurbsSurfaceToSurface

#The inputs to this node will be stored as a list in the IN variable.
dataEnteringNode = IN

if isinstance(IN[0], list):
	rhObjects = IN[0]
else:
	rhObjects = [IN[0]]

def GetNurbsSurfaces(rhObj):
	try:
		geo = rhObj.Geometry
		if geo.ToString() == "Rhino.Geometry.Brep":
			brepFaces = geo.Faces
			faceList = []
			for i in range(0, brepFaces.Count, 1):
				rhSurface = brepFaces.Item[i].UnderlyingSurface()
				if rhSurface.ToString() == "Rhino.Geometry.NurbsSurface":
					faceList.append(rhNurbsSurfaceToSurface(rhSurface))
				elif rhSurface.ToString() == "Rhino.Geometry.RevSurface":
					faceList.append(rhNurbsSurfaceToSurface(rhSurface.ToNurbsSurface()))
			return faceList
	except:
		pass

def ProcessList(_func, _list):
	return map(lambda x: ProcessList(_func, x) if type(x) == list else _func(x) , _list)

#convert rhino/gh geometry to ds geometry
try:
	errorReport = None
	dsNurbsSurfaces = ProcessList(GetNurbsSurfaces, rhObjects)
except:
	# if error accurs anywhere in the process catch it
	import traceback
	errorReport = traceback.format_exc()
	
#Assign your output to the OUT variable
if errorReport == None:
	OUT = dsNurbsSurfaces
else:
	OUT = errorReport
# ----------------------------------------
NurbsSurface = Output(python_script)
