# Dynamo custom node FileInfo.dyf (Dynamo 1.3.2.2480)
# category: DynaTools.QAQC.Document

python_script = Python()  # unwired: IN[0]
# ---------- python_script.python (67 lines) ----------
############################################
#Copyright 2017							 ###
#Twitter: @CesareCaoduro				 ###
#Email: cesare.caoduro@gmail.com		 ###
############################################

#Declaration section#

import sys
import clr
import math

from System.IO import FileInfo

mb = 1048576.0
kb = 1024.0

def getSize(p, mb=mb, kb=kb):
	sb = FileInfo(p).Length
	return round(sb/mb,3), sb/kb 
	
pyt_path = r'C:\Program Files (x86)\IronPython 2.7\Lib'
sys.path.append(pyt_path)
import os

clr.AddReference('ProtoGeometry')
from Autodesk.DesignScript.Geometry import *

clr.AddReference('RevitAPIUI')
from  Autodesk.Revit.UI import *

clr.AddReference('RevitAPI')
from Autodesk.Revit.DB import *
from Autodesk.Revit.Creation import *

clr.AddReference('RevitNodes')
import Revit

clr.ImportExtensions(Revit.Elements)
clr.ImportExtensions(Revit.GeometryConversion)

clr.AddReference('RevitServices')
from RevitServices.Persistence import DocumentManager
from RevitServices.Transactions import TransactionManager

#Access the active document#
doc = DocumentManager.Instance.CurrentDBDocument
uidoc = DocumentManager.Instance.CurrentUIApplication.ActiveUIDocument

#Start a transaction on the active document#
TransactionManager.Instance.EnsureInTransaction(doc)

#Insert here your code#
input = IN[0]

filePath = doc.PathName


output = []
output.append(filePath)
output.append(getSize(filePath))

#Dispose the active transaction
TransactionManager.Instance.TransactionTaskDone()

#List outputs#
OUT = output
# ----------------------------------------
code_block = CodeBlock(lst=python_script) { lst[0]; lst[1][0]; lst[1][1]; }
FilePath = Output(code_block.out0)
FileSizeMB = Output(code_block.out1)
FileSizeKB = Output(code_block.out2)
MaxFileSize = Input(MaxFileSize : double = 150)  # Define the maximum file size in MB
code_block_2 = CodeBlock(x=code_block.out1, MaxFileSize=MaxFileSize) { x<=MaxFileSize; }
MaxScore = Input(MaxScore : double = 5)
code_block_3 = CodeBlock(f=code_block.out1, tot=MaxFileSize, maxScore=MaxScore) { percentage = f * 100 / tot; score = maxScore - Math.Round(percentage * maxScore / 100,2); }
code_block_4 = CodeBlock { 0; }
if_ = If(test=code_block_2, true=code_block_3.score, false=code_block_4)
Score = Output(if_)
