# Dynamo custom node ParametersMatrixFromExcel.dyf (Dynamo 1.3.2.2480)
# category: DynaTools.QAQC.Parameters

PathToFile = Input()  # Excel file path
fromPath = FileObject(PathToFile)  # "File.FromPath"
SheetName = Input(SheetName : string = "ParameterMatrix")  # Sheet name
readFromFile = Excel.ReadFromFile(file=fromPath, sheetName=SheetName)
restOfItems = List.RestOfItems(readFromFile)
Refresh = Input(Refresh : bool)  # Refresh the script
python_script = Python(IN[0]=restOfItems, IN[1]=Refresh)
# ---------- python_script.python (19 lines) ----------
import clr
clr.AddReference('ProtoGeometry')
from Autodesk.DesignScript.Geometry import *
#The inputs to this node will be stored as a list in the IN variables.
lst = IN[0]
refresh = IN[1]
lstNoNull = []

if refresh:
	for l in lst:
		lstNo = []
		for k in range(0,len(l)):
			if l[k] != None:
				lstNo.append(l[k])
		lstNoNull.append(lstNo)			


#Assign your output to the OUT variable.
OUT = lstNoNull
# ----------------------------------------
restOfItems_2 = List.RestOfItems(python_script@L2)
CategoriesList = Output(restOfItems_2)
firstItem = List.FirstItem(python_script@L2)
ParameterList = Output(firstItem)
