# Dynamo custom node ScheduleOnSheet.dyf (Dynamo 1.3.2.2480)
# category: DynaTools.QAQC.Views

python_script = Python()  # unwired: IN[0]
# ---------- python_script.python (22 lines) ----------
import clr
clr.AddReference('RevitAPI')
from Autodesk.Revit.DB import *

clr.AddReference("RevitServices")
import RevitServices
from RevitServices.Persistence import DocumentManager

doc = DocumentManager.Instance.CurrentDBDocument
sheets = FilteredElementCollector(doc).OfCategory(BuiltInCategory.OST_Sheets)

elementlist = list()
for sheet in sheets:
	try:
		viewlist = list()
		collector = FilteredElementCollector(doc, sheet.Id).OfClass(ScheduleSheetInstance)
		for item in collector:
			viewlist.append(doc.GetElement(item.ScheduleId))
		elementlist.append(viewlist)
	except:
		elementlist.append(list())
OUT = elementlist
# ----------------------------------------
code_block = CodeBlock(lst=python_script) { lst[0]; }
ScheduleOnSheet = Output(code_block)
