# Dynamo custom node Score.dyf (Dynamo 1.3.2.2480)
# category: DynaTools.QAQC.Generic
# Score a number against another, using a KPI maximum value

TotalNumber = Input(TotalNumber: double)  # Total reference number
TotalNumber_2 = Output(TotalNumber)  # "TotalNumber"
ActualNumber = Input(ActualNumber: double)  # Value to score
ActualNumber_2 = Output(ActualNumber)  # "ActualNumber"
code_block = CodeBlock()
# ---------- code_block.designscript (10 lines) ----------
//Check wheter a number is a NaN value
"
import clr
import math
score = IN[0]
if math.isnan(score):
 OUT = 0
else:
 OUT = score;
";
# ----------------------------------------
MaxScore = Input(MaxScore : double = 5)  # Maximum reference score
code_block_2 = CodeBlock(f=TotalNumber, tot=ActualNumber, maxScore=MaxScore) { percentage = f * 100 / tot; score = Math.Round(percentage * maxScore / 100,2); }
python_script_from_string = PythonStringNode(script=code_block, IN[0]=code_block_2.score)
Score = Output(python_script_from_string)
