# Dynamo custom node ViewOnSheet.dyf (Dynamo 1.3.2.2480)
# category: DynaTools.QAQC.Views

python_script = Python()  # unwired: IN[0]
# ---------- python_script.python (50 lines) ----------
############################################
#Copyright 2017							 ###
#Twitter: @CesareCaoduro				 ###
#Email: cesare.caoduro@gmail.com		 ###
############################################

#Declaration section#

import sys
import clr

pyt_path = r'C:\Program Files (x86)\IronPython 2.7\Lib'
sys.path.append(pyt_path)
import os

clr.AddReference('ProtoGeometry')
from Autodesk.DesignScript.Geometry import *

clr.AddReference('RevitAPIUI')
from  Autodesk.Revit.UI import *

clr.AddReference('RevitAPI')
from Autodesk.Revit.DB import *
from Autodesk.Revit.Creation import *

clr.AddReference('RevitNodes')
import Revit

clr.ImportExtensions(Revit.Elements)
clr.ImportExtensions(Revit.GeometryConversion)

clr.AddReference('RevitServices')
from RevitServices.Persistence import DocumentManager
from RevitServices.Transactions import TransactionManager

#Access the active document#
doc = DocumentManager.Instance.CurrentDBDocument
uidoc = DocumentManager.Instance.CurrentUIApplication.ActiveUIDocument

#Insert here your code#
viewports, tot = [], []

col = FilteredElementCollector(doc).OfCategory(BuiltInCategory.OST_Viewports)

for c in col:
	viewports.append(doc.GetElement(c.ViewId).ToDSType(True))
	

#List outputs#
OUT = viewports, len(viewports)
# ----------------------------------------
code_block = CodeBlock(lst=python_script) { lst[0]; lst[1]; }
ViewOnSheet = Output(code_block.out0)
python_script_2 = Python()  # unwired: IN[0]
# ---------- python_script_2.python (22 lines) ----------
import clr
clr.AddReference('RevitAPI')
from Autodesk.Revit.DB import *

clr.AddReference("RevitServices")
import RevitServices
from RevitServices.Persistence import DocumentManager

doc = DocumentManager.Instance.CurrentDBDocument
sheets = FilteredElementCollector(doc).OfCategory(BuiltInCategory.OST_Sheets)

elementlist = list()
for sheet in sheets:
	try:
		viewlist = list()
		collector = FilteredElementCollector(doc, sheet.Id).OfClass(ScheduleSheetInstance)
		for item in collector:
			viewlist.append(doc.GetElement(item.ScheduleId))
		elementlist.append(viewlist)
	except:
		elementlist.append(list())
OUT = elementlist, len(elementlist)
# ----------------------------------------
code_block_2 = CodeBlock(lst=python_script_2) { lst[0]; lst[1]; }
flatten = Flatten(code_block_2.out0)
ScheduleOnSheet = Output(flatten)
code_block_3 = CodeBlock(t1=code_block.out1, t2=code_block_2.out1) { t1+t2; }
TotalNumber = Output(code_block_3)
