# Dynamo custom node Element Level.dyf (Dynamo 2.16.2.5624)
# category: GeniusLoci.Level
# Gets an element's level.
# Based on a Clockwork's node

element = Input(element: var[]..[])
python_script = Python(IN[0]=element)  # IronPython2
# ---------- python_script.python (78 lines) ----------
import clr
clr.AddReference('RevitAPI')
from Autodesk.Revit.DB import *

clr.AddReference("RevitNodes")
import Revit
clr.ImportExtensions(Revit.Elements)

#Definition by Daniel Woodcock
def getSketchIds(item):
	eIds = []
	t = Transaction(item.Document, "Temp")
	t.Start()   
	eIds = item.Document.Delete(item.Id) 
	t.RollBack()  
	return eIds
	
#Inspired by Clockwork
def GetLevel(item):
	val = None
	doc = item.Document
	if item.Category != None and item.Category.CategoryType != CategoryType.Internal :
		if item.Category.Id == ElementId(BuiltInCategory.OST_Rebar) :
			item = doc.GetElement(item.GetHostId())
		if (item.GetType().ToString() in ("Autodesk.Revit.DB.Architecture.StairsRun", "Autodesk.Revit.DB.Architecture.StairsLanding")):
			item = item.GetStairs()
		if hasattr(item, "LevelId"): 
			val = doc.GetElement(item.LevelId)
		if hasattr(item, "Level"):
			val = item.Level
		if hasattr(item, "GenLevel"):
			val = item.GenLevel
		if (item.GetType().ToString() == "Autodesk.Revit.DB.Architecture.Stairs") or item.Category.Id == ElementId(BuiltInCategory.OST_Ramps):
			try: val = doc.GetElement(item.get_Parameter(BuiltInParameter.STAIRS_BASE_LEVEL_PARAM).AsElementId())
			except: pass
		if (item.GetType().ToString() == "Autodesk.Revit.DB.ExtrusionRoof"):
			try: val = doc.GetElement(item.get_Parameter(BuiltInParameter.ROOF_CONSTRAINT_LEVEL_PARAM).AsElementId())
			except: pass
		#if (item.GetType().ToString() == "Autodesk.Revit.DB.Mechanical.Duct" or item.GetType().ToString() == "Autodesk.Revit.DB.Electrical.Conduit"):
			#try: return doc.GetElement(item.get_Parameter(BuiltInParameter.RBS_START_LEVEL_PARAM).AsElementId())
			#except: pass
		if hasattr(item, "OwnerViewId"):
			view = doc.GetElement(item.OwnerViewId)
			if hasattr(view, "GenLevel"):
				val = view.GenLevel
		if not val:
			collector = FilteredElementCollector(doc).OfClass(Level).ToElements()
			
			if isinstance(item,FamilyInstance) and item.Symbol.Family.IsInPlace:
				ids = getSketchIds(item)
				elems = [doc.GetElement(id) for id in ids]
				lName = next((ex.get_Parameter(BuiltInParameter.SKETCH_PLANE_PARAM).AsString() for ex in elems if ex.GetType() == Extrusion), None)
				try: val = [level for level in collector if lName.split(": ")[-1] == level.Name][0]
				except: pass
			else:
				try: val = doc.GetElement(item.get_Parameter(BuiltInParameter.INSTANCE_REFERENCE_LEVEL_PARAM).AsElementId())
				except: 
					try: val = doc.GetElement(item.get_Parameter(BuiltInParameter.INSTANCE_SCHEDULE_ONLY_LEVEL_PARAM).AsElementId())
					except: 
						try: val = doc.GetElement(item.get_Parameter(BuiltInParameter.SCHEDULE_LEVEL_PARAM).AsElementId())
						except:
							#if item is work plane based
							try: val = [level for level in collector if item.get_Parameter(BuiltInParameter.SKETCH_PLANE_PARAM).AsString().split(": ")[-1] == level.Name][0]
							except : val
	return val
	
ProcessLists = lambda function, lists: [ProcessLists(function, item) if isinstance(item, list) else function(item) for item in lists]
ApplyFunction = lambda func, objs: ProcessLists(func, objs) if isinstance(objs, list) else [func(objs)]

def Unwrap(item):
    return UnwrapElement(item)
    
if isinstance(IN[0], list):
	items = ProcessLists(Unwrap, IN[0])
else:
	items = Unwrap(IN[0])

OUT=ApplyFunction(GetLevel,items)
# ----------------------------------------
level = Output(python_script)
