# Dynamo custom node Cleanup.DeleteUnusedViewTemplates.dyf
# category: Modelical.Actions
# This node deletes all unused view templates in the project file.

bool = Input(_bool: bool = false)  # Set Toggle to TRUE to delete unused View Templates
python = Python(IN[0]=bool)  # CPython3
# ---------- python.python (62 lines) ----------
# This node has been made by Modelical
# www.modelical.com

import clr

clr.AddReference("RevitAPI")
from Autodesk.Revit.DB import *
from Autodesk.Revit.DB.Structure import *

clr.AddReference("RevitAPIUI")
from Autodesk.Revit.UI import *

clr.AddReference("RevitServices")
import RevitServices
from RevitServices.Persistence import DocumentManager
from RevitServices.Transactions import TransactionManager

doc = DocumentManager.Instance.CurrentDBDocument

# Logic starts here
bool = IN[0]

if bool:
    views=FilteredElementCollector(doc).OfCategory(BuiltInCategory.OST_Views)
    names=[]
    allVTemp=[]
    usedVTemp=[]

    count=0
    for v in views:
        if v.IsTemplate:
            allVTemp.append(v.Id)
        else:
            if v.ViewTemplateId.IntegerValue != -1:
                usedVTemp.append(v.ViewTemplateId)

    unusedVTemp=[]
    

    for vTemp in allVTemp:
        if vTemp not in usedVTemp:
            unusedVTemp.append(vTemp)

    if len(unusedVTemp)==0:
        OUT="There are no unused view templates"
        
    else:
        OUT=str(len(unusedVTemp))+" template/s have been deleted from Revit"
        t=Transaction(doc, "Modelical.RemoveUnusedTemplates")
        t.Start()
        try:
            for vt in unusedVTemp:
                doc.Delete(vt)
            t.Commit()
        except Exception as ex:
        	OUT=ex
        	#t.RollBack()
        finally:
        	t.Dispose()

else:
    OUT="Set Toggle to TRUE to delete unused View Templates"
# ----------------------------------------
Number_of_deleted_View_Templates__info = Output(python)  # "/*Number of deleted View Templates*/ _info"
