# Dynamo custom node Element.CheckoutStatus.dyf
# category: Modelical.Elements.Query
# This node gets information 'About Creator:', 'Last update in central performed by' and 'Current Owner:' of an element in the active project file.

elements = Input(_elements: var[]..[])  # Element(s) to ask about creator, last update in central and current owner
python = Python(IN[0]=elements)  # CPython3
# ---------- python.python (42 lines) ----------
# This node has been made by Modelical
# www.modelical.com

import clr

clr.AddReference("RevitAPI")
from Autodesk.Revit.DB import *
from Autodesk.Revit.DB.Structure import *

clr.AddReference("RevitAPIUI")
from Autodesk.Revit.UI import *

clr.AddReference("RevitServices")
import RevitServices
from RevitServices.Persistence import DocumentManager

doc = DocumentManager.Instance.CurrentDBDocument


def toList(input):
    if isinstance(input, list):
        return input
    else:
        return [input]

# Logic starts here
elements = toList(UnwrapElement(IN[0]))
fList=[]
for e in elements:
    creator= WorksharingUtils.GetWorksharingTooltipInfo(doc,e.Id).Creator +" is the creator "
    lastChageBy=WorksharingUtils.GetWorksharingTooltipInfo(doc,e.Id).LastChangedBy+" performed the last change"

    if WorksharingUtils.GetWorksharingTooltipInfo(doc,e.Id).Owner != "":
        owner = WorksharingUtils.GetWorksharingTooltipInfo(doc,e.Id).Owner+ " is the owner"
    else:
        owner = "It's free"


    fList.append([e,creator,lastChageBy,owner])

# Output
OUT =fList
# ----------------------------------------
info = Output(python)  # "_info"
