# Dynamo custom node Element.SelectInRevit.dyf
# category: Modelical.Elements.Actions
# This node allows to select Revit elements using the element ID or the element itself.

elementsOrIDs = Input(_elementsOrIDs: var[]..[])  # Elements or IDs
python = Python(IN[0]=elementsOrIDs)  # CPython3
# ---------- python.python (46 lines) ----------
# This node has been made by Modelical
# www.modelical.com

import clr
clr.AddReference("RevitAPI")
from Autodesk.Revit.DB import *

clr.AddReference("RevitAPIUI")
from Autodesk.Revit.UI import *

clr.AddReference("RevitServices")
import RevitServices
from RevitServices.Persistence import DocumentManager

from System.Collections.Generic import List

uidoc = DocumentManager.Instance.CurrentUIApplication.ActiveUIDocument
doc = DocumentManager.Instance.CurrentDBDocument

def toList(input):
    if isinstance(input, list):
        return input
    else:
        return [input]

# Logic starts here

elementsOrIDs = toList(UnwrapElement(IN[0]))

elementIds = List[ElementId]()
fList=[]

for elem in elementsOrIDs:
    try:
        int(elem)
        elementIds.Add(ElementId(int(elem)))
        fList.append(doc.GetElement(ElementId(int(elem))))
    except:
        elementIds.Add(elem.Id)
        fList.append(elem)
selection = uidoc.Selection.SetElementIds(elementIds)

# Transactions

# Output
OUT = fList
# ----------------------------------------
Selected_elements__elements = Output(python)  # "/*Selected elements*/ _elements"
