# Dynamo custom node List.FirstLastItem.dyf (Dynamo 2.6.1.8786)
# category: Modelical.Query
# This node gets the first, last, all but first and all but last elements in a list.

list = Input(_list: var[]..[])  # List
code_block = CodeBlock(l=list)
# ---------- code_block.designscript (6 lines) ----------
//This node has been made by Modelical
// www.modelical.com
List.FirstItem(l);
List.LastItem(l);
List.RestOfItems(l);
List.DropItems(l, -1);
# ----------------------------------------
first = Output(code_block.out0)  # "_first"
last = Output(code_block.out1)  # "_last"
allButFirst = Output(code_block.out2)  # "_allButFirst"
allButLast = Output(code_block.out3)  # "_allButLast"
