# Dynamo custom node PerspectiveView.ByPoints.dyf (Dynamo 2.12.0.5650)
# category: Modelical.Views.Create
# This node creates a new perspective view given its camera location, targets location and name.

cameraPointLocation = Input(_cameraPointLocation: Autodesk.DesignScript.Geometry.Point[]..[])  # Camera location point
targetPointLocation = Input(_targetPointLocation: Autodesk.DesignScript.Geometry.Point[]..[])  # Target location point
viewName = Input(_viewName: var[]..[])  # Name of the view
python_script = Python(IN[0]=cameraPointLocation, IN[1]=targetPointLocation, IN[2]=viewName)  # IronPython2
# ---------- python_script.python (88 lines) ----------
# This node has been made by Modelical
# www.modelical.com

import clr
clr.AddReference('ProtoGeometry')
from Autodesk.DesignScript.Geometry import *
import math

#Load DesignScript DSCore to use functions like List.Flatten
clr.AddReference('DSCoreNodes')
import DSCore
from DSCore import *

#Load Dynamo wrappers
clr.AddReference("RevitNodes")
import Revit
from Revit.Elements import *
clr.ImportExtensions(Revit.GeometryConversion)
clr.ImportExtensions(Revit.Elements)

#Load Revit API
clr.AddReference('RevitAPI')
from Autodesk.Revit.DB import *
import Autodesk

#Load document reference
clr.AddReference("RevitServices")
import RevitServices
from RevitServices.Persistence import DocumentManager
from RevitServices.Transactions import TransactionManager

doc = DocumentManager.Instance.CurrentDBDocument

def toList(input):
    """Return iterable if available, a list of 1 otherwise"""
    if hasattr(input, "__iter__") and not isinstance(input, basestring):
        return input
    else:
        return [input]

cameraPoints = toList(UnwrapElement(IN[0]))
targetPoints = toList(UnwrapElement(IN[1]))
names = toList(IN[2])

threedViewType = None

viewFamilyTypes = FilteredElementCollector(doc).OfClass(ViewFamilyType).ToElements()

allViews = FilteredElementCollector(doc).OfCategory(BuiltInCategory.OST_Views).ToElements()

allViewNames=[]
for v in allViews:
	allViewNames.append(v.Name)
	

for vFT in viewFamilyTypes:
	if vFT.ViewFamily.ToString() == "ThreeDimensional":
		threedViewType = vFT

views=[]
index = 0
TransactionManager.Instance.EnsureInTransaction(doc)
for n in names:
	
	view3D = View3D.CreatePerspective(doc,threedViewType.Id)
	eye = cameraPoints[index].ToXyz()
	forward = targetPoints[index].ToXyz()-cameraPoints[index].ToXyz()
	vecZ = XYZ(0,0,1)
	vecX = forward.CrossProduct(vecZ)
	up = vecX.CrossProduct(forward)
	
	view3D.SetOrientation(ViewOrientation3D(eye, up, forward))
	
	while n in allViewNames:
		n+="_"
	view3D.Name = n
	
	
	farClip = view3D.get_Parameter(BuiltInParameter.VIEWER_BOUND_ACTIVE_FAR)
	farClip.Set(False)
	

	index+=1
	views.append(view3D)
	
TransactionManager.Instance.TransactionTaskDone()	

OUT = views
# ----------------------------------------
views = Output(python_script)  # "_views"; Perspective views
