# Dynamo custom node Point.SimilarityBetweenPoints.dyf (Dynamo 2.6.1.8786)
# category: Modelical.Geometry.Query
# This node checks if two points are similar with an absolute tolerance.

referencePoint = Input(_referencePoint: Autodesk.DesignScript.Geometry.Point)  # Reference point
pointsToCompare = Input(_pointsToCompare: Autodesk.DesignScript.Geometry.Point[]..[])  # Point to compare
tolerance = Input(_tolerance: double = 0.0001)  # Absolute tolerance
python_script = Python(IN[0]=referencePoint, IN[1]=pointsToCompare, IN[2]=tolerance)
# ---------- python_script.python (51 lines) ----------
# This node has been made by Modelical
# www.modelical.com

import clr
clr.AddReference('ProtoGeometry')
from Autodesk.DesignScript.Geometry import *

from math import *

#Load Dynamo wrappers
clr.AddReference("RevitNodes")
import Revit
from Revit.Elements import *
clr.ImportExtensions(Revit.GeometryConversion)
clr.ImportExtensions(Revit.Elements)

def toList(input):
	if isinstance(input,list) == False:
		return [input]
	else:
		return input

def flatten(x):
    result = []
    for el in x:
        if hasattr(el, "__iter__") and not isinstance(el, basestring):
            result.extend(flatten(el))
        else:
            result.append(el)
    return result

def pointSimilarity(p1,p2,tolerance):
	if abs(p1.X - p2.X) <= tolerance and abs(p1.Y - p2.Y) <= tolerance and abs(p1.Z - p2.Z) <= tolerance:
		return True
	else:
		return False


rp = toList(IN[0])
points = toList(IN[1])
tolerance = IN[2]

result=[]

for p in points:
	result.append(pointSimilarity(rp[0],p,tolerance))
	



OUT = result
# ----------------------------------------
True_ = Output(python_script)  # "/*True=SimilarPoints & False=NotSimilarPoints*/ _similarPoints"
