# Dynamo custom node Sheet.RemoveRevision.dyf (Dynamo 2.12.0.5650)
# category: Modelical.Views.Actions
# This node deletes selected revisions from the selected sheets.

sheets = Input(_sheets: var[]..[])  # Sheets to remove the selected revisions. It just works on MANUAL mode.
revisions = Input(_revisions: Revit.Elements.Revision[]..[])  # Revisions to remove.
python_script = Python(IN[0]=sheets, IN[1]=revisions)  # IronPython2
# ---------- python_script.python (66 lines) ----------
# This node has been made by Modelical
# www.modelical.com

import clr
clr.AddReference('ProtoGeometry')
from Autodesk.DesignScript.Geometry import *

clr.AddReference('DScoreNodes')
import DSCore
from DSCore import *

#Load Dynamo wrappers
clr.AddReference("RevitNodes")
import Revit
from Revit.Elements import *
clr.ImportExtensions(Revit.GeometryConversion)
clr.ImportExtensions(Revit.Elements)

#Load Revit API
clr.AddReference('RevitAPI')
from Autodesk.Revit.DB import *

#Load document reference
clr.AddReference("RevitServices")
import RevitServices
from RevitServices.Persistence import DocumentManager
from RevitServices.Transactions import TransactionManager

doc = DocumentManager.Instance.CurrentDBDocument
uiapp = DocumentManager.Instance.CurrentUIApplication
app = uiapp.Application

def toList(input):
    """Return iterable if available, a list of 1 otherwise"""
    if hasattr(input, "__iter__") and not isinstance(input, basestring):
        return input
    else:
        return [input]


revisions = FilteredElementCollector(doc).OfCategory(BuiltInCategory.OST_Revisions).WhereElementIsNotElementType().ToElements()


sheets = toList(UnwrapElement(IN[0]))
revisions = toList(UnwrapElement(IN[1]))

fList=[]
TransactionManager.Instance.EnsureInTransaction(doc)
for s in sheets:
	revInfo=[]
	for rev in revisions:
		if rev.Id not in s.GetAdditionalRevisionIds():

			revInfo.append( rev.Name + " is not in this sheet")
			
		else:
			
			rlist = s.GetAdditionalRevisionIds()
			rlist.Remove(rev.Id)
			s.SetAdditionalRevisionIds(rlist)
			revInfo.append(rev.Name + " has been removed")
			
	fList.append([s,revInfo])			
TransactionManager.Instance.TransactionTaskDone()
	
OUT=[sheets,revInfo]
# ----------------------------------------
code_block = CodeBlock(l=python_script) { l[0]; l[1]; }
It_just_works_on_MANUAL_mode__sheets = Output(code_block.out0)  # "/*It just works on MANUAL mode. */ _sheets"
It_just_works_on_MANUAL_mode__info = Output(code_block.out1)  # "/*It just works on MANUAL mode. */ _info"
