# Dynamo custom node Sheet.UpdateLastRevision.dyf (Dynamo 2.12.0.5650)
# category: Modelical.Views.Actions
# This node update the last revision to the selected sheets, changing it for the next one following the sequence.

sheets = Input(_sheets: var[]..[])  # Sheets to update the revision. It just works on MANUAL mode.
python_script = Python(IN[0]=sheets)  # IronPython2
# ---------- python_script.python (69 lines) ----------
# This node has been made by Modelical
# www.modelical.com

import clr
clr.AddReference('ProtoGeometry')
from Autodesk.DesignScript.Geometry import *

clr.AddReference('DScoreNodes')
import DSCore
from DSCore import *

#Load Dynamo wrappers
clr.AddReference("RevitNodes")
import Revit
from Revit.Elements import *
clr.ImportExtensions(Revit.GeometryConversion)
clr.ImportExtensions(Revit.Elements)

#Load Revit API
clr.AddReference('RevitAPI')
from Autodesk.Revit.DB import *

#Load document reference
clr.AddReference("RevitServices")
import RevitServices
from RevitServices.Persistence import DocumentManager
from RevitServices.Transactions import TransactionManager

doc = DocumentManager.Instance.CurrentDBDocument
uiapp = DocumentManager.Instance.CurrentUIApplication
app = uiapp.Application

def toList(input):
    """Return iterable if available, a list of 1 otherwise"""
    if hasattr(input, "__iter__") and not isinstance(input, basestring):
        return input
    else:
        return [input]


revisions = FilteredElementCollector(doc).OfCategory(BuiltInCategory.OST_Revisions).WhereElementIsNotElementType().ToElements()

revSequence=[]
for rev in revisions:	
	revSequence.append(rev.SequenceNumber)

sheets = toList(UnwrapElement(IN[0]))

fList=[]
TransactionManager.Instance.EnsureInTransaction(doc)
for s in sheets:
		if doc.GetElement(s.GetCurrentRevision())== None:
			fList.append( s.Name + ": There aren't any revision to update")
		
		elif doc.GetElement(s.GetCurrentRevision()).SequenceNumber +1 not in revSequence:
			fList.append( s.Name + ": Last revision is already updated")
			
		else:
			for r in revisions:
				if doc.GetElement(s.GetCurrentRevision()).SequenceNumber +1 == r.SequenceNumber:
					rlist = s.GetAdditionalRevisionIds()
					rlist.Add(r.Id)
					rlist.Remove(s.GetCurrentRevision())
					s.SetAdditionalRevisionIds(rlist)
					fList.append(s.Name + ": Last revision has been updated")
				
TransactionManager.Instance.TransactionTaskDone()
	
OUT=[sheets,fList]
# ----------------------------------------
code_block = CodeBlock(l=python_script) { l[0]; l[1]; }
It_just_works_on_MANUAL_mode__sheets = Output(code_block.out0)  # "/*It just works on MANUAL mode. */ _sheets"
It_just_works_on_MANUAL_mode__info = Output(code_block.out1)  # "/*It just works on MANUAL mode. */ _info"
