# Dynamo custom node Stair.NumberOfRuns.dyf (Dynamo 2.6.1.8786)
# category: Modelical.Elements.Query
# This node returns the number of runs of the selected stair.

stairs = Input(_stairs: var[]..[])  # Stairs
python_script = Python(IN[0]=stairs)
# ---------- python_script.python (26 lines) ----------
# This node has been made by Modelical
# www.modelical.com

import clr
#Load document reference
clr.AddReference("RevitServices")
import RevitServices
from RevitServices.Persistence import DocumentManager

def toList(input):
    """Return iterable if available, a list of 1 otherwise"""
    if hasattr(input, "__iter__") and not isinstance(input, basestring):
        return input
    else:
        return [input]

stairs = toList(UnwrapElement(IN[0]))

runsList = []

for s in stairs:
	runsList.append(len(s.GetStairsRuns()))



OUT = runsList
# ----------------------------------------
numOfRuns = Output(python_script)  # "_numOfRuns"
