# Dynamo custom node ❄_PC_RANSAC_Plane_Detection.dyf
# category: Sastrugi.Pointcloud Geometry
# (Sastrugi_Pointcloud_Geometry) This node uses Random sample consensus (RANSAC) to determine planes within Pointclouds and groups point-sets based on these planes.

InputPoints = Input(InputPoints: var[]..[])
X = Point.X(point=InputPoints)
Y = Point.Y(point=InputPoints)
Z = Point.Z(point=InputPoints)
create = List.Create(item0=X, item1=Y, item2=Z)
transpose = List.Transpose(lists=create)
codeBlock = CodeBlock(input_points_list=transpose)
# ---------- codeBlock.designscript (3 lines) ----------
//Input points list in
//[[x,y,z],[x,y,z]] formated floats.
input_points_list;
# ----------------------------------------
python = Python(IN[0]=codeBlock)  # CPython3
# ---------- python.python (19 lines) ----------
def determine_divisor(values):
    max_abs_value = max(map(abs, values))
    
    if max_abs_value >= 10 and max_abs_value < 100:
        return 10
    elif max_abs_value >= 100 and max_abs_value < 1000:
        return 100
    elif max_abs_value >= 1000:
        return 1000
    else:
        return 1

result = []
items = IN[0]

for i in items:
    result.append(determine_divisor(i))

OUT = result
# ----------------------------------------
codeBlock_2 = CodeBlock(input=codeBlock, divsior=python)
# ---------- codeBlock_2.designscript (2 lines) ----------
//Required unit conversion
input / divsior;
# ----------------------------------------
Threshold = Input(Threshold: var = 0.05)  # The threshold for distance deviation from the 3-point plane equation to use to group planar points.
Iterations = Input(Iterations: int = 100)  # The number of times a random selection of 3-points is made to find planes that best fit point-sets.
python_2 = Python(IN[0]=codeBlock_2, IN[1]=Threshold, IN[2]=Iterations)  # CPython3
# ---------- python_2.python (97 lines) ----------
# Python coding credit to Dynamo Forum user - @Ewan_Opie 2023
# Sastrugi Package https://sites.google.com/view/sastrugi/home

import random
import math
import clr

clr.AddReference('ProtoGeometry')
from Autodesk.DesignScript.Geometry import *


def dot_product(v1, v2):
    return sum(x * y for x, y in zip(v1, v2))

def subtract(v1, v2):
    return [x - y for x, y in zip(v1, v2)]

def cross_product(v1, v2):
    return [v1[1] * v2[2] - v1[2] * v2[1],
            v1[2] * v2[0] - v1[0] * v2[2],
            v1[0] * v2[1] - v1[1] * v2[0]]

def fit_plane(points):
    p1, p2, p3 = points
    v1 = subtract(p2, p1)
    v2 = subtract(p3, p1)
    normal = cross_product(v1, v2)
    d = -dot_product(normal, p1)
    return normal + [d]

def distance_to_plane(plane_params, point):
    a, b, c, d = plane_params
    x, y, z = point
    denominator = (a**2 + b**2 + c**2)**0.5
    epsilon = 1e-6  # Small epsilon value to avoid division by zero
    return abs(a * x + b * y + c * z + d) / max(denominator, epsilon)

def ransac_plane_fit(points, tolerance, min_points, max_planes, max_iterations):
    planes = []
    used_points = []  # Keep track of points already used for plane fitting

    for _ in range(max_planes):
        best_inliers = []
        best_plane = None

        # Filter out used points from the available points
        available_points = [point for point in points if point not in used_points]

        if len(available_points) < min_points:
            break

        for _ in range(max_iterations):
            sample_indices = random.sample(range(len(available_points)), min_points)
            sample = [available_points[i] for i in sample_indices]
            plane_params = fit_plane(sample)

            inliers = []

            for point in available_points:
                if distance_to_plane(plane_params, point) <= tolerance:
                    inliers.append(point)

            if len(inliers) >= min_points:
                if len(inliers) > len(best_inliers):
                    best_inliers = inliers
                    best_plane = plane_params

        if best_plane is not None:
            planes.append((best_plane, best_inliers))
            used_points.extend(best_inliers)

    return planes

# Inputs
input_points = IN[0]
tolerance = IN[1]
max_iterations = IN[2]

# Constraints
min_points_per_plane = 3
max_planes = 100

# Output
result = []

# Main code
planes = ransac_plane_fit(input_points, tolerance, min_points_per_plane, max_planes,max_iterations)

# Process ransac eesults
for p in planes:
    pack = []
    pts = p[1]
    for pt in pts:
        pack.append(Point.ByCoordinates(pt[0],pt[1],pt[2]))
    result.append(pack)

OUT = result
# ----------------------------------------
codeBlock_3 = CodeBlock(p=python_2, divisor=python) { p.X*divisor; p.Y*divisor; p.Z*divisor; }
byCoordinates = Point.ByCoordinates(x=codeBlock_3.out0, y=codeBlock_3.out1, z=codeBlock_3.out2)
byBestFitThroughPoints = Plane.ByBestFitThroughPoints(points=byCoordinates)
Planes = Output(byBestFitThroughPoints)
PointSets = Output(byCoordinates)
