# Dynamo custom node ❄_PC_Select_Points_By_Intersecting_Element.dyf
# category: Sastrugi.Pointcloud Geometry
# (Sastrugi_Pointcloud_Geometry) This node takes a sample of random points from a Pointcloud Instance by using an intersecting element as the filter.

Refresh = Input(Refresh: bool = true)
python = Python(IN[0]=Refresh)  # CPython3
# ---------- python.python (27 lines) ----------
# Python coding credit to Dynamo Forum user - @Ewan_Opie 2021
# Sastrugi Package https://sites.google.com/view/sastrugi/home

import clr

clr.AddReference("RevitAPIUI")
from  Autodesk.Revit.UI import *

clr.AddReference("RevitServices")
import RevitServices
from RevitServices.Persistence import DocumentManager
doc = DocumentManager.Instance.CurrentDBDocument
uidoc=DocumentManager.Instance.CurrentUIApplication.ActiveUIDocument

clr.AddReference("RevitNodes")
import Revit
clr.ImportExtensions(Revit.Elements)

sel1 = uidoc.Selection
ot1 = Selection.ObjectType.Element
msg = 'Pick PointCloud in Active View.'
TaskDialog.Show("Sastrugi", msg)
i = sel1.PickObject(ot1, "Select")
try:
	OUT = doc.GetElement(i.ElementId)
except:
	OUT = []
# ----------------------------------------
flatten = List.Flatten(list=python)
firstItem = List.FirstItem(list=flatten)
FilterElement = Input(FilterElement: var[]..[])  # Any Revit element that intersects the Pointcloud.
solids = Element.Solids(element=FilterElement)
byUnion = Solid.ByUnion(solids=solids)
faces = Element.Faces(element=FilterElement)
byJoinedSurfaces = Solid.ByJoinedSurfaces(facesOfSolid=faces)
boundingBox = Element.BoundingBox(element=FilterElement)
toCuboid = BoundingBox.ToCuboid(boundingBox=boundingBox)
faces_2 = Topology.Faces(topology=solids)
vertices = Face.Vertices(face=faces_2)
count = List.Count(list=vertices@L2)
faces_3 = Topology.Faces(topology=byJoinedSurfaces)
vertices_2 = Face.Vertices(face=faces_3)
count_2 = List.Count(list=vertices_2@L2)
python_2 = Python(IN[0]=byUnion, IN[1]=byJoinedSurfaces, IN[2]=toCuboid, IN[3]=count, IN[4]=count_2)  # CPython3
# ---------- python_2.python (16 lines) ----------
s1 = IN[0]
s2 = IN[1]
s3 = IN[2]

check1 = IN[3]
check2 = IN[3]
if s1 == []:
	OUT = s2
elif s1 == None:
	OUT = s2
elif 2 in check1:
	OUT = s3
elif 2 in check2:
	OUT = s3
else:
	OUT = s3
# ----------------------------------------
centroid = Solid.Centroid(solid=python_2)
ZAxis = Vector.ZAxis()
byOriginNormal = Plane.ByOriginNormal(origin=centroid, normal=ZAxis)
codeBlock = CodeBlock { 1.01; }
scale = Geometry.Scale(geometry=python_2, plane=byOriginNormal, xamount=codeBlock, yamount=codeBlock, zamount=codeBlock)
faces_4 = Topology.Faces(topology=scale)
vertices_3 = Face.Vertices(face=faces_4)
pointGeometry = Vertex.PointGeometry(vertex=vertices_3)
byBestFitThroughPoints = Plane.ByBestFitThroughPoints(points=pointGeometry)
origin = Plane.Origin(plane=byBestFitThroughPoints)
byTwoPoints = Vector.ByTwoPoints(start=origin, end=centroid, lacing=Longest)
byOriginNormal_2 = Plane.ByOriginNormal(origin=origin, normal=byTwoPoints)
codeBlock_2 = CodeBlock { 0.001; }
PointSampleSize = Input(PointSampleSize: int = 1000)  # This is the number of points to take from within the Pointcloud.
python_3 = Python(IN[0]=firstItem, IN[1]=byOriginNormal_2, IN[2]=codeBlock_2, IN[3]=PointSampleSize)  # CPython3
# ---------- python_3.python (48 lines) ----------
# Python coding credit to Dynamo Forum user - @Ewan_Opie 2021
# Sastrugi Package https://sites.google.com/view/sastrugi/home

import clr
clr.AddReference('ProtoGeometry')
from Autodesk.DesignScript.Geometry import *

clr.AddReference("RevitNodes")
import Revit
clr.ImportExtensions(Revit.Elements)

clr.ImportExtensions(Revit.GeometryConversion)

clr.AddReference("RevitServices")
import RevitServices
from RevitServices.Persistence import DocumentManager
from RevitServices.Transactions import TransactionManager
from System.Collections.Generic import *

clr.AddReference("RevitAPI")
import Autodesk
from Autodesk.Revit.DB import *
from Autodesk.Revit.DB.PointClouds import *

doc = DocumentManager.Instance.CurrentDBDocument
uiapp = DocumentManager.Instance.CurrentUIApplication
app = uiapp.Application
uidoc=DocumentManager.Instance.CurrentUIApplication.ActiveUIDocument

PL=[]
for i in IN[1]:
	PL.append(UnwrapElement(i).ToPlane())

IPL=List[Autodesk.Revit.DB.Plane](PL)
PLfilter=PointCloudFilterFactory.CreateMultiPlaneFilter(PL)

dist = IN[2]
sample= IN[3]

points = UnwrapElement(IN[0]).GetPoints(PLfilter, dist, sample)
pointsample=[]
for p in points:
	X=p.X
	Y=p.Y
	Z=p.Z
	pointsample.append(Point.Create(XYZ(X,Y,Z)).ToProtoType(True))

OUT = pointsample
# ----------------------------------------
flatten_2 = List.Flatten(list=python_3)
elementType = Element.ElementType(element=python)
codeBlock_3 = CodeBlock { "Scale"; }
getParameterValueByName = Element.GetParameterValueByName(element=elementType, parameterName=codeBlock_3)
scale_2 = Geometry.Scale(geometry=flatten_2, xamount=getParameterValueByName, yamount=getParameterValueByName, zamount=getParameterValueByName)
identity = CoordinateSystem.Identity()
python_4 = Python(IN[0]=flatten)  # CPython3
# ---------- python_4.python (48 lines) ----------
# Python coding credit to Dynamo Forum user - @Ewan_Opie 2021
# Sastrugi Package https://sites.google.com/view/sastrugi/home

#BIG THANKS TO @AWILLIAMS
import clr
clr.AddReference('ProtoGeometry')
from Autodesk.DesignScript.Geometry import *

clr.AddReference("RevitNodes")
import Revit
clr.ImportExtensions(Revit.Elements)

clr.AddReference("RevitServices")
import RevitServices
from RevitServices.Persistence import DocumentManager
from RevitServices.Transactions import TransactionManager

from System.Collections.Generic import *

clr.AddReference("RevitAPI")
import Autodesk
from Autodesk.Revit.DB import *

clr.ImportExtensions(Revit.GeometryConversion)

doc = DocumentManager.Instance.CurrentDBDocument
uiapp = DocumentManager.Instance.CurrentUIApplication
app = uiapp.Application


cloud = UnwrapElement(IN[0])

TransactionManager.Instance.EnsureInTransaction(doc)


cloudtransform = []

for c in cloud:
	transform = c.GetTotalTransform()
	X = transform.Origin.X
	Y = transform.Origin.Y
	Z = transform.Origin.Z
	point=Point.Create(XYZ(X,Y,Z)).ToProtoType(True)
	cloudtransform.append(point)
	
TransactionManager.Instance.TransactionTaskDone()

OUT = cloudtransform
# ----------------------------------------
ZAxis_2 = Vector.ZAxis()
byOriginNormal_3 = Plane.ByOriginNormal(origin=python_4, normal=ZAxis_2)
byPlane = CoordinateSystem.ByPlane(plane=byOriginNormal_3)
transform = Geometry.Transform(geometry=scale_2, fromCoordinateSystem=identity, contextCoordinateSystem=byPlane, lacing=Longest)
flatten_3 = List.Flatten(list=transform)
OutputPoints = Output(flatten_3)
python_5 = Python(IN[0]=Refresh)  # CPython3
# ---------- python_5.python (46 lines) ----------
# Import necessary Revit API classes
import clr
clr.AddReference("RevitAPI")
from Autodesk.Revit.DB import *

import clr
clr.AddReference('RevitAPI')
import Autodesk
from Autodesk.Revit.DB import *

clr.AddReference('RevitServices')
import RevitServices
from RevitServices.Persistence import DocumentManager


	
# Get the active Revit document
doc = DocumentManager.Instance.CurrentDBDocument
uiapp = DocumentManager.Instance.CurrentUIApplication 
app = uiapp.Application 
uidoc = uiapp.ActiveUIDocument

# Get Revit Versions
revit_version=int(app.VersionNumber)

# Check if the display unit type is for metric or imperial units
if revit_version < 2021:
    display_unit_type = doc.GetUnits().GetFormatOptions(UnitType.UT_Length).DisplayUnits
    if display_unit_type == UnitType.UT_Millimeters or display_unit_type == UnitType.UT_Meters:
        units_used = "Metric"
    elif display_unit_type == UnitType.UT_FeetFractionalInches or display_unit_type == UnitType.UT_DecimalFeet:
        units_used = "Imperial"
    else:
        # Use Metric by Default if nothing found
        units_used = "Metric"
else:
    display_unit_type = doc.GetUnits().GetFormatOptions(SpecTypeId.Length).GetUnitTypeId()
    if display_unit_type == UnitTypeId.Millimeters or display_unit_type == UnitTypeId.Meters:
        units_used = "Metric"
    elif display_unit_type == UnitTypeId.FeetFractionalInches or display_unit_type == UnitTypeId.DecimalFeet:
        units_used = "Imperial"
    else:
        # Use Metric by Default if nothing found
        units_used = "Metric"
    
OUT = units_used
# ----------------------------------------
