# Dynamo custom node ❄_PC_Select_Points_By_Region.dyf
# category: Sastrugi.Pointcloud Geometry
# (Sastrugi_Pointcloud_Geometry) This node allows users to select a specific number of Pointcloud Points by creating a selection region in the Active View.

Refresh = Input(Refresh: bool = false)
codeBlock = CodeBlock(refresh=Refresh) { refresh; }
python = Python(IN[0]=codeBlock)  # CPython3
# ---------- python.python (21 lines) ----------
import clr

clr.AddReference('RevitAPI')
from Autodesk.Revit.DB import *

clr.AddReference('RevitServices')
import RevitServices
from RevitServices.Persistence import DocumentManager
from RevitServices.Transactions import TransactionManager

doc = DocumentManager.Instance.CurrentDBDocument

try:
    unittype = UnitType.UT_Length
    formatoptions = doc.GetUnits().GetFormatOptions(unittype)
    dispunits = formatoptions.DisplayUnits
    OUT = str(dispunits)
except:
    UIunit = doc.GetUnits().GetFormatOptions(SpecTypeId.Length).GetUnitTypeId()
    nameUnit = LabelUtils.GetLabelForUnit(UIunit)
    OUT = str(nameUnit)
# ----------------------------------------
codeBlock_2 = CodeBlock()
# ---------- codeBlock_2.designscript (3 lines) ----------
["Feet",
"Inches"];
true;
# ----------------------------------------
contains = String.Contains(string=python, searchFor=codeBlock_2.out0, ignoreCase=codeBlock_2.out1)
countTrue = List.CountTrue(list=contains)
codeBlock_3 = CodeBlock(n=countTrue)
# ---------- codeBlock_3.designscript (3 lines) ----------
n > 0?
1:
0;
# ----------------------------------------
codeBlock_4 = CodeBlock(passthrough=codeBlock, waitfor=codeBlock_3) { [passthrough,waitfor][0]; }
codeBlock_5 = CodeBlock(passthrough=codeBlock, waitfor=codeBlock_4) { [passthrough,waitfor][0]; }
python_2 = Python(IN[0]=codeBlock_5)  # CPython3
# ---------- python_2.python (15 lines) ----------
import clr

clr.AddReference("RevitServices")
import RevitServices
from RevitServices.Persistence import DocumentManager

doc = DocumentManager.Instance.CurrentDBDocument

clr.AddReference("RevitNodes")
import Revit
clr.ImportExtensions(Revit.Elements)

refresh = IN[0]

OUT = doc.ActiveView.ToDSType(True)
# ----------------------------------------
firstItem = List.FirstItem(list=python_2)
elementType = Element.ElementType(element=firstItem)
python_3 = Python(IN[0]=elementType)  # CPython3
# ---------- python_3.python (12 lines) ----------
import clr
clr.AddReference('RevitAPI')
from Autodesk.Revit.DB import *

def GetFamilyName(item):
	if hasattr(item, "FamilyName"): return item.FamilyName
	else: return None

items = UnwrapElement(IN[0])

if isinstance(IN[0], list): OUT = [GetFamilyName(x) for x in items]
else: OUT = GetFamilyName(items)
# ----------------------------------------
codeBlock_6 = CodeBlock { "3D"; }
contains_2 = String.Contains(string=python_3, searchFor=codeBlock_6)
codeBlock_7 = CodeBlock { "Section Box"; }
getParameterValueByName = Element.GetParameterValueByName(element=firstItem, parameterName=codeBlock_7)
codeBlock_8 = CodeBlock(passthrough=codeBlock, waitfor=firstItem) { [passthrough,waitfor][0]; }
python_4 = Python(IN[0]=codeBlock_8, IN[1]=firstItem, IN[2]=codeBlock_3)  # CPython3
# ---------- python_4.python (62 lines) ----------
# Python coding credit to Dynamo Forum user - @Ewan_Opie 2019
# Sastrugi Package https://sites.google.com/view/sastrugi/home

import clr
clr.AddReference('RevitAPI')
import Autodesk
from Autodesk.Revit.DB import *

clr.AddReference("RevitServices")
import RevitServices
from RevitServices.Persistence import DocumentManager
from RevitServices.Transactions import TransactionManager

clr.AddReference("RevitAPIUI")
from  Autodesk.Revit.UI import *

clr.AddReference('ProtoGeometry')
from Autodesk.DesignScript.Geometry import *

clr.AddReference('DSCoreNodes') 
import DSCore
from DSCore import *

clr.AddReference("RevitNodes")
import Revit
clr.ImportExtensions(Revit.GeometryConversion)

doc = DocumentManager.Instance.CurrentDBDocument
uidoc=DocumentManager.Instance.CurrentUIApplication.ActiveUIDocument

# Start
TransactionManager.Instance.EnsureInTransaction(doc)

buttonlist = TaskDialogCommonButtons.Ok
TaskDialog.Show("Sastrugi","Please select a region in the Active View.",buttonlist)

pboxS=Autodesk.Revit.UI.Selection.PickBoxStyle.Enclosing
pickedBox = uidoc.Selection.PickBox(pboxS, "Select a box")
minP = UnwrapElement(pickedBox.Min)
maxP = UnwrapElement(pickedBox.Max)

if IN[2]==0:
	p1=Point.ByCoordinates(minP.X*304.8,minP.Y*304.8,minP.Z*304.8)
	p2=Point.ByCoordinates(maxP.X*304.8,maxP.Y*304.8,maxP.Z*304.8)
else:
	p1=Point.ByCoordinates(minP.X,minP.Y,minP.Z)
	p2=Point.ByCoordinates(maxP.X,maxP.Y,maxP.Z)

aView = UnwrapElement(IN[1])

aVO = aView.Origin.ToPoint()
aVD = aView.ViewDirection.ToVector()
aVP = Plane.ByOriginNormal(aVO,aVD)

rL = Line.ByStartPointEndPoint(p1,p2)
rLaVP = Curve.PullOntoPlane(rL,aVP)

newO = Curve.PointAtParameter(rLaVP,0.5)

TransactionManager.Instance.TransactionTaskDone()

OUT = aVP,rLaVP,newO,aView
# ----------------------------------------
codeBlock_9 = CodeBlock(passthrough=codeBlock, waitfor=python_4) { [passthrough,waitfor][0]; }
python_5 = Python(IN[0]=codeBlock_9)  # CPython3
# ---------- python_5.python (25 lines) ----------
import clr

clr.AddReference("RevitAPIUI")
from  Autodesk.Revit.UI import *

clr.AddReference("RevitServices")
import RevitServices
from RevitServices.Persistence import DocumentManager
doc = DocumentManager.Instance.CurrentDBDocument
uidoc=DocumentManager.Instance.CurrentUIApplication.ActiveUIDocument

clr.AddReference("RevitNodes")
import Revit
clr.ImportExtensions(Revit.Elements)

sel1 = uidoc.Selection
ot1 = Selection.ObjectType.Element
msg = 'Pick PointCloud in Active View.'
TaskDialog.Show("Sastrugi", msg)
i = sel1.PickObject(ot1, "Select")

try:
    OUT = doc.GetElement(i.ElementId)
except:
	OUT = []
# ----------------------------------------
codeBlock_10 = CodeBlock(out=python_4) { out[0]; out[1]; out[2]; out[3]; }
ZAxis = Vector.ZAxis()
codeBlock_11 = CodeBlock { 1000; }
translate = Geometry.Translate(geometry=codeBlock_10.out2, direction=ZAxis, distance=codeBlock_11)
normal = Plane.Normal(plane=codeBlock_10.out0)
translate_2 = Geometry.Translate(geometry=codeBlock_10.out2, direction=normal, distance=codeBlock_11)
byThreePoints = Plane.ByThreePoints(origin=codeBlock_10.out2, planePoint=translate, xAxisPoint=translate_2)
YAxis = Plane.YAxis(plane=codeBlock_10.out0)
byOriginNormal = Plane.ByOriginNormal(origin=codeBlock_10.out2, normal=YAxis)
codeBlock_12 = CodeBlock(planecheck=byThreePoints, usethisone=byOriginNormal, usetheotherone=byThreePoints)
# ---------- codeBlock_12.designscript (3 lines) ----------
planecheck==null?
usethisone:
usetheotherone;
# ----------------------------------------
mirror = Geometry.Mirror(geometry=codeBlock_10.out1, mirrorPlane=codeBlock_12)
codeBlock_13 = CodeBlock { 0..1; }
pointAtParameter = Curve.PointAtParameter(curve=mirror, param=codeBlock_13)
pointAtParameter_2 = Curve.PointAtParameter(curve=codeBlock_10.out1, param=codeBlock_13)
create = List.Create(item0=pointAtParameter, item1=pointAtParameter_2)
transpose = List.Transpose(lists=create)
flatten = List.Flatten(list=transpose)
byCornerPoints = Rectangle.ByCornerPoints(points=flatten)
normal_2 = Plane.Normal(plane=codeBlock_10.out0)
python_6 = Python(IN[0]=firstItem, IN[1]=codeBlock_3)  # CPython3
# ---------- python_6.python (36 lines) ----------
import clr
clr.AddReference('RevitAPI')
import Autodesk
from Autodesk.Revit.DB import *

view = UnwrapElement(IN[0])
units = IN[1]

top = []
cut = []
bottom = []
depth = []

metric = 304.8
values = []
range = []

try:
	if units == 1:
		values.append(view.GetViewRange().GetOffset(PlanViewPlane.TopClipPlane))
		values.append(view.GetViewRange().GetOffset(PlanViewPlane.CutPlane))
		values.append(view.GetViewRange().GetOffset(PlanViewPlane.BottomClipPlane))
		values.append(view.GetViewRange().GetOffset(PlanViewPlane.ViewDepthPlane))
		range.append(min(values))
		range.append(max(values))
	else:
		values.append((view.GetViewRange().GetOffset(PlanViewPlane.TopClipPlane))*metric)
		values.append((view.GetViewRange().GetOffset(PlanViewPlane.CutPlane))*metric)
		values.append((view.GetViewRange().GetOffset(PlanViewPlane.BottomClipPlane))*metric)
		values.append((view.GetViewRange().GetOffset(PlanViewPlane.ViewDepthPlane))*metric)
		range.append(min(values))
		range.append(max(values))
except:
	range.append([0,1000000])

OUT = range
# ----------------------------------------
minimumItem = List.MinimumItem(list=python_6)
maximumItem = List.MaximumItem(list=python_6)
codeBlock_14 = CodeBlock { "Far Clipping"; }
getParameterValueByName_2 = Element.GetParameterValueByName(element=firstItem, parameterName=codeBlock_14)
codeBlock_15 = CodeBlock { "Far Clip Offset"; }
getParameterValueByName_3 = Element.GetParameterValueByName(element=firstItem, parameterName=codeBlock_15)
codeBlock_16 = CodeBlock(clipping=getParameterValueByName_2, useclip=getParameterValueByName_3)
# ---------- codeBlock_16.designscript (3 lines) ----------
clipping>0?
useclip:
1000000;
# ----------------------------------------
codeBlock_17 = CodeBlock { "Far Clip Active"; }
getParameterValueByName_4 = Element.GetParameterValueByName(element=firstItem, parameterName=codeBlock_17)
codeBlock_18 = CodeBlock { "Far Clip Offset"; }
getParameterValueByName_5 = Element.GetParameterValueByName(element=firstItem, parameterName=codeBlock_18)
codeBlock_19 = CodeBlock(clipping=getParameterValueByName_4, useclip=getParameterValueByName_5)  # same code as codeBlock_16
codeBlock_20 = CodeBlock(viewtype=python_3, planmin=minimumItem, planmax=maximumItem, sdoffset=codeBlock_16, viewdepth3d=codeBlock_19) { viewtype; planmin; planmax; sdoffset; viewdepth3d; }
python_7 = Python(IN[0]=Refresh)  # CPython3
# ---------- python_7.python (46 lines) ----------
# Import necessary Revit API classes
import clr
clr.AddReference("RevitAPI")
from Autodesk.Revit.DB import *

import clr
clr.AddReference('RevitAPI')
import Autodesk
from Autodesk.Revit.DB import *

clr.AddReference('RevitServices')
import RevitServices
from RevitServices.Persistence import DocumentManager


	
# Get the active Revit document
doc = DocumentManager.Instance.CurrentDBDocument
uiapp = DocumentManager.Instance.CurrentUIApplication 
app = uiapp.Application 
uidoc = uiapp.ActiveUIDocument

# Get Revit Versions
revit_version=int(app.VersionNumber)

# Check if the display unit type is for metric or imperial units
if revit_version < 2021:
    display_unit_type = doc.GetUnits().GetFormatOptions(UnitType.UT_Length).DisplayUnits
    if display_unit_type == UnitType.UT_Millimeters or display_unit_type == UnitType.UT_Meters:
        units_used = "Metric"
    elif display_unit_type == UnitType.UT_FeetFractionalInches or display_unit_type == UnitType.UT_DecimalFeet:
        units_used = "Imperial"
    else:
        # Use Metric by Default if nothing found
        units_used = "Metric"
else:
    display_unit_type = doc.GetUnits().GetFormatOptions(SpecTypeId.Length).GetUnitTypeId()
    if display_unit_type == UnitTypeId.Millimeters or display_unit_type == UnitTypeId.Meters:
        units_used = "Metric"
    elif display_unit_type == UnitTypeId.FeetFractionalInches or display_unit_type == UnitTypeId.DecimalFeet:
        units_used = "Imperial"
    else:
        # Use Metric by Default if nothing found
        units_used = "Metric"
    
OUT = units_used
# ----------------------------------------
python_8 = Python(IN[0]=codeBlock_20.viewtype, IN[1]=codeBlock_20.planmin, IN[2]=codeBlock_20.planmax, IN[3]=codeBlock_20.sdoffset, IN[4]=codeBlock_20.viewdepth3d, IN[5]=python_7)  # CPython3
# ---------- python_8.python (36 lines) ----------
import clr

clr.AddReference('DSCoreNodes') 
import DSCore
from DSCore import *

viewtype = IN[0]
planmin = IN[1]
planmax = IN[2]
sdoffset = IN[3]
viewdepth3d = IN[4]
doc_units = IN[5]

if "Metric" in doc_units:
    div = 1
else:
    div = 304.8
    
away = []
towards = []

if String.Contains(viewtype,'Plan') == True:
	towards.append(planmax/div)
	away.append(planmin/div)

elif String.Contains(viewtype,'Section') or String.Contains(viewtype,'Detail') == True:
	towards.append(0)
	away.append((sdoffset/div)*-1)
elif String.Contains(viewtype,'3D') == True:
	towards.append(viewdepth3d/div)
	away.append((viewdepth3d/div)*-1)
else:
	towards.append(1000/div)
	away.append(-1000/div)
	
OUT = towards,away
# ----------------------------------------
codeBlock_21 = CodeBlock(result=python_8) { result[0]; result[1]; }
translate_3 = Geometry.Translate(geometry=byCornerPoints, direction=normal_2, distance=codeBlock_21.out0)
translate_4 = Geometry.Translate(geometry=byCornerPoints, direction=normal_2, distance=codeBlock_21.out1)
join = List.Join(list0=translate_3, list1=translate_4)
byLoft = Solid.ByLoft(crossSections=join)
faces = Topology.Faces(topology=byLoft)
vertices = Face.Vertices(face=faces)
pointGeometry = Vertex.PointGeometry(vertex=vertices)
byBestFitThroughPoints = Plane.ByBestFitThroughPoints(points=pointGeometry)
origin = Plane.Origin(plane=byBestFitThroughPoints)
boundingBox = Geometry.BoundingBox(geometry=byLoft)
maxPoint = BoundingBox.MaxPoint(boundingBox=boundingBox)
minPoint = BoundingBox.MinPoint(boundingBox=boundingBox)
join_2 = List.Join(list0=maxPoint, list1=minPoint)
codeBlock_22 = CodeBlock(pts=join_2) { pt = Math.Average([pts.X,pts.Y,pts.Z]); pt[0]; pt[1]; pt[2]; }
byCoordinates = Point.ByCoordinates(x=codeBlock_22.out1, y=codeBlock_22.out2, z=codeBlock_22.out3)
byTwoPoints = Vector.ByTwoPoints(start=origin, end=byCoordinates, lacing=Longest)
byOriginNormal_2 = Plane.ByOriginNormal(origin=origin, normal=byTwoPoints)
PointSampleSize = Input(PointSampleSize: int = 1000)  # This is the number of points to take from within the selected region. Please note that the actual number of Points output may vary from this number if a Sectionbox has been used.
codeBlock_23 = CodeBlock(pcinstance=python_5, boxplane=byOriginNormal_2, PointSampleSize=PointSampleSize) { pcinstance; boxplane; 0.001; PointSampleSize; }
flatten_2 = List.Flatten(list=codeBlock_23.pcinstance)
firstItem_2 = List.FirstItem(list=flatten_2)
python_9 = Python(IN[0]=firstItem_2, IN[1]=codeBlock_23.boxplane, IN[2]=codeBlock_23.out2, IN[3]=codeBlock_23.PointSampleSize)  # CPython3
# ---------- python_9.python (46 lines) ----------
import clr
clr.AddReference('ProtoGeometry')
from Autodesk.DesignScript.Geometry import *

clr.AddReference("RevitNodes")
import Revit
clr.ImportExtensions(Revit.Elements)

clr.ImportExtensions(Revit.GeometryConversion)

clr.AddReference("RevitServices")
import RevitServices
from RevitServices.Persistence import DocumentManager
from RevitServices.Transactions import TransactionManager
from System.Collections.Generic import *

clr.AddReference("RevitAPI")
import Autodesk
from Autodesk.Revit.DB import *
from Autodesk.Revit.DB.PointClouds import *


doc = DocumentManager.Instance.CurrentDBDocument
uiapp = DocumentManager.Instance.CurrentUIApplication
app = uiapp.Application
uidoc=DocumentManager.Instance.CurrentUIApplication.ActiveUIDocument

planes=[]
for i in IN[1]:
	planes.append(UnwrapElement(i).ToPlane())
Iplanes=List[Autodesk.Revit.DB.Plane](planes)

pcf=PointCloudFilterFactory.CreateMultiPlaneFilter(planes)

averageDistance = IN[2]
numberOfPoints= IN[3]

points = UnwrapElement(IN[0]).GetPoints(pcf, averageDistance, numberOfPoints)
elements=[]
for p in points:
	X=p.X
	Y=p.Y
	Z=p.Z
	elements.append(Point.Create(XYZ(X,Y,Z)).ToProtoType(True))

OUT = elements
# ----------------------------------------
flatten_3 = List.Flatten(list=python_9)
codeBlock_24 = CodeBlock(passthrough=codeBlock_23.pcinstance, waitfor=python_9) { [passthrough,waitfor][0]; }
elementType_2 = Element.ElementType(element=codeBlock_24)
codeBlock_25 = CodeBlock { "Scale"; }
getParameterValueByName_6 = Element.GetParameterValueByName(element=elementType_2, parameterName=codeBlock_25)
scale = Geometry.Scale(geometry=flatten_3, xamount=getParameterValueByName_6, yamount=getParameterValueByName_6, zamount=getParameterValueByName_6)
identity = CoordinateSystem.Identity()
python_10 = Python(IN[0]=flatten_2)  # CPython3
# ---------- python_10.python (49 lines) ----------
#BIG THANKS TO @AWILLIAMS

import clr
clr.AddReference('ProtoGeometry')
from Autodesk.DesignScript.Geometry import *

clr.AddReference("RevitNodes")
import Revit
clr.ImportExtensions(Revit.Elements)

clr.AddReference("RevitServices")
import RevitServices
from RevitServices.Persistence import DocumentManager
from RevitServices.Transactions import TransactionManager

from System.Collections.Generic import *

clr.AddReference("RevitAPI")
import Autodesk
from Autodesk.Revit.DB import *

clr.ImportExtensions(Revit.GeometryConversion)

doc = DocumentManager.Instance.CurrentDBDocument
uiapp = DocumentManager.Instance.CurrentUIApplication
app = uiapp.Application


cloud = UnwrapElement(IN[0])

TransactionManager.Instance.EnsureInTransaction(doc)


cloudtransform = []

for c in cloud:
	transform = c.GetTotalTransform()
	X = transform.Origin.X
	Y = transform.Origin.Y
	Z = transform.Origin.Z
	bX = transform.BasisX.ToVector()
	bY = transform.BasisY.ToVector()
	point = Point.Create(XYZ(X,Y,Z)).ToProtoType(True)
	cloudtransform.append(point)
	cloudtransform.append(bX)
		
TransactionManager.Instance.TransactionTaskDone()

OUT = cloudtransform
# ----------------------------------------
codeBlock_26 = CodeBlock(p=python_10) { p[0]; p[1]; }
ZAxis_2 = Vector.ZAxis()
byOriginNormal_3 = Plane.ByOriginNormal(origin=codeBlock_26.out0, normal=ZAxis_2)
ZAxis_3 = Vector.ZAxis()
X = Vector.X(vector=codeBlock_26.out1)
Y = Vector.Y(vector=codeBlock_26.out1)
XAxis = Vector.XAxis()
angleWithVector = Vector.AngleWithVector(vector=codeBlock_26.out1, otherVector=XAxis)
python_11 = Python(IN[0]=codeBlock_26.out1, IN[1]=X, IN[2]=Y, IN[3]=angleWithVector)  # CPython3
# ---------- python_11.python (16 lines) ----------
# Load the Python Standard and DesignScript Libraries
import sys
import clr
clr.AddReference('ProtoGeometry')
from Autodesk.DesignScript.Geometry import *

vec = IN[0]
xv = IN[1]
yv = IN[2]
va = IN[3]

if xv>yv:
	OUT = 360-va
else:
	OUT = va-360
	
# ----------------------------------------
rotate = Geometry.Rotate(geometry=byOriginNormal_3, origin=codeBlock_26.out0, axis=ZAxis_3, degrees=python_11)
byPlane = CoordinateSystem.ByPlane(plane=rotate)
transform = Geometry.Transform(geometry=scale, fromCoordinateSystem=identity, contextCoordinateSystem=byPlane, lacing=Longest)
flatten_4 = List.Flatten(list=firstItem)
python_12 = Python(IN[0]=flatten_4)  # CPython3
# ---------- python_12.python (60 lines) ----------
#BIG THANKS TO @AWILLIAMS

import clr
clr.AddReference('ProtoGeometry')
from Autodesk.DesignScript.Geometry import *

clr.AddReference("RevitNodes")
import Revit
clr.ImportExtensions(Revit.Elements)

clr.AddReference("RevitServices")
import RevitServices
from RevitServices.Persistence import DocumentManager
from RevitServices.Transactions import TransactionManager

from System.Collections.Generic import *

clr.AddReference("RevitAPI")
import Autodesk
from Autodesk.Revit.DB import *

clr.ImportExtensions(Revit.GeometryConversion)

doc = DocumentManager.Instance.CurrentDBDocument
uiapp = DocumentManager.Instance.CurrentUIApplication
app = uiapp.Application


views = UnwrapElement(IN[0])

TransactionManager.Instance.EnsureInTransaction(doc)

sectionboxes = []

for view in views:
	sectionbox = view.GetSectionBox()
	transform = sectionbox.Transform
	sboxoriginx = transform.Origin.X
	sboxoriginy = transform.Origin.Y
	sboxoriginz = transform.Origin.Z
	vx = transform.BasisX.ToVector()
	bp = Point.Create(XYZ(sboxoriginx,sboxoriginy,sboxoriginz)).ToProtoType(True)
	minx = sectionbox.Min.X + sboxoriginx
	maxx = sectionbox.Max.X + sboxoriginx
	miny = sectionbox.Min.Y + sboxoriginy
	maxy = sectionbox.Max.Y + sboxoriginy
	minz = sectionbox.Min.Z + sboxoriginz
	maxz = sectionbox.Max.Z + sboxoriginz
	bbox = BoundingBoxXYZ()
	bbox.Min = XYZ((minx), (miny), (minz))
	bbox.Max = XYZ((maxx), (maxy), (maxz))
	tsectionbox = bbox.ToProtoType()
	sectionboxes.append(tsectionbox)
	sectionboxes.append(vx)
	sectionboxes.append(bp)

	
TransactionManager.Instance.TransactionTaskDone()

OUT = sectionboxes
# ----------------------------------------
codeBlock_27 = CodeBlock(p=python_12) { p[0]; p[1]; p[2]; }
toCuboid = BoundingBox.ToCuboid(boundingBox=codeBlock_27.out0)
ZAxis_4 = Vector.ZAxis()
YAxis_2 = Vector.YAxis()
angleWithVector_2 = Vector.AngleWithVector(vector=codeBlock_27.out1, otherVector=YAxis_2)
XAxis_2 = Vector.XAxis()
angleWithVector_3 = Vector.AngleWithVector(vector=codeBlock_27.out1, otherVector=XAxis_2)
codeBlock_28 = CodeBlock(v=angleWithVector_2, this1=angleWithVector_3)
# ---------- codeBlock_28.designscript (3 lines) ----------
v>90?
0-this1:
this1;
# ----------------------------------------
rotate_2 = Geometry.Rotate(geometry=toCuboid, origin=codeBlock_27.out2, axis=ZAxis_4, degrees=codeBlock_28)
doesIntersect = Geometry.DoesIntersect(geometry=transform, other=rotate_2)
filterByBoolMask = List.FilterByBoolMask(list=transform, mask=doesIntersect)
python_13 = Python(IN[0]=contains_2, IN[1]=getParameterValueByName, IN[2]=filterByBoolMask.in, IN[3]=transform, IN[4]=transform)  # CPython3
# ---------- python_13.python (17 lines) ----------
import sys
import clr
clr.AddReference('ProtoGeometry')
from Autodesk.DesignScript.Geometry import *

is3d = IN[0]
sectionenabled = IN[1]
pass1 = IN[2]
pass2= IN[3]
pass3 = IN[4]

if is3d == True and sectionenabled == 1:
	OUT = pass1
elif is3d == True and sectionenabled == 0:
	OUT = pass2
else:
	OUT = pass3
# ----------------------------------------
flatten_5 = List.Flatten(list=python_13)
OutputPoints = Output(flatten_5)
byBestFitThroughPoints_2 = Plane.ByBestFitThroughPoints(points=flatten_5)
BestFitPlane = Output(byBestFitThroughPoints_2)
Troubleshooting = Input(Troubleshooting: bool = true)  # !!! Not an Input !!! - Troubleshooting - If no points are being returned when trying to select a region in a 3D view, a forced refresh of the Active View plane may be necessary. To do this perform the following steps: 1 - Select the Pointcloud Instance 2 - Use the Zoom-All command, or click a corner of the Viewcube 3 - Refresh the Node and attempt a region selection
