# Dynamo custom node ❄_PC_Select_Points_Randomly.dyf
# category: Sastrugi.Pointcloud Geometry
# (Sastrugi_Pointcloud_Geometry) This node takes a sample of random points from a Pointcloud Instance.

Refresh = Input(Refresh: bool = true)
python = Python(IN[0]=Refresh)  # CPython3
# ---------- python.python (27 lines) ----------
# Python coding credit to Dynamo Forum user - @Ewan_Opie 2021
# Sastrugi Package https://sites.google.com/view/sastrugi/home
import clr

clr.AddReference("RevitAPIUI")
from  Autodesk.Revit.UI import *

clr.AddReference("RevitServices")
import RevitServices
from RevitServices.Persistence import DocumentManager
doc = DocumentManager.Instance.CurrentDBDocument
uidoc=DocumentManager.Instance.CurrentUIApplication.ActiveUIDocument

clr.AddReference("RevitNodes")
import Revit
clr.ImportExtensions(Revit.Elements)

sel1 = uidoc.Selection
ot1 = Selection.ObjectType.Element
msg = 'Pick PointCloud in Active View.'
TaskDialog.Show("Sastrugi", msg)
i = sel1.PickObject(ot1, "Select")
try:
    OUT = doc.GetElement(i.ElementId)
except:
	OUT = []
		
# ----------------------------------------
flatten = List.Flatten(list=python)
firstItem = List.FirstItem(list=flatten)
boundingBox = Element.BoundingBox(element=python)
toCuboid = BoundingBox.ToCuboid(boundingBox=boundingBox)
centroid = Solid.Centroid(solid=toCuboid)
ZAxis = Vector.ZAxis()
byOriginNormal = Plane.ByOriginNormal(origin=centroid, normal=ZAxis)
codeBlock = CodeBlock { 1.01; }
scale = Geometry.Scale(geometry=toCuboid, plane=byOriginNormal, xamount=codeBlock, yamount=codeBlock, zamount=codeBlock)
faces = Topology.Faces(topology=scale)
vertices = Face.Vertices(face=faces)
pointGeometry = Vertex.PointGeometry(vertex=vertices)
byBestFitThroughPoints = Plane.ByBestFitThroughPoints(points=pointGeometry)
origin = Plane.Origin(plane=byBestFitThroughPoints)
centroid_2 = Solid.Centroid(solid=toCuboid)
byTwoPoints = Vector.ByTwoPoints(start=origin, end=centroid_2, lacing=Longest)
byOriginNormal_2 = Plane.ByOriginNormal(origin=origin, normal=byTwoPoints)
codeBlock_2 = CodeBlock { 0.001; }
PointSampleSize = Input(PointSampleSize: int = 1000)  # This is the number of points to take from within the Pointcloud.
python_2 = Python(IN[0]=firstItem, IN[1]=byOriginNormal_2, IN[2]=codeBlock_2, IN[3]=PointSampleSize)  # CPython3
# ---------- python_2.python (48 lines) ----------
# Python coding credit to Dynamo Forum user - @Ewan_Opie 2021
# Sastrugi Package https://sites.google.com/view/sastrugi/home

import clr
clr.AddReference('ProtoGeometry')
from Autodesk.DesignScript.Geometry import *

clr.AddReference("RevitNodes")
import Revit
clr.ImportExtensions(Revit.Elements)

clr.ImportExtensions(Revit.GeometryConversion)

clr.AddReference("RevitServices")
import RevitServices
from RevitServices.Persistence import DocumentManager
from RevitServices.Transactions import TransactionManager
from System.Collections.Generic import *

clr.AddReference("RevitAPI")
import Autodesk
from Autodesk.Revit.DB import *
from Autodesk.Revit.DB.PointClouds import *

doc = DocumentManager.Instance.CurrentDBDocument
uiapp = DocumentManager.Instance.CurrentUIApplication
app = uiapp.Application
uidoc=DocumentManager.Instance.CurrentUIApplication.ActiveUIDocument

PL=[]
for i in IN[1]:
	PL.append(UnwrapElement(i).ToPlane())

IPL=List[Autodesk.Revit.DB.Plane](PL)
PLfilter=PointCloudFilterFactory.CreateMultiPlaneFilter(PL)

dist = IN[2]
sample= IN[3]

points = UnwrapElement(IN[0]).GetPoints(PLfilter, dist, sample)
pointsample=[]
for p in points:
	X=p.X
	Y=p.Y
	Z=p.Z
	pointsample.append(Point.Create(XYZ(X,Y,Z)).ToProtoType(True))

OUT = pointsample
# ----------------------------------------
flatten_2 = List.Flatten(list=python_2)
elementType = Element.ElementType(element=python)
codeBlock_3 = CodeBlock { "Scale"; }
getParameterValueByName = Element.GetParameterValueByName(element=elementType, parameterName=codeBlock_3)
scale_2 = Geometry.Scale(geometry=flatten_2, xamount=getParameterValueByName, yamount=getParameterValueByName, zamount=getParameterValueByName)
identity = CoordinateSystem.Identity()
python_3 = Python(IN[0]=flatten)  # CPython3
# ---------- python_3.python (48 lines) ----------
# Python coding credit to Dynamo Forum user - @Ewan_Opie 2021
# Sastrugi Package https://sites.google.com/view/sastrugi/home

#BIG THANKS TO @AWILLIAMS
import clr
clr.AddReference('ProtoGeometry')
from Autodesk.DesignScript.Geometry import *

clr.AddReference("RevitNodes")
import Revit
clr.ImportExtensions(Revit.Elements)

clr.AddReference("RevitServices")
import RevitServices
from RevitServices.Persistence import DocumentManager
from RevitServices.Transactions import TransactionManager

from System.Collections.Generic import *

clr.AddReference("RevitAPI")
import Autodesk
from Autodesk.Revit.DB import *

clr.ImportExtensions(Revit.GeometryConversion)

doc = DocumentManager.Instance.CurrentDBDocument
uiapp = DocumentManager.Instance.CurrentUIApplication
app = uiapp.Application


cloud = UnwrapElement(IN[0])

TransactionManager.Instance.EnsureInTransaction(doc)


cloudtransform = []

for c in cloud:
	transform = c.GetTotalTransform()
	X = transform.Origin.X
	Y = transform.Origin.Y
	Z = transform.Origin.Z
	point=Point.Create(XYZ(X,Y,Z)).ToProtoType(True)
	cloudtransform.append(point)
	
TransactionManager.Instance.TransactionTaskDone()

OUT = cloudtransform
# ----------------------------------------
ZAxis_2 = Vector.ZAxis()
byOriginNormal_3 = Plane.ByOriginNormal(origin=python_3, normal=ZAxis_2)
byPlane = CoordinateSystem.ByPlane(plane=byOriginNormal_3)
transform = Geometry.Transform(geometry=scale_2, fromCoordinateSystem=identity, contextCoordinateSystem=byPlane, lacing=Longest)
flatten_3 = List.Flatten(list=transform)
OutputPoints = Output(flatten_3)
