# Dynamo custom node ❄_PC_Set_Graphics_Override_for_Scans.dyf
# category: Sastrugi.Pointcloud Graphics
# (Sastrugi-Pointcloud_Graphics) Overrides the graphics for Scan locations within a Pointcloud instance in the specified views.

PointcloudInstance = Input(PointcloudInstance: var[]..[])
flatten = List.Flatten(list=PointcloudInstance)
PointcloudOverrideSettings = Input(PointcloudOverrideSettings: var[]..[])  # Plese note that Scans within Pointcloud Instances can only be overriden with a Fixed Color graphics style.
flatten_2 = List.Flatten(list=PointcloudOverrideSettings)
ScanNames = Input(ScanNames: var[]..[])
flatten_3 = List.Flatten(list=ScanNames)
ViewList = Input(ViewList: var[]..[])
flatten_4 = List.Flatten(list=ViewList)
python = Python(IN[0]=flatten, IN[1]=flatten_2, IN[2]=flatten_3, IN[3]=flatten_4)  # CPython3
# ---------- python.python (74 lines) ----------
# Python coding credit to Dynamo Forum user - @Ewan_Opie 2019
# Sastrugi Package https://sites.google.com/view/sastrugi/home

import clr
clr.AddReference("RevitNodes")
import Revit
clr.ImportExtensions(Revit.Elements)

clr.AddReference("RevitServices")
import RevitServices
from RevitServices.Persistence import DocumentManager
from RevitServices.Transactions import TransactionManager

from System.Collections.Generic import *

clr.AddReference("RevitAPI")
import Autodesk
from Autodesk.Revit.DB import *

from Autodesk.Revit import DB

import sys
pyt_path = r'C:\Program Files (x86)\IronPython 2.7\Lib'
sys.path.append(pyt_path)

clr.ImportExtensions(Revit.GeometryConversion)

doc = DocumentManager.Instance.CurrentDBDocument
uiapp = DocumentManager.Instance.CurrentUIApplication
app = uiapp.Application

def tolist(obj1):
	if hasattr(obj1,"__iter__"): return obj1
	else: return [obj1]	
	
cloud = tolist(UnwrapElement(IN[0]))

pcORsettings = tolist(IN[1])

name = tolist(IN[2])

views = tolist(UnwrapElement(IN[3]))

errorReport = []

TransactionManager.Instance.EnsureInTransaction(doc)

try:
		errorReport = None
		if len(cloud)>1:
			for c in cloud:
				for v in views:
					pt_overrides = v.GetPointCloudOverrides()
				for p1,n1 in zip(pcORsettings,name):
					for p2,n2 in zip(p1,n1):
						pt_overrides.SetPointCloudScanOverrideSettings(c.Id, p2,n2,doc)
		else:
			for c in cloud:
				for v in views:
					pt_overrides = v.GetPointCloudOverrides()
				for p,n in zip(pcORsettings,name):
						pt_overrides.SetPointCloudScanOverrideSettings(c.Id, p,n,doc)
except:
		import traceback
		errorReport.append(str(traceback.format_exc()))
		
TransactionManager.Instance.TransactionTaskDone()

if errorReport == None:
	OUT = cloud
else:
	OUT = errorReport

	
# ----------------------------------------
PointcloudInstance_2 = Output(python)  # "PointcloudInstance"
