# Dynamo graph test.dyn (Dynamo 2.16.1.2727)
# packages: SastrugiPointCloud 2.3.0

select_model_element = DSModelElementSelection()  # 1 picked in the model
pc_get_scans_and_regions = Custom[❄_PC_Get_Scans_and_Regions](PointcloudInstance=select_model_element)  # package SastrugiPointCloud; (Sastrugi_Pointcloud_Geometry) This node extracts Scan Names/Origins and Scan Region Names from within a Pointcloud Instance.
code_block = CodeBlock { "Test 2"; }
code_block_2 = CodeBlock { "ground points"; }
pc_graphics_override_settings_no = Custom[❄_PC_Graphics_Override_Settings_No-Override]()  # package SastrugiPointCloud; (Sastrugi_Pointcloud_Graphics) Override settings for Pointcloud by No-Override.
current = Document.Current()
activeView = Document.ActiveView(document=current)
pc_set_graphics_override = Custom[❄_PC_Set_Graphics_Override](PointcloudInstance=select_model_element, PointcloudOverrideSettings=pc_graphics_override_settings_no, ViewList=activeView)  # package SastrugiPointCloud; (Sastrugi-Pointcloud_Graphics) Overrides the graphics for a Pointcloud instance in the specified views.
code_block_3 = CodeBlock { 125; }
byARGB = Color.ByARGB(green=code_block_3)
pc_graphics_override_settings_by = Custom[❄_PC_Graphics_Override_Settings_By_Elevation]()  # package SastrugiPointCloud; (Sastrugi_Pointcloud_Graphics) Override settings for Pointcloud by Elevation.
pc_graphics_override_settings_by_2 = Custom[❄_PC_Graphics_Override_Settings_By_Fixed_Color]()  # package SastrugiPointCloud; (Sastrugi_Pointcloud_Graphics) Override settings for Pointcloud by Fixed Color.
pc_graphics_override_settings_by_3 = Custom[❄_PC_Graphics_Override_Settings_By_Intensity]()  # package SastrugiPointCloud; (Sastrugi_Pointcloud_Graphics) Override settings for Pointcloud by Intensity.
pc_graphics_override_settings_by_4 = Custom[❄_PC_Graphics_Override_Settings_By_Normals]()  # package SastrugiPointCloud; (Sastrugi_Pointcloud_Graphics) Override settings for Pointcloud by Normals.
pc_graphics_override_settings = Custom[❄_PC_Graphics_Override_Settings_Visibility_Show]()  # package SastrugiPointCloud; (Sastrugi_Pointcloud_Graphics) Override settings to Show Scans/Regions.
pc_graphics_override_settings_2 = Custom[❄_PC_Graphics_Override_Settings_Visibilty_Hide]()  # package SastrugiPointCloud; (Sastrugi_Pointcloud_Graphics) Override settings to Hide Scans/Regions.
