# Dynamo custom node FillPattern.LinePatternCreation.dyf (Dynamo 0.9.0.3067)
# category: Zebra.Revit
# Creates and visualises the line pattern used in fill patterns. Part of the method of creating a Fill Pattern (.pat) file using the Zebra package.

Origin_X = Input()  # "Origin.X"
Origin_Y = Input()  # "Origin.Y"
Angle = Input()

# group: Base Line
start_origin = Point.ByCoordinates(x=Origin_X, y=Origin_Y)
code_block = CodeBlock(t2=Origin_Y) { point1 = Autodesk.Point.ByCoordinates(5000, t2, 0); point2 = Autodesk.Point.ByCoordinates(-5000, t2, 0); }
byStartPointEndPoint = Line.ByStartPointEndPoint(startPoint=code_block.point1, endPoint=code_block.point2)
ZAxis = Vector.ZAxis()
rotate = Geometry.Rotate(geometry=byStartPointEndPoint, origin=start_origin, axis=ZAxis, degrees=Angle)
startPoint = Curve.StartPoint(rotate)
byStartPointEndPoint_2 = Line.ByStartPointEndPoint(startPoint=start_origin, endPoint=startPoint)
endPoint = Curve.EndPoint(rotate)
byStartPointEndPoint_3 = Line.ByStartPointEndPoint(startPoint=start_origin, endPoint=endPoint)
direction = Line.Direction(rotate)

Pen_Down = Input()

# group: Pen Down Conversion
code_block_2 = CodeBlock { 0; }
eq = Pen_Down == code_block_2
code_block_3 = CodeBlock { 100; }
if_ = If(test=eq, true=code_block_3, false=Pen_Down)

Pen_Up = Input()

# group: First Pattern Line
code_block_4 = CodeBlock { 0.000; }
create = List.Create(if_, Pen_Up)
code_block_5 = CodeBlock { 0.000; }
contains = Contains(create, code_block_5)
length = Curve.Length(byStartPointEndPoint_2)
code_block_6 = CodeBlock(len=length, pd=if_, pu=Pen_Up) { len/(pd+pu); }
ceiling = Math.Ceiling(code_block_6)
ofRepeatedItem = List.OfRepeatedItem(item=create, amount=ceiling)
flatten = Flatten(ofRepeatedItem)
python_script = Python(IN[0]=flatten)
# ---------- python_script.python (19 lines) ----------
#Copyright(c) 2014, Nathan Miller
# The Proving Ground, http://theprovingground.org
import clr
clr.AddReference('ProtoGeometry')
from Autodesk.DesignScript.Geometry import *

#The input to this node will be stored in the IN[0] variable.
list = IN[0]
mass = 0
masspart = []
if hasattr(list, "__iter__"):
    for i in range(0,len(list)):
	mass = mass + list[i]
	masspart.append(mass)
else:
    masspart.append(list)

#Assign your output to the OUT variable
OUT = masspart
# ----------------------------------------
if_2 = If(test=contains, true=length, false=python_script)
uniqueItems = List.UniqueItems(if_2)
addItemToFront = List.AddItemToFront(item=code_block_4, list=uniqueItems)
pointAtDistance = Curve.PointAtDistance(byStartPointEndPoint_2, addItemToFront)
code_block_7 = CodeBlock { 0..1; 2; }
sublists = List.Sublists(list=pointAtDistance, ranges=code_block_7.out0, offset=code_block_7.out1)
transpose = List.Transpose(sublists)
code_block_8 = CodeBlock(x=transpose) { x[0]; x[1]; }
byStartPointEndPoint_4 = Line.ByStartPointEndPoint(startPoint=code_block_8.out0, endPoint=code_block_8.out1)
pointAtDistance_2 = Curve.PointAtDistance(byStartPointEndPoint_3, Pen_Up)
byStartPointEndPoint_5 = Line.ByStartPointEndPoint(startPoint=pointAtDistance_2, endPoint=endPoint)
code_block_9 = CodeBlock { 0.000; }
length_2 = Curve.Length(byStartPointEndPoint_5)
code_block_10 = CodeBlock(len=length_2, pd=if_, pu=Pen_Up) { len/(pd+pu); }
ceiling_2 = Math.Ceiling(code_block_10)
ofRepeatedItem_2 = List.OfRepeatedItem(item=create, amount=ceiling_2)
flatten_2 = Flatten(ofRepeatedItem_2)
python_script_2 = Python(IN[0]=flatten_2)  # same code as python_script
if_3 = If(test=contains, true=length_2, false=python_script_2)
uniqueItems_2 = List.UniqueItems(if_3)
addItemToFront_2 = List.AddItemToFront(item=code_block_9, list=uniqueItems_2)
pointAtDistance_3 = Curve.PointAtDistance(byStartPointEndPoint_5, addItemToFront_2)
code_block_11 = CodeBlock { 0..1; 2; }
sublists_2 = List.Sublists(list=pointAtDistance_3, ranges=code_block_11.out0, offset=code_block_11.out1)
transpose_2 = List.Transpose(sublists_2)
code_block_12 = CodeBlock(x=transpose_2) { x[0]; x[1]; }
byStartPointEndPoint_6 = Line.ByStartPointEndPoint(startPoint=code_block_12.out0, endPoint=code_block_12.out1)
code_block_13 = CodeBlock(line1=byStartPointEndPoint_4, line2=byStartPointEndPoint_6) { t5 = List.Clean(line1, true); t6 = List.Clean(line2, true); t2 = t5; t3 = t6; t1 = {t2, t3}; t4 = Flatten(t1); }

Y_Shift = Input()
X_Shift = Input()

# group: Offset Pattern Lines
code_block_14 = CodeBlock(yshift=Y_Shift) { 5000/yshift; }
ceiling_3 = Math.Ceiling(code_block_14)
ofRepeatedItem_3 = List.OfRepeatedItem(item=Y_Shift, amount=ceiling_3)
flatten_3 = Flatten(ofRepeatedItem_3)
python_script_3 = Python(IN[0]=flatten_3)  # same code as python_script
offset = Curve.Offset(curve=code_block_13.t4, distance=python_script_3, lacing=CrossProduct)
transpose_3 = List.Transpose(offset)
flatten_4 = Flatten(transpose_3)
count = List.Count(transpose_3)
ofRepeatedItem_4 = List.OfRepeatedItem(item=X_Shift, amount=count)
flatten_5 = Flatten(ofRepeatedItem_4)
python_script_4 = Python(IN[0]=flatten_5)  # same code as python_script
count_2 = List.Count()
map = List.Map(list=transpose_3, f_x=count_2)
code_block_15 = CodeBlock(x=map) { x[0]; }
ofRepeatedItem_5 = List.OfRepeatedItem(item=python_script_4, amount=code_block_15, lacing=Longest)
flatten_6 = Flatten(ofRepeatedItem_5)
translate = Geometry.Translate(geometry=flatten_4, direction=direction, distance=flatten_6)

# group: Negative Offset Pattern Lines
code_block_16 = CodeBlock(distance=python_script_3) { -distance; }
offset_2 = Curve.Offset(curve=code_block_13.t4, distance=code_block_16, lacing=CrossProduct)
transpose_4 = List.Transpose(offset_2)
flatten_7 = Flatten(transpose_4)
count_3 = List.Count(transpose_4)
ofRepeatedItem_6 = List.OfRepeatedItem(item=X_Shift, amount=count_3)
flatten_8 = Flatten(ofRepeatedItem_6)
python_script_5 = Python(IN[0]=flatten_8)  # same code as python_script
count_4 = List.Count()
map_2 = List.Map(list=transpose_4, f_x=count_4)
code_block_17 = CodeBlock(x=map_2) { x[0]; }
ofRepeatedItem_7 = List.OfRepeatedItem(item=python_script_5, amount=code_block_17, lacing=Longest)
flatten_9 = Flatten(ofRepeatedItem_7)
code_block_18 = CodeBlock(distance=flatten_9) { -distance; }
translate_2 = Geometry.Translate(geometry=flatten_7, direction=direction, distance=code_block_18)

create_2 = List.Create(code_block_13.t4, translate, translate_2)
flatten_10 = Flatten(create_2)
LinePattern = Output(flatten_10)

# group: String Code Output
string = StringInput(",            ")
string_from_object = FromObject(Angle)
string_from_object_2 = FromObject(Origin_X)
string_from_object_3 = FromObject(Origin_Y)
string_from_object_4 = FromObject(X_Shift)
string_from_object_5 = FromObject(Y_Shift)
string_from_object_6 = FromObject(Pen_Down)
code_block_19 = CodeBlock { 0; }
eq_2 = Pen_Up == code_block_19
code_block_20 = CodeBlock(x=Pen_Up) { -x; }
if_4 = If(test=eq_2, true=Pen_Up, false=code_block_20)
string_from_object_7 = FromObject(if_4)
join = String.Join(string, string_from_object, string_from_object_2, string_from_object_3, string_from_object_4, string_from_object_5, string_from_object_6, string_from_object_7)
String = Output(join)
