# Dynamo custom node FillPattern.PresetFlooringPavers.dyf (Dynamo 0.9.0.3067)
# category: Zebra.Revit
# Creates the string needed for a custom flooring pavers pattern. Change the the width of the squares and diamonds to toggle the size of the pattern. Feed the output string into a FillPattern.ModelPatFile or FillPattern.DraftPatFIle node

n0 = DoubleSlider(0, range=0..360 step 1)  # "0"
Diamonds = Input()
code_block = CodeBlock(j=Diamonds) { c2 = j*j; sqrt = Math.Sqrt(c2/2); -sqrt; sqrt*2; }
Squares = Input()
code_block_2 = CodeBlock(p=Squares, sqrt=code_block.sqrt, j=Diamonds) { a = (p-sqrt); (p-sqrt)*2; c2 = (a*a)+(a*a); sqr = Math.Sqrt(c2); sqr + j; }
linePatternCreation = Custom[FillPattern.LinePatternCreation](Angle=n0, Origin_X=code_block.sqrt, Origin_Y=n0, X_Shift=Squares, Y_Shift=Squares, Pen_Down=code_block_2.out1, Pen_Up=code_block.out3)  # Creates and visualises the line pattern used in fill patterns. Part of the method of creating a Fill Pattern (.pat) file using the Zebra package.
n90 = DoubleSlider(90, range=0..360 step 1)  # "90"
linePatternCreation_2 = Custom[FillPattern.LinePatternCreation](Angle=n90, Origin_X=n0, Origin_Y=code_block.sqrt, X_Shift=Squares, Y_Shift=Squares, Pen_Down=code_block_2.out1, Pen_Up=code_block.out3)
n45 = DoubleSlider(45, range=0..360 step 1)  # "45"
linePatternCreation_3 = Custom[FillPattern.LinePatternCreation](Angle=n45, Origin_X=n0, Origin_Y=code_block.out2, X_Shift=n0, Y_Shift=code_block_2.out4, Pen_Down=Diamonds, Pen_Up=code_block_2.sqr)
linePatternCreation_4 = Custom[FillPattern.LinePatternCreation](Angle=n45, Origin_X=code_block.out2, Origin_Y=n0, X_Shift=n0, Y_Shift=code_block_2.out4, Pen_Down=Diamonds, Pen_Up=code_block_2.sqr)
n135 = DoubleSlider(135, range=0..360 step 1)  # "135"
linePatternCreation_5 = Custom[FillPattern.LinePatternCreation](Angle=n135, Origin_X=n0, Origin_Y=code_block.out2, X_Shift=n0, Y_Shift=code_block_2.out4, Pen_Down=Diamonds, Pen_Up=code_block_2.sqr)
linePatternCreation_6 = Custom[FillPattern.LinePatternCreation](Angle=n135, Origin_X=code_block.sqrt, Origin_Y=n0, X_Shift=n0, Y_Shift=code_block_2.out4, Pen_Down=Diamonds, Pen_Up=code_block_2.sqr)
create = List.Create(linePatternCreation.LinePattern, linePatternCreation_2.LinePattern, linePatternCreation_3.LinePattern, linePatternCreation_4.LinePattern, linePatternCreation_5.LinePattern, linePatternCreation_6.LinePattern)
LinePattern = Output(create)
string = StringInput("\n")
join = String.Join(string, linePatternCreation.String, linePatternCreation_2.String, linePatternCreation_3.String, linePatternCreation_4.String, linePatternCreation_5.String, linePatternCreation_6.String)
String = Output(join)
