# Dynamo custom node FillPattern.PresetHollandParquet.dyf (Dynamo 0.9.0.3067)
# category: Zebra.Revit
# Creates the string needed for a standard stone holland parquet pattern. Change the length to toggle the size of the pattern. Feed the ouptut string into a FillPattern.ModelPatFile or FillPattern.DraftPatFile node.

number = DoubleSlider(0, range=0..360 step 1)
Length = Input()
linePatternCreation = Custom[FillPattern.LinePatternCreation](Angle=number, Origin_X=number, Origin_Y=number, X_Shift=number, Y_Shift=Length, Pen_Down=number, Pen_Up=number)  # Creates and visualises the line pattern used in fill patterns. Part of the method of creating a Fill Pattern (.pat) file using the Zebra package.
number_2 = DoubleSlider(90, range=0..360 step 1)
linePatternCreation_2 = Custom[FillPattern.LinePatternCreation](Angle=number_2, Origin_X=number, Origin_Y=number, X_Shift=number, Y_Shift=Length, Pen_Down=number, Pen_Up=number)
code_block = CodeBlock(len=Length) { len2 = len/2; -len2; }
linePatternCreation_3 = Custom[FillPattern.LinePatternCreation](Angle=number, Origin_X=number, Origin_Y=code_block.len2, X_Shift=Length, Y_Shift=Length, Pen_Down=Length, Pen_Up=Length)
linePatternCreation_4 = Custom[FillPattern.LinePatternCreation](Angle=number_2, Origin_X=code_block.out1, Origin_Y=number, X_Shift=Length, Y_Shift=Length, Pen_Down=Length, Pen_Up=Length)
create = List.Create(linePatternCreation.LinePattern, linePatternCreation_2.LinePattern, linePatternCreation_3.LinePattern, linePatternCreation_4.LinePattern)
LinePattern = Output(create)
string = StringInput("\n")
join = String.Join(string, linePatternCreation.String, linePatternCreation_2.String, linePatternCreation_3.String, linePatternCreation_4.String)
String = Output(join)
