# Dynamo custom node String.AddLeadingZeros.dyf (Dynamo 0.8.1.1942)
# category: Zebra.Core.String.Action
# Takes an input of a series of numbers, finds the length of the maximum number and then adds leading zero's to any numbers of less digits til they all match.
# As an example if you feed in the numbers 1, 10 and 1000, it will give you the following 0001, 0010, 1000. Lists can be in any order as it searches for the maximum item.

Numbers = Input()
string_from_object = FromObject(Numbers)
length = String.Length(string_from_object)
maximumItem = List.MaximumItem(length)
python_script = Python(IN[0]=string_from_object, IN[1]=maximumItem)
# ---------- python_script.python (8 lines) ----------
import clr

stringlist = IN[0]
stringlength = IN[1]
elementlist = list()
for item in stringlist:
	elementlist.append(item.zfill(stringlength))
OUT = elementlist
# ----------------------------------------
Numbers_2 = Output(python_script)  # "Numbers"
