# Dynamo custom node String.AllIndicesOf.dyf (Dynamo 0.9.0.3067)
# category: Zebra.Core.String.Action
# Returns the indices of the given characters. Works on both nested lists of strings and multiple character inputs

Character = Input()
count = List.Count(Character)
code_block = CodeBlock { 1; }
eq = count == code_block
ignoreCase = Input(ignoreCase : bool = true)
toUpper = String.ToUpper(Character)
toLower = String.ToLower(Character)
create = List.Create(toUpper, toLower)
if_ = Custom[Logic.If](test=ignoreCase, ifTrue=create, ifFalse=Character)  # Retains the old status of the previous built-in IF node.
create_2 = List.Create(if_)
if_2 = Custom[Logic.If](test=eq, ifTrue=create_2, ifFalse=if_)
flatten = Flatten(if_2)
String = Input()
length = String.Length(String)
code_block_2 = CodeBlock(n=length) { 0..(n-1); 1; }
substring = String.Substring(str=String, startIndex=code_block_2.out0, length=code_block_2.out1)
if_equal_return_index = Custom[If Equal Return Index](listA=flatten, listB=substring)  # If element in list A is equal to an element in list B then return index from list B.
uniqueItems = List.UniqueItems(if_equal_return_index)
sort = List.Sort(uniqueItems)
Indices = Output(sort)
