# Dynamo custom node String.AlphabetAsList.dyf (Dynamo 0.8.0.950)
# category: Zebra.Core.String.Create
# Creates the alphabet as a list of strings

string = StringInput("abcdefghijklmnopqrstuvwxyz")
length = String.Length(string)
code_block = CodeBlock(n=length) { 0..(n-1); 1; }
substring = String.Substring(str=string, startIndex=code_block.out0, length=code_block.out1)
LowerString = Output(substring)
toUpper = String.ToUpper(substring)
UpperString = Output(toUpper)
