# Dynamo custom node String.AlphabetAsString.dyf (Dynamo 0.8.0.950)
# category: Zebra.Core.String.Create
# Creates the alphabet as a string

string = StringInput("abcdefghijklmnopqrstuvwxyz")
LowerString = Output(string)
toUpper = String.ToUpper(string)
UpperString = Output(toUpper)
