# Dynamo custom node String.ContainsThisAndThat.dyf (Dynamo 0.9.0.3067)
# category: Zebra.Core.String
# Returns true and false based on whether the string contains all the inputs (multiple input as list)

code_block = CodeBlock { false; }
String = Input()
code_block_2 = CodeBlock(x=String) { Count(x); }
cycle = List.Cycle(list=code_block, amount=code_block_2)
code_block_3 = CodeBlock { true; }
SearchFor = Input()
ignoreCase = Input(ignoreCase : bool = true)
contains = String.Contains(str=String, searchFor=SearchFor, ignoreCase=ignoreCase, lacing=CrossProduct)
transpose = List.Transpose(contains)
code_block_4 = CodeBlock { 1; }
flatten = List.Flatten(amt=code_block_4)
map = List.Map(list=transpose, f_x=flatten)
getKeys = GetKeys()
map_2 = List.Map(list=map, f_x=getKeys)
filterByBoolMask = List.FilterByBoolMask(list=map_2, mask=map)
flatten_2 = Flatten(filterByBoolMask.in)
identity = Object.Identity()
groupByFunction = GroupByFunction(flatten_2, identity)
firstItem = List.FirstItem()
map_3 = List.Map(list=groupByFunction, f_x=firstItem)
count = List.Count()
map_4 = List.Map(list=groupByFunction, f_x=count)
code_block_5 = CodeBlock(x=SearchFor) { Count(x); }
eq = map_4 == code_block_5
filterByBoolMask_2 = List.FilterByBoolMask(list=map_3, mask=eq)
python_script = Python(IN[0]=cycle, IN[1]=code_block_3, IN[2]=filterByBoolMask_2.in)
# ---------- python_script.python (6 lines) ----------
thelist = IN[0]
thereplacement = IN[1]
indices = IN[2]
for index in indices:
	thelist[index] = thereplacement
OUT = thelist
# ----------------------------------------
Bool = Output(python_script)
