# Dynamo custom node String.CreateListBasedOnReturns.dyf (Dynamo 0.8.0.950)
# category: Zebra.Core.String.Action
# Creates a list with a new index for each new line (return) within the string

String = Input()
code_block = CodeBlock { 0; }
code_block_2 = CodeBlock()
# ---------- code_block_2.designscript (2 lines) ----------
"
";
# ----------------------------------------
boolean = BoolSelector(true)
allIndicesOf = Custom[String.AllIndicesOf](String=String, Character=code_block_2, ignoreCase=boolean)  # Returns the indices of the given characters. Works on both nested lists of strings and multiple character inputs
code_block_3 = CodeBlock(x=allIndicesOf) { x+1; }
addItemToFront = List.AddItemToFront(item=code_block, list=code_block_3)
length = String.Length(String)
addItemToEnd = List.AddItemToEnd(length, allIndicesOf)
code_block_4 = CodeBlock(ind=addItemToEnd, len=addItemToFront) { ind - len; }
substring = String.Substring(str=String, startIndex=addItemToFront, length=code_block_4)
String_2 = Output(substring)  # "String"
