# Dynamo custom node String.DropFirstWord.dyf (Dynamo 0.8.0.950)
# category: Zebra.Core.String.Action
# Removes the set of characters upto the first whitespace in the string

String = Input()
code_block = CodeBlock { 0; }
code_block_2 = CodeBlock { " "; }
boolean = BoolSelector(true)
indexOf = String.IndexOf(string=String, searchFor=code_block_2, ignoreCase=boolean)
code_block_3 = CodeBlock(x=indexOf) { x+1; }
remove = String.Remove(str=String, startIndex=code_block, count=code_block_3)
String_2 = Output(remove)  # "String"
