# Dynamo custom node String.DropLastWord.dyf (Dynamo 0.8.0.950)
# category: Zebra.Core.String.Action
# Removes the set of characters after the last whitespace in the string

String = Input()
code_block = CodeBlock { " "; }
boolean = BoolSelector(true)
allIndicesOf = Custom[String.AllIndicesOf](String=String, Character=code_block, ignoreCase=boolean)  # Returns the indices of the given characters. Works on both nested lists of strings and multiple character inputs
lastItem = List.LastItem(allIndicesOf)
length = String.Length(String)
code_block_2 = CodeBlock(len=length, last=lastItem) { len-last; }
remove = String.Remove(str=String, startIndex=lastItem, count=code_block_2)
String_2 = Output(remove)  # "String"
