# Dynamo custom node String.RemoveAllWhitespace.dyf (Dynamo 0.8.0.950)
# category: Zebra.Core.String.Action
# Removes all the whitespace within the string

String = Input()
code_block = CodeBlock { " "; ""; }
changeAllCharactersTo = Custom[String.ChangeAllCharactersTo](String=String, ChangeFrom=code_block.out0, ChangeTo=code_block.out1)  # Changes all the given characters to the new value
trimTrailingWhitespace = String.TrimTrailingWhitespace(changeAllCharactersTo)
trimLeadingWhitespace = String.TrimLeadingWhitespace(trimTrailingWhitespace)
String_2 = Output(trimLeadingWhitespace)  # "String"
