# Dynamo custom node String.RemoveCharactersAtIndices.dyf "String.RemoveCharacterAtIndices" (Dynamo 0.8.0.950)
# category: Zebra.Core.String.Action
# Removes the characters from the string at the given indices

String = Input()
length = String.Length(String)
code_block = CodeBlock(n=length) { 0..(n-1); 1; }
substring = String.Substring(str=String, startIndex=code_block.out0, length=code_block.out1)
Indices = Input()
removeItemAtIndex = List.RemoveItemAtIndex(list=substring, indices=Indices)
concat = String.Concat(removeItemAtIndex)
string_from_array = FromArray(concat)
code_block_2 = CodeBlock { 0; 1; }
remove = String.Remove(str=string_from_array, startIndex=code_block_2.out0, count=code_block_2.out1)
length_2 = String.Length(remove)
code_block_3 = CodeBlock(x=length_2) { x-1; 1; }
remove_2 = String.Remove(str=remove, startIndex=code_block_3.out0, count=code_block_3.out1)
code_block_4 = CodeBlock()
# ---------- code_block_4.designscript (3 lines) ----------
",";
"
";
# ----------------------------------------
replace = String.Replace(str=remove_2, searchFor=code_block_4.out0, replaceWith=code_block_4.out1)
String_2 = Output(replace)  # "String"
