# Dynamo custom node String.ToList.dyf (Dynamo 0.8.1.1942)
# category: Zebra.Core.String.Action
# Convert the given string to a list

code_block = CodeBlock { 1; }
String = Input()
count = List.Count(String)
lt = code_block < count
length = String.Length(String)
code_block_2 = CodeBlock(n=length) { 0..(n-1); 1; }
substring = String.Substring(startIndex=code_block_2.out0, length=code_block_2.out1)
map = List.Map(list=String, f_x=substring)
code_block_3 = CodeBlock { 1; }
flatten = List.Flatten(list=map, amt=code_block_3)
code_block_4 = CodeBlock(x=flatten, count=count) { x[0..#count..(count+1)]; }
length_2 = String.Length(String)
code_block_5 = CodeBlock(n=length_2) { 0..(n-1); 1; }
substring_2 = String.Substring(str=String, startIndex=code_block_5.out0, length=code_block_5.out1)
if_ = Custom[Logic.If](test=lt, ifTrue=code_block_4, ifFalse=substring_2)  # Retains the old status of the previous built-in IF node.
List = Output(if_)
