# Dynamo custom node [&] Surface.TrimMultiple.dyf (Dynamo 2.10.1.3976)
# category: Ampersand.[&] Surface
# Trim a single surface with a list of closed curves and pick points (to designate the region to be subtracted)

# note: Colin McCrone
# Twitter:  @ColinMcCrone
# LinkedIn: https://www.linkedin.com/in/colinmccrone
# Updated:  2021-05-26
# An example Dynamo script for how to use this node can be found in the 'extra' folder where the package files are stored. To find it, go to the Packages Menu and select "Manage Packages." Where Ampersand is listed, open the drop-down menu link at the right and choose "Show Root Directory." Open the "extra" folder to find the example file called AmpersandExamples.dyn.
surface = Input(surface: Autodesk.DesignScript.Geometry.Surface)
trimCurves = Input(trimCurves: var[])
pickPoints = Input(pickPoints: Autodesk.DesignScript.Geometry.Point[])
python_script = Python(IN[0]=surface, IN[1]=trimCurves, IN[2]=pickPoints)  # CPython3
# ---------- python_script.python (20 lines) ----------
#
# Colin McCrone
# Twitter:  https://twitter.com/colinmccrone
# LinkedIn: https://www.linkedin.com/in/colinmccrone
# Updated:  2019-05-20
#
import clr
clr.AddReference('ProtoGeometry')
from Autodesk.DesignScript.Geometry import *

base_surface = IN[0]
circles = IN[1]
points = IN[2]

new_base = base_surface

for i in range(len(circles)):
	new_base = new_base.Trim(circles[i], points[i])[0]

OUT = new_base
# ----------------------------------------
surface_2 = Output(python_script)  # "surface"
