# Dynamo custom node Get Objects by Layer.dyf (Dynamo 1.2.0.2654)
# category: Archi-lab_MantisShrimp.Rhinoceros.ReadRhino
# Queries all Rhino objects on a given layer.

RhinoFile = Input()
RhinoLayer = Input()
python_script = Python(IN[0]=RhinoFile, IN[1]=RhinoLayer)
# ---------- python_script.python (51 lines) ----------
# Copyright(c) 2016, Konrad Sobon
# @arch_laboratory, http://archi-lab.net

import clr
import sys
import System

pyt_path = r'C:\Program Files (x86)\IronPython 2.7\Lib'
sys.path.append(pyt_path)

from os import path
assemblies = System.AppDomain.CurrentDomain.GetAssemblies()
msUIpath = [a.Location for a in assemblies if 'MantisShrimp,' in a.FullName][0]
msPath = System.IO.Path.GetDirectoryName(msUIpath).rsplit('\\',1)[0]
msPathExtra = '%s\\extra\\' %msPath
msPathRh = '%s\\bin\\Rhino3dmIO.dll' %msPath
sys.path.append(msPathExtra)
clr.AddReferenceToFileAndPath(msPathRh)
import Rhino as rc

#The inputs to this node will be stored as a list in the IN variable.
dataEnteringNode = IN
rhModel = IN[0]

if isinstance(IN[1], list):
	rhLayer = IN[1]
else:
	rhLayer = [IN[1]]

def GetObjectsByLayer(rhl = None, rhm = rhModel):
	if rhl != None:
		return rhm.Objects.FindByLayer(rhl)
	else:
		return None

def ProcessList(_func, _list):
    return map( lambda x: ProcessList(_func, x) if type(x)==list else _func(x), _list )

try:
	errorReport = None
	objects = ProcessList(GetObjectsByLayer, rhLayer)
except:
	# if error accurs anywhere in the process catch it
	import traceback
	errorReport = traceback.format_exc()

#Assign your output to the OUT variable
if errorReport == None:
	OUT = objects
else:
	OUT = errorReport
# ----------------------------------------
RhinoObject = Output(python_script)
