# Dynamo custom node Get Rhino Object Value by Key.dyf (Dynamo 1.2.0.2654)
# category: Archi-lab_MantisShrimp.Rhinoceros.Properties
# This node retrieves user string value by its key.

RhinoObject = Input()
Key = Input()
python_script = Python(IN[0]=RhinoObject, IN[1]=Key)
# ---------- python_script.python (55 lines) ----------
# Copyright(c) 2016, Konrad Sobon
# @arch_laboratory, http://archi-lab.net

import clr
import sys
import System

pyt_path = r'C:\Program Files (x86)\IronPython 2.7\Lib'
sys.path.append(pyt_path)

from os import path
assemblies = System.AppDomain.CurrentDomain.GetAssemblies()
msUIpath = [a.Location for a in assemblies if 'MantisShrimp,' in a.FullName][0]
msPath = System.IO.Path.GetDirectoryName(msUIpath).rsplit('\\',1)[0]
msPathExtra = '%s\\extra\\' %msPath
msPathRh = '%s\\bin\\Rhino3dmIO.dll' %msPath
sys.path.append(msPathExtra)
clr.AddReferenceToFileAndPath(msPathRh)
import Rhino as rc

#The inputs to this node will be stored as a list in the IN variable.
dataEnteringNode = IN

if isinstance(IN[0], list):
	rhObjects = IN[0]
else:
	rhObjects = [IN[0]]

key = IN[1]

def GetValue(obj, key):
	try:
		if obj.Attributes.HasUserData:
			us = obj.Attributes.GetUserStrings()
			return us.Item[key]
	except:
		pass

def ProcessListArg(_func, _list, _arg):
    return map( lambda x: ProcessListArg(_func, x, _arg) if type(x)==list else _func(x, _arg), _list )

#extract user keys
try:
	errorReport = None
	rhValues = ProcessListArg(GetValue, rhObjects, key)
except:
	# if error accurs anywhere in the process catch it
	import traceback
	errorReport = traceback.format_exc()

#Assign your output to the OUT variable
if errorReport == None:
	OUT = rhValues
else:
	OUT = errorReport
# ----------------------------------------
Value = Output(python_script)
