# Dynamo custom node Read GH File.dyf (Dynamo 1.2.0.2654)
# category: Archi-lab_MantisShrimp.Grasshopper.ReadGH
# Reads the file exported from Grasshopper (serializes it back into relevant Rhino geometry such as surfaces, points etc)

FilePath = Input()
Import = Input(Import:bool=false)
python_script = Python(IN[0]=FilePath, IN[1]=Import)
# ---------- python_script.python (107 lines) ----------
# Copyright(c) 2016, Konrad Sobon
# @arch_laboratory, http://archi-lab.net

import clr
clr.AddReference('ProtoGeometry')
from Autodesk.DesignScript.Geometry import *

import sys
pyt_path = r'C:\Program Files (x86)\IronPython 2.7\Lib'
sys.path.append(pyt_path)

import System
from os import path
assemblies = System.AppDomain.CurrentDomain.GetAssemblies()
msUIpath = [a.Location for a in assemblies if 'MantisShrimp,' in a.FullName][0]
msPath = System.IO.Path.GetDirectoryName(msUIpath).rsplit('\\',1)[0]
msPathExtra = '%s\\extra\\' %msPath
txtFilePath = '%s\\extra\\rhPath.txt' %msPath
sys.path.append(msPathExtra)
if not path.isfile(txtFilePath):
	message = "Provide valid RhinoCommon.dll path."
else:
	file = open(txtFilePath, 'r+')
	rhDllPath = file.readline()
	clr.AddReferenceToFileAndPath(rhDllPath)
	file.close()

from System import Array
from System.Collections.Generic import *
import Rhino as rc
import pickle
from mantisshrimp import *

#The inputs to this node will be stored as a list in the IN variable.
dataEnteringNode = IN
filePath = IN[0]
_import = IN[1]

class SerializeObjects(object):
	def __init__(self, filePath, data = None):
		self.filePath = filePath
		self.data = data

	def saveToFile(self):
		with open(self.filePath, 'wb') as outf:
			pickle.dump(self.data, outf)

	def readFromFile(self):
		with open(self.filePath, 'rb') as inf:
			self.data = pickle.load(inf)

if filePath != None:
	if filePath.GetType() == System.IO.FileInfo:
		filePath = filePath.FullName
		
serializer = SerializeObjects(filePath)
serializer.readFromFile()

def ProcessList(_func, _list):
    return map( lambda x: ProcessList(_func, x) if type(x)==list else _func(x), _list)
    
def toDSObject(item):
	if type(item) == MSPoint:
		return item.toDSPoint()
	elif type(item) == MSLine:
		return item.toDSLine()
	elif type(item) == MSPolyLine:
		return item.toDSPolyCurve()
	elif type(item) == MSEllipse:
		return item.toDSEllipse()
	elif type(item) == MSCircle:
		return item.toDSCircle()
	elif type(item) == MSArc:
		return item.toDSArc()
	elif type(item) == MSNurbsCurve:
		return item.toDSNurbsCurve()
	elif type(item) == MSMultiSpanNurbsCurve:
		return item.toDSPolyCurve()
	elif type(item) == MSPolyCurve:
		return item.toDSPolyCurve()
	elif type(item) == MSMesh:
		return item.toDSMesh()
	elif type(item) == MSNurbsSurface:
		return item.toDSNurbsSurface()
	elif type(item) == MSBrep:
		return item.toDSPolySurface()
	elif type(item) == MSData:
		return item.data
	else:
		message = "Geometry type not yet supported"
		return message

message = None
if _import:
	serializedData = serializer.data
	if type(serializedData) == MSData:
		geometryOut = serializedData.data
	else:
		geometryOut = ProcessList(toDSObject, serializedData)
else:
	message = "Import set to false"

#Assign your output to the OUT variable
if message == None:
	OUT = geometryOut
else:
	OUT = '\n'.join('{:^35}'.format(s) for s in message.split('\n'))
# ----------------------------------------
DS_Object = Output(python_script)
