# Dynamo custom node Document.LoadFamily.dyf (Dynamo 3.2.2.5494)
# category: Clockwork.Revit.Application.Actions
# A very crude implementation of family loading. Will *not* reload an already loaded family of the same name.
# packages: Clockwork for Dynamo 2.x 2.6.0

path = Input(path: string)  # The path to the family to be loaded
turnIntoList = Custom[TurnIntoList](unknownItem=path)  # package Clockwork for Dynamo 2.x
directoryName = FileSystem.DirectoryName(path=turnIntoList)
code_block = CodeBlock(path=directoryName) { path + "\\"; ""; ".rfa"; }
replace = String.Replace(string=turnIntoList, searchFor=code_block.out0, replaceWith=code_block.out1)
replace_2 = String.Replace(string=replace, searchFor=code_block.out2, replaceWith=code_block.out1)
python_script = Python(IN[0]=turnIntoList, IN[1]=replace_2)  # IronPython2
# ---------- python_script.python (36 lines) ----------
import clr
clr.AddReference('RevitAPI')
from Autodesk.Revit.DB import *

clr.AddReference("RevitNodes")
import Revit
clr.ImportExtensions(Revit.Elements)

clr.AddReference("RevitServices")
import RevitServices
from RevitServices.Persistence import DocumentManager
from RevitServices.Transactions import TransactionManager

doc = DocumentManager.Instance.CurrentDBDocument
fampaths = IN[0]
famnames = IN[1]
elementlist = []
booleans = []

TransactionManager.Instance.EnsureInTransaction(doc)
for fampath in fampaths:
	try: 
		doc.LoadFamily(fampath)
		booleans.append(True)
	except: booleans.append(False)
TransactionManager.Instance.TransactionTaskDone()

collector = FilteredElementCollector(doc)
collector.OfClass(Family)
for item in collector.ToElements():
	if item.Name in famnames:
		typelist = list()
		for famtypeid in item.GetFamilySymbolIds():
			typelist.append(doc.GetElement(famtypeid).ToDSType(True))
		elementlist.append(typelist)
OUT = (elementlist,booleans)
# ----------------------------------------
firstItem = List.FirstItem(list=python_script)
returnListOrSingleValue = Custom[ReturnListOrSingleValue](unknownItem=path, seq=firstItem)  # package Clockwork for Dynamo 2.x
familyTypes = Output(returnListOrSingleValue)
lastItem = List.LastItem(list=python_script)
returnListOrSingleValue_2 = Custom[ReturnListOrSingleValue](unknownItem=path, seq=lastItem)
success = Output(returnListOrSingleValue_2)
