# Dynamo custom node LinkedCADFile.dyf (Dynamo 1.3.2.2480)
# category: DynaTools.QAQC.Document
# Check the number of CAD drawings linked or imported

Refresh = Input(Refresh: bool)  # Define the highest score value for this KPI
python_script = Python(IN[0]=Refresh)
# ---------- python_script.python (62 lines) ----------
############################################
#Copyright 2017							 ###
#Twitter: @CesareCaoduro				 ###
#Email: cesare.caoduro@gmail.com		 ###
############################################

#Declaration section#

import sys
import clr

pyt_path = r'C:\Program Files (x86)\IronPython 2.7\Lib'
sys.path.append(pyt_path)
import os

clr.AddReference('ProtoGeometry')
from Autodesk.DesignScript.Geometry import *

clr.AddReference('RevitAPIUI')
from  Autodesk.Revit.UI import *

clr.AddReference('RevitAPI')
from Autodesk.Revit.DB import *
from Autodesk.Revit.Creation import *

clr.AddReference('RevitNodes')
import Revit

clr.ImportExtensions(Revit.Elements)
clr.ImportExtensions(Revit.GeometryConversion)

clr.AddReference('RevitServices')
from RevitServices.Persistence import DocumentManager
from RevitServices.Transactions import TransactionManager

#Access the active document#
doc = DocumentManager.Instance.CurrentDBDocument
uidoc = DocumentManager.Instance.CurrentUIApplication.ActiveUIDocument

#Start a transaction on the active document#
TransactionManager.Instance.EnsureInTransaction(doc)

#Insert here your code#
input = IN[0]
output, linked = [], []
isLinked = 0

if input:
	col = FilteredElementCollector(doc).OfClass(ImportInstance)
	for c in col:
		output.append(c.Category.Name)
		if c.IsLinked:
			linked.append(True)
			isLinked += 1
		else:
			linked.append(False)

#Dispose the active transaction
TransactionManager.Instance.TransactionTaskDone()

#List outputs#
OUT = output, linked, len(linked), isLinked
# ----------------------------------------
code_block = CodeBlock(lst=python_script) { lst[0]; lst[1]; lst[2]; lst[3]; }
CADFiles = Output(code_block.out0)
IsLinked = Output(code_block.out1)
code_block_2 = CodeBlock(x=code_block.out0) { Count(x) == 0; }
code_block_3 = CodeBlock { "NA"; }
code_block_4 = CodeBlock()
# ---------- code_block_4.designscript (9 lines) ----------
//Check wheter a number is a NaN value
"
import math
score = IN[0]
if math.isnan(score):
 OUT = 0
else:
 OUT = score
";
# ----------------------------------------
MaxScore = Input(MaxScore : double = 5)  # Define the highest score value for this KPI
code_block_5 = CodeBlock(f=code_block.out3, tot=code_block.out2, maxScore=MaxScore) { percentage = f * 100 / tot; score = Math.Round(percentage * maxScore / 100,2); }
python_script_from_string = PythonStringNode(script=code_block_4, IN[0]=code_block_5.score)
if_ = If(test=code_block_2, true=code_block_3, false=python_script_from_string)
Score = Output(if_)
