# Dynamo custom node ParameterBinding.dyf (Dynamo 1.3.2.2480)
# category: DynaTools.QAQC.Parameters
# Check whether a parameter is correctly associated to a list of categories

ParameterElement = Input()  # List of parameters found
CategoriesList = Input()  # List of categories
byName = Category.ByName(CategoriesList)
python_script = Python(IN[0]=ParameterElement, IN[1]=byName)
# ---------- python_script.python (44 lines) ----------
import clr
clr.AddReference('System')
from System.Collections.Generic import *
clr.AddReference('RevitAPI')
from Autodesk.Revit.DB import *
clr.AddReference('RevitServices')
import RevitServices
from RevitServices.Persistence import DocumentManager
from RevitServices.Transactions import TransactionManager

doc = DocumentManager.Instance.CurrentDBDocument
uiapp = DocumentManager.Instance.CurrentUIApplication
app = uiapp.Application

param = UnwrapElement(IN[0])

cats = UnwrapElement(IN[1])
bool, categories = [], []
t, f, tot = 0, 0, 0

bindings = doc.ParameterBindings

for p, c in zip(param,cats):
	b = []
	cc = []
	paramdef = p.GetDefinition()

	item = bindings.Item[paramdef]
	catset = item.Categories

	for cat in c:
		tot += 1
		if catset.Contains(cat):
			b.append(True)
			cc.append(str(cat.Name))
			t += 1
		else:
			b.append(False)
			f += 1
	bool.append(b)
	categories.append(cc)

#Assign your output to the OUT variable.
OUT = bool, categories, (t,f,tot)
# ----------------------------------------
code_block = CodeBlock(lst=python_script) { lst[0]; lst[2][0]; lst[2][2]; lst[1]; }
Check = Output(code_block.out0)
code_block_2 = CodeBlock()
# ---------- code_block_2.designscript (9 lines) ----------
//Check wheter a number is a NaN value
"
import math
score = IN[0]
if math.isnan(score):
 OUT = 0
else:
 OUT = score
";
# ----------------------------------------
MaxScore = Input(MaxScore : double = 5)  # Define the highest score value for this KPI
code_block_3 = CodeBlock(f=code_block.out1, tot=code_block.out2, maxScore=MaxScore) { percentage = f * 100 / tot; score = Math.Round(percentage * maxScore / 100,2); }
python_script_from_string = PythonStringNode(script=code_block_2, IN[0]=code_block_3.score)
Score = Output(python_script_from_string)
if_ = If()  # unwired: test, true, false
Categories = Output(code_block.out3)
