# Dynamo custom node Get CompoundStructureLayers.dyf (Dynamo 2.16.2.5624)
# category: GeniusLoci.CompoundStructure
# Retrieves the properties of the compound layers of wall, floor, roof or ceiling Type.

ElementOrFamilyType = Input(ElementOrFamilyType: var[]..[])
python_script = Python(IN[0]=ElementOrFamilyType)  # IronPython2
# ---------- python_script.python (61 lines) ----------
#Alban de Chasteigner 2018
#twitter : @geniusloci_bim
#geniusloci.bim@gmail.com
#https://github.com/albandechasteigner/GeniusLociForDynamo

import clr
clr.AddReference('RevitAPI')
import Autodesk
from Autodesk.Revit.DB import *

clr.AddReference('RevitServices')
import RevitServices
from RevitServices.Persistence import DocumentManager
uiapp = DocumentManager.Instance.CurrentUIApplication
app = uiapp.Application
version=int(app.VersionNumber)

elements = UnwrapElement(IN[0]) if isinstance(IN[0],list) else [UnwrapElement(IN[0])]
	
layerIds,layermat,layerfunc,layerwidth,layers,strucLayer,coreLayer,deckProfile = [],[],[],[],[],[],[],[]

for elem in elements :
	ids,mat,func,width,core,deck=[],[],[],[],[],[]
	doc =  elem .Document
	if version < 2021:
		UIunit = doc.GetUnits().GetFormatOptions(UnitType.UT_Length).DisplayUnits
	else:
		UIunit = doc.GetUnits().GetFormatOptions(SpecTypeId.Length).GetUnitTypeId()
	if isinstance(elem, ElementType):
		famType=elem
	elif isinstance(elem, Wall) and not elem.IsStackedWall and not elem.WallType.Kind == WallKind.Curtain :
		famType = elem.WallType
	elif isinstance(elem, Floor):
		famType = elem.FloorType
	elif isinstance(elem, FootPrintRoof) or isinstance(elem, ExtrusionRoof) or isinstance(elem, RoofBase) :
		famType = elem.RoofType
	elif isinstance(elem, Ceiling) or isinstance(elem, FaceWall) :
		famType = doc.GetElement(elem.GetTypeId())
	else: famType = None
	if famType and hasattr(famType, "GetCompoundStructure") :
		compStr = famType.GetCompoundStructure()
		# Get and sort layers by Id in reverse order (Highest id first)...
		layers = list(compStr.GetLayers())
		layers.sort(key=lambda x: x.LayerId)
		for l in layers:	
			ids.append(l.LayerId)
			mat.append(famType.Document.GetElement(l.MaterialId))
			func.append(l.Function)
			width.append(UnitUtils.ConvertFromInternalUnits(l.Width,UIunit))
			core.append(compStr.IsCoreLayer(l.LayerId))
			deck.append(doc.GetElement(l.DeckProfileId))
	layerIds.append(ids)
	layermat.append(mat)
	layerfunc.append(func)
	layerwidth.append(width)
	strucLayer.append(layers)
	coreLayer.append(core)
	deckProfile.append(deck)
	
if isinstance(IN[0], (list)): OUT = layerfunc,layermat,layerwidth,layerIds,strucLayer,coreLayer,deckProfile
else: OUT = layerfunc[0],layermat[0],layerwidth[0],layerIds[0],strucLayer[0],coreLayer[0],deckProfile[0]
# ----------------------------------------
code_block = CodeBlock(x=python_script) { x[0]; x[1]; x[2]; x[3]; x[4]; x[5]; x[6]; }
LayerFunction = Output(code_block.out0)
Material = Output(code_block.out1)
Thickness = Output(code_block.out2)
Index = Output(code_block.out3)
Layers = Output(code_block.out4)
IsCoreLayer = Output(code_block.out5)
StructuralDeckProfile = Output(code_block.out6)  # Only for floors
