# Dynamo custom node Publish Coordinates.dyf (Dynamo 2.6.1.8786)
# category: GeniusLoci.Document
# Works only in Revit 2018 and later.
# Publish the current shared coordinates to the specified ProjectLocation of the Revit link instance.
# The geolocation information will be pulled from host model to the linked model.
# If the Project Location Name doesn't exist in the linked model, the node create it.

RevitLinkInstance = Input(RevitLinkInstance: var[]..[])
LinkProjectLocationName = Input(LinkProjectLocationName: string[]..[] = "Internal")
python_script = Python(IN[0]=RevitLinkInstance, IN[1]=LinkProjectLocationName)
# ---------- python_script.python (54 lines) ----------
#Inspired by https://forum.dynamobim.com/t/publish-coordinates-transactions/42213
#Alban de Chasteigner 2020
#twitter : @geniusloci_bim
#geniusloci.bim@gmail.com
#https://github.com/albandechasteigner/GeniusLociForDynamo

import clr
clr.AddReference('RevitAPI')
from Autodesk.Revit.DB import*
clr.AddReference('RevitServices')
from RevitServices.Persistence import DocumentManager
from RevitServices.Transactions import TransactionManager
doc = DocumentManager.Instance.CurrentDBDocument
uidoc=DocumentManager.Instance.CurrentUIApplication.ActiveUIDocument
uiapp = DocumentManager.Instance.CurrentUIApplication
app = uiapp.Application

rvtLinkInstances = UnwrapElement(IN[0]) if isinstance(IN[0],list) else [UnwrapElement(IN[0])]
linkProjLocNames = IN[1] if isinstance(IN[1],list) else [IN[1]]
pln_len = len(linkProjLocNames) == 1
result=[]

for i in xrange(len(rvtLinkInstances)):
	rvtLinkInstance = rvtLinkInstances[i]
	p = 0 if pln_len else i
	linkDoc = rvtLinkInstance.GetLinkDocument()
	TransactionManager.Instance.ForceCloseTransaction()
	linkLocations = linkDoc.ProjectLocations
	bool = any(linkLocation.Name == linkProjLocNames[p] for linkLocation in linkLocations)
	if bool :
		linkLocationId = [linkLocation for linkLocation in linkLocations if linkLocation.Name == linkProjLocNames[p]][0].Id
	else : 
		filepath = linkDoc.PathName
		linkType = doc.GetElement(rvtLinkInstance.GetTypeId())
		linkType.Unload(None)
		linkDoc2 = app.OpenDocumentFile( ModelPathUtils.ConvertUserVisiblePathToModelPath(filepath), OpenOptions())
		t = Transaction(linkDoc2, "Create Project Location")
		t.Start()
		linkLocationId = linkDoc2.ActiveProjectLocation.Duplicate(linkProjLocNames[p]).Id
		t.Commit()
		linkDoc2.Close(True)
		linkType.Reload()
	t = Transaction(doc, "Publish Project Location")
	t.Start()
	try: 
		doc.PublishCoordinates(LinkElementId(rvtLinkInstance.Id, linkLocationId))
		message = "Project Location successfully published"
		t.Commit()
	except Exception as e: 
		message = "Could not publish project location due to: " + str(e)
		t.RollBack() 
	result.append(message)

OUT = result
# ----------------------------------------
Result = Output(python_script)
