# Dynamo custom node View CropBox.dyf (Dynamo 2.16.2.5624)
# category: GeniusLoci.View
# Obtain the CropBox, the SectionBox, the SectionMarker or the ElevationMarker element of the given view.
# Retrieve also the CropBox curves and the BoundingBox.

view = Input(view: var[]..[])
python_script = Python(IN[0]=view)  # IronPython2
# ---------- python_script.python (87 lines) ----------
#Alban de Chasteigner 2021
#twitter : @geniusloci_bim
#geniusloci.bim@gmail.com
#https://github.com/albandechasteigner/GeniusLociForDynamo

import clr
import math
clr.AddReference('RevitAPI')
import Autodesk
from Autodesk.Revit.DB import *
clr.AddReference('RevitServices')
import RevitServices
from RevitServices.Transactions import TransactionManager
clr.AddReference('RevitNodes')
import Revit
clr.ImportExtensions(Revit.GeometryConversion)

views = UnwrapElement(IN[0]) if isinstance(IN[0],list) else [UnwrapElement(IN[0])]

def GetCropBox(view):
	provider= ParameterValueProvider(ElementId(BuiltInParameter.ID_PARAM))
	rule = FilterElementIdRule(provider, FilterNumericEquals(), view.Id )
	filter= ElementParameterFilter(rule)
	return doc.GetElement(FilteredElementCollector(doc).WherePasses(filter).ToElementIds().Find(lambda x: x.IntegerValue != view.Id.IntegerValue))

elem,lines,box=[],[],[]

for view in views:
	doc=view.Document
	# CropBox
	if view.ViewType == ViewType.FloorPlan or view.ViewType == ViewType.CeilingPlan or view.ViewType == ViewType.EngineeringPlan :
		elem.append(GetCropBox(view))
		shape=view.GetCropRegionShapeManager().GetCropShape()
		if len(shape) > 0:
			lines.append([s.ToProtoType() for s in shape[0]])
		else:lines.append(None)
		# Transform required for the scopeboxes 
		bb = view.CropBox
		transform = bb.Transform
		min = transform.OfPoint(bb.Min)
		max = transform.OfPoint(bb.Max)
		viewRange = view.GetViewRange()

		topLevel = doc.GetElement(viewRange.GetLevelId(PlanViewPlane.TopClipPlane))
		topOffset = viewRange.GetOffset(PlanViewPlane.TopClipPlane)
		bttmLevel = doc.GetElement(viewRange.GetLevelId(PlanViewPlane.BottomClipPlane))
		bttmOffset = viewRange.GetOffset(PlanViewPlane.BottomClipPlane)
		cutLevel = doc.GetElement(viewRange.GetLevelId(PlanViewPlane.CutPlane))
		cutOffset = viewRange.GetOffset(PlanViewPlane.CutPlane)
		if bttmLevel : newmin = XYZ(min.X, min.Y, bttmLevel.ProjectElevation + bttmOffset)
		else: newmin = XYZ(min.X, min.Y, cutLevel.ProjectElevation + bttmOffset)
		if topLevel : newmax = XYZ(max.X, max.Y, topLevel.ProjectElevation + topOffset)
		else: newmax = XYZ(max.X, max.Y, cutLevel.ProjectElevation + cutOffset)
		newbox = BoundingBoxXYZ()
		newbox.Max = newmax
		newbox.Min = newmin
		box.append(newbox.ToProtoType())
	# viewSection Marker
	elif view.ViewType == ViewType.Section or view.ViewType == ViewType.Elevation or view.ViewType == ViewType.Detail :
		elem.append(GetCropBox(view))
		shape=view.GetCropRegionShapeManager().GetCropShape()
		if len(shape) > 0:
			lines.append([s.ToProtoType() for s in shape[0]])
		else:lines.append(None)	
		bb = view.CropBox
		transform = bb.Transform
		newmin = transform.OfPoint(bb.Min)
		newmax = transform.OfPoint(bb.Max)
		newbox = BoundingBoxXYZ()
		newbox.Max = newmax
		newbox.Min = newmin
		box.append(newbox.ToProtoType())
	# SectionBox
	elif view.ViewType == ViewType.ThreeD:
		elem.append(doc.GetElement(ElementId(view.Id.IntegerValue - 1)))
		lines.append(None)
		bb = view.GetSectionBox()
		transform = bb.Transform
		newmin = transform.OfPoint(bb.Min)
		newmax = transform.OfPoint(bb.Max)
		newbox = BoundingBoxXYZ()
		newbox.Max = newmax
		newbox.Min = newmin
		box.append(newbox.ToProtoType())

if isinstance(IN[0], list): OUT = elem, lines, box
else: OUT = elem[0], lines[0], box[0]
# ----------------------------------------
code_block = CodeBlock(x=python_script) { x[0]; x[1]; x[2]; }
Element = Output(code_block.out0)  # CropBox, SectionBox or ElevationMarker
Curves = Output(code_block.out1)  # CropBox curves
BoundingBox = Output(code_block.out2)  # CropBox or SectionBox BoundingBox
