# Dynamo custom node View ToSheet.dyf (Dynamo 2.16.2.5624)
# category: GeniusLoci.Sheet
# Returns the ViewSheet where this view is placed.

view = Input(view: var[]..[])
python_script = Python(IN[0]=view)  # IronPython2
# ---------- python_script.python (22 lines) ----------
import clr
clr.AddReference('RevitAPI')
from Autodesk.Revit.DB import *

clr.AddReference('RevitServices')
import RevitServices
from RevitServices.Persistence import DocumentManager
doc = DocumentManager.Instance.CurrentDBDocument

views = UnwrapElement(IN[0]) if isinstance(IN[0],list) else [UnwrapElement(IN[0])]
sheet=[]

for view in views:
	sheetNumber=view.get_Parameter(BuiltInParameter.VIEWER_SHEET_NUMBER).AsString()
	pvp = ParameterValueProvider(ElementId(BuiltInParameter.SHEET_NUMBER))
	fsr = FilterStringEquals()
	fRule = FilterStringRule(pvp, fsr, sheetNumber)
	filter = ElementParameterFilter(fRule)
	sheet.append(FilteredElementCollector(doc).OfCategory(BuiltInCategory.OST_Sheets).WherePasses(filter).FirstElement())

if isinstance(IN[0], list): OUT = sheet
else: OUT = sheet[0]
# ----------------------------------------
Sheet = Output(python_script)
