# Dynamo custom node Element.OverrideColorInViewByParameter.dyf
# category: Modelical.Elements.Actions
# This node modifies the visualization of the elements in the active view by selected parameter values. It allows controlling color range and reset modifications. It applies a solid fill pattern.

elements = Input(_elements: var[]..[])  # Elements to modify their color.
parameter = Input(_parameter: var[]..[])  # Parameter.
parameterByName = Parameter.ParameterByName(element=elements, name=parameter)
isNull = Object.IsNull(object=parameterByName)
not_ = Not(x=isNull)
filterByBoolMask = List.FilterByBoolMask(list=elements, mask=not_)
colors = Input(_colors: var[]..[] = [DSCore.Color.ByARGB(255, 255, 100, 100), DSCore.Color.ByARGB(255, 255, 255, 0), DSCore.Color.ByARGB(255, 0, 255, 255)])  # OPTIONAL list of colors.
colorsIndices = Input(_colorsIndices: var[]..[] = [0, 0.5, 1])  # OPTIONAL list of colors indices.
codeBlock = CodeBlock { 0; }
python = Python(IN[0]=filterByBoolMask.in, IN[1]=parameter, IN[2]=codeBlock, IN[3]=codeBlock)  # CPython3
# ---------- python.python (114 lines) ----------
# This node has been made by Modelical
# www.modelical.com

import clr
#Load document reference
clr.AddReference("RevitServices")
import RevitServices
from RevitServices.Persistence import DocumentManager
doc = DocumentManager.Instance.CurrentDBDocument
#Load Revit API
clr.AddReference('RevitAPI')
from Autodesk.Revit.DB import *

#The inputs to this node will be stored as a list in the IN variables.
input = IN[0]
param = IN[1]
minValue = IN[2]
maxValue = IN[3]

def toList(input):
        if isinstance(input,list) == False:
                return [input]
        else:
                return input

def flatten(x):
    result = []
    for el in x:
        if hasattr(el, "__iter__") and not isinstance(el, str):
            result.extend(flatten(el))
        else:
            result.append(el)
    return result

elementsInput = flatten(toList(input))
elements = UnwrapElement(elementsInput)

values = []
indexes = []
mapped = []

def map(value, min, max):
        a = (value - min) / (max - min)
        return a

def getValue(elem):
        p = elem.LookupParameter(param)
        if p == None:
                elemTypeId = elem.GetTypeId()
                elemType = doc.GetElement(elemTypeId)
                p = elemType.LookupParameter(param)
        if p == None:
                return "Parameter not found"
        else:
                if p.StorageType == StorageType.Integer:
                        return p.AsInteger()
                elif p.StorageType == StorageType.Double:
                        return p.AsDouble()
                elif p.StorageType == StorageType.ElementId:
                        return p.AsElementId()
                else:
                        return p.AsString()

for e in elements:
        values.append(getValue(e))

try: 0 + values[0]
except TypeError: isnumber=False
else: isnumber=True

if isnumber:
        valuesSorted = []
        for v in values:
                valuesSorted.append(v)
        valuesSorted.sort()
        if minValue == 0 and maxValue == 0:
                min = valuesSorted[0]
                max = valuesSorted[len(valuesSorted) - 1]*1.0
        else:
                min = minValue
                max = maxValue
        if len(values) > 1:
                for v in values:
                        mapped.append(list(map(v, min, max)))
        else:
                for v in values:
                        mapped.append(min)

elif not isnumber:
        strValues = []
        for v in values:
                strValues.append(str(v))
        uniqueValues = list(set(strValues))
        uniqueValues.sort()
        for v in strValues:
                i = 0
                for u in uniqueValues:
                        if v == u:
                                indexes.append(i)
                                break
                        i = i + 1
        min = 0.0
        max = len(uniqueValues)-1.0
        if len(uniqueValues) > 1:
                for i in indexes:
                        mapped.append(list(map(i, min, max)))
        else:
                for i in indexes:
                        mapped.append(min)

if "Parameter not found" in values:
        OUT = "Parameter not found"
else:
        OUT = mapped
# ----------------------------------------
colorRange = ColorRange(colors=colors, indices=colorsIndices, value=python)
reset = Input(_reset: bool = false)
python_2 = Python(IN[0]=filterByBoolMask.in, IN[1]=colorRange, IN[2]=reset, IN[3]=python)  # CPython3
# ---------- python_2.python (111 lines) ----------
# This node has been made by Modelical
# www.modelical.com

import clr
clr.AddReference('ProtoGeometry')
from Autodesk.DesignScript.Geometry import *

clr.AddReference("RevitNodes")
import Revit
clr.ImportExtensions(Revit.Elements)

clr.AddReference("RevitServices")
import RevitServices
from RevitServices.Persistence import DocumentManager
from RevitServices.Transactions import TransactionManager

from System.Collections.Generic import *

clr.AddReference("RevitAPI")
import Autodesk
from Autodesk.Revit.DB import *

doc = DocumentManager.Instance.CurrentDBDocument
uiapp = DocumentManager.Instance.CurrentUIApplication
app = uiapp.Application

input = IN[0]
dynColor = IN[1]
bool = IN[2]

def toList(input):
        if isinstance(input,list) == False:
                return [input]
        else:
                return input

def flatten(x):
    result = []
    for el in x:
        if hasattr(el, "__iter__") and not isinstance(el, str):
            result.extend(flatten(el))
        else:
            result.append(el)
    return result

notFound = flatten(toList(IN[3]))

if notFound[0] == "Parameter not found":
        OUT = "Parameter not found"
else:
        items = flatten(toList(input))

        fillPatterns = FilteredElementCollector(doc).OfClass(FillPatternElement).ToElements()
        for f in fillPatterns:
                if f.GetFillPattern().IsSolidFill:
                        fillPat = f
                        break

        elements = []
        for i in items:
                elements.append(UnwrapElement(i))


        if bool:
                view = doc.ActiveView
                override = OverrideGraphicSettings()

                TransactionManager.Instance.EnsureInTransaction(doc)
                for e in elements:
                        view.SetElementOverrides(e.Id, override)
                TransactionManager.Instance.TransactionTaskDone()
                OUT = elements

        else:
                graphSettings = Autodesk.Revit.DB.OverrideGraphicSettings()
                color = []
                for d in dynColor:
                        color.append(Autodesk.Revit.DB.Color(d.Red, d.Green, d.Blue))

                TransactionManager.Instance.EnsureInTransaction(doc)

                i = 0
                for e in elements:
                        if int(app.VersionNumber) < 2019:
                                id = e.Id
                                graphSettings.SetCutLineColor(color[i])
                                graphSettings.SetCutFillColor(color[i])
                                graphSettings.SetProjectionLineColor(color[i])
                                graphSettings.SetProjectionFillColor(color[i])
                                if fillPat:
                                        graphSettings.SetCutFillPatternId(fillPat.Id)
                                        graphSettings.SetProjectionFillPatternId(fillPat.Id)
                                doc.ActiveView.SetElementOverrides(id, graphSettings)
                                i = i + 1
                        else:
                                id = e.Id
                                graphSettings.SetCutLineColor(color[i])
                                graphSettings.SetCutForegroundPatternColor(color[i])
                                graphSettings.SetCutBackgroundPatternColor(color[i])
                                graphSettings.SetProjectionLineColor(color[i])
                                graphSettings.SetSurfaceForegroundPatternColor(color[i])
                                graphSettings.SetSurfaceBackgroundPatternColor(color[i])
                                if fillPat:
                                        graphSettings.SetCutForegroundPatternId(fillPat.Id)
                                        graphSettings.SetCutBackgroundPatternId(fillPat.Id)
                                        graphSettings.SetSurfaceForegroundPatternId(fillPat.Id)
                                        graphSettings.SetSurfaceBackgroundPatternId(fillPat.Id)
                                doc.ActiveView.SetElementOverrides(id, graphSettings)
                                i = i + 1
                TransactionManager.Instance.TransactionTaskDone()
                OUT = elements
# ----------------------------------------
elements_2 = Output(python_2)  # "_elements"
