# Dynamo custom node Element.OverrideColorInViewFull.dyf
# category: Modelical.Elements.Actions
# This node modifies the visualization of the elements in the active view by selecting color and fill pattern. Solid fill pattern will be applied by default.

elements = Input(_elements: var[]..[])  # Elements to override
colors = Input(_colors: DSCore.Color[]..[])  # Colors to be applied. You can use Color Range component
fillPatternName = Input(_fillPatternName: string[]..[])  # Fill Pattern name (String).Solid Fill will be applied by default
python = Python(IN[0]=elements, IN[1]=colors, IN[2]=fillPatternName)  # CPython3
# ---------- python.python (92 lines) ----------
# This node has been made by Modelical
# www.modelical.com

import clr

clr.AddReference("RevitServices")
import RevitServices
from RevitServices.Persistence import DocumentManager
from RevitServices.Transactions import TransactionManager

from System.Collections.Generic import *

clr.AddReference("RevitAPI")
import Autodesk
from Autodesk.Revit.DB import *

doc = DocumentManager.Instance.CurrentDBDocument
uiapp = DocumentManager.Instance.CurrentUIApplication
app = uiapp.Application

def toList(input):
    if isinstance(input, list):
        return input
    else:
        return [input]

elements = toList(UnwrapElement(IN[0]))
dynColor = toList(IN[1])
name = IN[2]




fillPatterns = FilteredElementCollector(doc).OfClass(FillPatternElement).ToElements()
for f in fillPatterns:
    if f.GetFillPattern().Name ==name:
        fillPat = f
        break

graphSettings = Autodesk.Revit.DB.OverrideGraphicSettings()
color = []
for d in dynColor:
        color.append(Autodesk.Revit.DB.Color(d.Red, d.Green, d.Blue))

fillPatDraft = FillPatternElement.GetFillPatternElementByName(doc, FillPatternTarget.Drafting, name)
if fillPatDraft != None:
        fillPat = fillPatDraft
        
t=Transaction(doc, "Modelical.OverrideColor")
t.Start()
try:
    
    i = 0
    for e in elements:
        if int(app.VersionNumber) < 2019:
            id = e.Id
            if len(color)==1:
                i = 0
            graphSettings.SetCutLineColor(color[i])
            graphSettings.SetCutFillColor(color[i])
            graphSettings.SetProjectionLineColor(color[i])
            graphSettings.SetProjectionFillColor(color[i])
            graphSettings.SetCutFillPatternId(fillPat.Id)
            graphSettings.SetProjectionFillPatternId(fillPat.Id)
            doc.ActiveView.SetElementOverrides(id, graphSettings)
        else:
            id = e.Id
            if len(color)==1:
                i = 0
            graphSettings.SetCutLineColor(color[i])
            graphSettings.SetCutForegroundPatternColor(color[i])
            graphSettings.SetCutBackgroundPatternColor(color[i])
            graphSettings.SetProjectionLineColor(color[i])
            graphSettings.SetSurfaceForegroundPatternColor(color[i])
            graphSettings.SetSurfaceBackgroundPatternColor(color[i])
            graphSettings.SetCutForegroundPatternId(fillPat.Id)
            graphSettings.SetCutBackgroundPatternId(fillPat.Id)
            graphSettings.SetSurfaceForegroundPatternId(fillPat.Id)
            graphSettings.SetSurfaceBackgroundPatternId(fillPat.Id)
            doc.ActiveView.SetElementOverrides(id, graphSettings)
            i += 1
            
    t.Commit()
    OUT = elements    
    

except Exception as ex:
	OUT=ex
	#t.RollBack()
finally:
	t.Dispose()
	
# ----------------------------------------
Selected_elements__elements = Output(python)  # "/*Selected elements*/ _elements"
