# Dynamo custom node Grid.FitToCropView.dyf
# category: Modelical.Elements.Actions
# This node fit the grids to the crop view on the selected views.

views = Input(_views: var[]..[])  # Views to fit their grids to crop view.
offset = Input(_offset: double = 0)  # Optional gap between crop view and grid end points.
python = Python(IN[0]=views, IN[1]=offset)  # CPython3
# ---------- python.python (127 lines) ----------
# This node has been made by Modelical
# www.modelical.com

import clr


clr.AddReference("RevitAPI")
from Autodesk.Revit.DB import *

clr.AddReference("RevitServices")
import RevitServices
from RevitServices.Persistence import DocumentManager

doc = DocumentManager.Instance.CurrentDBDocument
# Function Helpers
def Feet2m(value):
        return value * 0.3048

def M2Feet(value):
        return value / 0.3048
        
def toList(input):
    if isinstance(input, list):
        return input
    else:
        return [input]


# Logic starts here
views= toList(UnwrapElement(IN[0]))
offset=M2Feet(IN[1])
# Transactions

listout=[]
size= 0.003
fList=[]
eList=[]

t=Transaction(doc, "Grid.FitToCropView")
t.Start()
try:
    for view in views:
        viewGrids=[]
    
    
        if view == None:
            eList.append(view)
            continue
        try:
            len(FilteredElementCollector(doc,view.Id).OfCategory(BuiltInCategory.OST_Grids).ToElements())
        except:
            eList.append(view)
            continue
    
    
        try:
            cropLines=view.GetCropRegionShapeManager().GetCropShape()[0]
        except:
            eList.append(view)
            continue
        
        if len(FilteredElementCollector(doc,view.Id).OfCategory(BuiltInCategory.OST_Grids).ToElements())!=0:
            
    
            for grid in FilteredElementCollector(doc,view.Id).OfCategory(BuiltInCategory.OST_Grids).ToElements():
    
                gLine=grid.GetCurvesInView(DatumExtentType.ViewSpecific, view )[0]
        
                startPoint=gLine.GetEndPoint(0)
                endPoint=gLine.GetEndPoint(1)
     
        		
                newStart = startPoint.Add( startPoint.Subtract(endPoint).Multiply(10))
                newEnd = endPoint.Add(endPoint.Subtract(startPoint).Multiply(10))
                newGLine= Line.CreateBound(newStart,newEnd)
                
                
                intersectPoints=[]
                
        
                for cropLine in cropLines:
        
                    zValue=newGLine.GetEndPoint(0).Z
    
                    proCropLine=Line.CreateBound(XYZ(cropLine.GetEndPoint(0).X,cropLine.GetEndPoint(0).Y,zValue),XYZ(cropLine.GetEndPoint(1).X,cropLine.GetEndPoint(1).Y,zValue))
    
                    if len(newGLine.ToProtoType().Intersect(proCropLine.ToProtoType())) > 0 :
                       intersectPoints.append(newGLine.ToProtoType().Intersect(proCropLine.ToProtoType())[0])
    
                if len(intersectPoints) ==2:
                    cSPoint=intersectPoints[0].ToXyz()
                    cEPoint=intersectPoints[1].ToXyz()
        
                    newCSPoint = cSPoint.Add(cSPoint.Subtract(cEPoint).Normalize().Multiply(offset))
                    newCEPoint = cEPoint.Add(cEPoint.Subtract(cSPoint).Normalize().Multiply(offset))
                    newLine= Line.CreateBound(newCEPoint,newCSPoint)
        
                    gridBubble0=grid.IsBubbleVisibleInView(DatumEnds.End0,view)
                    gridBubble1=grid.IsBubbleVisibleInView(DatumEnds.End1,view)
                    
                    try:
                        a=grid.SetCurveInView( DatumExtentType.ViewSpecific , view, newLine)
        
                        if gridBubble0 == True:
                            grid.ShowBubbleInView(DatumEnds.End0,view)
                        else:
                            grid.HideBubbleInView(DatumEnds.End0,view)
    
                        if gridBubble1 == True:
                            grid.ShowBubbleInView(DatumEnds.End1,view)
                        else:
                            grid.HideBubbleInView(DatumEnds.End1,view)
                    except:
                        None
    
                
                fList.append(view)
    
    t.Commit()
    OUT=[fList,eList]
except Exception as ex:
    OUT=[ex,ex]
    #t.RollBack()
finally:
    t.Dispose()

# Output
# ----------------------------------------
codeBlock = CodeBlock(l=python) { l[0]; l[1]; }
views_2 = Output(codeBlock.out0)  # "_views"
errorViews = Output(codeBlock.out1)  # "_errorViews"
