# Dynamo custom node Help.AboutUs.dyf (Dynamo 2.12.0.5650)
# category: Modelical.Help.Query
# This node links you to our web site.

python_script = Python()  # IronPython2
# ---------- python_script.python (27 lines) ----------
# This node has been made by Modelical
# www.modelical.com
import clr

clr.AddReference("RevitServices")
import RevitServices
from RevitServices.Persistence import DocumentManager
from RevitServices.Transactions import TransactionManager

uidoc = DocumentManager.Instance.CurrentUIApplication
doc = DocumentManager.Instance.CurrentDBDocument
app = uidoc.Application

# To be able to import Python Standard Library modules, we need to locate them
import sys
sys.path.append(r"C:\Program Files (x86)\IronPython 2.7\Lib")
# Function Helpers
import webbrowser
# Logic starts here

webbrowser.open_new("https://www.modelical.com")	
# Transactions
TransactionManager.Instance.EnsureInTransaction(doc)
# Your code
TransactionManager.Instance.TransactionTaskDone()
# Output
OUT = "Visit us at www.modelical.com"
# ----------------------------------------
