# Dynamo custom node SpaceTag.MoveToSpaceLocation.dyf (Dynamo 2.12.0.5650)
# category: Modelical.Elements.Actions
# This node moves the space tag location of the selected tags to the associated space location.

spaceTags = Input(_spaceTags: var[]..[])  # Tag(s) to move to space location.
moveToRoomLocation = Python(IN[0]=spaceTags)  # "SpaceTag.MoveToRoomLocation"; IronPython2
# ---------- moveToRoomLocation.python (134 lines) ----------
# This bit is default. It is always used.
# It connects with DesignScript and Dynamo internals and
# Enable Python support and load DesignScript library.
import clr
clr.AddReference("ProtoGeometry")
from Autodesk.DesignScript.Geometry import *

# This import let's us call / use Dynamo nodes from Python code
clr.AddReference("DSCoreNodes")
from DSCore import *
# General API and User Interface API DLL

clr.AddReference("RevitAPI")
from Autodesk.Revit.DB import Mechanical as DBMechanical

clr.AddReference("RevitAPI")
from Autodesk.Revit.DB import *
from Autodesk.Revit.DB.Structure import *

clr.AddReference("RevitAPIUI")
from Autodesk.Revit.UI import *

clr.AddReference("RevitNodes")
import Revit
clr.ImportExtensions(Revit.GeometryConversion)
clr.ImportExtensions(Revit.Elements)
# This bit is needed to access revit documents (project and families) 
# and to use Transactions (when we need to WRITE data to the Revit database)
clr.AddReference("RevitServices")
import RevitServices
from RevitServices.Persistence import DocumentManager
from RevitServices.Transactions import TransactionManager

uidoc = DocumentManager.Instance.CurrentUIApplication
doc = DocumentManager.Instance.CurrentDBDocument
app = uidoc.Application

# To be able to import Python Standard Library modules, we need to locate them
import sys
sys.path.append(r"C:\Program Files (x86)\IronPython 2.7\Lib")
# Function Helpers
def Feet2m(value):
	return value * 0.3048
	
def m2Feet(value):
	return value / 0.3048

def toList(input):
    """Return iterable if available, a list of 1 otherwise"""
    if hasattr(input, "__iter__") and not isinstance(input, basestring):
        return iter(input)
    else:
        return [input]

def flatten(x):
    result = []
    for el in x:
        if hasattr(el, "__iter__") and not isinstance(el, basestring):
            result.extend(flatten(el))
        else:
            result.append(el)
    return result

def dRange(start,final,step):
	n=start
	fList=[]
	while n<=final:
		fList.append(n)
		n+=step
	return fList	

results = clr.Reference[IntersectionResultArray]()

SBO=SpatialElementBoundaryOptions()

	
#Get All Rooms
spaces=[]
for ldoc in app.Documents:
	for lr in FilteredElementCollector(ldoc).OfCategory(BuiltInCategory.OST_MEPSpaces).WhereElementIsNotElementType().ToElements():
	
		spaces.append(lr)
	
#Get All tags
selectedTags = toList(UnwrapElement(IN[0]))
tags=[]
tagsHostId=[]

for tag in selectedTags:
	if tag.GetType()==DBMechanical.SpaceTag :
		tags.append(tag)
		try:
			tagsHostId.append(tag.Space.Id)
		except:
			tagsHostId.append(tag.TaggedRoomId.LinkedElementId)

mList=[]
eList=[]
TransactionManager.Instance.EnsureInTransaction(doc)

for r in spaces :
	if r.Id in tagsHostId:
		try:
			p=r.Location.Point
			try:
				rTags=[]						
				for t in tags:
					if t.Space.Id == r.Id:
						t.Location.Point = p
						rTags.append(t)
			except:
				rTags=[]
				for t in tags:
					if t.TaggedRoomId.LinkedElementId ==r.Id:
						t.Location.Point = p
						rTags.append(t)
			mList.append([r,rTags])	
			
			
		except:	
			try:
				rTags=[]						
				for t in tags:
					if t.Space.Id == r.Id:
						rTags.append(t)
			except:
				rTags=[]
				for t in tags:
					if t.TaggedRoomId.LinkedElementId ==r.Id:
						rTags.append(t)
						
			eList.append([r,rTags])
TransactionManager.Instance.TransactionTaskDone()		
OUT=[mList,eList]
# ----------------------------------------
code_block = CodeBlock(l=moveToRoomLocation) { l[0]; }
Moved_to_space_location__movedTags = Output(code_block)  # "/*Moved to space location.*/ _movedTags"
code_block_2 = CodeBlock(l=moveToRoomLocation) { l[1]; }
Could_not_be_moved__errorTags = Output(code_block_2)  # "/*Could not be moved*/ _errorTags"
