# Dynamo custom node Structure.JoinUnjoinStructuralFraming.dyf (Dynamo 2.12.0.5650)
# category: Modelical.Elements.Actions
# This node allows or disallows join condition at structural framing ends.

strFraming = Input(_strFraming: var[]..[])  # Structural Framing elements to allow/disallow join
bool = Input(_bool: bool)  # Set True to allow & False to disallow
python_script = Python(IN[0]=strFraming, IN[1]=bool)  # IronPython2
# ---------- python_script.python (63 lines) ----------
# This node has been made by Modelical
# www.modelical.com

import clr
clr.AddReference('ProtoGeometry')
from Autodesk.DesignScript.Geometry import *

#Load Dynamo wrappers
clr.AddReference("RevitNodes")
import Revit
from Revit.Elements import *
clr.ImportExtensions(Revit.GeometryConversion)
clr.ImportExtensions(Revit.Elements)

#Load Revit API
clr.AddReference('RevitAPI')
from Autodesk.Revit.DB import *
from Autodesk.Revit.DB.Structure import *
import Autodesk

#Load document reference
clr.AddReference("RevitServices")
import RevitServices
from RevitServices.Persistence import DocumentManager
from RevitServices.Transactions import TransactionManager

doc = DocumentManager.Instance.CurrentDBDocument
uiapp = DocumentManager.Instance.CurrentUIApplication
app = uiapp.Application

def toList(input):
	if isinstance(input,list) == False:
		return [input]
	else:
		return input

def flatten(x):
    result = []
    for el in x:
        if hasattr(el, "__iter__") and not isinstance(el, basestring):
            result.extend(flatten(el))
        else:
            result.append(el)
    return result

strFraming = flatten(toList(UnwrapElement(IN[0])))
allowed = IN[1]

if not allowed:
	TransactionManager.Instance.EnsureInTransaction(doc)
	for strF in strFraming:
		StructuralFramingUtils.DisallowJoinAtEnd(strF,0)
		StructuralFramingUtils.DisallowJoinAtEnd(strF,1)
	TransactionManager.Instance.TransactionTaskDone()

else:
	TransactionManager.Instance.EnsureInTransaction(doc)
	for strF in strFraming:
		StructuralFramingUtils.AllowJoinAtEnd(strF,0)
		StructuralFramingUtils.AllowJoinAtEnd(strF,1)
	TransactionManager.Instance.TransactionTaskDone()

OUT = strFraming
# ----------------------------------------
strFraming_2 = Output(python_script)  # "_strFraming"
python_script_2 = Python(IN[0]=bool)  # IronPython2
# ---------- python_script_2.python (6 lines) ----------
value=IN[0]

if value==True:
	OUT="Allowed"
else:
	OUT="Disallowed"
# ----------------------------------------
state = Output(python_script_2)  # "_state"
