# Dynamo custom node View3D.CreateForEachWorkset.dyf (Dynamo 2.12.0.5650)
# category: Modelical.Views.Create
# This node creates a new 3D view for each workset in the model. It leaves only one workset visible.

bool = Input(_bool: bool = false)  # Set bolean to TRUE to create new 3D views
python_script = Python(IN[0]=bool)  # IronPython2
# ---------- python_script.python (60 lines) ----------
# This node has been made by Modelical
# www.modelical.com
import clr
clr.AddReference('ProtoGeometry')
from Autodesk.DesignScript.Geometry import *

# Import DocumentManager and TransactionManager
clr.AddReference("RevitServices")
import RevitServices
from RevitServices.Persistence import DocumentManager
from RevitServices.Transactions import TransactionManager

# Import RevitAPI
clr.AddReference("RevitAPI")
import Autodesk
from Autodesk.Revit.DB import *

doc = DocumentManager.Instance.CurrentDBDocument

bool = IN[0]
output = "Set boolean to TRUE to create new 3D views"

#Get IsmetricViewType Id

for viewType in FilteredElementCollector(doc).OfClass(ViewFamilyType).WhereElementIsElementType().ToElements():
	if viewType.ViewFamily == ViewFamily.ThreeDimensional:
		isometricViewId= viewType.Id
		
#Get Workset Id		
worksets = FilteredWorksetCollector(doc).OfKind(WorksetKind.UserWorkset).ToWorksets()

if bool == True:
	wsNames = []

	collector = FilteredWorksetCollector(doc)
	wsList = collector.OfKind(WorksetKind.UserWorkset)
	
	for w in wsList:
		wsNames.append(w.Name)

TransactionManager.Instance.EnsureInTransaction(doc)

viewsList=[]		
for name in wsNames:
	try:
		v=View3D.CreateIsometric(doc,isometricViewId)
		v.Name = name
		v.Unlock()
		for wk in worksets:
			if wk.Name == name:
				v.SetWorksetVisibility(wk.Id, WorksetVisibility.Visible)
			else:
				v.SetWorksetVisibility(wk.Id, WorksetVisibility.Hidden)
				
		viewsList.append(v)
	except:
		viewsList.append("Error with "+name+ " view")
TransactionManager.Instance.TransactionTaskDone()

OUT = viewsList
# ----------------------------------------
newViews = Output(python_script)  # "_newViews"
