# Dynamo custom node NetStructure.dyf (Dynamo 0.7.0.29646)
# category: NetStructure

pointsInX = Input()
pointsInY = Input()
code_block = CodeBlock(x=pointsInX, y=pointsInY) { 0..x; 0..y..#2; 0; }
byCoordinates = Point.ByCoordinates(code_block.out0, code_block.out1, code_block.out2, lacing=CrossProduct)
transpose = Transpose(byCoordinates)
code_block_2 = CodeBlock(p1=transpose) { p1[0]; p1[1]; }
byStartPointEndPoint = Line.ByStartPointEndPoint(code_block_2.out0, code_block_2.out1)
code_block_3 = CodeBlock(y1=pointsInY, x1=pointsInX) { 0..y1; 0..x1..#2; 0; }
byCoordinates_2 = Point.ByCoordinates(code_block_3.out1, code_block_3.out0, code_block_3.out2, lacing=CrossProduct)
code_block_4 = CodeBlock(p2=byCoordinates_2) { p2[0]; p2[1]; }
byStartPointEndPoint_2 = Line.ByStartPointEndPoint(code_block_4.out0, code_block_4.out1)
code_block_5 = CodeBlock(l1=byStartPointEndPoint, l2=byStartPointEndPoint_2) { arrayOfLines = Flatten({l1,l2}); }
netStructure = Output(code_block_5)
