# Dynamo custom node ❄_PC_Get_Scans_and_Regions.dyf
# category: Sastrugi.Pointcloud Geometry
# (Sastrugi_Pointcloud_Geometry) This node extracts Scan Names/Origins and Scan Region Names from within a Pointcloud Instance.

PointcloudInstance = Input(PointcloudInstance: var[]..[])
flatten = List.Flatten(list=PointcloudInstance)
python = Python(IN[0]=flatten)  # CPython3
# ---------- python.python (35 lines) ----------
# Python coding credit to Dynamo Forum user - @Ewan_Opie 2019
# Sastrugi Package https://sites.google.com/view/sastrugi/home

import clr
clr.AddReference("RevitNodes")
import Revit
clr.ImportExtensions(Revit.Elements)
clr.ImportExtensions(Revit.GeometryConversion)

clr.AddReference("RevitAPI")
import Autodesk
from Autodesk.Revit.DB import *
from Autodesk.Revit.DB.PointClouds import *

clr.AddReference('DSCoreNodes') 
import DSCore
from DSCore import *

def tolist(obj1):
	if hasattr(obj1,"__iter__"): return obj1
	else: return [obj1]	

cloud = UnwrapElement(IN[0])

scans = []
scansF = []

if len(cloud)>1:
	for c in cloud:
		scans.append(c.GetScans())
else:
	for c in cloud:
		scansF.append(c.GetScans())
		scans = DSCore.List.Flatten(scansF,1)
OUT = scans
# ----------------------------------------
Scans = Output(python)
python_2 = Python(IN[0]=flatten, IN[1]=python)  # CPython3
# ---------- python_2.python (46 lines) ----------
# Python coding credit to Dynamo Forum user - @Ewan_Opie 2019
# Sastrugi Package https://sites.google.com/view/sastrugi/home

import clr
clr.AddReference("RevitNodes")
import Revit
clr.ImportExtensions(Revit.Elements)
clr.ImportExtensions(Revit.GeometryConversion)

clr.AddReference("RevitAPI")
import Autodesk
from Autodesk.Revit.DB import *
from Autodesk.Revit.DB.PointClouds import *

clr.AddReference('DSCoreNodes') 
import DSCore
from DSCore import *

def tolist(obj1):
	if hasattr(obj1,"__iter__"): return obj1
	else: return [obj1]	

cloud = tolist(UnwrapElement(IN[0]))
scans = IN[1]
scanL = []
sc2 =[]

if len(cloud)>1:
		for sc,c in zip(scans,cloud):
			sca = []
			for s in sc:
				pX = c.GetScanOrigin(s).X
				pY = c.GetScanOrigin(s).Y
				pZ = c.GetScanOrigin(s).Z
				sca.append(Point.Create(XYZ(pX,pY,pZ)).ToProtoType(True))
			sc2.append(sca)
		scanL.append(sc2)
else:
	for c in cloud:
		scanFlat=DSCore.List.Flatten(scans,1)
		for s in scanFlat:
			pX = c.GetScanOrigin(s).X
			pY = c.GetScanOrigin(s).Y
			pZ = c.GetScanOrigin(s).Z
			scanL.append(Point.Create(XYZ(pX,pY,pZ)).ToProtoType(True))
OUT = scanL
# ----------------------------------------
codeBlock = CodeBlock { 1; }
flatten_2 = List.Flatten(list=python_2, amount=codeBlock)
Origins = Output(flatten_2)
python_3 = Python(IN[0]=flatten)  # CPython3
# ---------- python_3.python (35 lines) ----------
# Python coding credit to Dynamo Forum user - @Ewan_Opie 2019
# Sastrugi Package https://sites.google.com/view/sastrugi/home

import clr
clr.AddReference("RevitNodes")
import Revit
clr.ImportExtensions(Revit.Elements)
clr.ImportExtensions(Revit.GeometryConversion)

clr.AddReference("RevitAPI")
import Autodesk
from Autodesk.Revit.DB import *
from Autodesk.Revit.DB.PointClouds import *

clr.AddReference('DSCoreNodes') 
import DSCore
from DSCore import *

def tolist(obj1):
	if hasattr(obj1,"__iter__"): return obj1
	else: return [obj1]	

cloud = UnwrapElement(IN[0])

regions = []
regionsF = []

if len(cloud)>1:
	for c in cloud:
		regions.append(c.GetRegions())
else:
	for c in cloud:
		regionsF.append(c.GetRegions())
		regions = DSCore.List.Flatten(regionsF,1)
OUT = regions
# ----------------------------------------
Regions = Output(python_3)
