# Dynamo custom node ❄_PC_Graphics_Override_Settings_By_Fixed_Color.dyf
# category: Sastrugi.Pointcloud Graphics.Override Settings
# (Sastrugi_Pointcloud_Graphics) Override settings for Pointcloud by Fixed Color.

python = Python()  # CPython3; unwired: IN[0]
# ---------- python.python (40 lines) ----------
# Python coding credit to Dynamo Forum user - @Ewan_Opie 2019
# Sastrugi Package https://sites.google.com/view/sastrugi/home

import clr
clr.AddReference("RevitNodes")
import Revit
clr.ImportExtensions(Revit.Elements)

clr.AddReference("RevitServices")
import RevitServices
from RevitServices.Persistence import DocumentManager
from RevitServices.Transactions import TransactionManager

from System.Collections.Generic import *

clr.AddReference("RevitAPI")
import Autodesk
from Autodesk.Revit.DB import *

from Autodesk.Revit import DB

# Colormode Dict
cm = {
0:"NoOverride",# 	Show the actual colors
1:"FixedColor",# 	Show a single color
2:"Elevation",# 	Color by elevation
3:"Intensity",# 	Color by intensity (reflectivity)
4:"Normals"} 	#Color by normal vectors 

clr.ImportExtensions(Revit.GeometryConversion)

doc = DocumentManager.Instance.CurrentDBDocument

pts = DB.FilteredElementCollector(doc).OfClass(DB.PointCloudInstance).WhereElementIsNotElementType().ToElements()

pt_cloud_settings = DB.PointClouds.PointCloudOverrideSettings()

pt_cloud_settings.ColorMode = DB.PointCloudColorMode.FixedColor

OUT = [pt_cloud_settings.ColorMode]
# ----------------------------------------
FixedColor = Input(FixedColor: DSCore.Color = DSCore.Color.ByARGB(255, 255, 0, 0))
python_2 = Python(IN[0]=FixedColor, IN[1]=FixedColor)  # CPython3
# ---------- python_2.python (44 lines) ----------
# Python coding credit to Dynamo Forum user - @Ewan_Opie 2019
# Sastrugi Package https://sites.google.com/view/sastrugi/home

import clr
clr.AddReference("RevitNodes")
import Revit
clr.ImportExtensions(Revit.Elements)

clr.AddReference("RevitServices")
import RevitServices
from RevitServices.Persistence import DocumentManager
from RevitServices.Transactions import TransactionManager

from System.Collections.Generic import *

clr.AddReference("RevitAPI")
import Autodesk
from Autodesk.Revit.DB import *

from Autodesk.Revit import DB

clr.ImportExtensions(Revit.GeometryConversion)

doc = DocumentManager.Instance.CurrentDBDocument

color1 = IN[0]
color2 = IN[1]

r1 = color1.Red
g1 = color1.Green
b1 = color1.Blue

r2 = color2.Red
g2 = color2.Green
b2 = color2.Blue

c1 = Autodesk.Revit.DB.Color(r1,g1,b1)
c2 = Autodesk.Revit.DB.Color(r2,g2,b2)

pts = DB.FilteredElementCollector(doc).OfClass(DB.PointCloudInstance).WhereElementIsNotElementType().ToElements()

pc_col_set = DB.PointClouds.PointCloudColorSettings(c1,c2)

OUT=[pc_col_set]
# ----------------------------------------
codeBlock = CodeBlock(col_mode=python, col_settings=python_2) { col_mode; col_settings; }
python_3 = Python(IN[0]=codeBlock.col_mode, IN[1]=codeBlock.col_settings)  # CPython3
# ---------- python_3.python (45 lines) ----------
# Python coding credit to Dynamo Forum user - @Ewan_Opie 2019
# Sastrugi Package https://sites.google.com/view/sastrugi/home

import clr
clr.AddReference("RevitNodes")
import Revit
clr.ImportExtensions(Revit.Elements)

clr.AddReference("RevitServices")
import RevitServices
from RevitServices.Persistence import DocumentManager
from RevitServices.Transactions import TransactionManager

from System.Collections.Generic import *

clr.AddReference("RevitAPI")
import Autodesk
from Autodesk.Revit.DB import *

from Autodesk.Revit import DB

clr.ImportExtensions(Revit.GeometryConversion)

doc = DocumentManager.Instance.CurrentDBDocument
uiapp = DocumentManager.Instance.CurrentUIApplication
app = uiapp.Application

def tolist(obj1):
	if hasattr(obj1,"__iter__"): return obj1
	else: return [obj1]	
	
cmode = tolist(IN[0])
csettings = tolist(IN[1])

pcOSsettings = []

pts = DB.FilteredElementCollector(doc).OfClass(DB.PointCloudInstance).WhereElementIsNotElementType().ToElements()

for cm,cs in zip(cmode, csettings):
	pc_os = DB.PointClouds.PointCloudOverrideSettings()
	pc_os.ColorMode = cm
	pc_os.SetModeOverride(cm,cs)
	pcOSsettings.append(pc_os)

OUT = pcOSsettings
# ----------------------------------------
OverrideSettings = Output(python_3)
