# Dynamo custom node ❄_PC_Graphics_Override_Settings_Visibility_Hide.dyf "❄_PC_Graphics_Override_Settings_Visibilty_Hide"
# category: Sastrugi.Pointcloud Graphics.Override Settings
# (Sastrugi_Pointcloud_Graphics) Override settings to Hide Scans/Regions.

python = Python()  # CPython3; unwired: IN[0]
# ---------- python.python (43 lines) ----------
# Python coding credit to Dynamo Forum user - @Ewan_Opie 2019
# Sastrugi Package https://sites.google.com/view/sastrugi/home

import clr
clr.AddReference("RevitNodes")
import Revit
clr.ImportExtensions(Revit.Elements)

clr.AddReference("RevitServices")
import RevitServices
from RevitServices.Persistence import DocumentManager
from RevitServices.Transactions import TransactionManager

from System.Collections.Generic import *

clr.AddReference("RevitAPI")
import Autodesk
from Autodesk.Revit.DB import *

from Autodesk.Revit import DB

clr.ImportExtensions(Revit.GeometryConversion)

doc = DocumentManager.Instance.CurrentDBDocument
uiapp = DocumentManager.Instance.CurrentUIApplication
app = uiapp.Application

def tolist(obj1):
	if hasattr(obj1,"__iter__"): return obj1
	else: return [obj1]	
	
cmode = tolist(IN[0])

pcOSsettings = []

pts = DB.FilteredElementCollector(doc).OfClass(DB.PointCloudInstance).WhereElementIsNotElementType().ToElements()

for cm in cmode:
	pc_os = DB.PointClouds.PointCloudOverrideSettings()
	pc_os.Visible = False
	pcOSsettings.append(pc_os)

OUT = pcOSsettings
# ----------------------------------------
OverrideSettings = Output(python)
