# Dynamo custom node ❄_PC_Select_Points.dyf
# category: Sastrugi.Pointcloud Geometry
# (Sastrugi_Pointcloud_Geometry) This node allows the selection of a multiple points from a Pointcloud Instance.

Refresh = Input(Refresh: bool = true)
python = Python(IN[0]=Refresh)  # CPython3
# ---------- python.python (46 lines) ----------
# Import necessary Revit API classes
import clr
clr.AddReference("RevitAPI")
from Autodesk.Revit.DB import *

import clr
clr.AddReference('RevitAPI')
import Autodesk
from Autodesk.Revit.DB import *

clr.AddReference('RevitServices')
import RevitServices
from RevitServices.Persistence import DocumentManager


	
# Get the active Revit document
doc = DocumentManager.Instance.CurrentDBDocument
uiapp = DocumentManager.Instance.CurrentUIApplication 
app = uiapp.Application 
uidoc = uiapp.ActiveUIDocument

# Get Revit Versions
revit_version=int(app.VersionNumber)

# Check if the display unit type is for metric or imperial units
if revit_version < 2021:
    display_unit_type = doc.GetUnits().GetFormatOptions(UnitType.UT_Length).DisplayUnits
    if display_unit_type == UnitType.UT_Millimeters or display_unit_type == UnitType.UT_Meters:
        units_used = "Metric"
    elif display_unit_type == UnitType.UT_FeetFractionalInches or display_unit_type == UnitType.UT_DecimalFeet:
        units_used = "Imperial"
    else:
        # Use Metric by Default if nothing found
        units_used = "Metric"
else:
    display_unit_type = doc.GetUnits().GetFormatOptions(SpecTypeId.Length).GetUnitTypeId()
    if display_unit_type == UnitTypeId.Millimeters or display_unit_type == UnitTypeId.Meters:
        units_used = "Metric"
    elif display_unit_type == UnitTypeId.FeetFractionalInches or display_unit_type == UnitTypeId.DecimalFeet:
        units_used = "Imperial"
    else:
        # Use Metric by Default if nothing found
        units_used = "Metric"
    
OUT = units_used
# ----------------------------------------
codeBlock = CodeBlock()
# ---------- codeBlock.designscript (2 lines) ----------
//Initial Ray
100;
# ----------------------------------------
python_2 = Python(IN[0]=Refresh, IN[1]=python, IN[2]=codeBlock)  # CPython3
# ---------- python_2.python (81 lines) ----------
# Python coding credit to Dynamo Forum user - @Ewan_Opie 2021
# Sastrugi Package https://sites.google.com/view/sastrugi/home

import clr
import sys

clr.AddReference('RevitAPIUI')
from Autodesk.Revit.UI import *
from  Autodesk.Revit.UI import TaskDialog

clr.AddReference('RevitServices')
import RevitServices
from RevitServices.Persistence import DocumentManager

doc = DocumentManager.Instance.CurrentDBDocument
uiapp = DocumentManager.Instance.CurrentUIApplication
app = uiapp.Application
uidoc=DocumentManager.Instance.CurrentUIApplication.ActiveUIDocument

clr.AddReference('RevitNodes')

import System
from System import Array
from System.Collections.Generic import *

import Revit
clr.ImportExtensions(Revit.Elements)
clr.ImportExtensions(Revit.GeometryConversion)

clr.AddReference('RevitAPI')
import Autodesk
from Autodesk.Revit.DB import *
from Autodesk.Revit.DB.PointClouds import *

clr.AddReference('ProtoGeometry')
from Autodesk.DesignScript.Geometry import *
result = []

msg = 'Pick a PointCloudInstance, then the points required. Then click Finish.'

TaskDialog.Show("Sastrugi", msg)

sel1 = uidoc.Selection
ot1 = Selection.ObjectType.Element
ot2 = Selection.ObjectType.PointOnElement
li_ref = sel1.PickObject(ot1, 'Select Link')

link1 = doc.GetElement(li_ref.ElementId)
tf1 = link1.GetTotalTransform()
face_ref = sel1.PickObjects(ot2, 'Select Point')

doc_units = IN[1]
if "Metric" in doc_units:
    div = 1
else:
    div = 304.8
    
boxSize = IN[2] / div

offset_dist = 1000000 / div

sol_result = []
link1_result = []
viewLine2_result = []

for f in face_ref:
	basePt = f.GlobalPoint.ToPoint(True)
	
	viewDir = doc.ActiveView.ViewDirection.ToVector()
	viewPlane = Plane.ByOriginNormal(basePt,viewDir)
	viewLine1 = Line.ByStartPointDirectionLength(basePt,viewDir,offset_dist*-1)
	viewLine2 = Line.ExtendStart(viewLine1,offset_dist)
	Rect = Rectangle.ByWidthLength(viewPlane,boxSize,boxSize)
	r1 = Geometry.Translate(Rect,Vector.Reverse(viewDir),offset_dist)
	r2 = Geometry.Translate(Rect,viewDir,offset_dist)
	sol = Solid.ByLoft([r1,r2])
	sol_result.append(sol)
	link1_result.append(link1)
	viewLine2_result.append(viewLine2)

OUT = sol_result,link1_result,viewLine2_result
# ----------------------------------------
codeBlock_2 = CodeBlock(outSolid=python_2, outCloud=python_2, outViewLine=python_2) { outSolid[0]; outCloud[1]; outViewLine[2]; }
codeBlock_3 = CodeBlock(input_solid=codeBlock_2.out0) { input_solid; }
centroid = Solid.Centroid(solid=codeBlock_3)
ZAxis = Vector.ZAxis()
byOriginNormal = Plane.ByOriginNormal(origin=centroid, normal=ZAxis)
codeBlock_4 = CodeBlock { 1.01; }
scale = Geometry.Scale(geometry=codeBlock_3, plane=byOriginNormal, xamount=codeBlock_4, yamount=codeBlock_4, zamount=codeBlock_4)
faces = Topology.Faces(topology=scale)
vertices = Face.Vertices(face=faces)
pointGeometry = Vertex.PointGeometry(vertex=vertices)
byBestFitThroughPoints = Plane.ByBestFitThroughPoints(points=pointGeometry)
origin = Plane.Origin(plane=byBestFitThroughPoints)
centroid_2 = Solid.Centroid(solid=codeBlock_3)
byTwoPoints = Vector.ByTwoPoints(start=origin, end=centroid_2, lacing=Longest)
byOriginNormal_2 = Plane.ByOriginNormal(origin=origin, normal=byTwoPoints)
python_3 = Python(IN[0]=codeBlock_2.out1, IN[1]=byOriginNormal_2)  # CPython3
# ---------- python_3.python (54 lines) ----------
# Python coding credit to Dynamo Forum user - @Ewan_Opie 2021
# Sastrugi Package https://sites.google.com/view/sastrugi/home

import clr
clr.AddReference('ProtoGeometry')
from Autodesk.DesignScript.Geometry import *

clr.AddReference("RevitNodes")
import Revit
clr.ImportExtensions(Revit.Elements)

clr.ImportExtensions(Revit.GeometryConversion)

clr.AddReference("RevitServices")
import RevitServices
from RevitServices.Persistence import DocumentManager
from RevitServices.Transactions import TransactionManager
from System.Collections.Generic import *

clr.AddReference("RevitAPI")
import Autodesk
from Autodesk.Revit.DB import *
from Autodesk.Revit.DB.PointClouds import *

doc = DocumentManager.Instance.CurrentDBDocument
uiapp = DocumentManager.Instance.CurrentUIApplication
app = uiapp.Application
uidoc=DocumentManager.Instance.CurrentUIApplication.ActiveUIDocument
PL_filters = []
for pi in IN[1]:
	PL=[]
	for i in pi:
		PL.append(UnwrapElement(i).ToPlane())
	
	
	IPL=List[Autodesk.Revit.DB.Plane](PL)

	PLfilter=PointCloudFilterFactory.CreateMultiPlaneFilter(PL)
	PL_filters.append(PLfilter)

dist = 0.001
sample= 5
result = []

for pf,pts in zip(PL_filters,UnwrapElement(IN[0])):
	points = pts.GetPoints(pf, dist, sample)
	pointsample=[]
	for p in points:
		X=p.X
		Y=p.Y
		Z=p.Z
		pointsample.append(Point.Create(XYZ(X,Y,Z)).ToProtoType(True))
	result.append(pointsample)
OUT = result
# ----------------------------------------
elementType = Element.ElementType(element=codeBlock_2.out1)
codeBlock_5 = CodeBlock { "Scale"; }
getParameterValueByName = Element.GetParameterValueByName(element=elementType, parameterName=codeBlock_5)
scale_2 = Geometry.Scale(geometry=python_3, xamount=getParameterValueByName, yamount=getParameterValueByName, zamount=getParameterValueByName)
identity = CoordinateSystem.Identity()
flatten = List.Flatten(list=codeBlock_2.out1)
python_4 = Python(IN[0]=flatten)  # CPython3
# ---------- python_4.python (48 lines) ----------
# Python coding credit to Dynamo Forum user - @Ewan_Opie 2021
# Sastrugi Package https://sites.google.com/view/sastrugi/home

#BIG THANKS TO @AWILLIAMS
import clr
clr.AddReference('ProtoGeometry')
from Autodesk.DesignScript.Geometry import *

clr.AddReference("RevitNodes")
import Revit
clr.ImportExtensions(Revit.Elements)

clr.AddReference("RevitServices")
import RevitServices
from RevitServices.Persistence import DocumentManager
from RevitServices.Transactions import TransactionManager

from System.Collections.Generic import *

clr.AddReference("RevitAPI")
import Autodesk
from Autodesk.Revit.DB import *

clr.ImportExtensions(Revit.GeometryConversion)

doc = DocumentManager.Instance.CurrentDBDocument
uiapp = DocumentManager.Instance.CurrentUIApplication
app = uiapp.Application


cloud = UnwrapElement(IN[0])

TransactionManager.Instance.EnsureInTransaction(doc)


cloudtransform = []

for c in cloud:
	transform = c.GetTotalTransform()
	X = transform.Origin.X
	Y = transform.Origin.Y
	Z = transform.Origin.Z
	point=Point.Create(XYZ(X,Y,Z)).ToProtoType(True)
	cloudtransform.append(point)
	
TransactionManager.Instance.TransactionTaskDone()

OUT = cloudtransform
# ----------------------------------------
ZAxis_2 = Vector.ZAxis()
byOriginNormal_3 = Plane.ByOriginNormal(origin=python_4, normal=ZAxis_2)
byPlane = CoordinateSystem.ByPlane(plane=byOriginNormal_3)
transform = Geometry.Transform(geometry=scale_2, fromCoordinateSystem=identity, contextCoordinateSystem=byPlane, lacing=Longest)
closestPointTo = Geometry.ClosestPointTo(geometry=codeBlock_2.out2, other=transform, lacing=Longest)
distanceTo = Geometry.DistanceTo(geometry=transform, other=closestPointTo, lacing=Longest)
minimumItem = List.MinimumItem(list=distanceTo@L2)
indexOf = List.IndexOf(list=distanceTo@L2, element=minimumItem@L1)
getItemAtIndex = List.GetItemAtIndex(list=transform@L2, index=indexOf@L1)
codeBlock_6 = CodeBlock(localpoints=getItemAtIndex) { localpoints; }
OutputPoints = Output(codeBlock_6)
