# Dynamo graph spaceanalysis-pathfinding-05-closest-accessible-point.dyn (Dynamo 2.17.0.3472)
# packages: SpaceAnalysis 0.5.0

# note: Variables / Inputs
# Variables that can be altered per project and must be set accordingly before running the script.
# note: Working / Functions
# Core working of the script.
# note: Display / Visualization
# Logic used simply for visualization purposes, and doesn't contain core logic.

# group: Pathfinding - Closest Accessible Space Lattice Point
# note: DYNAMO PROJECT
# spaceanalysis-pathfinding-05-closest-accessible-point.dyn
# note: ASSOCIATED FILE(S)
# N/A
# note: AUTHOR(S) / CREATION DATE
# Autodesk Research / 2021
# note: DESCRIPTION
# Example showing use of SpaceLattice.ClosestPointTo node
# note: DYNAMO VERSION
# 2.17.0
# note: ADDITIONAL COMMENTS
# N/A
# note: REQUIRED DYNAMO PACKAGES
# SpaceAnalysis

# group: Outer Boundary
code_block = CodeBlock { [-10, -10, 10, 10]; }
code_block_2 = CodeBlock { [-20, 20, 20, -20]; }
byCoordinates = Point.ByCoordinates(x=code_block, y=code_block_2)
code_block_3 = CodeBlock { [-10, 10, 10, -10]; }
code_block_4 = CodeBlock { [20, 20, -20, -20]; }
byCoordinates_2 = Point.ByCoordinates(x=code_block_3, y=code_block_4)
byStartPointEndPoint = Line.ByStartPointEndPoint(startPoint=byCoordinates, endPoint=byCoordinates_2)

# group: Internal Boundary
number_slider = DoubleSlider(1.553, range=-5.692..100 step 0.1)
number_slider_2 = DoubleSlider(-4.524, range=-16.8..100 step 0.1)
byCoordinates_3 = Point.ByCoordinates(x=number_slider, y=number_slider_2)
number_slider_3 = DoubleSlider(-3.494, range=-6.882..100 step 0.1)
number_slider_4 = DoubleSlider(-4.511, range=-5.568..100 step 0.1)
byCoordinates_4 = Point.ByCoordinates(x=number_slider_3, y=number_slider_4)
byStartPointEndPoint_2 = Line.ByStartPointEndPoint(startPoint=byCoordinates_3, endPoint=byCoordinates_4)
number_slider_5 = DoubleSlider(1.431, range=-5.692..100 step 0.1)
number_slider_6 = DoubleSlider(-6.481, range=-16.8..100 step 0.1)
byCoordinates_5 = Point.ByCoordinates(x=number_slider_5, y=number_slider_6)
number_slider_7 = DoubleSlider(-3.431, range=-6.882..100 step 0.1)
number_slider_8 = DoubleSlider(-6.469, range=-7.971..100 step 0.1)
byCoordinates_6 = Point.ByCoordinates(x=number_slider_7, y=number_slider_8)
byStartPointEndPoint_3 = Line.ByStartPointEndPoint(startPoint=byCoordinates_5, endPoint=byCoordinates_6)
number_slider_9 = DoubleSlider(1.601, range=-5.692..100 step 0.1)
number_slider_10 = DoubleSlider(-3.55, range=-16.8..100 step 0.1)
byCoordinates_7 = Point.ByCoordinates(x=number_slider_9, y=number_slider_10)
number_slider_11 = DoubleSlider(-3.385, range=-6.882..100 step 0.1)
number_slider_12 = DoubleSlider(-3.533, range=-5.141..100 step 0.1)
byCoordinates_8 = Point.ByCoordinates(x=number_slider_11, y=number_slider_12)
byStartPointEndPoint_4 = Line.ByStartPointEndPoint(startPoint=byCoordinates_7, endPoint=byCoordinates_8)
number_slider_13 = DoubleSlider(1.618, range=-5.692..100 step 0.1)
number_slider_14 = DoubleSlider(-5.569, range=-16.8..100 step 0.1)
byCoordinates_9 = Point.ByCoordinates(x=number_slider_13, y=number_slider_14)
number_slider_15 = DoubleSlider(-3.464, range=-6.882..100 step 0.1)
number_slider_16 = DoubleSlider(-5.507, range=-7.004..100 step 0.1)
byCoordinates_10 = Point.ByCoordinates(x=number_slider_15, y=number_slider_16)
byStartPointEndPoint_5 = Line.ByStartPointEndPoint(startPoint=byCoordinates_9, endPoint=byCoordinates_10)
number_slider_17 = DoubleSlider(1.431, range=-5.692..100 step 0.1)
number_slider_18 = DoubleSlider(-7.465, range=-16.8..100 step 0.1)
byCoordinates_11 = Point.ByCoordinates(x=number_slider_17, y=number_slider_18)
number_slider_19 = DoubleSlider(-3.431, range=-6.882..100 step 0.1)
number_slider_20 = DoubleSlider(-7.444, range=-7.971..100 step 0.1)
byCoordinates_12 = Point.ByCoordinates(x=number_slider_19, y=number_slider_20)
byStartPointEndPoint_6 = Line.ByStartPointEndPoint(startPoint=byCoordinates_11, endPoint=byCoordinates_12)
number_slider_21 = DoubleSlider(1.431, range=-5.692..100 step 0.1)
number_slider_22 = DoubleSlider(-8.525, range=-16.8..100 step 0.1)
byCoordinates_13 = Point.ByCoordinates(x=number_slider_21, y=number_slider_22)
number_slider_23 = DoubleSlider(-3.431, range=-6.882..100 step 0.1)
number_slider_24 = DoubleSlider(-8.489, range=-8.489..100 step 0.1)
byCoordinates_14 = Point.ByCoordinates(x=number_slider_23, y=number_slider_24)
byStartPointEndPoint_7 = Line.ByStartPointEndPoint(startPoint=byCoordinates_13, endPoint=byCoordinates_14)
number_slider_25 = DoubleSlider(1.431, range=-5.692..100 step 0.1)
number_slider_26 = DoubleSlider(6.681, range=-16.8..100 step 0.1)
byCoordinates_15 = Point.ByCoordinates(x=number_slider_25, y=number_slider_26)
number_slider_27 = DoubleSlider(-3.431, range=-6.882..100 step 0.1)
number_slider_28 = DoubleSlider(1.296, range=-8.489..100 step 0.1)
byCoordinates_16 = Point.ByCoordinates(x=number_slider_27, y=number_slider_28)
byStartPointEndPoint_8 = Line.ByStartPointEndPoint(startPoint=byCoordinates_15, endPoint=byCoordinates_16)

join = List.Join(list0=byStartPointEndPoint_2, list1=byStartPointEndPoint_3, list2=byStartPointEndPoint_4, list3=byStartPointEndPoint_5, list4=byStartPointEndPoint_6, list5=byStartPointEndPoint_7, list6=byStartPointEndPoint_8)
code_block_5 = CodeBlock(lines=join) { lines; }

# group: Compute Lattice
byGeometry = BoundingBox.ByGeometry(geom=byStartPointEndPoint)
code_block_6 = CodeBlock { 1; }
byBoundingBoxAndLines = SpaceAnalysis.Core.SpaceLattice.ByBoundingBoxAndLines(boundingBox=byGeometry, barriers=code_block_5, resolution=code_block_6)

# group: Start Points
number_slider_29 = DoubleSlider(-14.745, range=-22.681..100 step 0.1)
number_slider_30 = DoubleSlider(-2.335, range=-28.537..100 step 0.1)
byCoordinates_17 = Point.ByCoordinates(x=number_slider_29, y=number_slider_30)
number_slider_31 = DoubleSlider(-0.813, range=-0.813..100 step 0.1)
number_slider_32 = DoubleSlider(-5.088, range=-5.208..100 step 0.1)
byCoordinates_18 = Point.ByCoordinates(x=number_slider_31, y=number_slider_32)
number_slider_33 = DoubleSlider(0.063, range=-0.451..100 step 0.1)
number_slider_34 = DoubleSlider(4.771, range=0..100 step 0.1)
byCoordinates_19 = Point.ByCoordinates(x=number_slider_33, y=number_slider_34)

join_2 = List.Join(list0=byCoordinates_17, list1=byCoordinates_18, list2=byCoordinates_19)
closestPointTo = SpaceAnalysis.Core.SpaceLattice.ClosestPointTo(spaceLattice=byBoundingBoxAndLines, point=join_2)

# group: End Point
number_slider_35 = DoubleSlider(0.291, range=-8.677..100 step 0.1)
number_slider_36 = DoubleSlider(0.511, range=-2.512..100 step 0.1)
byCoordinates_20 = Point.ByCoordinates(x=number_slider_35, y=number_slider_36)

bySpaceLattice = SpaceAnalysis.Pathfinding.Route.BySpaceLattice(spaceLattice=byBoundingBoxAndLines, startPoint=closestPointTo, endPoint=byCoordinates_20)

# group: Route Smoothness
number_slider_37 = DoubleSlider(10, range=0..50 step 1)

# group: Display Path as PolyCurve
curve = SpaceAnalysis.Pathfinding.Route.Curve(route=bySpaceLattice, tidyIterations=number_slider_37)
ZAxis = Vector.ZAxis()
code_block_7 = CodeBlock { 0.01; }
translate = Geometry.Translate(geometry=curve, direction=ZAxis, distance=code_block_7)
color_palette = ColorPalette({R: 0, G: 0, B: 255, A: 255})
byGeometryColor = Modifiers.GeometryColor.ByGeometryColor(geometry=translate, color=color_palette)

# group: Display Lattice as Edges
edges = SpaceAnalysis.Core.SpaceLattice.Edges(spaceLattice=byBoundingBoxAndLines)
color_palette_2 = ColorPalette({R: 50, G: 205, B: 50, A: 98})
byGeometryColor_2 = Modifiers.GeometryColor.ByGeometryColor(geometry=edges, color=color_palette_2)

# group: Display Start and End Point Markers
code_block_8 = CodeBlock { 0.25; }
byCenterPointRadius = Circle.ByCenterPointRadius(centerPoint=byCoordinates_20, radius=code_block_8)
color_palette_3 = ColorPalette({R: 255, G: 0, B: 255, A: 255})
byGeometryColor_3 = Modifiers.GeometryColor.ByGeometryColor(geometry=byCenterPointRadius, color=color_palette_3)
code_block_9 = CodeBlock { 0.25; }
byCenterPointRadius_2 = Circle.ByCenterPointRadius(centerPoint=join_2, radius=code_block_9)
code_block_10 = CodeBlock { 4; }
regularPolygon = Polygon.RegularPolygon(circle=byCenterPointRadius_2, numberSides=code_block_10)
color_palette_4 = ColorPalette({R: 75, G: 0, B: 130, A: 255})
byGeometryColor_4 = Modifiers.GeometryColor.ByGeometryColor(geometry=regularPolygon, color=color_palette_4)
