# Dynamo graph 12-VASA-Sensor-Coverage.dyn (Dynamo 2.19.3.6394)
# packages: VASA 0.4.0

# note: Input Variables
# Pink indicates variables that can be altered per project and must be set accordingly before running the script.
# note: Functional Logic
# Cyan indicates the logic of the script. No changes should be made in these groups unless advised.
# note: Output Values
# Orange indicates key resulting values of nodes that should be observed after running the graph.
# note: Display Objects
# Blue indicates objects that can be previewed in the 3D background after running the graph.

# group: VASA Workflow 12: Sensor Coverage
# note: DYNAMO PROJECT
# 12-VASA-Sensor-Coverage.dyn
# note: ASSOCIATED FILE(S)
# sample-data : 2 STL files
# note: REQUIRED DYNAMO PACKAGES
# VASA
# note: DYNAMO VERSION
# 2.19.3
# note: AUTHOR(S) / CREATION DATE
# Autodesk Research 2022
# note: DESCRIPTION
# A demonstration of how to combine sample point generation and proximity operations to select locations on walls and ceilings using the Voxel-based Architectural Space Analysis (VASA) package. In this example, the locations are used to place sensors and approximate their coverage.
# note: ADDITIONAL COMMENTS
# First, sample points are generated using a path model and a set of parameters. The points are filtered to include only indoor locations.
# Next, the points closest to walls are used to place wall-mounted sensors, each with a horizontally oriented pyramidal volume of coverage. The wall offset slider controls the fraction of wall-mounted sensors.
# Finally, the remaining points are used to place ceiling-mounted sensors, each with a downward oriented conical volume of coverage.

# group: STL File Paths
building_geometry_file_path = Filename(".\TechnicalSchool_building_mm_bin.stl")
glazing_geometry_file_path = Filename(".\TechnicalSchool_glazing_mm_bin.stl")

# group: Triangle Data
importFromSTL = VASA.Utils.TrianglesAsNineNumbers.ImportFromSTL(filePath=building_geometry_file_path)
code_block = CodeBlock(buildingTriangles=importFromSTL) { buildingTriangles; }
importFromSTL_2 = VASA.Utils.TrianglesAsNineNumbers.ImportFromSTL(filePath=glazing_geometry_file_path)
code_block_2 = CodeBlock(glazingTriangles=importFromSTL_2) { glazingTriangles; }

# group: Voxel/Path Model Parameters
coarse_voxel_width_code_block = CodeBlock { 1000; }
finestlod_integer_slider = IntegerSlider(3, range=0..5 step 1)
agent_diameter_offset_integer = IntegerSlider(3, range=1..7 step 1)  # "Agent Diameter Offset - Integer Slider"

# group: Voxel Model
byTriangles = VASA.Core.VoxelModel.ByTriangles(trianglesAsNineNumbers=code_block, coarseVoxelWidth=coarse_voxel_width_code_block, finestLOD=finestlod_integer_slider)
code_block_3 = CodeBlock(buildingVoxels=byTriangles) { buildingVoxels; }
byTriangles_2 = VASA.Core.VoxelModel.ByTriangles(trianglesAsNineNumbers=code_block_2, coarseVoxelWidth=coarse_voxel_width_code_block, finestLOD=finestlod_integer_slider)
list_create = List.Create(item0=byTriangles, item1=byTriangles_2)
union = VASA.Operations.SolidOperations.Union(voxelModels=list_create)
code_block_4 = CodeBlock(combinedVoxels=union) { combinedVoxels; }

# group: Building Voxels
code_block_5 = CodeBlock(buildingVoxels=code_block_3) { buildingVoxels; }

# group: Building Voxels
code_block_6 = CodeBlock(buildingVoxels=code_block_5) { buildingVoxels; }

# group: Crop Depth
integer_slider = IntegerSlider(9, range=0..60 step 1)

# group: Crop Voxel Model
crop = VASA.Core.VoxelModel.Crop(voxelModel=code_block_6, upperZDepth=integer_slider)
extents = VASA.Core.VoxelModel.Extents(voxelModel=crop)

# group: Building Voxel Color
color_palette = ColorPalette({R: 255, G: 255, B: 255, A: 127})

# group: Display Building Voxels
displayVoxels = VASA.Core.VoxelModel.DisplayVoxels(voxelModel=crop, color=color_palette)

# group: Horizontally Expanded Voxels
# Voxels representing walls and other buliding elements are expanded by one voxel in the X and Y directions.
expandAlongX = VASA.Operations.SurfaceOperations.ExpandAlongX(voxelModel=code_block_5)
expandAlongY = VASA.Operations.SurfaceOperations.ExpandAlongY(voxelModel=expandAlongX)

# group: Path Model
byVoxelModel = VASA.Pathfinding.PathModel.ByVoxelModel(voxelModel=code_block_4, agentDiameterOffset=agent_diameter_offset_integer)

# group: Sample Point Parameters
spacing_number_slider = DoubleSlider(4000, range=1000..5000 step 500)
min_diameter_offset_integer = IntegerSlider(9, range=1..45 step 1)  # "Min Diameter Offset - Integer Slider"

# group: Sample Point Generation
# Sample points are generated automatically from the path model and a set of parameters.
generateSamplePoints = VASA.Pathfinding.PathModel.GenerateSamplePoints(pathModel=byVoxelModel, spacing=spacing_number_slider, minDiameterOffset=min_diameter_offset_integer)

# group: Outdoor Voxels
# The visibility from direction operation is used to compute the set of voxels visible from directly above, which are assumed to be outside the building.
ZAxis = Vector.ZAxis()
reverse = Vector.Reverse(vector=ZAxis)
visibilityFromDirection = VASA.Operations.VisibilityOperations.VisibilityFromDirection(voxelModel=code_block_4, direction=reverse)

# group: Vertical Adjustment
number_slider = DoubleSlider(1000, range=0..2000 step 10)

# group: Indoor Sample Points
# The list of sample points is filtered to include only points that have a solid element, such as a ceiling, somewhere overhead.
byVoxelModelAndPoint = VASA.Iterators.VoxelIterator.ByVoxelModelAndPoint(voxelModel=visibilityFromDirection, point=generateSamplePoints)
isFilled = VASA.Iterators.VoxelIterator.IsFilled(voxelIterator=byVoxelModelAndPoint)
filterByBoolMask = List.FilterByBoolMask(list=generateSamplePoints, mask=isFilled)
translate = Geometry.Translate(geometry=filterByBoolMask.out, zTranslation=number_slider)

# group: Wall Offset
integer_slider_2 = IntegerSlider(27, range=1..54 step 1)

# group: Wall Points
# Proximity operations are used to produce a set of points near the surfaces of walls and other elements.
nearestFilledHorizontally = VASA.Operations.ProximityOperations.NearestFilledHorizontally(voxelModel=expandAlongY, point=translate, diameterOffset=integer_slider_2)
isValid = VASA.Iterators.VoxelIterator.IsValid(voxelIterator=nearestFilledHorizontally)
filterByBoolMask_2 = List.FilterByBoolMask(list=nearestFilledHorizontally, mask=isValid)
voxelCenter = VASA.Iterators.VoxelIterator.VoxelCenter(voxelIterator=filterByBoolMask_2.in)
code_block_7 = CodeBlock(wallPoints=voxelCenter) { wallPoints; }
filterByBoolMask_3 = List.FilterByBoolMask(list=translate, mask=isValid)
byTwoPoints = Vector.ByTwoPoints(start=voxelCenter, end=filterByBoolMask_3.in)
code_block_8 = CodeBlock(otherPoints=filterByBoolMask_3.out) { otherPoints; }

# group: Wall Sensor Parameters
horizontal_angle_number_slider = DoubleSlider(75, range=0..180 step 5)
vertical_angle_number_slider = DoubleSlider(60, range=0..180 step 5)
max_radius_number_slider = DoubleSlider(4000, range=0..8000 step 10)

# group: Wall Sensor Coverage
# Visibility within pyramid operations are used to compute the volumes of space covered by wall-mounted sensors.
boolean = BoolSelector(true)
visibilityWithinPyramid = VASA.Operations.VisibilityOperations.VisibilityWithinPyramid(voxelModel=code_block_6, point=code_block_7, direction=byTwoPoints, horizontalAngle=horizontal_angle_number_slider, verticalAngle=vertical_angle_number_slider, maxRadius=max_radius_number_slider, autoAdjustExtents=boolean)

# group: Wall Sensor Color
color_palette_2 = ColorPalette({R: 0, G: 191, B: 255, A: 255})

# group: Vertically Expanded Voxels
# Voxels representing ceilings and other buliding elements are expanded by one voxel in the downward Z direction.
code_block_9 = CodeBlock { 0; }
expandAlongZ = VASA.Operations.SurfaceOperations.ExpandAlongZ(voxelModel=code_block_6, upperOffset=code_block_9)

# group: Ceiling Offset
integer_slider_3 = IntegerSlider(12, range=1..24 step 1)

# group: Ceiling Points
# Proximity operations are used to produce a set of points just under ceilings.
code_block_10 = CodeBlock { 0; }
nearestFilledAlongZ = VASA.Operations.ProximityOperations.NearestFilledAlongZ(voxelModel=expandAlongZ, point=code_block_8, lowerOffset=code_block_10, upperOffset=integer_slider_3)
isValid_2 = VASA.Iterators.VoxelIterator.IsValid(voxelIterator=nearestFilledAlongZ)
filterByBoolMask_4 = List.FilterByBoolMask(list=nearestFilledAlongZ, mask=isValid_2)
voxelCenter_2 = VASA.Iterators.VoxelIterator.VoxelCenter(voxelIterator=filterByBoolMask_4.in)
code_block_11 = CodeBlock(ceilingPoints=voxelCenter_2) { ceilingPoints; }
filterByBoolMask_5 = List.FilterByBoolMask(list=code_block_8, mask=isValid_2)
byTwoPoints_2 = Vector.ByTwoPoints(start=voxelCenter_2, end=filterByBoolMask_5.in)

# group: Ceiling Sensor Parameters
angle_number_slider = DoubleSlider(75, range=0..180 step 5)
max_radius_number_slider_2 = DoubleSlider(4000, range=0..8000 step 10)

# group: Ceiling Sensor Coverage
# Visibility within cone operations are used to compute the volumes of space covered by ceiling-mounted sensors.
boolean_2 = BoolSelector(true)
visibilityWithinCone = VASA.Operations.VisibilityOperations.VisibilityWithinCone(voxelModel=code_block_6, point=code_block_11, direction=byTwoPoints_2, angle=angle_number_slider, maxRadius=max_radius_number_slider_2, autoAdjustExtents=boolean_2)

# group: Union and Resize Voxel Models
union_2 = VASA.Operations.SolidOperations.Union(voxelModels=visibilityWithinPyramid)
resize = VASA.Core.VoxelModel.Resize(voxelModel=union_2, newExtents=extents)
union_3 = VASA.Operations.SolidOperations.Union(voxelModels=visibilityWithinCone)
resize_2 = VASA.Core.VoxelModel.Resize(voxelModel=union_3, newExtents=extents)

# group: Display Wall Sensor Coverage
displayVoxels_2 = VASA.Core.VoxelModel.DisplayVoxels(voxelModel=resize, color=color_palette_2)

# group: Wall Sensor Color
color_palette_3 = ColorPalette({R: 255, G: 255, B: 0, A: 255})

# group: Display Ceiling Sensor Coverage
displayVoxels_3 = VASA.Core.VoxelModel.DisplayVoxels(voxelModel=resize_2, color=color_palette_3)
