# Dynamo graph 14-VASA-Revit-RAC-Advanced-Sample.dyn (Dynamo 2.16.1.2727)
# packages: VASA 0.4.0

# note: Input Variables
# Pink indicates variables that can be altered per project and must be set accordingly before running the script.
# note: Functional Logic
# Cyan indicates the logic of the script. No changes should be made in these groups unless advised.
# note: Output Values
# Orange indicates key resulting values of nodes that should be observed after running the graph.
# note: Display Objects
# Blue indicates objects that can be previewed in the 3D background after running the graph.

# group: VASA Workflow 14: Revit RAC Advanced Sample
# note: DYNAMO PROJECT
# 14-VASA-Revit-RAC-Advanced-Sample.dyn
# note: ASSOCIATED FILE(S)
# None
# note: AUTHOR(S) / CREATION DATE
# Autodesk Research 2023
# note: DESCRIPTION
# Demonstrates the use of VASA in Dynamo for Revit using the RAC Advanced Sample Project. The analysis computes a path between two selected door locations.
# The path computation will fail for certain doors on the outside of the building because the analysis regards them as being close to a dropoff. This issue can be corrected by voxelizing the topography surrounding the building, and combining it with the building voxels before creating the path model.
# note: REQUIRED DYNAMO PACKAGES
# VASA
# note: ADDITIONAL COMMENTS
# 1. Open the sample project below in Revit:
#         rac_advanced_sample_project.rvt
#         To find sample projects, search
#         online for "Revit Sample Project Files"
#         or look in the path below:
#         C:\Program Files\Autodesk\Revit 20XX\Samples
# 2. Select the 3D View named "{3D}".
# 3. Click Manage -> Dynamo.
# 4. Adjust the path endpoint sliders and explore.
# note: DYNAMO VERSION
# Dynamo Revit 2.16.1

# group: Revit Geometry
element_types = ElementTypes("Floor")
all_elements_of_type = ElementsOfType(element_type=element_types)
geometry = Element.Geometry(element=all_elements_of_type)
element_types_2 = ElementTypes("Wall")
all_elements_of_type_2 = ElementsOfType(element_type=element_types_2)
geometry_2 = Element.Geometry(element=all_elements_of_type_2)
element_types_3 = ElementTypes("Ceiling")
all_elements_of_type_3 = ElementsOfType(element_type=element_types_3)
geometry_3 = Element.Geometry(element=all_elements_of_type_3)
element_types_4 = ElementTypes("RoofBase")
all_elements_of_type_4 = ElementsOfType(element_type=element_types_4)
geometry_4 = Element.Geometry(element=all_elements_of_type_4)
element_types_5 = ElementTypes("Stairs")
all_elements_of_type_5 = ElementsOfType(element_type=element_types_5)
geometry_5 = Element.Geometry(element=all_elements_of_type_5)
element_types_6 = ElementTypes("BuildingPad")
all_elements_of_type_6 = ElementsOfType(element_type=element_types_6)
geometry_6 = Element.Geometry(element=all_elements_of_type_6)
string = StringInput("Structural Columns")
byName = Category.ByName(name=string)
all_elements_of_category = ElementsOfCategory(Category=byName)
geometry_7 = Element.Geometry(element=all_elements_of_category)
element_types_7 = ElementTypes("Panel")
all_elements_of_type_7 = ElementsOfType(element_type=element_types_7)
geometry_8 = Element.Geometry(element=all_elements_of_type_7)
string_2 = StringInput("Doors")
byName_2 = Category.ByName(name=string_2)
all_elements_of_category_2 = ElementsOfCategory(Category=byName_2)
geometry_9 = Element.Geometry(element=all_elements_of_category_2)

# group: Building Geometry
list_create = List.Create(item0=geometry, item1=geometry_2, item2=geometry_3, item3=geometry_4, item4=geometry_5, item5=geometry_6, item6=geometry_7)
flatten = List.Flatten(list=list_create)
code_block = CodeBlock(glazing=geometry_8) { glazing; }
flatten_2 = List.Flatten(list=code_block)
join = List.Join(list0=flatten, list1=flatten_2)
code_block_2 = CodeBlock(combined=join) { combined; }
code_block_3 = CodeBlock(glazing=flatten_2) { glazing; }
code_block_4 = CodeBlock(building=flatten) { building; }

# group: Coarse Voxel Width
# Set to 1 meter or 4 feet in project Length units.
# (e.g. Use 1000 if project is in millimeters).
code_block_5 = CodeBlock { 1000; }

# group: Building Voxels
byGeometry = VASA.Core.VoxelModel.ByGeometry(geometry=code_block_2, coarseVoxelWidth=code_block_5)
union = VASA.Operations.SolidOperations.Union(voxelModels=byGeometry)

# group: Building Voxel Color
color_palette = ColorPalette({R: 255, G: 255, B: 255, A: 63})

# group: Display Building Voxels
displayVoxels = VASA.Core.VoxelModel.DisplayVoxels(voxelModel=union, color=color_palette)

# group: Path Model
byVoxelModel = VASA.Pathfinding.PathModel.ByVoxelModel(voxelModel=union)

# group: Door Locations
code_block_6 = CodeBlock(doors=geometry_9) { doors; }
byGeometry_2 = BoundingBox.ByGeometry(geom=code_block_6)
string_3 = StringInput("BoundingBox")
removeIfNot = List.RemoveIfNot(list=byGeometry_2, type=string_3)
toCuboid = BoundingBox.ToCuboid(boundingBox=removeIfNot)
centroid = Solid.Centroid(solid=toCuboid)

# group: Select Source Point
integer_slider = IntegerSlider(2, range=0..99 step 1)

# group: Select Sample Point
integer_slider_2 = IntegerSlider(79, range=0..99 step 1)

# group: Selected Points
getItemAtIndex = List.GetItemAtIndex(list=centroid, index=integer_slider)
getItemAtIndex_2 = List.GetItemAtIndex(list=centroid, index=integer_slider_2)

# group: Path
byPathModelAndPoints = VASA.Pathfinding.Path.ByPathModelAndPoints(pathModel=byVoxelModel, sourcePoint=getItemAtIndex, samplePoint=getItemAtIndex_2)
curveFromSourceToSample = VASA.Pathfinding.Path.CurveFromSourceToSample(path=byPathModelAndPoints)

# group: Path Color
color_palette_2 = ColorPalette({R: 138, G: 43, B: 226, A: 255})

# group: Display Path
byGeometryColor = Modifiers.GeometryColor.ByGeometryColor(geometry=curveFromSourceToSample, color=color_palette_2)

# group: Building Geometry Color
color_palette_3 = ColorPalette({R: 255, G: 255, B: 255, A: 127})

# group: Display Building Geometry
byGeometryColor_2 = Modifiers.GeometryColor.ByGeometryColor(geometry=code_block_4, color=color_palette_3)
