# Dynamo custom node FillPattern.ModelPatFileImperial.dyf (Dynamo 0.9.0.3067)
# category: Zebra.Revit
# Creates the relevant strings for the .pat file.

string = StringInput(";%UNITS=INCH\n\n")
string_2 = StringInput("*")
Name = Input()
string_3 = StringInput(", ")
Description = Input()
string_4 = StringInput("\n;%TYPE=MODEL\n")
LineStrings = Input()
concat = String.Concat(string, string_2, Name, string_3, Description, string_4, LineStrings)
string_5 = Output(concat)  # "string"
