# Dynamo custom node FillPattern.PresetBrick.dyf (Dynamo 0.9.0.3067)
# category: Zebra.Revit
# Creates a the string needed for a standard custom brick pattern. Change the height and width of brick to toggle the size of the pattern. Feed the output string into a FillPattern.ModelPatFile or FillPattern.DraftingPatFile node.

number = DoubleSlider(0, range=0..360 step 1)
Height = Input()
linePatternCreation = Custom[FillPattern.LinePatternCreation](Angle=number, Origin_X=number, Origin_Y=number, X_Shift=number, Y_Shift=Height, Pen_Down=number, Pen_Up=number)  # Creates and visualises the line pattern used in fill patterns. Part of the method of creating a Fill Pattern (.pat) file using the Zebra package.
angle = DoubleSlider(90, range=0..360 step 1)
Width = Input(Width : var[]..[])
linePatternCreation_2 = Custom[FillPattern.LinePatternCreation](Angle=angle, Origin_X=number, Origin_Y=number, X_Shift=Height, Y_Shift=Width, Pen_Down=Height, Pen_Up=Height)
create = List.Create(linePatternCreation.LinePattern, linePatternCreation_2.LinePattern)
LinePattern = Output(create)
string = StringInput("\n")
join = String.Join(string, linePatternCreation.String, linePatternCreation_2.String)
String = Output(join)
