# Dynamo custom node FillPattern.PresetBrickMortar.dyf (Dynamo 0.9.0.3067)
# category: Zebra.Revit
# Creates a string needed for the a standard custom brick pattern with mortar. Change the height and width of the brick, as well as the mortar allowance to toggle the size of the pattern. Feed the output string into a FillPattern.ModelPatFile or FillPattern.DraftingPatFile node.

number = DoubleSlider(0, range=0..360 step 1)
Width = Input()
Mortar = Input()
code_block = CodeBlock(w=Width, m=Mortar) { (w/2)+(m/2); }
Height = Input()
code_block_2 = CodeBlock(h=Height, m=Mortar) { h+m; }
linePatternCreation = Custom[FillPattern.LinePatternCreation](Angle=number, Origin_X=number, Origin_Y=number, X_Shift=code_block, Y_Shift=code_block_2, Pen_Down=Width, Pen_Up=Mortar)  # Creates and visualises the line pattern used in fill patterns. Part of the method of creating a Fill Pattern (.pat) file using the Zebra package.
linePatternCreation_2 = Custom[FillPattern.LinePatternCreation](Angle=number, Origin_X=number, Origin_Y=Height, X_Shift=code_block, Y_Shift=code_block_2, Pen_Down=Width, Pen_Up=Mortar)
number_2 = DoubleSlider(90, range=0..360 step 1)
code_block_3 = CodeBlock(h=Height, m=Mortar) { h+(m*2); }
linePatternCreation_3 = Custom[FillPattern.LinePatternCreation](Angle=number_2, Origin_X=number, Origin_Y=number, X_Shift=code_block_2, Y_Shift=code_block, Pen_Down=Height, Pen_Up=code_block_3)
linePatternCreation_4 = Custom[FillPattern.LinePatternCreation](Angle=number_2, Origin_X=Width, Origin_Y=number, X_Shift=code_block_2, Y_Shift=code_block, Pen_Down=Height, Pen_Up=code_block_3)
create = List.Create(linePatternCreation.LinePattern, linePatternCreation_2.LinePattern, linePatternCreation_3.LinePattern, linePatternCreation_4.LinePattern)
LinePattern = Output(create)
string = StringInput("\n")
join = String.Join(string, linePatternCreation.String, linePatternCreation_2.String, linePatternCreation_3.String, linePatternCreation_4.String)
String = Output(join)
