# Dynamo custom node FillPattern.PresetFlemishMortar.dyf (Dynamo 0.9.0.3067)
# category: Zebra.Revit
# Creates the string needed for a standard flemish bond pattern with mortar. Change the height and width of the brick, as well as the mortar allowance to toggle the size of the pattern. Feed the output string into a FillPattern.ModelPatFile or FillPattern.DraftingPatFile node.

number = DoubleSlider(0, range=0..360 step 1)
Width = Input()
Mortar = Input()
code_block = CodeBlock(w=Width, m=Mortar) { (w/2)+((w/2)/2)+m; }
Height = Input()
code_block_2 = CodeBlock(h=Height, m=Mortar) { h+m; }
code_block_3 = CodeBlock(w=Width, m=Mortar) { (w/2)+(m*2); }
linePatternCreation = Custom[FillPattern.LinePatternCreation](Angle=number, Origin_X=number, Origin_Y=number, X_Shift=code_block, Y_Shift=code_block_2, Pen_Down=Width, Pen_Up=code_block_3)  # Creates and visualises the line pattern used in fill patterns. Part of the method of creating a Fill Pattern (.pat) file using the Zebra package.
code_block_4 = CodeBlock(w=Width, m=Mortar) { w+m; }
code_block_5 = CodeBlock(w=Width) { w/2; }
code_block_6 = CodeBlock(w=Width, m=Mortar) { w+(m*2); }
linePatternCreation_2 = Custom[FillPattern.LinePatternCreation](Angle=number, Origin_X=code_block_4, Origin_Y=number, X_Shift=code_block, Y_Shift=code_block_2, Pen_Down=code_block_5, Pen_Up=code_block_6)
linePatternCreation_3 = Custom[FillPattern.LinePatternCreation](Angle=number, Origin_X=number, Origin_Y=Height, X_Shift=code_block, Y_Shift=code_block_2, Pen_Down=Width, Pen_Up=code_block_3)
linePatternCreation_4 = Custom[FillPattern.LinePatternCreation](Angle=number, Origin_X=code_block_4, Origin_Y=Height, X_Shift=code_block, Y_Shift=code_block_2, Pen_Down=code_block_5, Pen_Up=code_block_6)
number_2 = DoubleSlider(90, range=0..360 step 1)
code_block_7 = CodeBlock(h=Height, m=Mortar) { h+(m*2); }
linePatternCreation_5 = Custom[FillPattern.LinePatternCreation](Angle=number_2, Origin_X=number, Origin_Y=number, X_Shift=code_block_2, Y_Shift=code_block, Pen_Down=Height, Pen_Up=code_block_7)
linePatternCreation_6 = Custom[FillPattern.LinePatternCreation](Angle=number_2, Origin_X=Width, Origin_Y=number, X_Shift=code_block_2, Y_Shift=code_block, Pen_Down=Height, Pen_Up=code_block_7)
linePatternCreation_7 = Custom[FillPattern.LinePatternCreation](Angle=number_2, Origin_X=code_block_4, Origin_Y=number, X_Shift=code_block_2, Y_Shift=code_block, Pen_Down=Height, Pen_Up=code_block_7)
code_block_8 = CodeBlock(w=Width, m=Mortar) { (w+(w/2)+m); }
linePatternCreation_8 = Custom[FillPattern.LinePatternCreation](Angle=number_2, Origin_X=code_block_8, Origin_Y=number, X_Shift=code_block_2, Y_Shift=code_block, Pen_Down=Height, Pen_Up=code_block_7)
create = List.Create(linePatternCreation.LinePattern, linePatternCreation_2.LinePattern, linePatternCreation_3.LinePattern, linePatternCreation_4.LinePattern, linePatternCreation_5.LinePattern, linePatternCreation_6.LinePattern, linePatternCreation_7.LinePattern, linePatternCreation_8.LinePattern)
LinePattern = Output(create)
string = StringInput("\n")
join = String.Join(string, linePatternCreation.String, linePatternCreation_2.String, linePatternCreation_3.String, linePatternCreation_4.String, linePatternCreation_5.String, linePatternCreation_6.String, linePatternCreation_7.String, linePatternCreation_8.String)
String = Output(join)
