# Dynamo custom node FillPattern.PresetHerringbone.dyf (Dynamo 0.9.0.3067)
# category: Zebra.Revit
# Creates the string needed for a standard custom herringbone pattern. Change width to toggle the size of the pattern. Feed the output string into a FillPattern.ModelPatFile or FillPattern.DraftPatFile node.

angle = DoubleSlider(90, range=0..360 step 1)
X = DoubleSlider(0, range=0..500 step 1)  # "Origin.X"
Width = Input()
code_block = CodeBlock(w=Width) { w/2; }
code_block_2 = CodeBlock(w=Width, x=code_block) { w+x; }
linePatternCreation = Custom[FillPattern.LinePatternCreation](Angle=angle, Origin_X=X, Origin_Y=X, X_Shift=Width, Y_Shift=Width, Pen_Down=code_block_2, Pen_Up=code_block)  # Creates and visualises the line pattern used in fill patterns. Part of the method of creating a Fill Pattern (.pat) file using the Zebra package.
linePatternCreation_2 = Custom[FillPattern.LinePatternCreation](Angle=X, Origin_X=code_block_2, Origin_Y=X, X_Shift=code_block, Y_Shift=code_block, Pen_Down=code_block_2, Pen_Up=code_block)
linePatternCreation_3 = Custom[FillPattern.LinePatternCreation](Angle=angle, Origin_X=code_block, Origin_Y=code_block, X_Shift=Width, Y_Shift=Width, Pen_Down=code_block_2, Pen_Up=code_block)
create = List.Create(linePatternCreation.LinePattern, linePatternCreation_2.LinePattern, linePatternCreation_3.LinePattern)
LinePattern = Output(create)
string = StringInput("\n")
join = String.Join(string, linePatternCreation.String, linePatternCreation_2.String, linePatternCreation_3.String)
String = Output(join)
