# Dynamo custom node Rooms.SortByLevelAndParameter.dyf (Dynamo 1.0.0.1180)
# category: Zebra.Revit
# Feed in a list of rooms and sort them first by the elevation of the level they are placed and then by a parameter.
# As an example if you feed in a list of rooms and then choose a second parameter such as "Number" as a string.

rooms = Input()
code_block = CodeBlock { "Level"; }
getParameterValueByName = Element.GetParameterValueByName(parameterName=code_block)
groupByFunction = GroupByFunction(rooms, getParameterValueByName)
categories = Categories("Levels")
all_elements_of_category = ElementsOfCategory(categories)
elevation = Level.Elevation(all_elements_of_category)
firstItem = List.FirstItem()
map = List.Map(list=groupByFunction, f_x=firstItem)
code_block_2 = CodeBlock { "Level"; }
getParameterValueByName_2 = Element.GetParameterValueByName(element=map, parameterName=code_block_2)
count = List.Count(getParameterValueByName_2)
ofRepeatedItem = List.OfRepeatedItem(item=elevation, amount=count)
name = Level.Name(all_elements_of_category)
eq = getParameterValueByName_2 == name  # lacing=CrossProduct
filterByBoolMask = List.FilterByBoolMask(list=ofRepeatedItem, mask=eq)
flatten = Flatten(filterByBoolMask.in)
sort = List.Sort(flatten)
indexOf = IndexOf(flatten)
map_2 = List.Map(list=sort, f_x=indexOf)
getItemAtIndex = List.GetItemAtIndex(list=groupByFunction, index=map_2)
parameter = Input()
getParameterValueByName_3 = Element.GetParameterValueByName(parameterName=parameter)
sortByFunction = SortByFunction(arg1=getParameterValueByName_3)
map_3 = List.Map(list=getItemAtIndex, f_x=sortByFunction)
SortedRooms = Output(map_3)
code_block_3 = CodeBlock { "Level"; }
getParameterValueByName_4 = Element.GetParameterValueByName(parameterName=code_block_3)
map_4 = List.Map(list=map_3, f_x=getParameterValueByName_4)
SortedLevels = Output(map_4)
getParameterValueByName_5 = Element.GetParameterValueByName(parameterName=parameter)
map_5 = List.Map(list=map_3, f_x=getParameterValueByName_5)
SortedParameter = Output(map_5)
