# Dynamo custom node String.AsciiCharactersAsList.dyf (Dynamo 0.8.0.950)
# category: Zebra.Core.String.Create
# Creates the ASCII printable characters excluding letters and digits as a list of strings

string = StringInput(" !\"#$%&'()*+,-./:;<=>?@{\\}^_`{|}~")
length = String.Length(string)
code_block = CodeBlock(n=length) { 0..(n-1); 1; }
substring = String.Substring(str=string, startIndex=code_block.out0, length=code_block.out1)
ASCII = Output(substring)
