# Dynamo custom node String.AsciiDescription.dyf (Dynamo 0.8.0.950)
# category: Zebra.Core.String.Create
# Creates the ASCII description as string

des = CodeBlock()
# ---------- des.designscript (23 lines) ----------
{"Null char","Start of Heading","Start of Text","End of Text","End of Transmission",
"Enquiry","Acknowledgment","Bell","Back Space","Horizontal Tab","Line Feed","Vertical Tab",
"Form Feed","Carriage Return","Shift Out / X-On","Shift In / X-Off","Data Line Escape",
"Device Control 1 (oft. XON)","Device Control 2","Device Control 3 (oft. XOFF)",
"Device Control 4","Negative Acknowledgement","Synchronous Idle","End of Transmit Block",
"Cancel","End of Medium","Substitute","Escape","File Separator","Group Separator",
"Record Separator","Unit Separator","Space","Exclamation mark","Double quotes (or speech marks)",
"Number","Dollar","Procenttecken","Ampersand","Single quote","Open parenthesis (or open bracket)",
"Close parenthesis (or close bracket)","Asterisk","Plus","Comma","Hyphen","Period, dot or full stop",
"Slash or divide","Zero","One","Two","Three","Four","Five","Six","Seven","Eight",
"Nine","Colon","Semicolon","Less than (or open angled bracket)","Equals","Greater than (or close angled bracket)",
"Question mark","At symbol","Uppercase A","Uppercase B","Uppercase C","Uppercase D",
"Uppercase E","Uppercase F","Uppercase G","Uppercase H","Uppercase I","Uppercase J",
"Uppercase K","Uppercase L","Uppercase M","Uppercase N","Uppercase O","Uppercase P",
"Uppercase Q","Uppercase R","Uppercase S","Uppercase T","Uppercase U","Uppercase V",
"Uppercase W","Uppercase X","Uppercase Y","Uppercase Z","Opening bracket","Backslash",
"Closing bracket","Caret - circumflex","Underscore","Grave accent","Lowercase a",
"Lowercase b","Lowercase c","Lowercase d","Lowercase e","Lowercase f","Lowercase g",
"Lowercase h","Lowercase i","Lowercase j","Lowercase k","Lowercase l","Lowercase m",
"Lowercase n","Lowercase o","Lowercase p","Lowercase q","Lowercase r","Lowercase s",
"Lowercase t","Lowercase u","Lowercase v","Lowercase w","Lowercase x","Lowercase y",
"Lowercase z","Opening brace","Vertical bar","Closing brace","Equivalency sign - tilde",
"Delete"};
# ----------------------------------------
Des = Output(des)
