# Dynamo custom node String.AsciiSymbol.dyf (Dynamo 0.8.0.950)
# category: Zebra.Core.String.Create
# Creates the ASCII symbols as string

string = StringInput(";")
code_block = CodeBlock()
# ---------- code_block.designscript (4 lines) ----------
{"NUL","SOH","STX","ETX","EOT","ENQ","ACK","BEL","BS","HT","LF","VT","FF",
"CR","SO","SI","DLE","DC1","DC2","DC3","DC4","NAK","SYN","ETB","CAN","EM",
"SUB","ESC","FS","GS","RS","US"," ","!","\"","#","$","%","&","'","(",")",
"*","+",",","-",".","/","0","1","2","3","4","5","6","7","8","9",":"};
# ----------------------------------------
addItemToEnd = List.AddItemToEnd(string, code_block)
code_block_2 = CodeBlock()
# ---------- code_block_2.designscript (2 lines) ----------
{"<","=",">","?","@","A","B","C","D","E","F","G","H","I","J","K","L","M","N",
"O","P","Q","R","S","T","U","V","W","X","Y","Z","[","\"};
# ----------------------------------------
code_block_3 = CodeBlock()
# ---------- code_block_3.designscript (2 lines) ----------
{"]","^","_","`","a","b","c","d","e","f","g","h","i","j","k","l","m","n","o","p",
"q","r","s","t","u","v","w","x","y","z","{","|","}","~",""};
# ----------------------------------------
join = List.Join(addItemToEnd, code_block_2, code_block_3)
Sym = Output(join)
