# Dynamo custom node String.ChangeCharacterAtIndexToLower.dyf (Dynamo 0.8.1.1823)
# category: Zebra.Core.String.Action
# Changes the character/s at the given index/s to lower

String = Input()
length = String.Length(String)
Index = Input()
code_block = CodeBlock(str=String, ind=Index)
# ---------- code_block.designscript (9 lines) ----------
//Create List from string
sta = 0..(String.Length(str)-1);
sub = String.Substring(str,sta,1);

//Get String characters at index
lst = List.GetItemAtIndex(sub,ind);

//Convert characters to lower
String.ToLower(lst);
# ----------------------------------------
replaceItemAtIndex = List.ReplaceItemAtIndex(list=code_block.sub)
cartesianProduct = List.CartesianProduct(replaceItemAtIndex, Index, code_block.out3)
code_block_2 = CodeBlock(cart=cartesianProduct, x=Index) { lst = List.Flatten(cart,1); n = List.Count(x) +1; List.Count(x); List.Transpose(List.TakeEveryNthItem(lst,n,1)); }
identity = Object.Identity()
groupByKey = GroupByKey(arg1=identity)
map = List.Map(list=code_block_2.out3, f_x=groupByKey)
count = List.Count()
map_2 = List.Map(f_x=count)
map_3 = List.Map(list=map, f_x=map_2)
code_block_3 = CodeBlock { 1; }
eq = map_3 == code_block_3
eq_2 = map_3 == code_block_2.out2
or_ = eq || eq_2
filterByBoolMask = List.FilterByBoolMask(list=map, mask=or_)
code_block_4 = CodeBlock { 0; }
getItemAtIndex = List.GetItemAtIndex(index=code_block_4)
map_4 = List.Map(f_x=getItemAtIndex)
map_5 = List.Map(list=filterByBoolMask.in, f_x=map_4)
flatten = Flatten(map_5)
concat = String.Concat(flatten)
string_from_array = FromArray(concat)
code_block_5 = CodeBlock(str=string_from_array)
# ---------- code_block_5.designscript (4 lines) ----------
str1 = String.Remove(str,0,1);
str2 = String.Remove(str1,(String.Length(str1)-1),1);
String.Replace(str2,",","
");
# ----------------------------------------
length_2 = String.Length(code_block_5.out2)
eq_3 = length == length_2
code_block_6 = CodeBlock(x=Index) { y = List.Cycle(1,(List.Count(x))); x+y; }
removeCharacterAtIndices = Custom[String.RemoveCharactersAtIndices](String=code_block_5.out2, Indices=code_block_6.out1)  # "String.RemoveCharacterAtIndices"; Removes the characters from the string at the given indices
if_ = Custom[Logic.If](test=eq_3, ifTrue=code_block_5.out2, ifFalse=removeCharacterAtIndices)  # Retains the old status of the previous built-in IF node.
String_2 = Output(if_)  # "String"
