# Dynamo custom node String.Randomise.dyf (Dynamo 0.9.0.3067)
# category: Zebra.Core.String.Create
# Returns a random selection of letters, numbers and characters

alphabetAsList = Custom[String.AlphabetAsList]()  # Creates the alphabet as a list of strings
numbersAsList = Custom[String.NumbersAsList]()  # Creates the numbers 0-9 as a list of strings
asciiCharactersAsList = Custom[String.AsciiCharactersAsList]()  # Creates the ASCII printable characters excluding letters and digits as a list of strings
create = List.Create(alphabetAsList.LowerString, alphabetAsList.UpperString, numbersAsList, asciiCharactersAsList)
LettersLower = Input(LettersLower : bool = true)
LettersUpper = Input(LettersUpper : bool = true)
Numbers = Input(Numbers : bool = true)
Characters = Input(Characters : bool = true)
create_2 = List.Create(LettersLower, LettersUpper, Numbers, Characters)
flatten = Flatten(create_2)
filterByBoolMask = List.FilterByBoolMask(list=create, mask=flatten)
NumberOfCharacters = Input()
cycle = List.Cycle(list=filterByBoolMask.in, amount=NumberOfCharacters)
flatten_2 = Flatten(cycle)
shuffle = List.Shuffle(flatten_2)
count = List.Count(shuffle)
code_block = CodeBlock(count=count) { 0..(count-1); }
shuffle_2 = List.Shuffle(code_block)
code_block_2 = CodeBlock(item=NumberOfCharacters) { Flatten({item}); }
python_script = Python(IN[0]=shuffle_2, IN[1]=code_block_2)
# ---------- python_script.python (15 lines) ----------
import clr

inputlist = IN[0]
listlengths = IN[1]
rowcounter = 0
elementlist = list()
for item in listlengths:
	itemcounter = 0
	itemlist = list()
	while itemcounter < item:
		itemlist.append(inputlist[rowcounter])
		rowcounter += 1
		itemcounter += 1
	elementlist.append(itemlist)
OUT = elementlist
# ----------------------------------------
code_block_3 = CodeBlock(x=shuffle, chop=python_script) { x[chop]; }
python_script_2 = Python(IN[0]=code_block_3, IN[1]=code_block_2)  # same code as python_script
concat = String.Concat(python_script_2)
flatten_3 = Flatten(concat)
string_from_array = FromArray(flatten_3)
code_block_4 = CodeBlock { 0; 1; }
remove = String.Remove(str=string_from_array, startIndex=code_block_4.out0, count=code_block_4.out1)
length = String.Length(remove)
code_block_5 = CodeBlock(x=length) { x-1; 1; }
remove_2 = String.Remove(str=remove, startIndex=code_block_5.out0, count=code_block_5.out1)
code_block_6 = CodeBlock()
# ---------- code_block_6.designscript (3 lines) ----------
",";
"
";
# ----------------------------------------
replace = String.Replace(str=remove_2, searchFor=code_block_6.out0, replaceWith=code_block_6.out1)
String = Output(replace)
