# Dynamo custom node String.RemoveCharactersBetweenInputs.dyf (Dynamo 0.9.0.3067)
# category: Zebra.Core.String.Action
# Removes the part of the string between the two inputs

String = Input()
code_block = CodeBlock { 0; }
Characters1 = Input()
ignoreCase = Input(ignoreCase : bool = true)
indexOf = String.IndexOf(string=String, searchFor=Characters1, ignoreCase=ignoreCase)
length = String.Length(Characters1)
code_block_2 = CodeBlock(x=indexOf, len=length) { x+len; }
remove = String.Remove(str=String, startIndex=code_block, count=code_block_2)
Characters2 = Input()
indexOf_2 = String.IndexOf(string=remove, searchFor=Characters2, ignoreCase=ignoreCase)
length_2 = String.Length(remove)
code_block_3 = CodeBlock(x=length_2, len=indexOf_2) { x-len; }
remove_2 = String.Remove(str=remove, startIndex=indexOf_2, count=code_block_3)
code_block_4 = CodeBlock { ""; }
replace = String.Replace(str=String, searchFor=remove_2, replaceWith=code_block_4)
String_2 = Output(replace)  # "String"
