# Dynamo custom node String.ReturnCharacterAtIndex.dyf (Dynamo 0.8.0.950)
# category: Zebra.Core.String.Action
# Returns the character in the given string at the specified index(s)

String = Input()
Index = Input()
code_block = CodeBlock(str=String, x=Index) { str[x]; }
Characters = Output(code_block)
