# Dynamo custom node [&] List.ContainsList.dyf (Dynamo 2.10.1.3976)
# category: Ampersand
# Check if a 2-dimensional list contains a 1-dimensional list.

# note: Colin McCrone
# Twitter:  @ColinMcCrone
# LinkedIn: https://www.linkedin.com/in/colinmccrone
# Updated:  2021-05-26
# An example Dynamo script for how to use this node can be found in the 'extra' folder where the package files are stored. To find it, go to the Packages Menu and select "Manage Packages." Where Ampersand is listed, open the drop-down menu link at the right and choose "Show Root Directory." Open the "extra" folder to find the example file called AmpersandExamples.dyn.
masterList = Input(masterList: var[][])
searchFor = Input(searchFor: var[])
python_script = Python(IN[0]=masterList, IN[1]=searchFor)  # CPython3
# ---------- python_script.python (34 lines) ----------
# Check whether a list of lists contains a list
#
# Colin McCrone
# Twitter:  https://twitter.com/colinmccrone
# LinkedIn: https://www.linkedin.com/in/colinmccrone
# Updated:  2016-11-11

import clr

def ListMatch(ls1, ls2):
	len1 = len(ls1)
	len2 = len(ls2)
	if len1 != len2:
		return False
		
	for i in range(len1):
		if ls1[i] != ls2[i]:
			return False
	
	return True


# Inputs
masterList = IN[0]
searchList = IN[1]

answer = False

for i in range(len(masterList)):
	if ListMatch(masterList[i], searchList):
		answer = True
		break

OUT = answer
# ----------------------------------------
bool = Output(python_script)
