# Dynamo custom node [&] List.GroupByKey.dyf (Dynamo 2.10.1.3976)
# category: Ampersand
# Sort the items of a list into groups (sublists) based on the corresponding items of a reference list.  Example: The list {A,B,C,D,E} with the reference list {1,anyWord,4,anyWord,1} will be grouped into lists as { {A,E}, {B,D}, {C} } and the unique references will be {1, anyWord, 4}.

# note: Colin McCrone
# Twitter:  @ColinMcCrone
# LinkedIn: https://www.linkedin.com/in/colinmccrone
# Updated:  2021-05-26
# An example Dynamo script for how to use this node can be found in the 'extra' folder where the package files are stored. To find it, go to the Packages Menu and select "Manage Packages." Where Ampersand is listed, open the drop-down menu link at the right and choose "Show Root Directory." Open the "extra" folder to find the example file called AmpersandExamples.dyn.
objectList = Input(objectList: var[]..[])
keys = Input(keys: var[])
sortKeys = Input(sortKeys: bool = true)
python_script = Python(IN[0]=objectList, IN[1]=keys, IN[2]=sortKeys)  # CPython3
# ---------- python_script.python (45 lines) ----------
# Sort data into bins according to a matching a set of criteria
#
# Colin McCrone
# Twitter:  https://twitter.com/colinmccrone
# LinkedIn: https://www.linkedin.com/in/colinmccrone
# Updated:  2019-05-20
#
import clr

# Get input
data = IN[0]		# Data (list of same length as criteria) to be binned
criteria = IN[1]	# List of criteria related to the data
toSort = IN[2]		# Whether to sort keys

# Find a unique set of values for the criteria, a list of all the bins
# to sort data into
bins = []
bins.append(criteria[0])
sorted = []
sorted.append([])

for i in range(1,len(criteria)):
	if criteria[i] in bins:
		continue
	else:
		bins.append(criteria[i])
		sorted.append([]) # initialize an empty list

# Sort bins if requested
if toSort:
	bins.sort()

# Sort data into bins
for i in range(len(criteria)):
	for j in range(len(bins)):
		if criteria[i] == bins[j]:
			temp = sorted[j]
			temp.append(data[i])
			sorted[j] = temp
			continue

# Assign your output to the OUT variable
OUT = []
OUT.append(sorted)
OUT.append(bins)
# ----------------------------------------
code_block = CodeBlock(OUT=python_script) { OUT[0]; OUT[1]; }
groups = Output(code_block.out0)
unique_keys = Output(code_block.out1)
