# Dynamo custom node [&] List.PickByKeyUnique.dyf (Dynamo 2.10.1.3976)
# category: Ampersand
# Pick items from a list using a set of keys values.  Items and their key values will either be picked or excluded, and they can only be picked once.  Pick keys that do not match any of the list key values will be listed as keysNotMatched.

# note: Colin McCrone
# Twitter:  @ColinMcCrone
# LinkedIn: https://www.linkedin.com/in/colinmccrone
# Updated:  2021-05-26
# An example Dynamo script for how to use this node can be found in the 'extra' folder where the package files are stored. To find it, go to the Packages Menu and select "Manage Packages." Where Ampersand is listed, open the drop-down menu link at the right and choose "Show Root Directory." Open the "extra" folder to find the example file called AmpersandExamples.dyn.
list = Input(list: var[]..[])
keys = Input(keys: var[])
pickKeys = Input(pickKeys: var[])
python_script = Python(IN[0]=list, IN[1]=keys, IN[2]=pickKeys)  # CPython3
# ---------- python_script.python (69 lines) ----------
# Pick items from a list whose keys are included in a given set of choose values.  Each item will only appear once in either the selected or not selected list.  Keys and values do not need to be unique.  Output includes the list items selected and their corresponding keys, the items not selected and their corresponding keys, and a list of the choose values that did not match any of the keys. Items selected and not selected are given in the order in which they appeared in the original list.
#
# Example input:
#    list			= {A,B,C,D,E}
#    keys			= {4,5,6,7,8}
#    values			= {5,8,9}
#
# Example output:
#    itemsTaken		= {B,E}
#	 keysTaken		= {5,8}
#    itemsDropped	= {A,C,D}
#    keysDropped    = {4,6,7}
#    noKeyMatch		= {9}
#
# Colin McCrone
# Twitter:  https://twitter.com/colinmccrone
# LinkedIn: https://www.linkedin.com/in/colinmccrone
# Updated:  2019-05-20
#
import clr

# Input
data = IN[0]
keys = IN[1]
vals = IN[2]

# Output
itemsTaken = []
itemsDropped = []
keysTaken = []
keysDropped = []
noKeyMatch = []

# Check whether each value matches a key
valInKeys = []
for val in vals:
	hasMatch = False
	for key in keys:
		if val == key:
			valInKeys.append(True)
			hasMatch = True
			break
	if not hasMatch:
		valInKeys.append(False)
		noKeyMatch.append(val)

# Sort each data and key into taken and dropped groups
for i in range(len(data)):
	isTaken = False
	for j in range(len(vals)):
		# Move on if the value does not have a key match
		if not valInKeys[j]:
			continue	
		# For a key/value match
		if keys[i] == vals[j]:
			itemsTaken.append(data[i])
			keysTaken.append(keys[i])
			isTaken = True
			break
	if not isTaken:
		itemsDropped.append(data[i])
		keysDropped.append(keys[i])

OUT = []
OUT.append(itemsTaken)
OUT.append(keysTaken)
OUT.append(itemsDropped)
OUT.append(keysDropped)
OUT.append(noKeyMatch)
# ----------------------------------------
code_block = CodeBlock(OUT=python_script) { itemsSelected = OUT[0]; keysSelected = OUT[1]; itemsDropped = OUT[2]; keysDropped = OUT[3]; valuesNotMatched = OUT[4]; }
itemsPicked = Output(code_block.itemsSelected)
keysPicked = Output(code_block.keysSelected)
itemsExcluded = Output(code_block.itemsDropped)
keysExcluded = Output(code_block.keysDropped)
keysNotMatched = Output(code_block.valuesNotMatched)
