# Dynamo custom node [&] PolySurface.Split.dyf (Dynamo 2.10.1.3976)
# category: Ampersand.[&] Surface
# Split a polysurface and return organized polysurfaces.

# note: Colin McCrone
# Twitter:  @ColinMcCrone
# LinkedIn: https://www.linkedin.com/in/colinmccrone
# Updated:  2021-05-26
# An example Dynamo script for how to use this node can be found in the 'extra' folder where the package files are stored. To find it, go to the Packages Menu and select "Manage Packages." Where Ampersand is listed, open the drop-down menu link at the right and choose "Show Root Directory." Open the "extra" folder to find the example file called AmpersandExamples.dyn.
polySurface = Input(polySurface: var)
# note: Split a polysurface into organized polysurfaces.
# The out-of-the-box Geometry.Split function when used with a polysurface does not organize the results after a split operation into polysurfaces.  This node explodes a polysurface into its constituent pieces, performs a split operation on each, then uses a depth-first-search algorithm to stitch together the results into sensible groups.
surfaces = PolySurface.Surfaces(polySurface=polySurface)
tool = Input(tool: var)
split = Geometry.Split(geometry=surfaces, other=tool)
flatten = List.Flatten(list=split)
python_script = Python(IN[0]=flatten, IN[1]=tool)  # CPython3
# ---------- python_script.python (135 lines) ----------
#
# Colin McCrone
# Twitter:  https://twitter.com/colinmccrone
# LinkedIn: https://www.linkedin.com/in/colinmccrone
# Updated:  2016-05-13
#
#
import clr
clr.AddReference('ProtoGeometry')
from Autodesk.DesignScript.Geometry import *

# Determine whether an object is a curve of any sort
def IsCurve(obj):
	if ("Line" in str(type(obj))):
		return True
	elif ("Curve" in str(type(obj))):
		return True
	elif ("Arc" in str(type(obj))):
		return True
	elif ("Ellipse" in str(type(obj))):
		return True
	elif ("Circle" in str(type(obj))):
		return True
	elif ("Polygon" in str(type(obj))):
		return True
	else:
		return False

# Determine whether an object is a point
def IsPoint(obj):
	if ("Point" in str(type(obj))):
		return True
	else:
		return False

# Find whether two surfaces touch each other in places other than coincident with the tool and therefore belong in the same group after the split operation by the tool
def BelongsWith(s1, s2, tool):
	iSrfSrf = Geometry.Intersect(s1, s2)
	
	# Assume surfaces do not belong together
	answer = False
	
	for i in range(len(iSrfSrf)):
		# If the surfaces share only a point, they belong together if that point does not also touch the tool
		if IsPoint(iSrfSrf[i]):
			if (Geometry.DoesIntersect(iSrfSrf[i], tool)):
				continue
			else:
				answer = True
				break
		
		# If the surfaces share a curve, they belong together if that curve does not touch the tool by more than a point
		if IsCurve(iSrfSrf[i]):
			iIntTool = Geometry.Intersect(iSrfSrf[i], tool)
			
			# Change default answer to true
			if not iIntTool:
				answer = True
				break
			else:
				answer = True
			
			for j in range(len(iIntTool)):
				if IsCurve(iIntTool[j]):
					answer = False
					return answer
				else:
					continue
	
	return answer



# Sort a series of surfaces into groups divided by a splitting tool.
srfs = IN[0]		# surfaces after split operation
tool = IN[1]		# the splitting tool
srfGroups = []

# Build an adjacency matrix
adj = [[False]*len(srfs) for srf in srfs]
for i in range(len(srfs)):
	for j in range(i+1, len(srfs)):
		if (BelongsWith(srfs[i], srfs[j], tool)):
			adj[i][j] = True
			adj[j][i] = True		

# Depth-first search: find all surfaces connected to the first available unconnected surface until no paths remain unexplored. Mark 
connected = [False]*len(srfs)
exhausted = [False]*len(srfs)
numFound = 0
counter = 0

# Loop finds one full connected set of surfaces per iteration
while(numFound < len(srfs)):
	numConnected = 0				# in this group
	numExhausted = 0				# in this group
	foundOrder = []					# trail of breadcrumbs (not incl loc)
	group = []						# group of connected surfaces
	loc = 0							# location of current search
	
	# Find first available root node
	for i in range(len(srfs)):
		if (not connected[i]):
			connected[i] = True
			loc = i
			numFound += 1			# found ever
			numConnected = 1		# part of this group
			group.append(srfs[i])
			break
	
	# Find all nodes connected to root node in the network
	while (numExhausted < numConnected and numFound < len(srfs)):
		for k in range(len(srfs)):
			# If found a new connection, make the jump to new loc
			if (adj[loc][k]) and (not connected[k]):
				foundOrder.append(loc)
				numFound += 1
				connected[k] = True
				numConnected += 1
				loc = k
				group.append(srfs[k])
				break
			
			# If no new connections, mark location as exhausted and jump backward
			if (k == (len(srfs)-1)):
				exhausted[loc] = True
				numExhausted += 1
				if (foundOrder):
					loc = foundOrder.pop()
				break

	srfGroups.append(group)

# Output
OUT = srfGroups
# ----------------------------------------
byJoinedSurfaces = PolySurface.ByJoinedSurfaces(surfaces=python_script)
PolySurfaces = Output(byJoinedSurfaces)
