# Dynamo custom node SelectModelElements Data.dyf (Dynamo 3.3.0.6316)
# category: Data-Shapes.UI.Selection
# Creates a Revit element selection input for UI.MultipleInputForm++ . Check out www.data-shapes.net for more infos!

InputName = Input(InputName_: string = "")
ButtonText = Input(ButtonText_: string = "Select Model Element(s)")
CategoryFilter = Input(CategoryFilter_: var[] = "")
SelectSingleElement = Input(SelectSingleElement_: bool = false)
python_script = Python(IN[0]=InputName, IN[1]=ButtonText, IN[2]=CategoryFilter, IN[3]=SelectSingleElement)  # CPython3
# ---------- python_script.python (151 lines) ----------
# Copyright (c) Data Shapes, 2025
# Data-Shapes www.data-shapes.io, elayoubi.mostafa@data-shapes.io @data_shapes

import clr
import System
clr.AddReference('RevitAPIUI')
from Autodesk.Revit.UI import Selection, TaskDialog
from Autodesk.Revit.UI.Selection import ISelectionFilter
clr.AddReference('RevitAPI')
try:
    from Autodesk.Revit.DB import ImageImportOptions
except:
    from Autodesk.Revit.DB import ImageTypeOptions, ImageType, ImagePlacementOptions, ImageInstance
from Autodesk.Revit.DB import FilteredElementCollector, Transaction, View, ViewType, ViewFamily, ViewDrafting, ViewFamilyType, Element, ElementId, FamilyInstance, Document, XYZ, BoxPlacement, UnitUtils

try:
    from Autodesk.Revit.DB import UnitType
except:
    from Autodesk.Revit.DB import SpecTypeId

clr.AddReference('RevitServices')
from RevitServices.Persistence import DocumentManager
doc = DocumentManager.Instance.CurrentDBDocument
uidoc = DocumentManager.Instance.CurrentUIApplication.ActiveUIDocument


class CategorySelectionFilter(object):
    def __new__(cls, *args, **kwargs):
        cls.args = args
        cls.__namespace__ = "CategorySelectionFilter_" + str(System.Guid.NewGuid()).replace('-', '_')
        try:
            module_type = __import__(cls.__namespace__)
            return module_type._CategorySelectionFilter(*cls.args)
        except ImportError:
            class _CategorySelectionFilter(ISelectionFilter):
                __namespace__ = cls.__namespace__
                def __init__(self, *a, **k):
                    super().__init__()
                def AllowElement(self, element):
                    try:
                        cat = element.Category
                        return (cat is not None) and (cat.Name in _filter_cat_names)
                    except:
                        return False
                def AllowReference(self, reference, point):
                    return False
            return _CategorySelectionFilter(*cls.args)


class uiselectelements():

    def __init__(self, inputname, buttontext, multi):
        self.inputname = inputname
        self.buttontext = buttontext
        self.multi = multi
        self._input_type = 'uiselectelements'

    def __repr__(self):
        return 'UI.SelectElements input'

    def pickobjects(self, sender, event):
        try:
            sel = uidoc.Selection.PickObjects(Selection.ObjectType.Element, '')
            selelem = [doc.GetElement(s.ElementId) for s in sel]
            sender.Tag = selelem
        except:
            pass

    def pickobject(self, sender, event):
        try:
            sel = uidoc.Selection.PickObject(Selection.ObjectType.Element, '')
            selelem = doc.GetElement(sel.ElementId)
            sender.Tag = selelem
        except:
            pass


class uiselectelementsofcat():

    def __init__(self, inputname, buttontext, category, multi):
        self.inputname = inputname
        self.buttontext = buttontext
        self.category = category
        if isinstance(category, list):
            self._raw_category = category
        else:
            self._raw_category = [category]
        self.multi = multi
        self._input_type = 'uiselectelementsofcat'

    def __repr__(self):
        return 'UI.SelectElementsOfCategory input'

    def _get_unwrapped_categories(self):
        unwrapped = []
        for c in self._raw_category:
            if hasattr(c, 'InternalElement'):
                unwrapped.append(c.InternalElement)
            elif hasattr(c, 'Id'):
                unwrapped.append(c)
            else:
                unwrapped.append(c)
        return unwrapped

    def pickobjectsofcat(self, sender, event):
        global _filter_cat_names
        try:
            category = self._get_unwrapped_categories()
            _filter_cat_names = [c.Name for c in category]
            selfilt = CategorySelectionFilter()
            sel = uidoc.Selection.PickObjects(Selection.ObjectType.Element, selfilt, 'Select %s' % (', '.join(_filter_cat_names)))
            selelem = [doc.GetElement(s.ElementId) for s in sel]
            sender.Tag = selelem
        except:
            pass

    def pickobjectofcat(self, sender, event):
        global _filter_cat_names
        try:
            category = self._get_unwrapped_categories()
            _filter_cat_names = [c.Name for c in category]
            selfilt = CategorySelectionFilter()
            sel = uidoc.Selection.PickObject(Selection.ObjectType.Element, selfilt, 'Select %s' % (', '.join(_filter_cat_names)))
            selelem = doc.GetElement(sel.ElementId)
            sender.Tag = selelem
        except:
            pass


inputname = IN[0] if len(IN) > 0 else ""
buttontext = IN[1] if len(IN) > 1 else "Select Model Element(s)"
category = IN[2] if len(IN) > 2 else ""
multi = not IN[3] if len(IN) > 3 else True

if category == [""] or category == "" or category == []:
    x = uiselectelements(inputname, buttontext, multi)
else:
    if isinstance(category, list):
        catnames = ', '.join([UnwrapElement(i).Name for i in category])
        if buttontext == "Select Model Element(s)":
            buttontext = 'Select %s' % catnames
    else:
        if buttontext == "Select Model Element(s)":
            try:
                buttontext = 'Select %s' % UnwrapElement(category).Name
            except:
                pass
    
    x = uiselectelementsofcat(inputname, buttontext, category, multi)

OUT = x
# ----------------------------------------
SelectModelElements_input = Output(python_script)
