# Dynamo custom node All Elements of Family.dyf (Dynamo 2.16.2.5624)
# category: GeniusLoci.Family
# Get the family instances of the given loadable family.

family = Input(family: var[]..[])
python_script = Python(IN[0]=family)  # IronPython2
# ---------- python_script.python (16 lines) ----------
#Alban de Chasteigner 2020
#twitter : @geniusloci_bim
#geniusloci.bim@gmail.com
#https://github.com/albandechasteigner/GeniusLociForDynamo

import clr
clr.AddReference('RevitAPI')
import Autodesk
from Autodesk.Revit.DB import FilteredElementCollector, ElementId, BuiltInCategory

families = UnwrapElement(IN[0]) if isinstance(IN[0],list) else [UnwrapElement(IN[0])]

instances=[FilteredElementCollector(fam.Document).OfCategoryId(fam.FamilyCategoryId).WhereElementIsNotElementType().ToElements().FindAll(lambda x : hasattr(fam.Document.GetElement(x.GetTypeId()), "Family") and fam.Document.GetElement(x.GetTypeId()).Family.Id == fam.Id) if fam.FamilyCategoryId != ElementId(BuiltInCategory.OST_DetailComponents) and fam.FamilyCategoryId != ElementId(BuiltInCategory.OST_StructuralFoundation) and fam.FamilyCategoryId != ElementId(BuiltInCategory.OST_BoundaryConditions) and fam.FamilyCategoryId != ElementId(BuiltInCategory.OST_Walls) and fam.FamilyCategoryId != ElementId(BuiltInCategory.OST_Floors) else None for fam in families]

if isinstance(IN[0], list): OUT = instances
else: OUT = instances[0]
# ----------------------------------------
Elements = Output(python_script)
