# Dynamo custom node Documents Properties.dyf (Dynamo 2.16.2.5624)
# category: GeniusLoci.Document
# Queries the document properties.
# Works also with familyDocument

docOrRevitLinkInstance = Input(docOrRevitLinkInstance: var[]..[] = null)  # Autodesk.Revit.DB.Document or RevitLinkInstance
python_script = Python(IN[0]=docOrRevitLinkInstance)  # IronPython2
# ---------- python_script.python (57 lines) ----------
#Alban de Chasteigner 2020
#twitter : @geniusloci_bim
#geniusloci.bim@gmail.com
#https://github.com/albandechasteigner/GeniusLociForDynamo

import clr
clr.AddReference('RevitAPI')
from Autodesk.Revit.DB import *
clr.AddReference('RevitServices')
import RevitServices
from RevitServices.Persistence import DocumentManager

import sys
sys.path.append(r"C:\Program Files (x86)\IronPython 2.7\Lib")
import System.IO
from System.IO import Path, SearchOption 

docs=UnwrapElement(IN[0]) if isinstance(IN[0],list) else [UnwrapElement(IN[0])]

titles,paths,linked,workshared,central,fams,version,number,sizes = [],[],[],[],[],[],[],[],[]

for d in docs:
	if d==None:
		doc=DocumentManager.Instance.CurrentDBDocument
	elif isinstance(d,RevitLinkInstance):
		doc=d.GetLinkDocument()
	else:
		doc=d
	titles.append(doc.Title)
	fams.append(doc.IsFamilyDocument)
	linked.append(doc.IsLinked)
	workshared.append(doc.IsWorkshared)
	if doc.IsWorkshared:
		cPath = doc.GetWorksharingCentralModelPath()
		central.append(ModelPathUtils.ConvertModelPathToUserVisiblePath(cPath))
	else:
		central.append("")
	version.append(doc.Application.VersionNumber)
	number.append(Document.GetDocumentVersion(doc).NumberOfSaves)
	if not doc.IsModelInCloud :
		localPath = doc.PathName
		paths.append(localPath)
		if localPath :
			try :sizes.append(str(round(System.IO.FileInfo(localPath).Length  / 1024) /1000) + " MB") #str(round(os.path.getsize(localPath)/1000000.0,2))+ " MB"
			except:sizes.append("")
		else : sizes.append("")
	elif doc.IsModelInCloud :
		modelPath = doc.GetCloudModelPath()
		guid = modelPath.GetModelGUID().ToString()
		location = "C:\\Users\\" + System.Environment.UserName + "\\AppData\\Local\\Autodesk\\Revit\\Autodesk Revit " + doc.Application.VersionNumber + "\\CollaborationCache"
		cashedFile = System.IO.Directory.GetFiles(location, str(guid) +'.rvt', SearchOption.AllDirectories)
		cloudLocalPath = next((Path.GetFullPath(file) for file in cashedFile), None)
		paths.append(cloudLocalPath)
		sizes.append(str(round(System.IO.FileInfo(cloudLocalPath).Length / 1024) /1000) + " MB")

if isinstance(IN[0], list): OUT = titles,paths,fams,linked,workshared,central,version,number,sizes
else: OUT = titles[0],paths[0],fams[0],linked[0],workshared[0],central[0],version[0],number[0],sizes[0]
# ----------------------------------------
code_block = CodeBlock(x=python_script) { x[0]; x[1]; x[2]; x[3]; x[4]; x[5]; x[6]; x[7]; x[8]; }
FileName = Output(code_block.out0)
FilePath = Output(code_block.out1)
IsFamilyDocument = Output(code_block.out2)
IsLinked = Output(code_block.out3)
IsWorkshared = Output(code_block.out4)
CentralPath = Output(code_block.out5)  # If any
RevitVersion = Output(code_block.out6)
NumberOfSaves = Output(code_block.out7)
FileSize = Output(code_block.out8)  # If FilePath
