# Dynamo custom node Select CAD Curve.dyf (Dynamo 2.12.1.8246)
# category: GeniusLoci.CAD Import
# Select one or several curves in a linked DWG.
# Dynamo conversion of DWG polyline geometry may be incomplete.
# (Unfortunately location of the curves in blocks is incorrect.)

refresh = Input(refresh: bool = true)
select_line = Python(IN[0]=refresh)  # IronPython2
# ---------- select_line.python (44 lines) ----------
#Alban de Chasteigner 2022
#twitter : @geniusloci_bim
#geniusloci.bim@gmail.com
#https://github.com/albandechasteigner/GeniusLociForDynamo

import clr
clr.AddReference('RevitAPI')
import Autodesk
from Autodesk.Revit.DB import Curve, PolyLine, ElementId

clr.AddReference('RevitServices')
import RevitServices
from RevitServices.Persistence import DocumentManager
doc = DocumentManager.Instance.CurrentDBDocument
uiapp = DocumentManager.Instance.CurrentUIApplication

clr.AddReference('RevitAPIUI')
from Autodesk.Revit.UI.Selection import ObjectType

clr.AddReference("RevitNodes")
import Revit
clr.ImportExtensions(Revit.GeometryConversion)

coords, line,layerName=[],[],[]

sel = uiapp.ActiveUIDocument.Selection
pickedRef=sel.PickObjects(ObjectType.PointOnElement, "Click on the line")

for ref in pickedRef :
	#coords.append(ref.GlobalPoint.ToPoint())
	element = doc.GetElement(ref)
	trans = element.GetTotalTransform()
	geoObj = element.GetGeometryObjectFromReference(ref)
	if isinstance (geoObj, Curve):
		line.append(geoObj.CreateTransformed(trans).ToProtoType())
	elif isinstance (geoObj, PolyLine):
		try:line.append(geoObj.GetTransformed(trans).ToProtoType())
		except:	line.append(geoObj.GetTransformed(trans))
	if geoObj.GraphicsStyleId != ElementId.InvalidElementId :
		gs = doc.GetElement(geoObj.GraphicsStyleId)
		if (gs != None) :
			layerName.append(gs.GraphicsStyleCategory.Name)

OUT = line, layerName#, trans.ToCoordinateSystem(1)
# ----------------------------------------
code_block = CodeBlock(x=select_line) { x[0]; x[1]; }
Curve = Output(code_block.out0)
LayerName = Output(code_block.out1)
