# Dynamo custom node Element.Delete.dyf
# category: Modelical.Elements.Actions
# This node deletes Revit elements of the active project file, using the element ID or the element itself.

elementsOrIDs = Input(_elementsOrIDs: var[]..[])  # Elements or IDs
python = Python(IN[0]=elementsOrIDs)  # CPython3
# ---------- python.python (51 lines) ----------
# This node has been made by Modelical
# www.modelical.com

import clr

clr.AddReference("RevitAPI")
from Autodesk.Revit.DB import *
from Autodesk.Revit.DB.Structure import *

clr.AddReference("RevitAPIUI")
from Autodesk.Revit.UI import *

clr.AddReference("RevitServices")
import RevitServices
from RevitServices.Persistence import DocumentManager

doc = DocumentManager.Instance.CurrentDBDocument


def toList(input):
    if isinstance(input, list):
        return input
    else:
        return [input]

# Logic starts here
elementsOrIDs = toList(UnwrapElement(IN[0]))

t=Transaction(doc, "Modelical.DeleteElemets")
t.Start()
try:
    count=0
    for elem in elementsOrIDs:
        try:
            doc.Delete(ElementId(int(elem)))
            count+=1
        except:
            try:
                doc.Delete(elem.Id)
                count+=1
            except:
                None
    t.Commit()
    
except Exception as ex:
	OUT=ex
	#t.RollBack()
finally:
	t.Dispose()
# Output
OUT = str(count) + " element/s have been deleted from Revit"
# ----------------------------------------
Number_of_deleted_elements__info = Output(python)  # "/*Number of deleted elements*/ _info"
