# Dynamo custom node Element.GetRotation.dyf
# category: Modelical.Elements.Query
# This node gets information about handflipping, faceflipping clockwise rotation and counteclockwise rotation.

elements = Input(_elements: var[]..[])  # Element(s) to get rotation
python = Python(IN[0]=elements)  # CPython3
# ---------- python.python (78 lines) ----------
# This node has been made by Modelical
# www.modelical.com

import clr

clr.AddReference("ProtoGeometry")
from Autodesk.DesignScript.Geometry import *

clr.AddReference("RevitAPI")
from Autodesk.Revit.DB import *
from Autodesk.Revit.DB.Structure import *

clr.AddReference("RevitAPIUI")
from Autodesk.Revit.UI import *

# Function Helpers
from math import *

def Feet2m(value):
        return value * 0.3048

def length(v):
    return sqrt(v.X**2 + v.Y**2)

def toList(input):
    if isinstance(input, list):
        return input
    else:
        return [input]
        
def dot_product(v,w):
   return v.X * w.X + v.Y * w.Y

def determinant(v,w):
   return v.X*w.Y-v.Y*w.X

def inner_angle(v,w):
   cosx=dot_product(v,w)/(length(v)*length(w))
   rad=acos(cosx) # in radians
   return rad*180/pi # returns degrees

def angle_clockwise(A, B):
    inner=inner_angle(A,B)
    det = determinant(A,B)
    if det<0:
        return round(inner,5)
    else:
        return round(360-inner,5)

# Logic starts here
elements = toList(UnwrapElement(IN[0]))
fList=[]

for e in elements:
    try:
        ff=e.FacingFlipped
    except:
        ff=None

    try:
        hf=e.HandFlipped
    except:
        hf=None

    try:
        ro=e.HandOrientation
        roCL=angle_clockwise(XYZ(1,0,0), ro)
        roCC=360-roCL
    except:
        roCL=None
        roCC=None

    fList.append([e,[ff,hf,roCL,roCC]])



# Output
OUT =fList
# ----------------------------------------
FacingFlipped_HandFlipped_Clockwise_Rota = Output(python)  # "/*FacingFlipped, HandFlipped, Clockwise Rotation and CounterClockwise Rotation */ _info"
