# Dynamo custom node Space.CenterLocationAndTags.dyf (Dynamo 2.12.0.5650)
# category: Modelical.Elements.Actions
# This node moves the space location of the selected spaces to the closest possible point to geometrical center. Also modifies the associated space tags in all model.

spaces = Input(_spaces: var[]..[])  # Space(s) to move location and tags.
centerLocationAndTags = Python(IN[0]=spaces)  # "Space.CenterLocationAndTags"; IronPython2
# ---------- centerLocationAndTags.python (165 lines) ----------
# This bit is default. It is always used.
# It connects with DesignScript and Dynamo internals and
# Enable Python support and load DesignScript library.
import clr
clr.AddReference("ProtoGeometry")
from Autodesk.DesignScript.Geometry import *

# This import let's us call / use Dynamo nodes from Python code
clr.AddReference("DSCoreNodes")
from DSCore import *
# General API and User Interface API DLL

clr.AddReference("RevitAPI")
from Autodesk.Revit.DB import *
from Autodesk.Revit.DB.Structure import *

clr.AddReference("RevitAPI")
from Autodesk.Revit.DB import Mechanical as DBMechanical

clr.AddReference("RevitAPIUI")
from Autodesk.Revit.UI import *

clr.AddReference("RevitNodes")
import Revit
clr.ImportExtensions(Revit.GeometryConversion)
clr.ImportExtensions(Revit.Elements)
# This bit is needed to access revit documents (project and families) 
# and to use Transactions (when we need to WRITE data to the Revit database)
clr.AddReference("RevitServices")
import RevitServices
from RevitServices.Persistence import DocumentManager
from RevitServices.Transactions import TransactionManager

uidoc = DocumentManager.Instance.CurrentUIApplication
doc = DocumentManager.Instance.CurrentDBDocument
app = uidoc.Application

# To be able to import Python Standard Library modules, we need to locate them
import sys
sys.path.append(r"C:\Program Files (x86)\IronPython 2.7\Lib")
# Function Helpers
def Feet2m(value):
	return value * 0.3048
	
def m2Feet(value):
	return value / 0.3048

def toList(input):
    """Return iterable if available, a list of 1 otherwise"""
    if hasattr(input, "__iter__") and not isinstance(input, basestring):
        return iter(input)
    else:
        return [input]

def flatten(x):
    result = []
    for el in x:
        if hasattr(el, "__iter__") and not isinstance(el, basestring):
            result.extend(flatten(el))
        else:
            result.append(el)
    return result

def dRange(start,final,step):
	n=start
	fList=[]
	while n<=final:
		fList.append(n)
		n+=step
	return fList	

results = clr.Reference[IntersectionResultArray]()

SBO=SpatialElementBoundaryOptions()

	
#Get Selected Rooms

spaces = toList(UnwrapElement(IN[0]))

#Get All tags
tags=[]

for tag in FilteredElementCollector(doc).OfCategory(BuiltInCategory.OST_MEPSpaceTags).WhereElementIsNotElementType().ToElements():
	if tag.GetType()==DBMechanical.SpaceTag:
		tags.append(tag)

cList=[]
mList=[]
eList=[]
TransactionManager.Instance.EnsureInTransaction(doc)
for r in spaces:
	try:	
		r.Location
		rCurves=[]
		cLoops=[]
	#Geometry
		for segGroup in r.GetBoundarySegments(SBO):
			pGroup=[]
			for seg in segGroup:
				pGroup.append(seg.GetCurve().GetEndPoint(0).ToPoint())
			cLoops.append(PolyCurve.ByPoints(pGroup, True).ToRevitType())
	
		cSolid=GeometryCreationUtilities.CreateExtrusionGeometry(cLoops,XYZ(0,0,2),1)
		
		for f in cSolid.Faces:
			if f.ComputeNormal(UV(0.5,0.5)).IsAlmostEqualTo(XYZ(0,0,-1)):
				rp=f.ToProtoType()[0].PointAtParameter(0.5,0.5)
				p=rp.ToXyz()
				
	#Center is in Room
		#Search Center
				if f.Project(p)!=None:
					try:	
						r.Location.Point = p
						for t in tags:
							if t.Space.Id == r.Id:
								t.Location.Point = p
					except:
						for t in tags:
							if t.TaggedSpaceId.LinkedElementId ==r.Id:
								t.Location.Point = p
					cList.append(r)	
					
					
	#Center isn't in Room
				else:
					tPoints=[]
					dPoints=[]
					
		#Testpoints
					for n in dRange(0,1,0.1):
						for m in dRange(0,1,0.1):
							rtp=f.ToProtoType()[0].PointAtParameter(n,m)
							tp=rtp.ToXyz()
							tPoints.append(tp)
							dPoints.append(tp.DistanceTo(p))
							
		#Sort it by distance		
					zList=sorted(zip(dPoints,tPoints))
					for stp in zList:
					
		#Search nearest point to center
						if f.Project(stp[1])!=None:
							try:	
								r.Location.Point = stp[1]
								for t in tags:
									if t.Space.Id ==r.Id:
										t.Location.Point = stp[1]
							except:
								for t in tags:
									if t.TaggedRoomId.LinkedElementId ==r.Id:
										t.Location.Point = stp[1]
		
							break
					mList.append(r)		
		
				break	
		
	except:
		eList.append(r)
TransactionManager.Instance.TransactionTaskDone()

# Output
OUT =[cList,mList,eList]
# ----------------------------------------
code_block = CodeBlock(l=centerLocationAndTags) { l[0]; }
Moved_to_geometrical_center__centeredSpa = Output(code_block)  # "/*Moved to geometrical center.*/ _centeredSpaces"
code_block_2 = CodeBlock(l=centerLocationAndTags) { l[1]; }
Moved_to_closest_possible_point_to_geome = Output(code_block_2)  # "/*Moved to closest possible point to geometrical center.*/ _movedSpaces"
code_block_3 = CodeBlock(l=centerLocationAndTags) { l[2]; }
Could_not_be_moved__errorSpaces = Output(code_block_3)  # "/*Could not be moved*/ _errorSpaces"
