# Dynamo custom node Stair.Area.dyf (Dynamo 2.12.0.5650)
# category: Modelical.Elements.Query
# This node gets the horizontal area of the selected stair.

stairs = Input(_stairs: var[]..[])  # Stair
python_script = Python(IN[0]=stairs)  # IronPython2
# ---------- python_script.python (44 lines) ----------
# This node has been made by Modelical
# www.modelical.com

import clr
clr.AddReference('ProtoGeometry')
from Autodesk.DesignScript.Geometry import *

def flatten(x):
    result = []
    for el in x:
        if hasattr(el, "__iter__") and not isinstance(el, basestring):
            result.extend(flatten(el))
        else:
            result.append(el)
    return result
    
def toList(input):
	"""Return iterable if available, a list of 1 otherwise"""
	if hasattr(input, "__iter__") and not isinstance(input, basestring):
		return input
	else:
		return [input]  
        
stairs = toList(IN[0])

stairsSrfs = []
stairAreas = []

for st in stairs:
	solids = st.Geometry()
	tempPSrf = []
	for s in solids:
		tempPSrf.append(PolySurface.Surfaces(PolySurface.BySolid(s)))
	stairsSrfs.append(flatten(tempPSrf))


for sSrfs in stairsSrfs:
	tempSrf = []
	for srf in sSrfs:
		if Surface.NormalAtParameter(srf, 0, 0).Z == 1:
			tempSrf.append(srf.Area)
	stairAreas.append(sum(map(float,tempSrf)))	

OUT = stairAreas
# ----------------------------------------
area = Output(python_script)  # "_area"
