# Dynamo custom node View.DuplicateAsDependentByScopebox.dyf (Dynamo 2.12.0.5650)
# category: Modelical.Views.Create
# This node duplicates the selected view as dependant for every selected scope box. Also modifies the new view name and applies the corresponding scope box.

views = Input(_views: var[]..[])  # Selected view(s)
scopeBoxes = Input(_scopeBoxes: var[]..[])  # ScopeBox(es) to add to selected views
python_script = Python(IN[0]=views, IN[1]=scopeBoxes)  # IronPython2
# ---------- python_script.python (89 lines) ----------
# This node has been made by Modelical
# www.modelical.com

import clr
clr.AddReference("ProtoGeometry")
from Autodesk.DesignScript.Geometry import *


clr.AddReference("DSCoreNodes")
from DSCore import *


clr.AddReference("RevitAPI")
from Autodesk.Revit.DB import *
from Autodesk.Revit.DB.Structure import *

clr.AddReference("RevitAPIUI")
from Autodesk.Revit.UI import *

clr.AddReference("RevitNodes")
import Revit
clr.ImportExtensions(Revit.GeometryConversion)
clr.ImportExtensions(Revit.Elements)


clr.AddReference("RevitServices")
import RevitServices
from RevitServices.Persistence import DocumentManager
from RevitServices.Transactions import TransactionManager

uidoc = DocumentManager.Instance.CurrentUIApplication
doc = DocumentManager.Instance.CurrentDBDocument
app = uidoc.Application


import sys
sys.path.append(r"C:\Program Files (x86)\IronPython 2.7\Lib")
# Function Helpers
def Feet2m(value):
	return value * 0.3048

def toList(input):

    if hasattr(input, "__iter__") and not isinstance(input, basestring):
        return input
    else:
        return [input]

def flatten(x):
    result = []
    for el in x:
        if hasattr(el, "__iter__") and not isinstance(el, basestring):
            result.extend(flatten(el))
        else:
            result.append(el)
    return result

# Logic starts here
views = toList(UnwrapElement(IN[0]))
scopeBoxes = toList(UnwrapElement(IN[1]))
newViews=[]
eList=[]
TransactionManager.Instance.EnsureInTransaction(doc)
for v in views:
	vNewViews=[]
	try:
		if not v.CanViewBeDuplicated(ViewDuplicateOption.AsDependent):
			eList.append(v)
			continue
	except:
		eList.append(v)
		continue
		
	for scopeBox in scopeBoxes:
		if v.CanViewBeDuplicated(ViewDuplicateOption.AsDependent) and not v.IsTemplate:
			newView=doc.GetElement(v.Duplicate(ViewDuplicateOption.AsDependent))
			newView.get_Parameter(BuiltInParameter.VIEWER_VOLUME_OF_INTEREST_CROP).Set(scopeBox.Id)
			newView.get_Parameter(BuiltInParameter.VIEWER_CROP_REGION_VISIBLE).Set(True)
			try:
				newView.Name = v.Name + "_" + scopeBox.Name
			except:
				None
			vNewViews.append(newView)
	
	newViews.append(vNewViews)
	
TransactionManager.Instance.TransactionTaskDone()
# Output
OUT = [newViews,eList]
# ----------------------------------------
code_block = CodeBlock(l=python_script) { l[0]; l[1]; }
newViews = Output(code_block.out0)  # "_newViews"
errorViews = Output(code_block.out1)  # "_errorViews"
