# Dynamo custom node View.GetAnnotationCropOffsets.dyf (Dynamo 2.12.0.5650)
# category: Modelical.Views.Query
# This node gets the annotation crop view offsets from the selecter views.

views = Input(_views: var[]..[])  # Views to get the annotation crop offset. Views must have crop view activated.
getAnnotationCropOffset = Python(IN[0]=views)  # "View.GetAnnotationCropOffset"; IronPython2
# ---------- getAnnotationCropOffset.python (93 lines) ----------
# This bit is default. It is always used.
# It connects with DesignScript and Dynamo internals and
# Enable Python support and load DesignScript library.
import clr
clr.AddReference("ProtoGeometry")
from Autodesk.DesignScript.Geometry import *
from Autodesk.DesignScript.Geometry import Line as rLine

# This import let's us call / use Dynamo nodes from Python code
clr.AddReference("DSCoreNodes")
from DSCore import *
# General API and User Interface API DLL

clr.AddReference("RevitAPI")
from Autodesk.Revit.DB import *
from Autodesk.Revit.DB.Structure import *

clr.AddReference("RevitAPIUI")
from Autodesk.Revit.UI import *

clr.AddReference("RevitNodes")
import Revit
clr.ImportExtensions(Revit.GeometryConversion)
clr.ImportExtensions(Revit.Elements)
# This bit is needed to access revit documents (project and families) 
# and to use Transactions (when we need to WRITE data to the Revit database)
clr.AddReference("RevitServices")
import RevitServices
from RevitServices.Persistence import DocumentManager
from RevitServices.Transactions import TransactionManager

uidoc = DocumentManager.Instance.CurrentUIApplication
doc = DocumentManager.Instance.CurrentDBDocument
app = uidoc.Application

# To be able to import Python Standard Library modules, we need to locate them
import sys
sys.path.append(r"C:\Program Files (x86)\IronPython 2.7\Lib")
# Function Helpers
def Feet2m(value):
	return value * 0.3048
	
def M2Feet(value):
	return value / 0.3048


def toList(input):
    """Return iterable if available, a list of 1 otherwise"""
    if hasattr(input, "__iter__") and not isinstance(input, basestring):
        return input
    else:
        return [input]

def flatten(x):
    result = []
    for el in x:
        if hasattr(el, "__iter__") and not isinstance(el, basestring):
            result.extend(flatten(el))
        else:
            result.append(el)
    return result

# Logic starts here
views= toList(UnwrapElement(IN[0]))

# Transactions


eList=[]
fList=[]


for view in views:
	try:
		regionMan = view.GetCropRegionShapeManager()
		TransactionManager.Instance.EnsureInTransaction(doc)
	
		try:
			bottomOffset=Feet2m(regionMan.BottomAnnotationCropOffset)
			leftOffset=Feet2m(regionMan.LeftAnnotationCropOffset)
			rightOffset=Feet2m(regionMan.RightAnnotationCropOffset)
			topOffset=Feet2m(regionMan.TopAnnotationCropOffset)
			fList.append([view,rightOffset,leftOffset,topOffset,bottomOffset])
		except:
			eList.append(view)
		TransactionManager.Instance.TransactionTaskDone()
		
	except:
		eList.append(view)
			
# Output

OUT=[fList, eList]
# ----------------------------------------
code_block = CodeBlock(l=getAnnotationCropOffset) { l[0]; }
View_right_offset_left_offset_top_offset = Output(code_block)  # "/*View,right offset, left offset, top offset and bottom offset.*/ _viewsAndOffsets"
code_block_2 = CodeBlock(l=getAnnotationCropOffset) { l[1]; }
Not_croped_views__errorViews = Output(code_block_2)  # "/*Not croped views.*/ _errorViews"
