# Dynamo custom node View.GetViewsByType.dyf (Dynamo 2.12.0.5650)
# category: Modelical.Views.Query
# This node gets all views in the project classified by type.

python_script = Python()  # IronPython2; graph input
# ---------- python_script.python (112 lines) ----------
#Copyright(c) 2014, Konrad Sobon
# @arch_laboratory, http://archi-lab.net
 
import clr
clr.AddReference('ProtoGeometry')
from Autodesk.DesignScript.Geometry import *
 
# Import DocumentManager and TransactionManager
clr.AddReference("RevitServices")
import RevitServices
from RevitServices.Persistence import DocumentManager
from RevitServices.Transactions import TransactionManager
 
# Import RevitAPI
clr.AddReference("RevitAPI")
import Autodesk
from Autodesk.Revit.DB import *
 
doc = DocumentManager.Instance.CurrentDBDocument
uiapp = DocumentManager.Instance.CurrentUIApplication
app = uiapp.Application
 
from System.Collections.Generic import *
 
# Import ToDSType(bool) extension method
clr.AddReference("RevitNodes")
import Revit
clr.ImportExtensions(Revit.Elements)
 
#The inputs to this node will be stored as a list in the IN variable.
dataEnteringNode = IN
 
#collect all views in the model
collector = FilteredElementCollector(doc)
views = collector.OfClass(View).ToElements()

wrappers = clr.GetClrType(Revit.Elements.ElementWrapper).GetMethods()
for w in wrappers:
	if w.ToString().startswith("Revit.Elements.UnknownElement"):
		uew = w
		break
#sort views into separate lists based on view type
areaPlans, ceilingPlans, columnSchedules = [], [], []
costReport, details, draftingViews = [], [], []
drawingSheets, elevations, engineetingPlans = [], [], []
floorPlans, internal, legends, loadReports = [], [], [], []
panelSchedules, pressureLossReports, renderings = [], [], []
reports, schedules, sections, threeD = [], [], [], []
undefined, walkthrough, viewTemplates = [], [], []

for i in views:
	if not i.IsTemplate:
		if i.ViewType == ViewType.AreaPlan:
			areaPlans.append(i.ToDSType(True))
		elif i.ViewType == ViewType.CeilingPlan:
			ceilingPlans.append(i.ToDSType(True))
		elif i.ViewType == ViewType.ColumnSchedule:
			columnSchedules.append(i.ToDSType(True))
		elif i.ViewType == ViewType.CostReport:
			costReport.append(i.ToDSType(True))
		elif i.ViewType == ViewType.Detail:
			details.append(i.ToDSType(True))
		elif i.ViewType == ViewType.DraftingView:
			draftingViews.append(i.ToDSType(True))
		elif i.ViewType == ViewType.DrawingSheet:
			drawingSheets.append(i.ToDSType(True))
		elif i.ViewType == ViewType.Elevation:
			elevations.append(i.ToDSType(True))
		elif i.ViewType == ViewType.EngineeringPlan:
			engineetingPlans.append(i.ToDSType(True))
		elif i.ViewType == ViewType.FloorPlan:
			floorPlans.append(i.ToDSType(True))
		elif i.ViewType == ViewType.Internal:
			internal.append(i.ToDSType(True))
		elif i.ViewType == ViewType.Legend:
			legends.append(i.ToDSType(True))
		elif i.ViewType == ViewType.LoadsReport:
			loadReports.append(i.ToDSType(True))
		elif i.ViewType == ViewType.PanelSchedule:
			panelSchedules.append(i.ToDSType(True))
		elif i.ViewType == ViewType.PresureLossReport:
			pressureLossReports.append(i.ToDSType(True))
		elif i.ViewType == ViewType.Rendering:
			renderings.append(i.ToDSType(True))
		elif i.ViewType == ViewType.Report:
			reports.append(i.ToDSType(True))
		elif i.ViewType == ViewType.Schedule:
			schedules.append(i.ToDSType(True))
		elif i.ViewType == ViewType.Section:
			sections.append(i.ToDSType(True))
		elif i.ViewType == ViewType.ThreeD:
			threeD.append(i.ToDSType(True))
		elif i.ViewType == ViewType.Undefined:
			undefined.append(i.ToDSType(True))
		elif i.ViewType == ViewType.Walkthrough:
			walkthrough.append(i.ToDSType(True))
		elif i.IsTemplate:
			viewTemplates.append(i.ToDSType(True))
		else:
			continue
 	else:
 		if i.ViewType != ViewType.ThreeD:	
 			viewTemplates.append(i)
 		else:
			viewTemplates.append(uew.Invoke(None,(i,True)))		
#Assign your output to the OUT variable
OUT = areaPlans, ceilingPlans, columnSchedules, costReport, \
	details, draftingViews, drawingSheets, elevations, \
	engineetingPlans, floorPlans, internal, legends, \
	loadReports, panelSchedules, pressureLossReports, \
	renderings, reports, schedules, sections, threeD, \
	undefined, walkthrough,viewTemplates
# ----------------------------------------
code_block = CodeBlock(l=python_script)
# ---------- code_block.designscript (23 lines) ----------
l[0];
l[1];
l[2];
l[3];
l[4];
l[5];
l[6];
l[7];
l[8];
l[9];
l[10];
l[11];
l[12];
l[13];
l[14];
l[15];
l[16];
l[17];
l[18];
l[19];
l[20];
l[21];
l[22];
# ----------------------------------------
areaPlans = Output(code_block.out0)  # "_areaPlans"
ceilingPlans = Output(code_block.out1)  # "_ceilingPlans"
floorPlans = Output(code_block.out9)  # "_floorPlans"
loadReports = Output(code_block.out12)  # "_loadReports"
renderings = Output(code_block.out15)  # "_renderings"
columnSchedules = Output(code_block.out2)  # "_columnSchedules"
draftingViews = Output(code_block.out5)  # "_draftingViews"
elevations = Output(code_block.out7)  # "_elevations"
internal = Output(code_block.out10)  # "_internal"
panelSchedules = Output(code_block.out13)  # "_panelSchedules"
reports = Output(code_block.out16)  # "_reports"
costReport = Output(code_block.out3)  # "_costReport"
drawingSheets = Output(code_block.out6)  # "_drawingSheets"
engineeringPlans = Output(code_block.out8)  # "_engineeringPlans"
legends = Output(code_block.out11)  # "_legends"
pressureLossReports = Output(code_block.out14)  # "_pressureLossReports"
schedules = Output(code_block.out17)  # "_schedules"
details = Output(code_block.out4)  # "_details"
sections = Output(code_block.out18)  # "_sections"
threeD = Output(code_block.out19)  # "_threeD"
undefined = Output(code_block.out20)  # "_undefined"
walkthrough = Output(code_block.out21)  # "_walkthrough"
viewTemplates = Output(code_block.out22)  # "_viewTemplates"
