# Dynamo custom node Wall.Inserts.dyf (Dynamo 2.12.0.5650)
# category: Modelical.Elements.Query
# This node gets all the inserts in a wall.

walls = Input(_walls: var[]..[])  # Walls to check
python_script = Python(IN[0]=walls)  # IronPython2
# ---------- python_script.python (45 lines) ----------
# This node has been made by Modelical
# www.modelical.com

import clr
clr.AddReference('RevitAPI')
from Autodesk.Revit.DB import *

clr.AddReference("RevitNodes")
import Revit
clr.ImportExtensions(Revit.Elements)

clr.AddReference("RevitServices")
import RevitServices
from RevitServices.Persistence import DocumentManager

doc = DocumentManager.Instance.CurrentDBDocument

def toList(input):
    """Return iterable if available, a list of 1 otherwise"""
    if hasattr(input, "__iter__") and not isinstance(input, basestring):
        return input
    else:
        return [input]

def flatten(x):
    result = []
    for el in x:
        if hasattr(el, "__iter__") and not isinstance(el, basestring):
            result.extend(flatten(el))
        else:
            result.append(el)
    return result

inputWalls = toList(UnwrapElement(IN[0]))
inserts = []

for w in inputWalls:
	wInserts = []

	for item in w.FindInserts(True, True, True, True):
		wInserts.append(doc.GetElement(item))
	inserts.append(wInserts)
		
	
OUT =[inputWalls, inserts]
# ----------------------------------------
code_block = CodeBlock(l=python_script) { l[0]; l[1]; }
inserts = Output(code_block.out1)  # "_inserts"
walls_2 = Output(code_block.out0)  # "_walls"
