# Dynamo graph 03-VASA-Pathfinding-in-2D.dyn (Dynamo 2.19.3.6394)
# packages: VASA 0.4.0

# note: Input Variables
# Pink indicates variables that can be altered per project and must be set accordingly before running the script.
# note: Functional Logic
# Cyan indicates the logic of the script. No changes should be made in these groups unless advised.
# note: Output Values
# Orange indicates key resulting values of nodes that should be observed after running the graph.
# note: Display Objects
# Blue indicates objects that can be previewed in the 3D background after running the graph.

# group: VASA Workflow 03: Pathfinding in 2D
# note: DYNAMO PROJECT
# 03-VASA-Pathfinding-in-2D.dyn
# note: ASSOCIATED FILE(S)
# sample-data : 1 SAT file
# note: REQUIRED DYNAMO PACKAGES
# VASA
# note: DYNAMO VERSION
# 2.19.3
# note: AUTHOR(S) / CREATION DATE
# Autodesk Research 2021
# note: DESCRIPTION
# A demonstration of pathfinding in 2D using the Voxel-based Architectural Space Analysis (VASA) package.
# note: ADDITIONAL COMMENTS
# Pathfinding in 2D is a special case that requires the voxel model to be exactly 1 voxel in height. In this example, the voxel model is created from line data that happens to be entirely within a single voxel in the vertical direction. The example also includes traversable and non-traversable voxels, and a path that is displayed using points instead of a curve. It should be possible to drag the endpoints of the path and see it update interactively.

# group: SAT File Path
# In this example, 2D building geometry is imported from an STL file and then voxelized.
building_geometry_file_path = Filename(".\TechnicalSchool_lines_m.stl")

# group: Line Data
# The data from the STL file is imported as geometry using a standard Dynamo node.
importFromSTL = VASA.Utils.TrianglesAsNineNumbers.ImportFromSTL(filePath=building_geometry_file_path)

# group: Coarse Voxel Width
# The coarse voxel width should generally be 1 meter (or possibly 4 feet if using imperial length units). In this example, the imported building geometry is in meters, so the coarse voxel width is 1.
code_block_coarse_voxel_wdith = CodeBlock { 1; }

# group: Level of Detail
# The level of detail (LOD) determines the voxel width (assuming the coarse voxel width is always 1 m). If the default LOD of 4 is used, then the default agent diameter of 7 should work well for pathfinding. If the LOD is reduced to 3, then the agent diameter should be reduced to somewhere around 3 to ensure paths can negotiate narrow passageways and staircases.
integer_slider = IntegerSlider(4, range=0..5 step 1)

# group: Voxel Model
# Voxel models are created from the geometry and then combined into a single voxel model.
byTriangles = VASA.Core.VoxelModel.ByTriangles(trianglesAsNineNumbers=importFromSTL, coarseVoxelWidth=code_block_coarse_voxel_wdith, finestLOD=integer_slider)
union = VASA.Operations.SolidOperations.Union(voxelModels=byTriangles)

# group: Building Voxel Color
color_palette = ColorPalette({R: 0, G: 0, B: 139, A: 255})

# group: Display Building Voxels
displayVoxels = VASA.Core.VoxelModel.DisplayVoxels(voxelModel=union, color=color_palette)

# group: Agent Diameter
# The approximate diameter of an agent, specified in horizontal voxel spacings, determines whether paths can be found through narrow passageways or up/down steep slopes and staircases. If the voxel model level of detail (LOD) is reduced from 4 to 3, then the agent diameter should also be reduced to somewhere around 3. If the LOD is reduced too far, no path will be found regardless of the diameter.
integer_slider_2 = IntegerSlider(7, range=1..15 step 1)

# group: Agent Height
# Pathfinding in 2D is a special case in which the voxel model must be exactly 1 voxel in height and the agent height is exactly 1. It is expected that VASA will normally be used for 3D pathfinding, in which case the agent height must be greater than 1 to allow travel up and down slopes.
code_block_agent_height = CodeBlock { 1; }

# group: Path Model
# Voxel models must be converted into path models to create distance fields or perform pathfinding.
byVoxelModel = VASA.Pathfinding.PathModel.ByVoxelModel(voxelModel=union, agentDiameterOffset=integer_slider_2, agentHeightOffset=code_block_agent_height)

# group: Path Endpoints
source_point_x_number_slider = DoubleSlider(51, range=-100..100 step 0.01)
source_point_y_number_slider = DoubleSlider(-22, range=-100..100 step 0.01)
source_point_z_number_slider = DoubleSlider(0.2, range=0..0.24 step 0.01)
byCoordinates = Point.ByCoordinates(x=source_point_x_number_slider, y=source_point_y_number_slider, z=source_point_z_number_slider)
sample_point_x_number_slider = DoubleSlider(-4, range=-100..100 step 0.01)
sample_point_y_number_slider = DoubleSlider(26, range=-100..100 step 0.01)
sample_point_z_number_slider = DoubleSlider(0.2, range=0..0.24 step 0.01)
byCoordinates_2 = Point.ByCoordinates(x=sample_point_x_number_slider, y=sample_point_y_number_slider, z=sample_point_z_number_slider)

# group: Path
# A shortest path is calculated between two endpoints. The path is produced by computing a distance field outward from the source point until the sample point is reached.
byPathModelAndPoints = VASA.Pathfinding.Path.ByPathModelAndPoints(pathModel=byVoxelModel, sourcePoint=byCoordinates, samplePoint=byCoordinates_2)

# group: Display Path as Points
pointsFromSampleToSource = VASA.Pathfinding.Path.PointsFromSampleToSource(path=byPathModelAndPoints)

# group: Non-Traversable Voxels
# The traversable voxels are retreived from the path model and inverted to display the non-traversable voxels near the walls.
traversableVoxels = VASA.Pathfinding.PathModel.TraversableVoxels(pathModel=byVoxelModel)
invert = VASA.Operations.SolidOperations.Invert(voxelModel=traversableVoxels)
code_block = CodeBlock(voxelModel=union) { voxelModel; }
subtract = VASA.Operations.SolidOperations.Subtract(voxelModel0=invert, voxelModel1=code_block)

# group: Non-Traversable Voxel Color
color_palette_2 = ColorPalette({R: 224, G: 255, B: 255, A: 255})

# group: Display Non-Traversable Voxels
displayVoxels_2 = VASA.Core.VoxelModel.DisplayVoxels(voxelModel=subtract, color=color_palette_2)

# group: Voxel Model Height
# The number of voxels in the vertical direction is calculated from the voxel model extents. The height must be 1 voxel for pathfinding to be performed in 2D instead of 3D.
extents = VASA.Core.VoxelModel.Extents(voxelModel=union)
upperZOffset = VASA.Core.Extents.UpperZOffset(extents=extents)
lowerZOffset = VASA.Core.Extents.LowerZOffset(extents=extents)
sub = upperZOffset - lowerZOffset

# group: Report Voxel Model Height
watch_voxel_model_height = Watch(sub)

# group: Path Length
# Path lengths can be computed directly from path objects.
pathLength = VASA.Pathfinding.Path.PathLength(path=byPathModelAndPoints)
watch = Watch(pathLength)
