# Dynamo graph 04-VASA-Distance-Field.dyn (Dynamo 2.19.3.6394)
# packages: VASA 0.4.0

# note: Input Variables
# Pink indicates variables that can be altered per project and must be set accordingly before running the script.
# note: Functional Logic
# Cyan indicates the logic of the script. No changes should be made in these groups unless advised.
# note: Output Values
# Orange indicates key resulting values of nodes that should be observed after running the graph.
# note: Display Objects
# Blue indicates objects that can be previewed in the 3D background after running the graph.

# group: VASA Workflow 04: Distance Field
# note: DYNAMO PROJECT
# 04-VASA-Distance-Field.dyn
# note: ASSOCIATED FILE(S)
# sample-data : 2 STL files
# note: REQUIRED DYNAMO PACKAGES
# VASA
# note: DYNAMO VERSION
# 2.19.3
# note: AUTHOR(S) / CREATION DATE
# Autodesk Research 2021
# note: DESCRIPTION
# A demonstration of the distance field feature in the Voxel-based Architectural Space Analysis (VASA) package.
# note: ADDITIONAL COMMENTS
# A distance field is computed outward from a source point, allowing paths that share that point to be efficiently computed. In this example, paths are displayed as voxel models. To explore the example, adjust the maximum distance slider and observe the propagation of the field as well as the calculation of encompassed paths.

# group: STL File Paths
main_geometry_file_path = Filename(".\ResidentialSample_main_ft.stl")
furniture_geometry_file_path = Filename(".\ResidentialSample_furniture_ft.stl")

# group: Triangle Data
importFromSTL = VASA.Utils.TrianglesAsNineNumbers.ImportFromSTL(filePath=main_geometry_file_path)
code_block = CodeBlock(mainTriangles=importFromSTL) { mainTriangles; }
importFromSTL_2 = VASA.Utils.TrianglesAsNineNumbers.ImportFromSTL(filePath=furniture_geometry_file_path)
code_block_2 = CodeBlock(furnitureTriangles=importFromSTL_2) { furnitureTriangles; }

# group: Coarse Voxel Width
# The coarse voxel width should generally be 1 meter, though this example uses 4 feet. With a default level of detail (LOD) of 4, the width of the finest voxels is 3 inches (4 feet divided in half 4 times). The height of each voxel is 1 foot.
code_block_coarse_voxel_width = CodeBlock { 4; }

# group: Furniture Offset
# The purpose of the furniture offset is to prevent paths from traversing low furniture by expanding the furniture upwards. In this example, paths will go over the bed unless the furniture offset is at least 1. Paths cannot go over the table because it is at least two voxels tall regardless of the offset.
integer_slider = IntegerSlider(1, range=0..2 step 1)

# group: Voxel Model
# A voxel model is created from the triangle data by combining one voxel model representing the building and context with another representing the furniture. The furniture voxel model may be expanded in the vertical direction to ensure all furniture is at least two voxels higher than the floor. This prevents paths from going over the furniture.
code_block_3 = CodeBlock(coarseVoxelWidth=code_block_coarse_voxel_width) { coarseVoxelWidth; }
byTriangles = VASA.Core.VoxelModel.ByTriangles(trianglesAsNineNumbers=code_block, coarseVoxelWidth=code_block_3)
byTriangles_2 = VASA.Core.VoxelModel.ByTriangles(trianglesAsNineNumbers=code_block_2, coarseVoxelWidth=code_block_3)
code_block_4 = CodeBlock { 0; }
code_block_5 = CodeBlock(furnitureOffset=integer_slider) { furnitureOffset; }
boolean = BoolSelector(true)
expandAlongZ = VASA.Operations.SurfaceOperations.ExpandAlongZ(voxelModel=byTriangles_2, lowerOffset=code_block_4, upperOffset=code_block_5, autoAdjustExtents=boolean)
list_create = List.Create(item0=byTriangles, item1=expandAlongZ)
union = VASA.Operations.SolidOperations.Union(voxelModels=list_create)

# group: Crop Depth
integer_slider_2 = IntegerSlider(10, range=0..60 step 1)

# group: Crop Voxel Model
# The top several layers of voxels are removed for visualization purposes, allowing the user to see into the building.
crop = VASA.Core.VoxelModel.Crop(voxelModel=union, upperZDepth=integer_slider_2)
extents = VASA.Core.VoxelModel.Extents(voxelModel=crop)

# group: Display Building and Context Voxels
displayVoxels = VASA.Core.VoxelModel.DisplayVoxels(voxelModel=crop)

# group: Path Model
# Voxel models must be converted into path models to create distance fields or perform pathfinding.
byVoxelModel = VASA.Pathfinding.PathModel.ByVoxelModel(voxelModel=union)

# group: Source Point
source_point_x_number_slider = DoubleSlider(-26, range=-100..100 step 0.1)
source_point_y_number_slider = DoubleSlider(-28, range=-100..100 step 0.1)
source_point_z_number_slider = DoubleSlider(4, range=-10..10 step 0.1)
byCoordinates = Point.ByCoordinates(x=source_point_x_number_slider, y=source_point_y_number_slider, z=source_point_z_number_slider)

# group: Maximum Distance
# note: Distance fields are computed up to a specified distance from the source point. The default value of -1 means that the field will be computed as far as possible.
number_slider = DoubleSlider(73, range=0..160 step 0.25)

# group: Distance Field
# A field of travel distances is computed from a point. Distance fields can be visualized, as in this example or used to find paths with a common endpoint. Both uses are demonstrated here.
byPathModelAndSourcePoint = VASA.Pathfinding.DistanceField.ByPathModelAndSourcePoint(pathModel=byVoxelModel, sourcePoint=byCoordinates, maxDistance=number_slider)

# group: Reachable Voxels
# Reachable voxels are voxels reachable from the source point according to the distance field.
reachableVoxels = VASA.Pathfinding.DistanceField.ReachableVoxels(distanceField=byPathModelAndSourcePoint)

# group: Distance Field Color
color_palette = ColorPalette({R: 138, G: 43, B: 226, A: 63})

# group: Sample Point A
source_point_x_number_slider_2 = DoubleSlider(4, range=-100..100 step 0.1)
source_point_y_number_slider_2 = DoubleSlider(-54, range=-100..100 step 0.1)
source_point_z_number_slider_2 = DoubleSlider(4, range=-10..10 step 0.1)
byCoordinates_2 = Point.ByCoordinates(x=source_point_x_number_slider_2, y=source_point_y_number_slider_2, z=source_point_z_number_slider_2)

# group: Sample Point B
source_point_x_number_slider_3 = DoubleSlider(-7, range=-100..100 step 0.1)
source_point_y_number_slider_3 = DoubleSlider(-15, range=-100..100 step 0.1)
source_point_z_number_slider_3 = DoubleSlider(4, range=-10..10 step 0.1)
byCoordinates_3 = Point.ByCoordinates(x=source_point_x_number_slider_3, y=source_point_y_number_slider_3, z=source_point_z_number_slider_3)

# group: Sample Point C
source_point_x_number_slider_4 = DoubleSlider(-64, range=-100..100 step 0.1)
source_point_y_number_slider_4 = DoubleSlider(-24, range=-100..100 step 0.1)
source_point_z_number_slider_4 = DoubleSlider(4, range=-10..10 step 0.1)
byCoordinates_4 = Point.ByCoordinates(x=source_point_x_number_slider_4, y=source_point_y_number_slider_4, z=source_point_z_number_slider_4)

# group: Sample Point D
source_point_x_number_slider_5 = DoubleSlider(-59, range=-100..100 step 0.1)
source_point_y_number_slider_5 = DoubleSlider(-6, range=-100..100 step 0.1)
source_point_z_number_slider_5 = DoubleSlider(4, range=-10..10 step 0.1)
byCoordinates_5 = Point.ByCoordinates(x=source_point_x_number_slider_5, y=source_point_y_number_slider_5, z=source_point_z_number_slider_5)

# group: Sample Point E
source_point_x_number_slider_6 = DoubleSlider(-7, range=-100..100 step 0.1)
source_point_y_number_slider_6 = DoubleSlider(30, range=-100..100 step 0.1)
source_point_z_number_slider_6 = DoubleSlider(4, range=-10..10 step 0.1)
byCoordinates_6 = Point.ByCoordinates(x=source_point_x_number_slider_6, y=source_point_y_number_slider_6, z=source_point_z_number_slider_6)

# group: Sample Point F
source_point_x_number_slider_7 = DoubleSlider(-61, range=-100..100 step 0.1)
source_point_y_number_slider_7 = DoubleSlider(53, range=-100..100 step 0.1)
source_point_z_number_slider_7 = DoubleSlider(4, range=-10..10 step 0.1)
byCoordinates_7 = Point.ByCoordinates(x=source_point_x_number_slider_7, y=source_point_y_number_slider_7, z=source_point_z_number_slider_7)

# group: Sample Points
# When multiple paths share an endpoint, it is most efficient to create a distance field with the common endpoint as the source point. Sample points, as listed here, can then be used to extract paths.
list_create_2 = List.Create(item0=byCoordinates_2, item1=byCoordinates_3, item2=byCoordinates_4, item3=byCoordinates_5, item4=byCoordinates_6, item5=byCoordinates_7)

# group: Paths
# A shortest path is calculated between a sample point and the source point of the distance field.
byDistanceFieldAndSamplePoint = VASA.Pathfinding.Path.ByDistanceFieldAndSamplePoint(distanceField=byPathModelAndSourcePoint, samplePoint=list_create_2)

# group: Valid Paths
# Invalid paths are filtered out. In this example, some of the paths may be invalid if the sample point lies outside the distance field.
isValid = VASA.Pathfinding.Path.IsValid(path=byDistanceFieldAndSamplePoint)
filterByBoolMask = List.FilterByBoolMask(list=byDistanceFieldAndSamplePoint, mask=isValid)

# group: Path Voxels
# Valid paths may be represented using curves, points, and voxels. This example uses voxels.
pathVoxels = VASA.Pathfinding.Path.PathVoxels(path=filterByBoolMask.in)

# group: Resize Voxel Models
# All voxel models are resized to the same extents before being displayed.
resize = VASA.Core.VoxelModel.Resize(voxelModel=reachableVoxels, newExtents=extents)
resize_2 = VASA.Core.VoxelModel.Resize(voxelModel=pathVoxels, newExtents=extents)

# group: Display Distance Field Voxels
displayVoxels_2 = VASA.Core.VoxelModel.DisplayVoxels(voxelModel=resize, color=color_palette)

# group: Path Voxel Color
color_palette_2 = ColorPalette({R: 255, G: 255, B: 0, A: 255})

# group: Display Path Voxels
displayVoxels_3 = VASA.Core.VoxelModel.DisplayVoxels(voxelModel=resize_2, color=color_palette_2)
