# Dynamo graph 07-VASA-Direct-Daylight.dyn (Dynamo 2.19.3.6394)
# packages: VASA 0.4.0

# note: Input Variables
# Pink indicates variables that can be altered per project and must be set accordingly before running the script.
# note: Functional Logic
# Cyan indicates the logic of the script. No changes should be made in these groups unless advised.
# note: Output Values
# Orange indicates key resulting values of nodes that should be observed after running the graph.
# note: Display Objects
# Blue indicates objects that can be previewed in the 3D background after running the graph.

# group: VASA Workflow 07: Direct Daylight
# note: DYNAMO PROJECT
# 07-VASA-Direct-Daylight.dyn
# note: ASSOCIATED FILE(S)
# sample-data : 2 STL files
# note: REQUIRED DYNAMO PACKAGES
# VASA
# note: DYNAMO VERSION
# 2.19.3
# note: AUTHOR(S) / CREATION DATE
# Autodesk Research 2021
# note: DESCRIPTION
# A demonstration of how the amount of direct daylight that enters a building can be characterized using the Voxel-based Architectural Space Analysis (VASA) package.
# note: ADDITIONAL COMMENTS
# This example approximates the fraction of the volume of all indoor spaces that receives direct daylight from a single direction. The graph employs a number of VASA's surface and fill operations in order to determine the voxels representing all indoor spaces. It then intersects these voxels with visibility results representing daylight.

# group: STL File Paths
building_geometry_file_path = Filename(".\TechnicalSchool_building_mm_bin.stl")
glazing_geometry_file_path = Filename(".\TechnicalSchool_glazing_mm_bin.stl")

# group: Triangle Data
importFromSTL = VASA.Utils.TrianglesAsNineNumbers.ImportFromSTL(filePath=building_geometry_file_path)
code_block = CodeBlock(buildingTriangles=importFromSTL) { buildingTriangles; }
importFromSTL_2 = VASA.Utils.TrianglesAsNineNumbers.ImportFromSTL(filePath=glazing_geometry_file_path)
code_block_2 = CodeBlock(glazingTriangles=importFromSTL_2) { glazingTriangles; }

# group: Coarse Voxel Width
code_block_3 = CodeBlock { 1000; }

# group: Level of Detail
integer_slider = IntegerSlider(4, range=0..5 step 1)

# group: Voxel Models
byTriangles = VASA.Core.VoxelModel.ByTriangles(trianglesAsNineNumbers=code_block, coarseVoxelWidth=code_block_3, finestLOD=integer_slider)
code_block_4 = CodeBlock(buildingVoxels=byTriangles) { buildingVoxels; }
byTriangles_2 = VASA.Core.VoxelModel.ByTriangles(trianglesAsNineNumbers=code_block_2, coarseVoxelWidth=code_block_3, finestLOD=integer_slider)
code_block_5 = CodeBlock(glazingVoxels=byTriangles_2) { glazingVoxels; }

# group: Voxel Model for Indoor Space Detection
list_create = List.Create(item0=code_block_4, item1=code_block_5)
union = VASA.Operations.SolidOperations.Union(voxelModels=list_create)

# group: Door Height Offset
integer_slider_2 = IntegerSlider(7, range=0..10 step 1)

# group: Space Filter Offset
integer_slider_3 = IntegerSlider(5, range=0..10 step 1)

# group: Indoor Space Voxels
# The voxels representing all indoor spaces of the building are determined by (1) expanding voxels downward to close off all doorways, (2) filling the model, and (3) expanding the filled regions upward by the same amount that was used to close doorways (the door height offset). Small spaces, such as the area inside walls, are filtered out by reducing and expanding spaces horizontally by the same amount (the small space filter offset).
code_block_6 = CodeBlock(doorHeightOffset=integer_slider_2) { doorHeightOffset; }
code_block_7 = CodeBlock { 0; }
expandAlongZ = VASA.Operations.SurfaceOperations.ExpandAlongZ(voxelModel=union, lowerOffset=code_block_6, upperOffset=code_block_7)
fillEnclosedRegions = VASA.Operations.FillOperations.FillEnclosedRegions(voxelModel=expandAlongZ)
subtract = VASA.Operations.SolidOperations.Subtract(voxelModel0=fillEnclosedRegions, voxelModel1=expandAlongZ)
code_block_8 = CodeBlock(spaceFilterOffset=integer_slider_3) { spaceFilterOffset; }
reduceHorizontally = VASA.Operations.SurfaceOperations.ReduceHorizontally(voxelModel=subtract, diameterOffset=code_block_8)
expandHorizontally = VASA.Operations.SurfaceOperations.ExpandHorizontally(voxelModel=reduceHorizontally, diameterOffset=code_block_8)
code_block_9 = CodeBlock { 0; }
expandAlongZ_2 = VASA.Operations.SurfaceOperations.ExpandAlongZ(voxelModel=expandHorizontally, lowerOffset=code_block_9, upperOffset=code_block_6)

# group: Indoor Space Voxel Color
color_palette = ColorPalette({R: 255, G: 255, B: 255, A: 63})

# group: Display Indoor Space Voxels
displayVoxels = VASA.Core.VoxelModel.DisplayVoxels(voxelModel=expandAlongZ_2, color=color_palette)

# group: Daylight Direction
x_number_slider = DoubleSlider(-3, range=-10..10 step 0.1)
y_number_slider = DoubleSlider(4, range=0..10 step 0.1)
z_number_slider = DoubleSlider(-6, range=-10..0 step 0.1)
byCoordinates = Vector.ByCoordinates(x=x_number_slider, y=y_number_slider, z=z_number_slider)

# group: Direct Daylight
visibilityFromDirection = VASA.Operations.VisibilityOperations.VisibilityFromDirection(voxelModel=code_block_4, direction=byCoordinates)

# group: Daylit Indoor Space Voxels
# The daylit indoor space voxels are computed by intersecting the indoor space voxels with the results of the visibility operation.
list_create_2 = List.Create(item0=expandAlongZ_2, item1=visibilityFromDirection)
intersect = VASA.Operations.SolidOperations.Intersect(voxelModels=list_create_2)

# group: Daylit Voxel Color
color_palette_2 = ColorPalette({R: 255, G: 255, B: 0, A: 255})

# group: Display Daylit Indoor Space Voxels
displayVoxels_2 = VASA.Core.VoxelModel.DisplayVoxels(voxelModel=intersect, color=color_palette_2)

# group: Direct Daylit Fraction
# This metric approximates the fraction of the volume of all indoor spaces that receives direct daylight from a single direction.
countFilled = VASA.Core.VoxelModel.CountFilled(voxelModel=intersect)
countFilled_2 = VASA.Core.VoxelModel.CountFilled(voxelModel=expandAlongZ_2)
div = countFilled / countFilled_2
direct_daylit_fraction_watch = Watch(div)
