# Dynamo graph 10-VASA-Slices-and-Images.dyn (Dynamo 2.19.3.6394)
# packages: VASA 0.4.0

# note: Input Variables
# Pink indicates variables that can be altered per project and must be set accordingly before running the script.
# note: Functional Logic
# Cyan indicates the logic of the script. No changes should be made in these groups unless advised.
# note: Output Values
# Orange indicates key resulting values of nodes that should be observed after running the graph.
# note: Display Objects
# Blue indicates objects that can be previewed in the 3D background after running the graph.

# group: VASA Workflow 10: Slices and Images
# note: DYNAMO PROJECT
# 10-VASA-Slices-and-Images.dyn
# note: ASSOCIATED FILE(S)
# sample-data : 2 STL files
# note: REQUIRED DYNAMO PACKAGES
# VASA
# note: DYNAMO VERSION
# 2.19.3
# note: AUTHOR(S) / CREATION DATE
# Autodesk Research 2021
# note: DESCRIPTION
# A demonstration of how slice iterators can be used as section tools. Horizontal and vertical 2D slices are extracted from a 3D voxel model using the Voxel-based Architectural Space Analysis (VASA) package.
# note: ADDITIONAL COMMENTS
# Slice iterators can be used to create 2D voxel models, or to access internal voxel data as nested lists of 0s and 1s. Here the voxel data is used to generate images of slices in the X, Y, and Z directions. There is also a Python script that counts the number of filled voxels for each slice in the Z direction. While both slice iterators and voxel iterators could be used to traverse voxels, slice iterators are easier to use and more efficient.

# group: STL File Paths
building_geometry_file_path = Filename(".\TechnicalSchool_building_mm_bin.stl")
glazing_geometry_file_path = Filename(".\TechnicalSchool_glazing_mm_bin.stl")

# group: Triangle Data
importFromSTL = VASA.Utils.TrianglesAsNineNumbers.ImportFromSTL(filePath=building_geometry_file_path)
importFromSTL_2 = VASA.Utils.TrianglesAsNineNumbers.ImportFromSTL(filePath=glazing_geometry_file_path)
list_create = List.Create(item0=importFromSTL, item1=importFromSTL_2)

# group: Coarse Voxel Width
code_block = CodeBlock { 1000; }

# group: Level of Detail
vertical_level_of_detail_integer = IntegerSlider(1, range=0..5 step 1)  # "Vertical Level of Detail - Integer Slider"
finest_level_of_detail_integer = IntegerSlider(1, range=0..5 step 1)  # "Finest Level of Detail - Integer Slider"

# group: Building and Glazing Voxels
byTriangles = VASA.Core.VoxelModel.ByTriangles(trianglesAsNineNumbers=list_create, coarseVoxelWidth=code_block, verticalLOD=vertical_level_of_detail_integer, finestLOD=finest_level_of_detail_integer)
union = VASA.Operations.SolidOperations.Union(voxelModels=byTriangles)

# group: Building Voxel Color
color_palette = ColorPalette({R: 255, G: 255, B: 255, A: 31})

# group: Display Building Voxels
displayVoxels = VASA.Core.VoxelModel.DisplayVoxels(voxelModel=union, color=color_palette)

# group: Slice Indices
slice_x_index_integer_slider = IntegerSlider(4, range=-30..120 step 1)
slice_y_index_integer_slider = IntegerSlider(-40, range=-60..80 step 1)
slice_z_index_integer_slider = IntegerSlider(13, range=-10..30 step 1)

# group: Slices
byVoxelModelAndXIndex = VASA.Iterators.SliceIterator.ByVoxelModelAndXIndex(voxelModel=union, sliceXIndex=slice_x_index_integer_slider)
sliceVoxels = VASA.Iterators.SliceIterator.SliceVoxels(sliceIterator=byVoxelModelAndXIndex)
byVoxelModelAndYIndex = VASA.Iterators.SliceIterator.ByVoxelModelAndYIndex(voxelModel=union, sliceYIndex=slice_y_index_integer_slider)
sliceVoxels_2 = VASA.Iterators.SliceIterator.SliceVoxels(sliceIterator=byVoxelModelAndYIndex)
byVoxelModelAndZIndex = VASA.Iterators.SliceIterator.ByVoxelModelAndZIndex(voxelModel=union, sliceZIndex=slice_z_index_integer_slider)
sliceVoxels_3 = VASA.Iterators.SliceIterator.SliceVoxels(sliceIterator=byVoxelModelAndZIndex)
boolean = BoolSelector(true)
sliceData = VASA.Iterators.SliceIterator.SliceData(sliceIterator=byVoxelModelAndXIndex, startAtUpperRow=boolean)
boolean_2 = BoolSelector(true)
sliceData_2 = VASA.Iterators.SliceIterator.SliceData(sliceIterator=byVoxelModelAndYIndex, startAtUpperRow=boolean_2)
boolean_3 = BoolSelector(true)
sliceData_3 = VASA.Iterators.SliceIterator.SliceData(sliceIterator=byVoxelModelAndZIndex, startAtUpperRow=boolean_3)

# group: Display Slice Voxels
color_palette_2 = ColorPalette({R: 255, G: 0, B: 0, A: 255})
displayVoxels_2 = VASA.Core.VoxelModel.DisplayVoxels(voxelModel=sliceVoxels, color=color_palette_2)

# group: Display Slice Voxels
color_palette_3 = ColorPalette({R: 127, G: 255, B: 0, A: 255})
displayVoxels_3 = VASA.Core.VoxelModel.DisplayVoxels(voxelModel=sliceVoxels_2, color=color_palette_3)

# group: Display Slice Voxels
color_palette_4 = ColorPalette({R: 0, G: 0, B: 255, A: 255})
displayVoxels_4 = VASA.Core.VoxelModel.DisplayVoxels(voxelModel=sliceVoxels_3, color=color_palette_4)

# group: Slice Images
code_block_2 = CodeBlock(value=sliceData) { 255*value; }
byARGB = Color.ByARGB(red=code_block_2)
fromPixels = Image.FromPixels(colors=byARGB)
watch_image = WatchImageCore(image=fromPixels)
code_block_3 = CodeBlock(value=sliceData_2) { 255*value; }
byARGB_2 = Color.ByARGB(green=code_block_3)
fromPixels_2 = Image.FromPixels(colors=byARGB_2)
watch_image_2 = WatchImageCore(image=fromPixels_2)
code_block_4 = CodeBlock(value=sliceData_3) { 255*value; }
byARGB_3 = Color.ByARGB(blue=code_block_4)
fromPixels_3 = Image.FromPixels(colors=byARGB_3)
watch_image_3 = WatchImageCore(image=fromPixels_3)

# group: Filled Voxel Counts (using Python script)
python_script = Python(IN[0]=union)  # CPython3
# ---------- python_script.python (56 lines) ----------
# Load the Python Standard and DesignScript Libraries
import sys
import clr
clr.AddReference('ProtoGeometry')
from Autodesk.DesignScript.Geometry import *

# Load types from the VASA Library.
from VASA.Iterators import SliceIterator

# The inputs to this node will be stored as a list in the IN variables.
voxelModel = IN[0]

# Use the finest available level of detail.
voxelLOD = voxelModel.FinestLOD()

# Get the extents of the voxel model.
extents = voxelModel.Extents(voxelLOD)

# Get the number of voxels in the X and Y directions.
nx = extents.UpperXOffset() - extents.LowerXOffset()
ny = extents.UpperYOffset() - extents.LowerYOffset()

# Create an iterator starting at the lowest slice in the Z direction.
lowerZIndex = extents.LowerIndices()[2]
sliceIter = SliceIterator.ByVoxelModelAndZIndex(voxelModel, lowerZIndex, voxelLOD)

# Create a list to store filled voxel counts.
filledVoxelCounts = []

# Iterate over each slice of the voxel model in the Z direction.
while sliceIter.IsValid():

    # Get the voxel data for the current slice.
    sliceBools = sliceIter.SliceBools()

    # Add a new entry to the list of voxel counts.
    filledVoxelCounts.append(0)

    # Iterate over each row of the current slice.
    for iy in range(ny):

        # Get the voxel data for the current row.
        rowBools = sliceBools[iy]

        # Iterate over each voxel of the current row.
        for ix in range(nx):
            
            # If the voxel is filled, add 1 to the filled voxel count for the current slice.
            if rowBools[ix]:
                filledVoxelCounts[-1] += 1
                
    # Advance to the next slice.
    sliceIter = sliceIter.Advance(1)

# Output the list of filled voxel counts.
OUT = filledVoxelCounts
# ----------------------------------------
watch = Watch(python_script)
