# Dynamo custom node [&] List.ChopByLengths.dyf (Dynamo 2.10.1.3976)
# category: Ampersand
# Chop a list into sublists given a series of sizes.  Remaining list items after the sublists have been filled are discarded.  Remaining sublist capacity after list items are exhausted is ignored.

# note: Colin McCrone
# Twitter:  @ColinMcCrone
# LinkedIn: https://www.linkedin.com/in/colinmccrone
# Updated:  2021-05-26
# An example Dynamo script for how to use this node can be found in the 'extra' folder where the package files are stored. To find it, go to the Packages Menu and select "Manage Packages." Where Ampersand is listed, open the drop-down menu link at the right and choose "Show Root Directory." Open the "extra" folder to find the example file called AmpersandExamples.dyn.
list = Input(list: var[])
lengths = Input(lengths: int[])
python_script = Python(IN[0]=list, IN[1]=lengths)  # CPython3
# ---------- python_script.python (34 lines) ----------
# Place successive items from a list into sublists of the given sizes.
# This functionality now supported by the native List.Chop node.
#
# Colin McCrone
# Twitter:  https://twitter.com/colinmccrone
# LinkedIn: https://www.linkedin.com/in/colinmccrone
# Updated:  2019-05-20
#
import clr

# Input
data = IN[0]        # 1-D list to chopped into groups
binSizes = IN[1]    # List of group sizes, ex: {2,3,1}

# Initialize quantities
groups = []
idxData = 0
idxBins = 0

# Place successive data items into sublists equal
# to the sizes listed in binSizes and append to groups[]
while idxData < len(data) and idxBins < len(binSizes):
	sublist = []
	for j in range(int(binSizes[idxBins])):
		if idxData < len(data):
			sublist.append(data[idxData])
			idxData = idxData + 1
		else:
			break
	groups.append(sublist)
	idxBins = idxBins + 1

#Assign your output to the OUT variable
OUT = groups
# ----------------------------------------
groups = Output(python_script)
