# Dynamo custom node [&] PointGrid.ToQuadSets.dyf (Dynamo 2.10.1.3976)
# category: Ampersand.[&] Point
# Create groups of 4 items describing the "cells" of a rectangular grid of data.  In the case of a grid of points, the output will be the set of points describing the corners of 4-pointed panels.

list_create = List.Create()  # unwired: item0, item1, item2, item3
wrap = Input(wrap: bool = false)
# note: Colin McCrone
# Twitter:  @ColinMcCrone
# LinkedIn: https://www.linkedin.com/in/colinmccrone
# Updated:  2021-05-26
# An example Dynamo script for how to use this node can be found in the 'extra' folder where the package files are stored. To find it, go to the Packages Menu and select "Manage Packages." Where Ampersand is listed, open the drop-down menu link at the right and choose "Show Root Directory." Open the "extra" folder to find the example file called AmpersandExamples.dyn.
pointGrid = Input(pointGrid: var[]..[])

# group: "Wrap" rows within grid of points
firstItem = List.FirstItem(list=pointGrid@L2)
code_block = CodeBlock { null; }
count = List.Count(list=pointGrid)
ofRepeatedItem = List.OfRepeatedItem(item=code_block, amount=count)
if_ = If(test=wrap, true=firstItem, false=ofRepeatedItem)
addItemToEnd = List.AddItemToEnd(item=if_@L1, list=pointGrid@L2)
clean = List.Clean(list=addItemToEnd)

# group: All but last column
count_2 = List.Count(list=clean)
code_block_2 = CodeBlock(count=count_2) { count-1; }
takeItems = List.TakeItems(list=clean, amount=code_block_2)

# group: All but last row
count_3 = List.Count(list=takeItems@L2)
code_block_3 = CodeBlock(count=count_3) { count-1; }
takeItems_2 = List.TakeItems(list=takeItems@L2, amount=code_block_3@L1)

# group: All but first row
restOfItems = List.RestOfItems(list=takeItems@L2)

# group: All but first column
restOfItems_2 = List.RestOfItems(list=clean)

# group: All but first row
restOfItems_3 = List.RestOfItems(list=restOfItems_2@L2)

# group: All but last row
count_4 = List.Count(list=restOfItems_2@L2)
code_block_4 = CodeBlock(count=count_4) { count-1; }
takeItems_3 = List.TakeItems(list=restOfItems_2@L2, amount=code_block_4@L1)

combine = List.Combine(comb=list_create, list1=takeItems_2, list2=restOfItems, list3=restOfItems_3, list4=takeItems_3)
transpose = List.Transpose()  # unwired: lists
map = List.Map(list=combine, f_x=transpose)
pointSets = Output(map)
