# Dynamo custom node [&] PointGrid.ToTriSets.dyf (Dynamo 2.10.1.3976)
# category: Ampersand.[&] Point
# Construct three-point sets describing panels from a rectangular grid of points.  May use a grid of points in the form of a diagrid.  Boolean values "swapDiagDirection" and "alternateDiagsByRow" control how triangles are formed from the points.  Boolean value "wrap"
# packages: Ampersand 2019.12.31

list_create = List.Create()  # unwired: item0, item1
list_create_2 = List.Create()  # unwired: item0, item1, item2
# note: Colin McCrone
# Twitter:  @ColinMcCrone
# LinkedIn: https://www.linkedin.com/in/colinmccrone
# Updated:  2021-05-26
# An example Dynamo script for how to use this node can be found in the 'extra' folder where the package files are stored. To find it, go to the Packages Menu and select "Manage Packages." Where Ampersand is listed, open the drop-down menu link at the right and choose "Show Root Directory." Open the "extra" folder to find the example file called AmpersandExamples.dyn.
pointGrid = Input(pointGrid: Autodesk.DesignScript.Geometry.Point[][])
wrap = Input(wrap: bool = false)
pointgrid_toquadsets = Custom[[&] PointGrid.ToQuadSets](pointGrid=pointGrid, wrap=wrap)  # package Ampersand; Create groups of 4 items describing the "cells" of a rectangular grid of data. In the case of a grid of points, the output will be the set of points describing the corners of 4-pointed panels.
alternateDiagsByRow = Input(alternateDiagsByRow: bool = true)
code_block = CodeBlock(alternateDiagsByRow=alternateDiagsByRow) { alternateDiagsByRow ? 1 : 0; }
swapDiagDirection = Input(swapDiagDirection: bool = false)
code_block_2 = CodeBlock(swapDiagDirection=swapDiagDirection) { swapDiagDirection ? 1 : 0; }
count = List.Count(list=pointgrid_toquadsets)
code_block_3 = CodeBlock(n=count) { (1..n)%2; (0..(n-1))%2; }
if_ = If(test=code_block_2, true=code_block_3.out0, false=code_block_3.out1)
firstItem = List.FirstItem(list=if_)
code_block_4 = CodeBlock(ls=if_, item=firstItem) { ls*0 + item; }
if_2 = If(test=code_block, true=if_, false=code_block_4)
list_create_3 = List.Create()  # unwired: item0
map = List.Map(list=if_2, f_x=list_create_3)
count_2 = List.Count(list=pointgrid_toquadsets@L3)
ofRepeatedItem = List.OfRepeatedItem(item=map@L2, amount=count_2@L1)
shiftIndices = List.ShiftIndices(list=pointgrid_toquadsets@L2, amount=ofRepeatedItem@L2)
code_block_5 = CodeBlock { 0; }
getItemAtIndex = List.GetItemAtIndex(list=shiftIndices@@L2, index=code_block_5)
code_block_6 = CodeBlock { 2; }
getItemAtIndex_2 = List.GetItemAtIndex(list=shiftIndices@@L2, index=code_block_6)
code_block_7 = CodeBlock { 3; }
getItemAtIndex_3 = List.GetItemAtIndex(list=shiftIndices@@L2, index=code_block_7)
combine = List.Combine(comb=list_create_2, list1=getItemAtIndex, list2=getItemAtIndex_2, list3=getItemAtIndex_3)
transpose = List.Transpose()  # unwired: lists
map_2 = List.Map(list=combine, f_x=transpose)
code_block_8 = CodeBlock { 1; }
getItemAtIndex_4 = List.GetItemAtIndex(list=shiftIndices@@L2, index=code_block_8)
combine_2 = List.Combine(comb=list_create_2, list1=getItemAtIndex_2, list2=getItemAtIndex, list3=getItemAtIndex_4)
transpose_2 = List.Transpose()  # unwired: lists
map_3 = List.Map(list=combine_2, f_x=transpose_2)
combine_3 = List.Combine(comb=list_create, list1=map_2, list2=map_3)
transpose_3 = List.Transpose(lists=combine_3@@L4)
code_block_9 = CodeBlock { 1; }
flatten = List.Flatten(list=transpose_3@L4, amt=code_block_9)
pointSets = Output(flatten)
