# Dynamo custom node [&] String.ExtractNumbers.dyf (Dynamo 2.10.1.3976)
# category: Ampersand
# Extract a number or a list of numbers from a string

# note: Colin McCrone
# Twitter:  @ColinMcCrone
# LinkedIn: https://www.linkedin.com/in/colinmccrone
# Updated:  2021-05-26
# An example Dynamo script for how to use this node can be found in the 'extra' folder where the package files are stored. To find it, go to the Packages Menu and select "Manage Packages." Where Ampersand is listed, open the drop-down menu link at the right and choose "Show Root Directory." Open the "extra" folder to find the example file called AmpersandExamples.dyn.
str = Input(str: string)
python_script = Python(IN[0]=str)  # CPython3
# ---------- python_script.python (72 lines) ----------
# Extract a list of numbers from a string
#
# Colin McCrone
# Twitter:  https://twitter.com/colinmccrone
# LinkedIn: https://www.linkedin.com/in/colinmccrone
# Updated:  2017-07-04
#
import clr


# True if character is a number, false otherwise
def IsNum(char):
    try:
        int(char)
        return True
    except ValueError:
        return False


# Join a single list of characters into a string
def JoinChars(chars):
	if not chars:
		return None
	elif len(chars) == 1:
		return chars[0]
	else:
		return "".join(chars)


# Return a list of contiguous numbers from a string
def StringToNumbers(str):
	# Extract lists of contiguous number characters
	nums = []
	lastWasNum = False
	ls = []
	for i in range(len(str)):
		if IsNum(str[i]):
			ls.append(str[i])
			lastWasNum = True
		elif str[i] == "." and lastWasNum:
			ls.append(str[i])
		elif lastWasNum:
			nums.append(ls)
			ls = []
			lastWasNum = False
		
		if i == len(str)-1 and ls:
			nums.append(ls)

	# Cast character strings to numbers
	if not nums:
		return [None,None]
	elif len(nums) == 1:
		asStr = JoinChars(nums[0])
		return [asStr,float(asStr)]
	else:
		asStr = []
		asNum = []
		for i in range(len(nums)):
			oneStr = JoinChars(nums[i])
			asStr.append(oneStr)
			asNum.append(float(oneStr))
		return [asStr,asNum]


str = IN[0]
OUT = StringToNumbers(str)




	
# ----------------------------------------
code_block = CodeBlock(OUT=python_script) { OUT[0]; OUT[1]; }
string = Output(code_block.out0)
number = Output(code_block.out1)
