# Dynamo graph AmpersandExamples.dyn (Dynamo 2.10.1.3976)
# packages: Ampersand 2019.12.31

# group: [&] List
# note: Ampersand > [&] List

# group: [&] Math
# note: Ampersand > [&] Math

# group: [&] String
# note: Ampersand > [&] String

# group: [&] Curve > PolyCurve
# note: Ampersand > Curve > [&] PolyCurve

# group: [&] Point > PointGrid (Point[][])
# note: Ampersand > [&] PointGrid

# group: [&] Point > PointList (Point[])
# note: Ampersand > [&] PointGrid

# group: [&] Vector
# note: Ampersand > [&] Vector

# group: [&] Misc
# note: Ampersand > [&] Misc

# group: [&] Revit
# note: Ampersand > [&] Revit

# group: [&] Curve > Curves
# note: Ampersand > Curve > [&] Curves

# group: [&] Curve > Arc
# note: Ampersand > Curve > [&] Curves

# group: [&] Geometry
# note: Ampersand > [&] Geometry

# group: [&] Surface > Surface
# note: Ampersand > Surface > [&] Surface

# group: [&] Surface > PolySurface
# note: Ampersand > Surface > [&] PolySurface

# group: [&] List.ChopByLengths Divide a list into uneven sublists
# note: Note that this functionality is now supported in the out-of-the-box node List.Chop.
code_block = CodeBlock { 1..30; }
code_block_2 = CodeBlock { [3,5,2,1,0,3,3]; }
list_chopbylengths = Custom[[&] List.ChopByLengths](list=code_block, lengths=code_block_2)  # package Ampersand; Chop a list into sublists given a series of sizes. Remaining list items after the sublists have been filled are discarded. Remaining sublist capacity after list items are exhausted is ignored.
watch = Watch(list_chopbylengths)

# group: [&] List.ContainsList True/False whether a list contains a smaller list
code_block_3 = CodeBlock()
# ---------- code_block_3.designscript (4 lines) ----------
[["Honolulu","HI"],
["Boston","MA"],
["Albany","NY"],
["Santa Fe","NM"]];
# ----------------------------------------
code_block_4 = CodeBlock()
# ---------- code_block_4.designscript (2 lines) ----------
[["Santa Fe","NM"],
["Columbus","OH"]];
# ----------------------------------------
list_containslist = Custom[[&] List.ContainsList](masterList=code_block_3, searchFor=code_block_4)  # package Ampersand; Check if a 2-dimensional list contains a 1-dimensional list.
watch_2 = Watch(list_containslist)

# group: [&] List.GroupByKey Group (and sort) items by key vaules
code_block_5 = CodeBlock()
# ---------- code_block_5.designscript (7 lines) ----------
[
["Paris","Lyon","Marseille"],
["Cleveland","Houston","Denver","Miami"],
["San Francisco","Chicago"],
["Edmonton","Toronto"],
["Ottawa","Vancouver","Montreal","Halifax"]
];
# ----------------------------------------
code_block_6 = CodeBlock { ["France","USA","USA","Canada","Canada"]; }
boolean = BoolSelector(true)
list_groupbykey = Custom[[&] List.GroupByKey](objectList=code_block_5, keys=code_block_6, sortKeys=boolean)  # package Ampersand; Sort the items of a list into groups (sublists) based on the corresponding items of a reference list. Example: The list {A,B,C,D,E} with the reference list {1,anyWord,4,anyWord,1} will be grouped into lists as { {A,E}, {B,D}, {C} } and the unique references will be {1, anyWord, 4}.
watch_3 = Watch(list_groupbykey.groups)
watch_4 = Watch(list_groupbykey.unique_keys)

# group: [&] List.PickByKeyUnique Pick items by their key value - items selected uniquely one time
# note: Select all items whose key values match a pickKey value. Also returns items that do not match a picked value. All matching items are returned in a simplified list.
code_block_7 = CodeBlock()  # same code as code_block_5
code_block_8 = CodeBlock { ["France","USA","USA","Canada","Canada"]; }
code_block_9 = CodeBlock { ["Japan","Canada","Germany"]; }
list_pickbykeyunique = Custom[[&] List.PickByKeyUnique](list=code_block_7, keys=code_block_8, pickKeys=code_block_9)  # package Ampersand; Pick items from a list using a set of keys values. Items and their key values will either be picked or excluded, and they can only be picked once. Pick keys that do not match any of the list key values will be listed as keysNotMatched.
watch_5 = Watch(list_pickbykeyunique.itemsPicked)
watch_6 = Watch(list_pickbykeyunique.keysPicked)
watch_7 = Watch(list_pickbykeyunique.itemsExcluded)
watch_8 = Watch(list_pickbykeyunique.keysExcluded)
watch_9 = Watch(list_pickbykeyunique.keysNotMatched)

# group: [&] List.SplitOddEven Split a list into even and odd items
code_block_10 = CodeBlock()
# ---------- code_block_10.designscript (4 lines) ----------
[[0,"I'm even"],[1,"I'm odd"],
[2,"I'm even"],[3,"I'm odd"],
[4,"I'm even"],[5,"I'm odd"],
[6,"I'm even"],[7,"I'm odd"]];
# ----------------------------------------
list_splitoddeven = Custom[[&] List.SplitOddEven](list=code_block_10)  # package Ampersand
watch_10 = Watch(list_splitoddeven.odds)
watch_11 = Watch(list_splitoddeven.evens)

# group: [&] String.ByListAsDS Write a list to DesignScript syntax
code_block_11 = CodeBlock { ["USA","Japan","England","France","Canada"]; }
string_bylistasds = Custom[[&] String.ByListAsDS](list=code_block_11)  # package Ampersand; Convert a list of strings to a single string in DS format that would produce the same string
watch_12 = Watch(string_bylistasds)

# group: [&] Math.PartialSums Partial Sums
code_block_12 = CodeBlock()
# ---------- code_block_12.designscript (5 lines) ----------
// credits and debits
[250.00,
-50.00,
300.00,
-450.00];
# ----------------------------------------
math_partialsums = Custom[[&] Math.PartialSums](numbers=code_block_12)  # package Ampersand; Find the sum of a set of numbers and a list of the partial sums.
total_after_all_transactions = Watch(math_partialsums.sum)
running_balance = Watch(math_partialsums.partialSums)

# group: [&] String.ExtractNumbers Extract numbers from strings
code_block_13 = CodeBlock()
# ---------- code_block_13.designscript (2 lines) ----------
["Level 5",
"30 dollars is 0.05 cents too much!"];
# ----------------------------------------
string_extractnumbers = Custom[[&] String.ExtractNumbers](str=code_block_13)  # package Ampersand; Extract a number or a list of numbers from a string
numbers_as_strings = Watch(string_extractnumbers.string)
numbers_as_numbers = Watch(string_extractnumbers.number)

# group: [&] List.PickByKey Pick items by their key value - first occurance of their key value, ordered by pick value
# note: The pick keys "Japan" and "Germany" return null because there are no items with those key values. They are listed in the "keysNotMatched" output. The "itemsPicked" and "keysPicked" outputs represent the order of the pickKeys input.
code_block_14 = CodeBlock()  # same code as code_block_5
code_block_15 = CodeBlock { ["France","USA","USA","Canada","Canada"]; }
code_block_16 = CodeBlock { ["Japan","Canada","Germany"]; }
list_pickbykey = Custom[[&] List.PickByKey](list=code_block_14, keys=code_block_15, pickKeys=code_block_16)  # package Ampersand; Take items from a list whose keys match a given set of choose values. Items and their corresponding keys are output in the order in which they are requested by the set of choose values. As needed, items may appear multiple times in the output list or not at all. Choose values that do not correspond to a key value produce a null selection, and all values not matched to a key are given as a third output.
watch_13 = Watch(list_pickbykey.keysNotMatched)
watch_14 = Watch(list_pickbykey.keysPicked)
watch_15 = Watch(list_pickbykey.itemsPicked)

# group: [&] List.SublistByIndices Select a range from a list by specifying the indices that bound it, inclusive.
code_block_17 = CodeBlock()
# ---------- code_block_17.designscript (2 lines) ----------
["zero","one","two","three","four","five",
"six","seven","eight","nine","ten"];
# ----------------------------------------
integer_slider = IntegerSlider(2, range=0..10 step 1)
integer_slider_2 = IntegerSlider(6, range=0..10 step 1)
list_sublistbyrange = Custom[[&] List.SublistByRange](list=code_block_17, fromIndex=integer_slider, toIndex=integer_slider_2)  # package Ampersand; Select a sublist by specifying start and end indices, inclusive. If the TO index is smaller than the FROM index, the selection will wrap around to the beginning of the list.
watch_16 = Watch(list_sublistbyrange)

# group: [&] List.WrappingCouplets Choose sublists of two that wrap around to the start of the list
code_block_18 = CodeBlock { "A".."D"; }
list_wrappingcouplets = Custom[[&] List.WrappingCouplets](list=code_block_18)  # package Ampersand; Divide a list into overlapping couplets, connecting the first to the last items.
watch_17 = Watch(list_wrappingcouplets)

# group: [&] Math.ArcLengthFromChordLength
chord_length = DoubleSlider(3.4, range=0..10 step 0.1)
radius = DoubleSlider(3.4, range=0..10 step 0.1)
math_arclengthfromchordlength = Custom[[&] Math.ArcLengthFromChordLength](chordLength=chord_length, radius=radius)  # package Ampersand
watch_18 = Watch(math_arclengthfromchordlength)

# group: [&] Math.ArcLengthFromAngle Angle in degrees
angle_degrees = DoubleSlider(180, range=0..360 step 1)
radius_2 = DoubleSlider(1, range=0..10 step 0.1)
math_arclengthfromangle = Custom[[&] Math.ArcLengthFromAngle](angle=angle_degrees, radius=radius_2)  # package Ampersand
watch_19 = Watch(math_arclengthfromangle)

# group: [&] Math.ArcAngleFromChordLength Angle in degrees
chord_length_2 = DoubleSlider(3.4, range=0..10 step 0.1)
radius_3 = DoubleSlider(3.4, range=0..10 step 0.1)
math_arcanglefromchordlength = Custom[[&] Math.ArcAngleFromChordLength](chordLength=chord_length_2, radius=radius_3)  # package Ampersand
watch_20 = Watch(math_arcanglefromchordlength)

# group: [&] Misc.Pentagram
code_block_19 = CodeBlock { 120; -25; }
byCoordinates = Point.ByCoordinates(x=code_block_19.out0, y=code_block_19.out1)
misc_pentagram = Custom[[&] Misc.Pentagram](centerPoint=byCoordinates)  # package Ampersand; Closed polycurve in the shape of a 5-pointed star.

# group: [&] Misc.ChainOfCircles
code_block_20 = CodeBlock { [65,85,100]; [-55,-25,-45]; }
byCoordinates_2 = Point.ByCoordinates(x=code_block_20.out0, y=code_block_20.out1)
byPoints = NurbsCurve.ByPoints(points=byCoordinates_2)
code_block_21 = CodeBlock { [5,2,6,3,4]; }
start_param = DoubleSlider(0.066, range=0..1 step 0.001)
misc_chainofcircles = Custom[[&] Misc.ChainOfCircles](baseCurve=byPoints, radii=code_block_21, startParam=start_param)  # package Ampersand; Find a series of tangent circles with the given radii whose centers lie along a curve.
list_create = List.Create(item0=byPoints, item1=misc_chainofcircles)

code_block_22 = CodeBlock()
# ---------- code_block_22.designscript (12 lines) ----------
// Create a rectangular PointGrid
point2 = Point.Origin();
point1 = Point.ByCoordinates(0, 50, 0);
vector1 = Vector.ZAxis();
arc1 = Arc.ByCenterPointStartPointSweepAngle(point2, point1, -80, vector1);
curve1 = Curve.Reverse(arc1);
t2 = (0..1..#10);
point3 = Curve.PointAtParameter(curve1, t2);
t3 = (0..#4..10);
vector2 = Vector.ByCoordinates(0, 0, t3);
point4 = Point.Add(point3<1>, vector2<2>);
t4 = List.Transpose(point4);
# ----------------------------------------
code_block_23 = CodeBlock(pts=code_block_22.t4) { v = Vector.ByCoordinates(80,60); pts.Translate(v); }

# group: [&] PointGrid.Diagrid Leaves a "checkerboard pattern" of points
# note: switchSet
# - choose which set of checkerboard points in the PointGrid is chosen
boolean_2 = BoolSelector(false)  # graph input
pointgrid_todiagrid = Custom[[&] PointGrid.ToDiagrid](pointGrid=code_block_23.out1, switchSet=boolean_2)  # package Ampersand; Create a diagrid point patterns from a rectangular grid of points. Change the switchSet Boolean value to swith which set of checker-board points is selected.

code_block_24 = CodeBlock(pts=pointgrid_todiagrid) { v = Vector.ByCoordinates(20,5); pts.Translate(v); }
boolean_3 = BoolSelector(false)  # graph input
boolean_4 = BoolSelector(true)  # graph input
boolean_5 = BoolSelector(false)  # graph input
pointgrid_totrisets = Custom[[&] PointGrid.ToTriSets](pointGrid=code_block_24.out1, swapDiagDirection=boolean_3, alternateDiagsByRow=boolean_4, wrap=boolean_5)  # package Ampersand; Construct three-point sets describing panels from a rectangular grid of points. May use a grid of points in the form of a diagrid. Boolean values "swapDiagDirection" and "alternateDiagsByRow" control how triangles are formed from the points. Boolean value "wrap"
code_block_25 = CodeBlock { 1; }
flatten = List.Flatten(list=pointgrid_totrisets@L2, amt=code_block_25)
pointlist_visualizepanels = Custom[[&] PointList.VisualizePanels](vertices=flatten)  # package Ampersand
code_block_26 = CodeBlock(pts=pointgrid_todiagrid) { v = Vector.ByCoordinates(40,10); pts.Translate(v); }
boolean_6 = BoolSelector(false)  # graph input
pointgrid_toquadsets = Custom[[&] PointGrid.ToQuadSets](pointGrid=code_block_26.out1, wrap=boolean_6)  # package Ampersand; Create groups of 4 items describing the "cells" of a rectangular grid of data. In the case of a grid of points, the output will be the set of points describing the corners of 4-pointed panels.
pointlist_visualizepanels_2 = Custom[[&] PointList.VisualizePanels](vertices=pointgrid_toquadsets)
code_block_27 = CodeBlock(pts=code_block_22.t4) { v = Vector.ByCoordinates(0,60); pts.Translate(v); }

# group: [&] PointGrid.ToTriSets Divides 4-sided panels into 3-sided panels with settings
boolean_7 = BoolSelector(false)  # graph input
boolean_8 = BoolSelector(false)  # graph input
# note: swapDiagDirection
# - change which way the diagonal is introduced through the rectangular cells of the pointGrid
# alternateDiagsByRow
# - change whether direction of diagonals remains the same for every row or alternates
# wrap
# - choose whether the panels should wrap around and connect back to one another, ex: true for a cylinder or cone
boolean_9 = BoolSelector(false)  # graph input
pointgrid_totrisets_2 = Custom[[&] PointGrid.ToTriSets](pointGrid=code_block_27.out1, swapDiagDirection=boolean_7, alternateDiagsByRow=boolean_8, wrap=boolean_9)
code_block_28 = CodeBlock { 1; }
flatten_2 = List.Flatten(list=pointgrid_totrisets_2@L2, amt=code_block_28)
pointlist_visualizepanels_3 = Custom[[&] PointList.VisualizePanels](vertices=flatten_2)

# group: [&] PointList.VariablyOffsetTriangle Offset sides of a triangular panel by different dimensions.
code_block_29 = CodeBlock(tri=flatten_2) { v = Vector.ByCoordinates(20,5); tri.Translate(v); }
# note: offsets
# - a set or sets of 3 numbers corresponding to the offsets for the sides of the triangular panels represented by the vertices.
# - for a set of verticies [A, B, C], offsets are [AB, BC, CA]
code_block_30 = CodeBlock { [1,0.3,0.3]; }
pointlist_variablyoffsettriangle = Custom[[&] PointList.VariablyOffsetTriangle](vertices=code_block_29.out1, offsets=code_block_30)  # package Ampersand; For a triangle vertices ABC, specify the points {A, B, C}, and the offset distance in the order {AB, BC, CA}. Use (+) for inside offset, (-) for outside offset. Output is a new set of points {A', B', C'}.
pointlist_visualizepanels_4 = Custom[[&] PointList.VisualizePanels](vertices=pointlist_variablyoffsettriangle)

# group: [&] PointList.IsCollinear true/false whether a set of points is collinear
integer_slider_3 = IntegerSlider(120, range=118..122 step 2)
code_block_31 = CodeBlock(x=integer_slider_3) { [116,x,124]; [-50,-53,-56]; }
byCoordinates_3 = Point.ByCoordinates(x=code_block_31.out0, y=code_block_31.out1)
pointlist_iscollinear = Custom[[&] PointList.IsCollinear](points=byCoordinates_3)  # package Ampersand; Whether a set of points is collinear.
watch_21 = Watch(pointlist_iscollinear)

# group: [&] PointList.SortAzimuthally Sort a set of points counterclockwise around the origin of the "plane" provided
code_block_32 = CodeBlock { Point.ByCoordinates(35,15); }
misc_pentagram_2 = Custom[[&] Misc.Pentagram](centerPoint=code_block_32)
polycurve_vertices = Custom[[&] PolyCurve.Vertices](polyCurve=misc_pentagram_2)  # package Ampersand; Find the points at vertices for a closed polycurve and indicates whether the vertices are concave (-1), straight (0), or convex (+1).
shuffle = List.Shuffle(list=polycurve_vertices.points)
code_block_33 = CodeBlock(pts=shuffle) { v = Vector.ByCoordinates(-25,0); pts.Translate(v); }
code_block_34 = CodeBlock { true; }
byPoints_2 = PolyCurve.ByPoints(points=code_block_33.out1, connectLastToFirst=code_block_34)
byOriginNormal = Plane.ByOriginNormal(origin=code_block_32)
pointlist_sortazimuthally = Custom[[&] PointList.SortAzimuthally](points=shuffle, plane=byOriginNormal)  # package Ampersand; Sort points azimuthally (like sorting numbers around a clock face) in a plane. Points are ordered about the origin of the plane, proceeding from the positive x-axis of the plane in a counter-clockwise direction about the plane normal vector.
code_block_35 = CodeBlock { true; }
byPoints_3 = PolyCurve.ByPoints(points=pointlist_sortazimuthally.points, connectLastToFirst=code_block_35)

code_block_36 = CodeBlock { 10; 40; }
byCoordinates_4 = Point.ByCoordinates(x=code_block_36.out0, y=code_block_36.out1)
misc_pentagram_3 = Custom[[&] Misc.Pentagram](centerPoint=byCoordinates_4)
polycurve_vertices_2 = Custom[[&] PolyCurve.Vertices](polyCurve=misc_pentagram_3)
count = List.Count(list=polycurve_vertices_2.points)
code_block_37 = CodeBlock(count=count) { "A"..#count..1; }
list_create_2 = List.Create(item0=code_block_37, item1=polycurve_vertices_2.points)
transpose = List.Transpose(lists=list_create_2)
shuffle_2 = List.Shuffle(list=transpose)

# group: [&] List.SortAzimuthally "Azimuth" is the angle to a point from the origin in a plane, counter-clockwise from the x-axis, a term often used in astronomy to locate stars in the sky relative to east. Use this node to sort a list items counter-clockwise about the z-axis of a plane, starting from the first item nearest to and above the positive x-axis. Example: Sort Revit Curtainwall Panels counterclockwise around a facade.
lastItem = List.LastItem(list=shuffle_2@L2)
code_block_38 = CodeBlock { true; }
byPoints_4 = PolyCurve.ByPoints(points=lastItem, connectLastToFirst=code_block_38)
firstItem = List.FirstItem(list=shuffle_2@L2)
code_block_39 = CodeBlock(pts=lastItem) { v = Vector.ByCoordinates(25); pts.Translate(v); }
code_block_40 = CodeBlock(pts=code_block_39.out1)
# ---------- code_block_40.designscript (3 lines) ----------
// center point for the shape
ctr = Point.ByCoordinates(
Math.Average(pts.X),Math.Average(pts.Y));
# ----------------------------------------
XAxis = Vector.XAxis()
ZAxis = Vector.ZAxis()
angle_of_x_axis_for_plane = DoubleSlider(-15, range=-90..90 step 1)
rotate = Vector.Rotate(vector=XAxis, axis=ZAxis, degrees=angle_of_x_axis_for_plane)
YAxis = Vector.YAxis()
rotate_2 = Vector.Rotate(vector=YAxis, axis=ZAxis, degrees=angle_of_x_axis_for_plane)
byOriginXAxisYAxis = Plane.ByOriginXAxisYAxis(origin=code_block_40, xAxis=rotate, yAxis=rotate_2)
# note: This is exactly like PointList.SortAziumathaly except that you can also sort an arbitrary list of data along with the points that represent them.
list_sortazimuthally = Custom[[&] List.SortAzimuthally](list=firstItem, locationPts=code_block_39.out1, plane=byOriginXAxisYAxis)  # package Ampersand; Sort objects azimuthally (like sorting numbers around a clock face) in a plane. Objects are ordered about the origin of the plane according the position of their representative point ("locations" input). Ordering proceeds from the positive x-axis of the plane in a counter-clockwise direction about the plane normal vector.
code_block_41 = CodeBlock { true; }
byPoints_5 = PolyCurve.ByPoints(points=list_sortazimuthally.locationPts, connectLastToFirst=code_block_41)
watch_22 = Watch(firstItem)
watch_23 = Watch(list_sortazimuthally.list)

# group: [&] List.GroupByContainer Group any set of objects by whether their representative location points are inside a container. "Containers" can be solids or polygons. Example: Find which Revit Room each placed Furniture element is in.
code_block_42 = CodeBlock { x = 5..45..#29; y = -x; }
shuffle_3 = List.Shuffle(list=code_block_42.y)
byCoordinates_5 = Point.ByCoordinates(x=code_block_42.x, y=shuffle_3)
code_block_43 = CodeBlock { 2; }
byLengths = Cuboid.ByLengths(origin=byCoordinates_5, width=code_block_43, length=code_block_43, height=code_block_43)
code_block_44 = CodeBlock { [5,35]; [-35,-20]; [10,20]; }
byCoordinates_6 = Point.ByCoordinates(x=code_block_44.out0, y=code_block_44.out1)
byCenterPointRadius = Circle.ByCenterPointRadius(centerPoint=byCoordinates_6, radius=code_block_44.out2)
code_block_45 = CodeBlock { 8; }
regularPolygon = Polygon.RegularPolygon(circle=byCenterPointRadius, numberSides=code_block_45)
list_groupbycontainer = Custom[[&] List.GroupByContainer](list=byLengths, locationPts=byCoordinates_5, containers=regularPolygon)  # package Ampersand; Sort a set of objects into groups using their location points by their inclusion in a set of given list of containers. Containters must be solids, closed polygons, polycurves. Objects and points not included are returned separately.
count_2 = List.Count(list=list_groupbycontainer.itemsByContainer)
code_block_46 = CodeBlock(ct=count_2) { 0..0.75..#ct; }
color_range = ColorRange(value=code_block_46)  # unwired: colors, indices
byGeometryColor = Modifiers.GeometryColor.ByGeometryColor(geometry=list_groupbycontainer.itemsByContainer, color=color_range)
code_block_47 = CodeBlock(excluded=list_groupbycontainer.excludedItems) { excluded; }

# group: [&] Categories.ListAll
categories_listall = Custom[[&] Categories.ListAll]()  # package Ampersand; List of all Revit Categories
watch_24 = Watch(categories_listall.names)

code_block_48 = CodeBlock { 120; -100; }
byCoordinates_7 = Point.ByCoordinates(x=code_block_48.out0, y=code_block_48.out1)

# group: [&] Vector.ByAltitudeAzimuth
altitude_degrees = DoubleSlider(47, range=-90..90 step 1)
azimuth_degrees = DoubleSlider(-35, range=-360..360 step 1)
vector_byaltitudeazimuth = Custom[[&] Vector.ByAltitudeAzimuth](altitude=altitude_degrees, azimuth=azimuth_degrees)  # package Ampersand; Create a unit vector by its altitude and azimuth. The positive Y axis is taken as north and the positive Z axis is taken as up. Altitudinal convention is: 90° = straight up (+Z axis), 0° = horizontal, -90° = straight down (-Z axis). Azimuthal convention is: 0° = North (+Y axis), 90° = East (+X axis), 180° = South (-Y axis), 270° = West (-X axis).
code_block_49 = CodeBlock { 20; }
scale = Vector.Scale(vector=vector_byaltitudeazimuth, scale_factor=code_block_49)
add = Point.Add(point=byCoordinates_7, vectorToAdd=scale)
byStartPointEndPoint = Line.ByStartPointEndPoint(startPoint=byCoordinates_7, endPoint=add)

# group: [&] Arc.CenterPoint Find the center point of an arc *even if the first item is null*
code_block_50 = CodeBlock()
# ---------- code_block_50.designscript (5 lines) ----------
// List of arcs where the first item is null
pts1 = Point.ByCoordinates(-50,[5..#4..5]);
pts2 = Point.ByCoordinates(-48,[5..#4..5]);
pts3 = Point.ByCoordinates(-45,[0..#4..5]);
List.Flatten([null,Arc.ByThreePoints(pts1,pts2,pts3)],2);
# ----------------------------------------
arc_centerpoint = Custom[[&] Arc.CenterPoint](arc=code_block_50.out3)  # package Ampersand; Works with a list of arcs. Returns the center point for an arc or null if the item is not an arc.
watch_25 = Watch(arc_centerpoint)

# group: [&] Curves.Shatter For a list of curves, split every curve by every other curve
code_block_51 = CodeBlock()
# ---------- code_block_51.designscript (7 lines) ----------
p1 = Point.ByCoordinates(150,50);
p2 = Point.ByCoordinates(140,40);
p3 = Point.ByCoordinates(140,50);
p4 = Point.ByCoordinates(150,40);

[Line.ByStartPointEndPoint(p1,p2),
Line.ByStartPointEndPoint(p3,p4)];
# ----------------------------------------
curves_shatter = Custom[[&] Curves.Shatter](curves=code_block_51.out4)  # package Ampersand; Split a collection of curves into smaller curves at each interesection
watch_26 = Watch(curves_shatter)

# group: [&] PolyCurve.ByCurves Create a polycurve or set of polycurves from an unordered set of curves. Matching is accomplished by end points.
code_block_52 = CodeBlock()
# ---------- code_block_52.designscript (8 lines) ----------
x1 = [-48,-49.5,-55.5,-54.8,-24.7,-16.5,-15,-12.7,-12.7,
-15,-13.5,-25.5,-29.4,-31.6,-33.1,-31.5,-36,-41.3,-48.8];
y1 = [44.8,42.5,40.2,37.2,37.2,32.7,29.7,32,43.2,50,61.3,
61.3,60.1,56.3,50.6,47,46.3,48.5,47];

p1 = Point.ByCoordinates(x1,y1);

1;
# ----------------------------------------
shiftIndices = List.ShiftIndices(list=code_block_52.p1, amount=code_block_52.out3)
byStartPointEndPoint_2 = Line.ByStartPointEndPoint(startPoint=code_block_52.p1, endPoint=shiftIndices)
shuffle_4 = List.Shuffle(list=byStartPointEndPoint_2)
polycurve_bycurves = Custom[[&] PolyCurve.ByCurves](curves=shuffle_4)  # package Ampersand; Create polycurves from an unordered list of curves.

reverse = Curve.Reverse(curve=polycurve_bycurves)

# group: [&] PolyCurve.AxisOfRotation Vector of the rotation of a planar polycurve.
polycurve_windingvector = Custom[[&] PolyCurve.WindingVector](polyCurve=polycurve_bycurves)  # package Ampersand; Find the winding vector of the direction of the vertices of a closed PolyCurve. Find the normal of a plane by best fit through points, then sum the outside angles for each vertex to see whether the winding angle aligns with or is the negative of the assumed plane normal vector. Return the plane normal vector aligned with the winding direction of the PolyCurve's vertices.
Z = Vector.Z(vector=polycurve_windingvector)
watch_27 = Watch(Z)
polycurve_windingvector_2 = Custom[[&] PolyCurve.WindingVector](polyCurve=reverse)
Z_2 = Vector.Z(vector=polycurve_windingvector_2)
watch_28 = Watch(Z_2)

# group: [&] PolyCurve.IsClockwise True/False: whether a polycurve is wound clockwise relative to a given plane.
XY = Plane.XY()
polycurve_isclockwise = Custom[[&] PolyCurve.IsClockwise](polycurve=polycurve_bycurves, plane=XY)  # package Ampersand; For closed polycurves with reasonably straight segments, return true if the curve is clockwise relative to the plane, false otherwise.
watch_29 = Watch(polycurve_isclockwise)
polycurve_isclockwise_2 = Custom[[&] PolyCurve.IsClockwise](polycurve=reverse, plane=XY)
watch_30 = Watch(polycurve_isclockwise_2)

code_block_53 = CodeBlock(upstateNY=polycurve_bycurves) { upstateNY; }

# group: [&] PolyCurve.ConvexHull Shrink-wrapped polycurve around given polycurve.
polycurve_convexhull = Custom[[&] PolyCurve.ConvexHull](polyCurve=code_block_53)  # package Ampersand; Find the convex hull for a planar polycurve
watch_31 = Watch(polycurve_convexhull)

# group: [&] PolyCurve.MinBoundingBox Minimum-area rectangle fully encompassing the given polycurve. Works for straight-line segments.
polycurve_minboundingbox = Custom[[&] PolyCurve.MinBoundingBox](polyCurve=code_block_53)  # package Ampersand; For a planar PolyCurve, find the minimum rectangular bounding box in its plane.
watch_32 = Watch(polycurve_minboundingbox.rectangle)

# group: [&] PolyCurve.Vertices For each vertex of a closed polycurve, identify which are convex (sticking out), concave (indented), and straight (180deg) angles.
polycurve_vertices_3 = Custom[[&] PolyCurve.Vertices](polyCurve=code_block_53)
filterByBoolMask = List.FilterByBoolMask(list=polycurve_vertices_3.points, mask=polycurve_vertices_3.isConcave)
code_block_54 = CodeBlock { 2; }
byCenterPointRadius_2 = Circle.ByCenterPointRadius(centerPoint=filterByBoolMask.in, radius=code_block_54)

# group: [&] PolyCurve.ClosedLoopsFromCurves Find closed loops from a set of intersecting curves, listed as polycurves
code_block_55 = CodeBlock()
# ---------- code_block_55.designscript (4 lines) ----------
Point.ByCoordinates([-30,-30,-52.83,-15.89,-44.11],
[-7,-7,-23.58,-50.42,-50.42]);
Point.ByCoordinates([-44.11,-15.89,-7.17,-52.83,-7.17],
[-50.42,-50.42,-23.58,-23.58,-23.58]);
# ----------------------------------------
byStartPointEndPoint_3 = Line.ByStartPointEndPoint(startPoint=code_block_55.out0, endPoint=code_block_55.out1)
polycurve_closedloopsfromcurves = Custom[[&] PolyCurve.ClosedLoopsFromCurves](curves=byStartPointEndPoint_3)  # package Ampersand; Find closed polycurves that enclose the "white spaces" from a network of planar, interesecting curves.
byPatch = Surface.ByPatch(closedCurve=polycurve_closedloopsfromcurves)
count_3 = List.Count(list=polycurve_closedloopsfromcurves)
code_block_56 = CodeBlock(num=count_3) { 0..1..#num; }
color_range_2 = ColorRange(value=code_block_56)  # unwired: colors, indices
byGeometryColor_2 = Modifiers.GeometryColor.ByGeometryColor(geometry=byPatch, color=color_range_2)

code_block_57 = CodeBlock { 60..110..#4; 0..50..#3; }
byCoordinates_8 = Point.ByCoordinates(x=code_block_57.out0, y=code_block_57.out1, lacing=CrossProduct)
pointgrid_toquadsets_2 = Custom[[&] PointGrid.ToQuadSets](pointGrid=byCoordinates_8)
byPoints_6 = Polygon.ByPoints(points=pointgrid_toquadsets_2)
flatten_3 = List.Flatten(list=byPoints_6)
byPatch_2 = Surface.ByPatch(closedCurve=flatten_3)
byJoinedSurfaces = PolySurface.ByJoinedSurfaces(surfaces=byPatch_2)
code_block_58 = CodeBlock(polysrf=byJoinedSurfaces) { polysrf; }
code_block_59 = CodeBlock()
# ---------- code_block_59.designscript (7 lines) ----------
p1 = Point.ByCoordinates(80,-10);
p2 = Point.ByCoordinates(100,60);
p3 = Point.ByCoordinates(90,-10);
p4 = Point.ByCoordinates(110,60);

Line.ByStartPointEndPoint(p1,p2);
Line.ByStartPointEndPoint(p3,p4);
# ----------------------------------------

# group: [&] PolySurface.Split Split a polysurface by a single piece of geometry and return the appropriate number of polysurfaces
polysurface_split = Custom[[&] PolySurface.Split](polySurface=code_block_58, tool=code_block_59.out4)  # package Ampersand; Split a polysurface and return organized polysurfaces.
watch_33 = Watch(polysurface_split)

# group: [&] Geometry.SplitByTools Split a single geometric object by a set of other geometries as if the set of splitting tools were one operation.
code_block_60 = CodeBlock { 150; 10; 20; }
byCoordinates_9 = Point.ByCoordinates(x=code_block_60.out0, y=code_block_60.out1)
byLengths_2 = Cuboid.ByLengths(origin=byCoordinates_9, width=code_block_60.out2, length=code_block_60.out2, height=code_block_60.out2)
code_block_61 = CodeBlock { [145,150,155]; 10; }
byCoordinates_10 = Point.ByCoordinates(x=code_block_61.out0, y=code_block_61.out1)
XAxis_2 = Vector.XAxis()
byOriginNormal_2 = Plane.ByOriginNormal(origin=byCoordinates_10, normal=XAxis_2)
geometry_splitbytools = Custom[[&] Geometry.SplitByTools](geometry=byLengths_2, tools=byOriginNormal_2)  # package Ampersand; Split one piece of geometry (other than a polysurface) by multiple tools
watch_34 = Watch(geometry_splitbytools)
count_4 = List.Count(list=geometry_splitbytools)
code_block_62 = CodeBlock(num=count_4) { 0..1..#num; }
color_range_3 = ColorRange(value=code_block_62)  # unwired: colors, indices
byGeometryColor_3 = Modifiers.GeometryColor.ByGeometryColor(geometry=geometry_splitbytools, color=color_range_3)

code_block_63 = CodeBlock(pts=code_block_22.t4) { v = Vector.ByCoordinates(-50,60); pts.Translate(v); }

# group: [&] PointGrid.ToQuadSets Rectangular grid of points into sets of pts per panel
# note: wrap
# - choose whether the panels should wrap around and connect back to one another, ex: true for a cylinder or cone
boolean_10 = BoolSelector(false)  # graph input
pointgrid_toquadsets_3 = Custom[[&] PointGrid.ToQuadSets](pointGrid=code_block_63.out1, wrap=boolean_10)

# group: [&] PointList.VisualizePanels Quickly shows colored geometry representation of ordered point sets
pointlist_visualizepanels_5 = Custom[[&] PointList.VisualizePanels](vertices=pointgrid_toquadsets_3)
watch_35 = Watch(pointlist_visualizepanels_5)

# group: [&] Misc.Airplane
misc_airplaine = Custom[[&] Misc.Airplaine]()  # package Ampersand; Airplane
code_block_64 = CodeBlock(geom=misc_airplaine) { v = Vector.ByCoordinates(-20,-90); geom.Translate(v); }

# group: [&] Misc.Bicycle
misc_bicycle = Custom[[&] Misc.Bicycle]()  # package Ampersand; Bicycle
code_block_65 = CodeBlock(geom=misc_bicycle) { v = Vector.ByCoordinates(40,-75); geom.Translate(v); }

# group: [&] Misc.Car
misc_car = Custom[[&] Misc.Car]()  # package Ampersand; Car
code_block_66 = CodeBlock(geom=misc_car) { v = Vector.ByCoordinates(50,-105); geom.Translate(v); }

# group: [&] Surface.TrimMultiple Trim a surface with more than one tool at a time.
code_block_67 = CodeBlock { [-31,-19,-19,-31]; [-1,-1,11,11]; }
byCoordinates_11 = Point.ByCoordinates(x=code_block_67.out0, y=code_block_67.out1)
byPoints_7 = Polygon.ByPoints(points=byCoordinates_11)
byPatch_3 = Surface.ByPatch(closedCurve=byPoints_7)
code_block_68 = CodeBlock { -30..-20..2; 0..10..2; }
byCoordinates_12 = Point.ByCoordinates(x=code_block_68.out0, y=code_block_68.out1, lacing=CrossProduct)
code_block_69 = CodeBlock { 0.75; }
byCenterPointRadius_3 = Circle.ByCenterPointRadius(centerPoint=byCoordinates_12, radius=code_block_69)
flatten_4 = List.Flatten(list=byCenterPointRadius_3)
# note: surface
# - surface to trim
# trimCurves
# - list of curves that will trim the surface
# pickPoints
# - points, per curve, corresponding to the part of the surface that should be DISCARDED
flatten_5 = List.Flatten(list=byCoordinates_12)
surface_trimmultiple = Custom[[&] Surface.TrimMultiple](surface=byPatch_3, trimCurves=flatten_4, pickPoints=flatten_5)  # package Ampersand; Trim a single surface with a list of closed curves and pick points (to designate the region to be subtracted)
watch_36 = Watch(surface_trimmultiple)

ZAxis_2 = Vector.ZAxis()
byOriginNormal_3 = Plane.ByOriginNormal(origin=byCoordinates_7, normal=ZAxis_2)

# group: [&] Vector.ProjectToPlane
vector_projecttoplane = Custom[[&] Vector.ProjectToPlane](vector=scale, plane=byOriginNormal_3)  # package Ampersand; Find the projection of the vector to the specified plane.
add_2 = Point.Add(point=byCoordinates_7, vectorToAdd=vector_projecttoplane)
byStartPointEndPoint_4 = Line.ByStartPointEndPoint(startPoint=byCoordinates_7, endPoint=add_2)

byStartPointEndPoint_5 = Line.ByStartPointEndPoint(startPoint=add_2, endPoint=add)
length = Vector.Length(vector=vector_projecttoplane)
byCenterPointRadius_4 = Circle.ByCenterPointRadius(centerPoint=byCoordinates_7, radius=length)

# group: [&] PolySurface.SplitByTools Split a polysurface by a list of tools and return the appropriate number of polysurfaces.
list_create_3 = List.Create(item0=code_block_59.out4, item1=code_block_59.out5)
polysurface_splitbytools = Custom[[&] PolySurface.SplitByTools](polySurface=code_block_58, tools=list_create_3)  # package Ampersand; Split a single polysurface with multiple tools.
count_5 = List.Count(list=polysurface_splitbytools)
code_block_70 = CodeBlock(num=count_5) { 0..1..#num; }
color_range_4 = ColorRange(value=code_block_70)  # unwired: colors, indices
byGeometryColor_4 = Modifiers.GeometryColor.ByGeometryColor(geometry=polysurface_splitbytools, color=color_range_4)
