# Dynamo custom node Get Rhino File.dyf (Dynamo 1.2.0.2654)
# category: Archi-lab_MantisShrimp.Rhinoceros.ReadRhino
# Reads Rhino 3dm file and outputs it as an object.

filePath = Input()
python_script = Python(IN[0]=filePath)
# ---------- python_script.python (30 lines) ----------
# Copyright(c) 2016, Konrad Sobon
# @arch_laboratory, http://archi-lab.net

import clr
import sys
import System

pyt_path = r'C:\Program Files (x86)\IronPython 2.7\Lib'
sys.path.append(pyt_path)

from os import path
assemblies = System.AppDomain.CurrentDomain.GetAssemblies()
msUIpath = [a.Location for a in assemblies if 'MantisShrimp,' in a.FullName][0]
msPath = System.IO.Path.GetDirectoryName(msUIpath).rsplit('\\',1)[0]
msPathExtra = '%s\\extra\\' %msPath
msPathRh = '%s\\bin\\Rhino3dmIO.dll' %msPath
sys.path.append(msPathExtra)
clr.AddReferenceToFileAndPath(msPathRh)
import Rhino as rc

#The inputs to this node will be stored as a list in the IN variable.
dataEnteringNode = IN
filePath = IN[0]

if filePath != None:
	if filePath.GetType() == System.IO.FileInfo:
		filePath = filePath.FullName

#Assign your output to the OUT variable
OUT = rc.FileIO.File3dm.Read(filePath)
# ----------------------------------------
RhinoFile = Output(python_script)
