# Dynamo custom node Get Rhino Layers.dyf (Dynamo 1.2.0.2654)
# category: Archi-lab_MantisShrimp.Rhinoceros.ReadRhino
# Queries Rhino file and extracts layers.

RhinoFile = Input()
python_script = Python(IN[0]=RhinoFile)
# ---------- python_script.python (31 lines) ----------
# Copyright(c) 2016, Konrad Sobon
# @arch_laboratory, http://archi-lab.net

import clr
import sys
import System

pyt_path = r'C:\Program Files (x86)\IronPython 2.7\Lib'
sys.path.append(pyt_path)

from os import path
assemblies = System.AppDomain.CurrentDomain.GetAssemblies()
msUIpath = [a.Location for a in assemblies if 'MantisShrimp,' in a.FullName][0]
msPath = System.IO.Path.GetDirectoryName(msUIpath).rsplit('\\',1)[0]
msPathExtra = '%s\\extra\\' %msPath
msPathRh = '%s\\bin\\Rhino3dmIO.dll' %msPath
sys.path.append(msPathExtra)
clr.AddReferenceToFileAndPath(msPathRh)
import Rhino as rc

#The inputs to this node will be stored as a list in the IN variable.
dataEnteringNode = IN
rhModel = IN[0]

#extract layer names from 3dm file
rhLayers = []
for i in rhModel.Layers:
	rhLayers.append(i.Name)

#Assign your output to the OUT variable
OUT = rhLayers
# ----------------------------------------
RhinoLayer = Output(python_script)
