# Dynamo custom node Specify RhinoCommon.dll Path.dyf (Dynamo 1.0.0.1180)
# category: Archi-lab_MantisShrimp.Grasshopper.Setup
# This node needs to be used to specify a valid RhinoCommon.dll path. After it was used for the first time, you will not have to use it again, unless a new version of Mantis Shrimp or Rhino is installed.

File_Path = Input()
python_script = Python(IN[0]=File_Path)
# ---------- python_script.python (30 lines) ----------
# Copyright(c) 2016, Konrad Sobon
# @arch_laboratory, http://archi-lab.net

import clr
import sys

pyt_path = r'C:\Program Files (x86)\IronPython 2.7\Lib'
sys.path.append(pyt_path)

import os
import os.path
appDataPath = os.getenv('APPDATA')

rhDllPath = IN[0]
txtFilePath = appDataPath + r"\Dynamo\Dynamo Revit\1.0\packages\Mantis Shrimp\extra\rhPath.txt"
if not os.path.isfile(txtFilePath):
	file = open(txtFilePath, 'w')
	clr.AddReferenceToFileAndPath(rhDllPath)
	file.write(rhDllPath)
	file.close()
	message = "You have successfully specified \nRhinoCommon.dll location."
else:
	file = open(txtFilePath, 'r+')
	file.truncate(0)
	clr.AddReferenceToFileAndPath(rhDllPath)
	file.write(rhDllPath)
	file.close()
	message = "You have successfully overriden \nRhinoCommon.dll location."

OUT = '\n'.join('{:^35}'.format(s) for s in message.split('\n'))
# ----------------------------------------
OUT = Output(python_script)
