# Dynamo custom node SelectAutoCadObjects_Data.dyf (Dynamo 3.6.1.9956)
# category: Data-Shapes.UI.AutocadCivil3D
# This input can be used in Civil 3D or in Autocad for object selection!

InputName = Input(InputName: string = "")
ButtonText = Input(ButtonText: string = "Select AutoCad Element(s)")
SelectSingleElement = Input(SelectSingleElement: bool = false)
python_script = Python(IN[0]=InputName, IN[1]=ButtonText, IN[2]=SelectSingleElement)  # CPython3
# ---------- python_script.python (87 lines) ----------
# Copyright (c) Data Shapes, 2026
# Data-Shapes www.data-shapes.io, elayoubi.mostafa@data-shapes.io @data_shapes

import clr
import ctypes
from ctypes import Structure, c_ulong, c_ushort, c_byte, c_void_p, byref, windll
from System import IntPtr, Array, Object
from System.Runtime.InteropServices import Marshal
from System.Reflection import BindingFlags

clr.AddReference('AutoCADNodes')
from Autodesk.AutoCAD.DynamoNodes import SelectionByQuery

class _GUID(Structure):
    _fields_ = [("Data1", c_ulong), ("Data2", c_ushort), ("Data3", c_ushort), ("Data4", c_byte * 8)]

_GET = BindingFlags.GetProperty | BindingFlags.Instance | BindingFlags.Public
_CALL = BindingFlags.InvokeMethod | BindingFlags.Instance | BindingFlags.Public

def _get_active_object(progid):
    clsid = _GUID()
    hr = windll.ole32.CLSIDFromProgID(progid, byref(clsid))
    if hr != 0:
        raise OSError("COM class not found for '{}'".format(progid))
    punk = c_void_p()
    hr = windll.oleaut32.GetActiveObject(byref(clsid), None, byref(punk))
    if hr != 0:
        raise OSError("No running instance of '{}'".format(progid))
    return Marshal.GetObjectForIUnknown(IntPtr.op_Explicit(punk.value))

def _com_prop(obj, name):
    return obj.GetType().InvokeMember(name, _GET, None, obj, None)

def _com_call(obj, name, *args):
    net_args = Array[Object](list(args)) if args else None
    return obj.GetType().InvokeMember(name, _CALL, None, obj, net_args)

def _wrap(com_entities):
    return [SelectionByQuery.GetObjectByObjectHandle(_com_prop(e, "Handle")) for e in com_entities]


class uiselectautocadelements():

    def __init__(self, inputname, buttontext, multi):
        self.inputname = inputname
        self.buttontext = buttontext
        self.multi = multi
        self._input_type = 'uiselectautocadelements'

    def __repr__(self):
        return 'UI.SelectAutocadElements input'

    def pickautocadobjects(self, sender, event):
        try:
            acadDoc = _com_prop(_get_active_object("AutoCAD.Application"), "ActiveDocument")
            _com_call(acadDoc, "Activate")
            acadUser = _com_call(acadDoc, "GetVariable", "users5")
            _com_call(acadDoc, "SendCommand", "(and(princ\042" + sender.Text + "\042)(setq ss(ssget))(setvar\042users5\042\042LinkDWGUIOK\042)(command\042_.Select\042ss\042\042)) ")
            selection_ = _com_prop(acadDoc, "ActiveSelectionSet")
            _com_call(acadDoc, "SendCommand", "(setq ss nil) ")
            if _com_call(acadDoc, "GetVariable", "users5") == "LinkDWGUIOK" and selection_ is not None:
                count = _com_prop(selection_, "Count")
                sender.Tag = _wrap([_com_call(selection_, "Item", i) for i in range(count)])
            _com_call(acadDoc, "SetVariable", "users5", acadUser)
        except:
            pass

    def pickautocadobject(self, sender, event):
        try:
            acadDoc = _com_prop(_get_active_object("AutoCAD.Application"), "ActiveDocument")
            acadUser = _com_call(acadDoc, "GetVariable", "users5")
            acadPickBox = _com_call(acadDoc, "GetVariable", "pickbox")
            _com_call(acadDoc, "SetVariable", "pickbox", 5)
            _com_call(acadDoc, "Activate")
            _com_call(acadDoc, "SendCommand", "(setq obj(car(entsel\042" + sender.Text + "\042))) ")
            _com_call(acadDoc, "SendCommand", "(and obj(setvar\042users5\042(cdr(assoc 5(entget obj))))(setq obj nil)) ")
            selection_ = _com_call(acadDoc, "GetVariable", "users5")
            _com_call(acadDoc, "SetVariable", "pickbox", acadPickBox)
            _com_call(acadDoc, "SetVariable", "users5", acadUser)
            sender.Tag = _wrap([_com_call(acadDoc, "HandleToObject", selection_)])[0]
        except:
            pass


x = uiselectautocadelements(IN[0], IN[1], not IN[2])

OUT = x
# ----------------------------------------
SelectAutocadElements_input = Output(python_script)
