# Dynamo custom node Element LocationCurve.dyf (Dynamo 2.16.2.5624)
# category: GeniusLoci.Geometry
# Gets the curve geometry from the element.

element = Input(element: var[]..[])
python_script = Python(IN[0]=element)  # IronPython2
# ---------- python_script.python (130 lines) ----------
#Alban de Chasteigner 2020
#twitter : @geniusloci_bim
#geniusloci.bim@gmail.com

import clr
clr.AddReference('RevitAPI')
import Autodesk
from Autodesk.Revit.DB import *

clr.AddReference("RevitNodes")
import Revit
clr.ImportExtensions(Revit.GeometryConversion)

clr.AddReference("RevitServices")
import RevitServices
from RevitServices.Persistence import DocumentManager
from RevitServices.Transactions import TransactionManager
uiapp = DocumentManager.Instance.CurrentUIApplication
app = uiapp.Application
version=int(app.VersionNumber)

items = UnwrapElement(IN[0]) if isinstance(IN[0],list) else [UnwrapElement(IN[0])]
curves = []

def Curve(dimension):
	curve = []
	if dimension.DimensionShape == DimensionShape.Linear:
		direction = dimension.Curve.Direction
		if dimension.NumberOfSegments ==0:
			start = dimension.Origin.Subtract(direction.Multiply(dimension.Value/2))
			end = dimension.Origin.Subtract(direction.Multiply(-dimension.Value/2))
			curve=Line.CreateBound(start,end).ToProtoType()
		else:
			for segment in dimension.Segments:
				start = segment.Origin.Subtract(direction.Multiply(segment.Value/2))
				end = segment.Origin.Subtract(direction.Multiply(-segment.Value/2))
				curve.append(Line.CreateBound(start,end).ToProtoType())
	return curve
	
def getCurve(section):
	#Get the section view from the Section Marker
	if ElementId(BuiltInCategory.OST_Viewers) == section.Category.Id :
		viewSection = doc.GetElement(ElementId(section.Id.IntegerValue + 1))
	elif isinstance(section,Autodesk.Revit.DB.ViewSection):
		viewSection=section
	shape=viewSection.GetCropRegionShapeManager().GetCropShape()
	#Last line of the rectangle
	l=[s for s in shape[0]][3]
	#Replace the Z value by 0
	curve=Line.CreateBound(XYZ(l.GetEndPoint(0).X,l.GetEndPoint(0).Y,0),XYZ(l.GetEndPoint(1).X,l.GetEndPoint(1).Y,0)).ToProtoType()
	return curve

#Columns not slanted
def colCurve(col):	
	loc= col.Location.Point
	bb = col.get_BoundingBox(None).Min
	height=col.get_Parameter(BuiltInParameter.INSTANCE_LENGTH_PARAM).AsDouble()
	start=XYZ(loc.X,loc.Y,bb.Z)
	end=XYZ(start.X,start.Y,start.Z+height)
	curve=Line.CreateBound(start,end).ToProtoType()
	return curve

for item in items:
	doc=item.Document
	view = doc.ActiveView
	#Railing
	if hasattr(item, "GetPath"):
		curves.append([railpath.ToProtoType() for railpath in item.GetPath()])
	#Revision Cloud
	elif hasattr(item, "GetSketchCurves"): 
		curves.append([sk.ToProtoType() for sk in item.GetSketchCurves()])
	elif hasattr(item, "LocationCurve"): 
		curves.append(item.LocationCurve.ToProtoType())
	elif hasattr(item, "FullCurve"): 
		curves.append(item.FullCurve.ToProtoType())
	elif hasattr(item, "ValueOverride"):
		curves.append(Curve(item))
	elif hasattr(item, "Curve"): 
		curves.append(item.Curve.ToProtoType())
	elif hasattr(item, "GeometryCurve"): 		
		curves.append(item.GeometryCurve.ToProtoType())
	elif hasattr(item, "GetEndpoint"): 
		curves.append(item.ToProtoType())
	elif isinstance(item,Autodesk.Revit.DB.MultiSegmentGrid):
		curves.append([doc.GetElement(i).Curve.ToProtoType() for i in item.GetGridIds()])
	elif version > 2019 and isinstance(item,Autodesk.Revit.DB.Analysis.PathOfTravel):
		curves.append([i.ToProtoType() for i in item.GetCurves()])
	elif ElementId(BuiltInCategory.OST_StructuralColumns) == item.Category.Id and not item.IsSlantedColumn :
		curves.append(colCurve(item))
	elif isinstance(item, Autodesk.Revit.DB.FamilyInstance) :
		opt = Options()
		opt.DetailLevel = ViewDetailLevel.Fine
		geoEle = item.get_Geometry(opt)
		if geoEle != None :
			for geoInstance in geoEle :
				if isinstance(geoInstance, GeometryInstance) :
					for symbIns in geoInstance.GetInstanceGeometry() :
						if isinstance(symbIns, Autodesk.Revit.DB.Curve) :
							curves.append(symbIns.ToProtoType())
	elif isinstance(item, Autodesk.Revit.DB.Structure.Rebar) :
		clr.AddReference('ProtoGeometry')
		from Autodesk.DesignScript.Geometry import *
		import Autodesk.DesignScript.Geometry as DS
		
		sketch = item.GetCenterlineCurves(False,True,True,Structure.MultiplanarOption.IncludeAllMultiplanarCurves,0)
		indice = round(item.NumberOfBarPositions/2)
		accessor = item.GetShapeDrivenAccessor();
		trf = accessor.GetBarPositionTransform(indice);
		if version >= 2023:
			curves.append(DS.PolyCurve.ByJoinedCurves([x.CreateTransformed(trf).ToProtoType() for x in sketch], 0.001, False, 0))
		else:
			curves.append(DS.PolyCurve.ByJoinedCurves(x.CreateTransformed(trf).ToProtoType() for x in sketch))
	elif hasattr(item, "GetCurvesInView"):
		for crv in item.GetCurvesInView(DatumExtentType.ViewSpecific,view):
			curves.append(crv.ToProtoType())
	#Get ViewSection or section marker curve
	elif ElementId(BuiltInCategory.OST_Viewers) == item.Category.Id or isinstance(item,Autodesk.Revit.DB.ViewSection):
		curves.append(getCurve(item))
	elif hasattr(item, "Location"):
		loc = item.Location
		if isinstance(loc,Autodesk.Revit.DB.LocationCurve):
			curves.append(loc.Curve.ToProtoType())
		else:
			curves.append(None)
	else: curves.append(None)

if isinstance(IN[0], (list)): OUT = curves
elif hasattr(item, "GetPath"): OUT = curves
elif hasattr(item, "ValueOverride"): OUT = curves
else: OUT = curves[0]
# ----------------------------------------
Curve = Output(python_script)
