# Dynamo custom node Cleanup.DeleteUnusedFilters.dyf
# category: Modelical.Actions
# This node deletes all unused filters in the project file.

bool = Input(_bool: bool = false)  # Set TRUE to delete unused Filters
python = Python(IN[0]=bool)  # CPython3
# ---------- python.python (101 lines) ----------
# This node has been made by Modelical
# www.modelical.com

#Note: The methods used in this script has been taken from Paul Wintour's BVN package and reused to achieve the purpose of the same. https://parametricmonkey.com/2016/03/09/get-unused-filters/

import clr
clr.AddReference('ProtoGeometry')
from Autodesk.DesignScript.Geometry import *

clr.AddReference("System.Core")
import System.Linq
clr.ImportExtensions(System.Linq)

clr.AddReference("RevitAPI")
import Autodesk.Revit
from Autodesk.Revit.Exceptions import InvalidOperationException
from Autodesk.Revit.DB import *
from Autodesk.Revit.DB import ElementId
from System.Collections.Generic import *

# Import ToDSType(bool) extension method
clr.AddReference("RevitNodes")
import Revit
clr.ImportExtensions(Revit.Elements)

# Import DocumentManager
clr.AddReference("RevitServices")
import RevitServices
from RevitServices.Persistence import DocumentManager
from RevitServices.Transactions import TransactionManager
from RevitServices.Persistence import DocumentManager

def GetFilterIds(view):
  filterIds = None
  try:
    filterIds = view.GetFilters()
  except InvalidOperationException as e:
    filterIds = None
  return filterIds

def GetUsedFilterIds(doc):
    views = FilteredElementCollector(doc).OfCategory(BuiltInCategory.OST_Views).WhereElementIsNotElementType().ToElements()
    usedFilterIds = []
    for view in views:
        viewFilterIds = []
        try:
            viewFilterIds = view.GetFilters()
        except InvalidOperationException as e:
            pass # this exception happens when a view doesn't support filters
    
        usedFilterIds.extend(viewFilterIds)
    return usedFilterIds

def GetUnusedFilters(doc):
    usedFilterIds = GetUsedFilterIds(doc)
    allFilters = FilteredElementCollector(doc).OfClass(ParameterFilterElement).ToElements()
    unusedFilters=[]
    for f in allFilters:
        if f.Id not in usedFilterIds:
            unusedFilters.append(f)

    return unusedFilters


#The inputs to this node will be stored as a list in the IN variables.

bool = IN[0]
output = "Set TRUE to delete unused Filters"

doc = DocumentManager.Instance.CurrentDBDocument


if bool == True:
    filters = GetUnusedFilters(doc)
    if len(filters)!=0:
        filters2 = UnwrapElement(filters)
        filtersID = []
        filtersNames = []

        for f in filters2:
                filtersID.append(f.Id)

        t=Transaction(doc, "Modelical.RemoveUnusedFilters")
        t.Start()
        try:
            output = str(len(filtersID)) + " Filter/s have been deleted"
            
            for f in filtersID:
                doc.Delete(f)
             
            t.Commit()
            
        except Exception as ex:
        	output=ex
        finally:
        	t.Dispose()

    else:
        output = "There are no unused Filters"
#Assign your output to the OUT variable.
OUT = output
# ----------------------------------------
info = Output(python)  # "_info"
