# Dynamo custom node Grid.SetElevation.dyf
# category: Modelical.Elements.Actions
# This node allows to modify grids at Z axis dimension, by selecting 2 levels and an offset.

grids = Input(_grids: Revit.Elements.Grid[]..[])  # Grids to be modified
baseLevel = Input(_baseLevel: Revit.Elements.Level)  # Inferior level
topLevel = Input(_topLevel: Revit.Elements.Level)  # Superior level
offset = Input(_offset: double = 0)  # Optional gap between level and extension
python = Python(IN[0]=grids, IN[1]=baseLevel, IN[2]=topLevel, IN[3]=offset)  # CPython3
# ---------- python.python (63 lines) ----------
# This node has been made by Modelical
# www.modelical.com

import clr

#Load Revit API
clr.AddReference('RevitAPI')
from Autodesk.Revit.DB import *
import Autodesk
#Load document reference
clr.AddReference("RevitServices")
import RevitServices
from RevitServices.Persistence import DocumentManager


doc = DocumentManager.Instance.CurrentDBDocument
uidoc = DocumentManager.Instance.CurrentUIApplication
app = uidoc.Application

def toList(input):
    if isinstance(input, list):
        return input
    else:
        return [input]

grids = toList(UnwrapElement(IN[0]))
level0 = UnwrapElement(IN[1])
level1 = UnwrapElement(IN[2])
inGap = IN[3]

def toModelUnits(x):
    if int(app.VersionNumber) <2020:
        docLengthUnit = Document.GetUnits(doc).GetFormatOptions(UnitType.UT_Length).DisplayUnits
        return UnitUtils.Convert(x,DisplayUnitType.DUT_DECIMAL_FEET,docLengthUnit)
    elif int(app.VersionNumber) >=2020:
        docLengthUnit = Document.GetUnits(doc).GetFormatOptions(SpecTypeId.Length).GetUnitTypeId()
        return UnitUtils.Convert(x, docLengthUnit, UnitTypeId.FeetFractionalInches)


gap=toModelUnits(inGap)


if level0.Elevation < level1.Elevation:
        min = level0.Elevation - gap
        max = level1.Elevation + gap
else:
        min = level1.Elevation - gap
        max = level0.Elevation + gap

t=Transaction(doc, "Modelical.SetGridElevation")
t.Start()
try:
    
    for grid in grids:
        grid.SetVerticalExtents(min,max)
    
    t.Commit()
    OUT = grids
except Exception as ex:
    OUT=ex
    #t.RolleBack()
finally:
    t.Dispose()
# ----------------------------------------
grids_2 = Output(python)  # "_grids"
