# Dynamo custom node Schedule.ExportToCSV.dyf (Dynamo 2.12.0.5650)
# category: Modelical.Actions
# This node allows to export schedules as CSV files.

viewSchedules = Input(_viewSchedules: var[]..[])  # Elements of type: ViewSchedule
directoryPath = Input(_directoryPath: var[]..[])
exportTitle = Input(_exportTitle: bool = true)  # Export title?
exportColumnHeaders = Input(_exportColumnHeaders: bool = true)  # Export Column Headers?
exportHeadersFootersBlankLines = Input(_exportHeadersFootersBlankLines: bool = true)  # Export Headers, Footers and Blank lines?
python_script = Python(IN[0]=viewSchedules, IN[1]=directoryPath, IN[2]=exportTitle, IN[3]=exportColumnHeaders, IN[4]=exportHeadersFootersBlankLines)  # IronPython2
# ---------- python_script.python (50 lines) ----------
# This node has been made by Modelical
# www.modelical.com

import clr

clr.AddReference("RevitServices")
import RevitServices
from RevitServices.Persistence import DocumentManager
doc = DocumentManager.Instance.CurrentDBDocument

clr.AddReference("RevitAPI")
from Autodesk.Revit.DB import *

clr.AddReference("RevitAPIUI")

clr.AddReference("RevitNodes")
import Revit
clr.ImportExtensions(Revit.Elements)

def tolist(obj1):
	if hasattr(obj1,"__iter__"): return obj1
	else: return [obj1]

schedules = UnwrapElement(tolist(IN[0]))
path = IN[1]
exportTitle = IN[2]
exportColumnHeaders = IN[3]
exportHeadersFooters = IN[4]

opt = ViewScheduleExportOptions()
opt.Title = IN[2]
if not exportColumnHeaders:
	opt.ColumnHeaders = 0
opt.HeadersFootersBlanks = IN[4]

i = 0
fList=i.ToString() + " schedules exported"	
for s in schedules:
	n = s.Name.ToString()+".csv"
	try:
		s.Export(path, n, opt)
		i=i+1
	except:
		fList="Invalid Path"
		break
if fList != "Invalid Path": 
	fList=i.ToString() + " schedules exported"			


OUT = fList
# ----------------------------------------
info = Output(python_script)  # "_info"
