# Dynamo custom node Sheet.GetTitleBlock.dyf (Dynamo 2.12.0.5650)
# category: Modelical.Views.Query
# This node gets the title block from the selected sheets.

sheets = Input(_sheets: var[]..[])  # Sheets to get their title block.
python_script = Python(IN[0]=sheets)  # IronPython2
# ---------- python_script.python (56 lines) ----------
# This bit is default. It is always used.
# It connects with DesignScript and Dynamo internals and
# Enable Python support and load DesignScript library.
import clr
clr.AddReference("ProtoGeometry")
from Autodesk.DesignScript.Geometry import *

# This import let's us call / use Dynamo nodes from Python code
clr.AddReference("DSCoreNodes")
from DSCore import *
# General API and User Interface API DLL

clr.AddReference("RevitAPI")
from Autodesk.Revit.DB import *
from Autodesk.Revit.DB.Structure import *

clr.AddReference("RevitAPIUI")
from Autodesk.Revit.UI import *

clr.AddReference("RevitNodes")
import Revit
clr.ImportExtensions(Revit.GeometryConversion)
clr.ImportExtensions(Revit.Elements)
# This bit is needed to access revit documents (project and families) 
# and to use Transactions (when we need to WRITE data to the Revit database)
clr.AddReference("RevitServices")
import RevitServices
from RevitServices.Persistence import DocumentManager
from RevitServices.Transactions import TransactionManager

uidoc = DocumentManager.Instance.CurrentUIApplication
doc = DocumentManager.Instance.CurrentDBDocument
app = uidoc.Application

# To be able to import Python Standard Library modules, we need to locate them
import sys
sys.path.append(r"C:\Program Files (x86)\IronPython 2.7\Lib")
# Function Helpers
def toList(input):
    """Return iterable if available, a list of 1 otherwise"""
    if hasattr(input, "__iter__") and not isinstance(input, basestring):
        return input
    else:
        return [input]

# Logic starts here
sheets = toList(UnwrapElement(IN[0]))
fList=[]
for s in sheets:
	fList.append(FilteredElementCollector(doc,s.Id).OfCategory(BuiltInCategory.OST_TitleBlocks).ToElements())
# Transactions

# Your code

# Output
OUT = fList
# ----------------------------------------
titleBlocks = Output(python_script)  # "_titleBlocks"
