# Dynamo custom node View.ApplyViewTemplate.dyf (Dynamo 2.12.0.5650)
# category: Modelical.Views.Actions
# This node applies a view template (selected by name) to the selected view.

views = Input(_views: var[]..[])  # Views to apply the template.
tempName = Input(_tempName: string[]..[])  # Template name.
python_script = Python(IN[0]=views, IN[1]=tempName)  # IronPython2
# ---------- python_script.python (70 lines) ----------
# This node has been made by Modelical
# www.modelical.com

import clr
clr.AddReference('ProtoGeometry')
from Autodesk.DesignScript.Geometry import *

# Import DocumentManager and TransactionManager
clr.AddReference("RevitServices")
import RevitServices
from RevitServices.Persistence import DocumentManager
from RevitServices.Transactions import TransactionManager

# Import RevitAPI
clr.AddReference("RevitAPI")
import Autodesk
from Autodesk.Revit.DB import *

doc = DocumentManager.Instance.CurrentDBDocument
uidoc = DocumentManager.Instance.CurrentUIApplication
app = uidoc.Application



def toList(input):
    #Return iterable if available, a list of 1 otherwise
    if hasattr(input, "__iter__") and not isinstance(input, basestring):
        return input
    else:
        return [input]

#The inputs to this node will be stored as a list in the IN variable.
views = toList(UnwrapElement(IN[0]))
viewTempName = toList(IN[1])
fList=[]
eList=[]
templateList = []
templateNameList=[]
collector = FilteredElementCollector(doc).OfClass(View)
for j in viewTempName:
	for i in collector:
		if i.IsTemplate == True and i.Name == j:
			templateList.append(i)
			templateNameList.append(i.Name)

TransactionManager.Instance.EnsureInTransaction(doc)

for v in views:
	try:
		for vtn in viewTempName:
			if vtn in templateNameList:
				for vt in  templateList:
					if vtn == vt.Name:
						v.ViewTemplateId = vt.Id
						fList.append(v)
						continue
					else:
						None
			else:
				fList.append( vtn+" is not a valid view template name")
					
	except:
		eList.append(v)
		
		

TransactionManager.Instance.TransactionTaskDone()

#Assign your output to the OUT variable
OUT = [fList,eList]
# ----------------------------------------
code_block = CodeBlock(l=python_script) { l[0]; l[1]; }
views_2 = Output(code_block.out0)  # "_views"
errorviews = Output(code_block.out1)  # "_errorviews"
