# Dynamo custom node View.CopyFiltersByName.dyf (Dynamo 2.12.0.5650)
# category: Modelical.Views.Actions
# This node copies some filters (selected by name) in a view to another one.

sourceView = Input(_sourceView: var[]..[])  # The view that has the filters
targetViews = Input(_targetViews: var[]..[])  # Views to apply filters
filterNames = Input(_filterNames: string[])  # Filters name list
python_script = Python(IN[0]=sourceView, IN[1]=targetViews, IN[2]=filterNames)  # IronPython2
# ---------- python_script.python (70 lines) ----------
# This node has been made by Modelical
# www.modelical.com

import clr

#Load Revit API
clr.AddReference('RevitAPI')
from Autodesk.Revit.DB import *
import Autodesk

#Load document reference
clr.AddReference("RevitServices")
import RevitServices
from RevitServices.Persistence import DocumentManager
from RevitServices.Transactions import TransactionManager


def toList(input):
    """Return iterable if available, a list of 1 otherwise"""
    if hasattr(input, "__iter__") and not isinstance(input, basestring):
        return input
    else:
        return [input]

doc = DocumentManager.Instance.CurrentDBDocument
		
sourceView =UnwrapElement(IN[0])
targetViews =toList(UnwrapElement(IN[1]))
filterNames=toList(IN[2])

sourceViewFiltersId = sourceView.GetFilters()
sourceViewFilters = []
filters = []
filtersOverrides = []
filtersVisibility = []
fList=[]
eList=[]

for id in sourceViewFiltersId:
	sourceViewFilters.append(doc.GetElement(id))

for sVF in sourceViewFilters:
	if sVF.Name in filterNames:
		filters.append(sVF.Id)
		filtersOverrides.append(sourceView.GetFilterOverrides(sVF.Id))
		filtersVisibility.append(sourceView.GetFilterVisibility(sVF.Id))

TransactionManager.Instance.EnsureInTransaction(doc)

for tV in targetViews:
	count = 0
	try:
		if tV.IsTemplate:
			eList.append(tV)
			continue
		for f in filters:
			try:
				tV.AddFilter(f)
			except:
				None
			tV.SetFilterOverrides(f,filtersOverrides[count])
			tV.SetFilterVisibility(f,filtersVisibility[count])
			count+=1
		fList.append(tV)
	except:
		eList.append(tV)

TransactionManager.Instance.TransactionTaskDone()

OUT = [fList,eList]
# ----------------------------------------
code_block = CodeBlock(l=python_script) { l[0]; l[1]; }
views = Output(code_block.out0)  # "_views"
errorViews = Output(code_block.out1)  # "_errorViews"
