# Dynamo custom node View.CopyViewRange.dyf (Dynamo 2.12.0.5650)
# category: Modelical.Views.Actions
# This node copies the view range from a view to another one. Also modifies the cut plane regardless the view level.

sourceView = Input(_sourceView: var[]..[])  # View(s) that has the view range
targetViews = Input(_targetViews: var[]..[])  # View(s) to apply view range
python_script = Python(IN[0]=sourceView, IN[1]=targetViews)  # IronPython2
# ---------- python_script.python (88 lines) ----------
# This node has been made by Modelical
# www.modelical.com

import clr
clr.AddReference("ProtoGeometry")
from Autodesk.DesignScript.Geometry import *


clr.AddReference("DSCoreNodes")
from DSCore import *


clr.AddReference("RevitAPI")
from Autodesk.Revit.DB import *
from Autodesk.Revit.DB.Structure import *

clr.AddReference("RevitAPIUI")
from Autodesk.Revit.UI import *

clr.AddReference("RevitNodes")
import Revit
clr.ImportExtensions(Revit.GeometryConversion)
clr.ImportExtensions(Revit.Elements)


clr.AddReference("RevitServices")
import RevitServices
from RevitServices.Persistence import DocumentManager
from RevitServices.Transactions import TransactionManager

uidoc = DocumentManager.Instance.CurrentUIApplication
doc = DocumentManager.Instance.CurrentDBDocument
app = uidoc.Application


import sys
sys.path.append(r"C:\Program Files (x86)\IronPython 2.7\Lib")
# Function Helpers
def Feet2m(value):
	return value * 0.3048

def toList(input):
    """Return iterable if available, a list of 1 otherwise"""
    if hasattr(input, "__iter__") and not isinstance(input, basestring):
        return input
    else:
        return [input]

def flatten(x):
    result = []
    for el in x:
        if hasattr(el, "__iter__") and not isinstance(el, basestring):
            result.extend(flatten(el))
        else:
            result.append(el)
    return result

# Logic starts here
sourceViews =toList(UnwrapElement(IN[0]))
targetViews =toList(UnwrapElement(IN[1]))

fList=[]
eList=[]
if len(sourceViews)==1:
	for tv in targetViews:
		try:
			TransactionManager.Instance.EnsureInTransaction(doc)
			tv.SetViewRange(sourceViews[0].GetViewRange())
			TransactionManager.Instance.TransactionTaskDone()
			fList.append([sourceViews[0],tv])
		except:
			eList.append([tv, "Plan view range is not valid."])
else:
	index=0
	for sv in sourceViews:
		
		for tv in toList(targetViews[index]):
			try:
				TransactionManager.Instance.EnsureInTransaction(doc)
				tv.SetViewRange(sv.GetViewRange())
				TransactionManager.Instance.TransactionTaskDone()
				fList.append([sv,tv])
			except:
				eList.append([tv, "Plan view range is not valid."])
		index+=1

# Output
OUT = [fList, eList]
# ----------------------------------------
code_block = CodeBlock(l=python_script) { l[0]; l[1]; }
SourceView_and_TargetView__views = Output(code_block.out0)  # "/*SourceView and TargetView*/ _views"
errorViews = Output(code_block.out1)  # "_errorViews"
