# Dynamo custom node View.SetAnnotationCropOffsets.dyf (Dynamo 2.12.0.5650)
# category: Modelical.Views.Actions
# This node sets the annotation crop view offsets in the selected views.

views = Input(_views: var[]..[])  # Views to set the annotation crop offset.
rightOffset = Input(_rightOffset: double = 0.003)  # Right offset.
leftOffset = Input(_leftOffset: double = 0.003)  # Left offset.
topOffset = Input(_topOffset: double = 0.003)  # Right offset.
bottomtOffset = Input(_bottomtOffset: double = 0.003)  # Right offset.
setAnnotationCropOffset = Python(IN[0]=views, IN[1]=rightOffset, IN[2]=leftOffset, IN[3]=topOffset, IN[4]=bottomtOffset)  # "View.SetAnnotationCropOffset"; IronPython2
# ---------- setAnnotationCropOffset.python (93 lines) ----------
# This bit is default. It is always used.
# It connects with DesignScript and Dynamo internals and
# Enable Python support and load DesignScript library.
import clr
clr.AddReference("ProtoGeometry")
from Autodesk.DesignScript.Geometry import *
from Autodesk.DesignScript.Geometry import Line as rLine

# This import let's us call / use Dynamo nodes from Python code
clr.AddReference("DSCoreNodes")
from DSCore import *
# General API and User Interface API DLL

clr.AddReference("RevitAPI")
from Autodesk.Revit.DB import *
from Autodesk.Revit.DB.Structure import *

clr.AddReference("RevitAPIUI")
from Autodesk.Revit.UI import *

clr.AddReference("RevitNodes")
import Revit
clr.ImportExtensions(Revit.GeometryConversion)
clr.ImportExtensions(Revit.Elements)
# This bit is needed to access revit documents (project and families) 
# and to use Transactions (when we need to WRITE data to the Revit database)
clr.AddReference("RevitServices")
import RevitServices
from RevitServices.Persistence import DocumentManager
from RevitServices.Transactions import TransactionManager

uidoc = DocumentManager.Instance.CurrentUIApplication
doc = DocumentManager.Instance.CurrentDBDocument
app = uidoc.Application

# To be able to import Python Standard Library modules, we need to locate them
import sys
sys.path.append(r"C:\Program Files (x86)\IronPython 2.7\Lib")
# Function Helpers
def Feet2m(value):
	return value * 0.3048
	
def M2Feet(value):
	return value / 0.3048


def toList(input):
    """Return iterable if available, a list of 1 otherwise"""
    if hasattr(input, "__iter__") and not isinstance(input, basestring):
        return input
    else:
        return [input]

def flatten(x):
    result = []
    for el in x:
        if hasattr(el, "__iter__") and not isinstance(el, basestring):
            result.extend(flatten(el))
        else:
            result.append(el)
    return result

# Logic starts here
views= toList(UnwrapElement(IN[0]))
offsetR=M2Feet(IN[1])
offsetL=M2Feet(IN[2])
offsetT=M2Feet(IN[3])
offsetB=M2Feet(IN[4])
# Transactions



fList=[]
eList=[]
for view in views:
	try:
		regionMan = view.GetCropRegionShapeManager()
		TransactionManager.Instance.EnsureInTransaction(doc)
		
		try:
			regionMan.BottomAnnotationCropOffset = offsetB
			regionMan.LeftAnnotationCropOffset = offsetL
			regionMan.RightAnnotationCropOffset = offsetR
			regionMan.TopAnnotationCropOffset = offsetT
			fList.append(view)
		except:
			eList.append(view)
		TransactionManager.Instance.TransactionTaskDone()
	except:
		eList.append(view)	
# Output

OUT=[fList,eList]
# ----------------------------------------
code_block = CodeBlock(l=setAnnotationCropOffset) { l[0]; l[1]; }
views_2 = Output(code_block.out0)  # "_views"
errorViews = Output(code_block.out1)  # "_errorViews"
