# Dynamo custom node Wall.WallFinishesByRoom.dyf (Dynamo 2.12.0.5650)
# category: Modelical.Elements.Create
# This node places room wall finishes using the info contained in the parameters (selected by name) where is defined the wall finishes type and the finishes height.

rooms = Input(_rooms: var[]..[])  # Rooms where to model finishes
wallFinishesParam = Input(_wallFinishesParam: string)  # Name of the parameter that stores the Wall Name. Finish parameter must be a Text type parameter with an available wall type writted
finishesHeightParam = Input(_finishesHeightParam: string)  # Name of the parameter that stores the Ceiling Height. Height parameter must be a Length type parameter expresed in meters bigger than 0
python_script = Python(IN[0]=rooms, IN[1]=wallFinishesParam, IN[2]=finishesHeightParam)  # IronPython2
# ---------- python_script.python (177 lines) ----------
# This bit is default. It is always used.
# It connects with DesignScript and Dynamo internals and
# Enable Python support and load DesignScript library.
import clr
clr.AddReference("ProtoGeometry")
from Autodesk.DesignScript.Geometry import *
from Autodesk.DesignScript.Geometry import Curve as DSCurve
from Autodesk.DesignScript.Geometry import Arc as DSArc

# This import let's us call / use Dynamo nodes from Python code
clr.AddReference("DSCoreNodes")
from DSCore import *
# General API and User Interface API DLL

clr.AddReference("RevitAPI")
from Autodesk.Revit.DB import *
from Autodesk.Revit.DB.Structure import *

clr.AddReference("RevitAPIUI")
from Autodesk.Revit.UI import *

clr.AddReference("RevitNodes")
import Revit
clr.ImportExtensions(Revit.GeometryConversion)
clr.ImportExtensions(Revit.Elements)
# This bit is needed to access revit documents (project and families) 
# and to use Transactions (when we need to WRITE data to the Revit database)
clr.AddReference("RevitServices")
import RevitServices
from RevitServices.Persistence import DocumentManager
from RevitServices.Transactions import TransactionManager

uidoc = DocumentManager.Instance.CurrentUIApplication
doc = DocumentManager.Instance.CurrentDBDocument
app = uidoc.Application

# To be able to import Python Standard Library modules, we need to locate them
import sys
sys.path.append(r"C:\Program Files (x86)\IronPython 2.7\Lib")

import math
# Function Helpers
def Feet2m(value):
	return value * 0.3048

def Meter2f(value):
	return value / 0.3048
	
def toList(input):
    """Return iterable if available, a list of 1 otherwise"""
    if hasattr(input, "__iter__") and not isinstance(input, basestring):
        return input
    else:
    	return [input]
    	
def toInternalUnits(x):
    if int(app.VersionNumber) <=2020:
        docLengthUnit = Document.GetUnits(doc).GetFormatOptions(UnitType.UT_Length).DisplayUnits
        return UnitUtils.Convert(x,DisplayUnitType.DUT_DECIMAL_FEET,docLengthUnit)
    elif int(app.VersionNumber) >2020:
        docLengthUnit = Document.GetUnits(doc).GetFormatOptions(SpecTypeId.Length).GetUnitTypeId()
        return UnitUtils.Convert(x, docLengthUnit, UnitTypeId.FeetFractionalInches)
def toModelUnits(x):
    if int(app.VersionNumber) <=2020:
        docLengthUnit = Document.GetUnits(doc).GetFormatOptions(UnitType.UT_Length).DisplayUnits
        return UnitUtils.Convert(x,docLengthUnit,DisplayUnitType.DUT_DECIMAL_FEET)
    elif int(app.VersionNumber) >2020:
        docLengthUnit = Document.GetUnits(doc).GetFormatOptions(SpecTypeId.Length).GetUnitTypeId()
        return UnitUtils.Convert(x,UnitTypeId.FeetFractionalInches, docLengthUnit)


# Logic starts here
rooms = toList(UnwrapElement(IN[0]))
sbo = SpatialElementBoundaryOptions()
wfParam=(IN[1])
whParam=(IN[2])
fList=[]
eList=[]
TransactionManager.Instance.EnsureInTransaction(doc)
for r in rooms:
	rWalls=[]
	rCurves=[]
	rLocation=r.Location.Point
	rLevel=r.LevelId
	rBoundaryElem=[]
#Finish parameter verification	
	try:
		rwf=None
		for wt in FilteredElementCollector(doc).OfClass(WallType).ToElements():
			if wt.get_Parameter(BuiltInParameter.ALL_MODEL_TYPE_NAME).AsString() == r.GetParameters(wfParam)[0].AsString():
				rwf=wt
		if rwf==None:
			eList.append([r,"Finish parameter must be a Text type parameter with an available wall type writted"])
			continue
		else:
			None	
	except:
		eList.append([r,"Finish parameter must be a Text type parameter with an available wall type writted"])
		continue



#Height parameter verification	
	try:
		if r.GetParameters(whParam)[0].AsDouble()==0:
			eList.append([r,"Height parameter must be a Length type parameter expresed in meters bigger than 0"])
			continue
		else:
			rwh= r.GetParameters(whParam)[0].AsDouble()
			
	except:
		eList.append([r,"Height parameter must be a Length type parameter expresed in meters bigger than 0"])
		continue	
		
#Get Room Boundaies
	try:
		if len(r.GetBoundarySegments(sbo)) ==0:
			eList.append([r,"Room must be closed"])
			continue
		else:
			None
	except:
		eList.append([r,"Room must be closed"])
		continue
	for segGroup in r.GetBoundarySegments(sbo):
		
		for seg in segGroup:
			if doc.GetElement(seg.ElementId) != None:
				
				if doc.GetElement(seg.ElementId).Category.Id.ToString()=="-2000011" and doc.GetElement(seg.ElementId).WallType.Kind == WallKind.Curtain:
					continue
				if doc.GetElement(seg.ElementId).Category.Id.ToString()=="-2000066":
					continue
				
				 
				
				p1=seg.GetCurve().ToProtoType().Offset(toModelUnits(rwf.Width)).PointAtParameter(0.5).ToXyz()
				p2=seg.GetCurve().ToProtoType().Offset(toModelUnits(-rwf.Width)).PointAtParameter(0.5).ToXyz()
				
				
				
				
				if r.IsPointInRoom(p1):
					c=seg.GetCurve().ToProtoType().Offset(toModelUnits(rwf.Width)/2).ToRevitType()
					w = Wall.Create(doc,c,rwf.Id,rLevel, 1,0,False,False)
					
				else:
					c=seg.GetCurve().ToProtoType().Offset(toModelUnits(-rwf.Width)/2).ToRevitType()
					w = Wall.Create(doc,c,rwf.Id,rLevel, 1,0,False,False)
									
						
			
				
				w.get_Parameter(BuiltInParameter.WALL_BASE_OFFSET).Set(r.get_Parameter(BuiltInParameter.ROOM_LOWER_OFFSET).AsDouble())
				w.get_Parameter(BuiltInParameter.WALL_USER_HEIGHT_PARAM).Set(rwh)
				w.get_Parameter(BuiltInParameter.WALL_ATTR_ROOM_BOUNDING).Set(False)
				w.get_Parameter(BuiltInParameter.WALL_KEY_REF_PARAM).Set(2)
				
				try:
					if len(doc.GetElement(seg.ElementId).FindInserts(True, True, True, True))!=0:
						try:
							JoinGeometryUtils.JoinGeometry(doc, w, doc.GetElement(seg.ElementId))
						except:
							None	
				except:
					None
				
				rCurves.append(seg)
				rWalls.append(w)
				
	fList.append([r,rWalls])
	

TransactionManager.Instance.TransactionTaskDone()
# Output

OUT=[fList,eList]
# ----------------------------------------
code_block = CodeBlock(l=python_script) { l[0]; l[1]; }
finishes = Output(code_block.out0)  # "_finishes"
errorList = Output(code_block.out1)  # "_errorList"
